# Grasshopper definition MACAD-G06-AR-M3-P01_Toilets and meditation Paula.gh (Grasshopper 1.0.7)
# plug-ins: Speckle 2, MetaHopper, Human, Pufferfish, MeshEdit Components, ShapeDiverForGrasshopper, Bifocals

sddp = ShapeDiverDocumentPayload({AbsoluteTolerance=0, AngleTolerance=0, DistanceDisplayPrecision=0, GltfVersion="Gltf2", GrasshopperVersion="1.0.0007", InputGroups="{}", OutputGroups="{}", RelativeTolerance=0, RhinoVersion="7.35.23346.11001", UnitSystem=0, VersionCreated="1.14.0.0", VersionSaved="1.16.0.0"})

# ----
# GetSiteGeometry
panel = Panel("https://macad.speckle.xyz/streams/4975f9f0a8/branches/site%2F00-federated-model")
receive = Receive(
    Stream=panel,
    AutoReceive=False,
    CurrentComponentState="expired",
    ExpandOutput=True,
    LastInfoMessage="James McBennett @ 01/19/2024 01:06:29: Pushed 38 elements from Grasshopper. (id:b5d4e56588)",
    ReceiveOnOpen=False,
    ReceivedCommitId="b5d4e56588",
    StreamWrapper="https://macad.speckle.xyz/streams/4975f9f0a8/branches/site/00-federated-model",
    selectedKitName="Objects")  # -> Info, CollectionType, Elements, Info_2, Levels, Name, Types
dso = DeconstructSpeckleObject(SpeckleObject=receive.Elements, selectedKitName="Objects")
dso_2 = DeconstructSpeckleObject(SpeckleObject=dso, selectedKitName="Objects")  # -> BaseLine, DisplayValue

panel_2 = Panel("https://macad.speckle.xyz/streams/4975f9f0a8/commits/6c185bed15")
receive_2 = Receive(
    Stream=panel_2,
    AutoReceive=False,
    CurrentComponentState="expired",
    ExpandOutput=True,
    ReceiveOnOpen=False,
    ReceivedCommitId="6c185bed15",
    StreamWrapper="https://macad.speckle.xyz/streams/4975f9f0a8/commits/6c185bed15",
    selectedKitName="Objects")  # -> Info, Data
geo = Geometry(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)
dso_3 = DeconstructSpeckleObject(SpeckleObject=receive_2.Data, selectedKitName="Objects")

crv = Curve([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])
pt = Point(Point(5159.268773, 9205.265575, 0))
pt_2 = Point(Point(5159.76961, 9205.265575, 3.861941404))
crv_2 = Curve(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)
pt_3 = Point([Point(5157.927383, 9205.265575, 1.930970702), Point(5160.369894, 9203.352493, 1.930970702), Point(5161.611836, 9204.518417, 1.930970702)])
crv_3 = Curve(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)
conndir = Wasp_ConnectionFromDirection(GEO=geo, CEN=pt_2, UP=crv_2, T="TOP")  # -> CONN, PLN_OUT; inputs CEN: list of Point3d, UP: list of Curve, T: list; plug-in component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
conndir_2 = Wasp_ConnectionFromDirection(GEO=geo, CEN=pt, UP=crv_3, T="BOTTOM")  # -> CONN, PLN_OUT; inputs CEN: list of Point3d, UP: list of Curve, T: list; plug-in component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
conndir_3 = Wasp_ConnectionFromDirection(GEO=geo, CEN=pt_3, UP=crv, T="SIDES")  # -> CONN, PLN_OUT; inputs CEN: list of Point3d, UP: list of Curve, T: list; plug-in component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
merge = Merge(Data1=conndir_3.CONN, Data2=conndir_2.CONN, Data3=conndir.CONN)

mesh = Mesh(dso_3)
pt_4 = Point([<point referenced from the Rhino model> x2])
crv_4 = Curve([<curve referenced from the Rhino model> x2])

geo_2 = Geometry(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)
attribute = Wasp_Attribute(ID="house", VAL=geo_2, TR=Toggle(True))  # -> ATTR; inputs VAL: list, TR: Boolean; plug-in component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

# ---- group: ROAD CURVES
crv_5 = Curve(<curve referenced from the Rhino model>)

# ----
geo_3 = Geometry(<brep referenced from the Rhino model>)
number_slider = Slider(60, range=0..500)
part = Wasp_BasicPart(NAME="BLOCK01", GEO=geo, CONN=flatten(merge), ATTR=attribute)  # -> PART; inputs GEO: Mesh, CONN: list, ATTR: list; plug-in component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
clean = CleanTree(RemoveNulls=True, RemoveInvalid=True, RemoveEmpty=True, Tree=dso_2.BaseLine)
clean_2 = CleanTree(RemoveNulls=True, RemoveInvalid=True, RemoveEmpty=True, Tree=dso_2.DisplayValue)  # -> flatten(Tree)
swatch = ColourSwatch(SwatchColor=RGB(138, 138, 138))
crv_6 = Curve([<curve referenced from the Rhino model> x4])
pt_5 = Point([<point referenced from the Rhino model> x4])
volume = MeshVolume(Mesh=dso_3)  # -> Volume, Centroid
geo_4 = Geometry(<brep referenced from the Rhino model>)

crv_7 = Curve([<curve referenced from the Rhino model> x4])
geo_5 = Geometry(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)
pt_6 = Point([<point referenced from the Rhino model> x4])
points = PointList(Points=pt_6, Size=Slider(1, range=0..1))
conndir_4 = Wasp_ConnectionFromDirection(GEO=geo_5, CEN=pt_6, UP=crv_7)  # -> CONN, PLN_OUT; inputs CEN: list of Point3d, UP: list of Curve, T: list; plug-in component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
part_2 = Wasp_BasicPart(NAME="OCTO", GEO=geo_5, CONN=flatten(conndir_4.CONN))  # -> PART; inputs GEO: Mesh, CONN: list, ATTR: list; plug-in component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

dom = ConstructDomain(DomainStart=expr("-x", number_slider), DomainEnd=number_slider)
previewlw = CustomPreviewLineweights(Geometry=clean, Shader=swatch, Absolute=False)  # disabled
project = Project(Geometry=volume.Centroid, Plane=PlaneXY(0, 0, 0))  # -> Geometry, Transform
pt_7 = Point(volume.Centroid)
crv_8 = Curve(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)
item = ListItem(List=clean_2, Index=Slider(0, range=0..2), Wrap=True)
mmx = MeshMesh(MeshA=item, MeshB=mesh)
msplit = MeshSplit(Mesh=item, Splitters=mesh)
pt_8 = Point([<point referenced from the Rhino model> x4])
crv_9 = Curve([<curve referenced from the Rhino model> x4])
item_2 = ListItem(List=msplit, Index=Slider(1, range=0..1), Wrap=True)
rectangle = Rectangle(Plane=project.Geometry, XSize=dom, YSize=dom, Radius=0)  # -> Rectangle, Length
number_slider_2 = Slider(30, range=0..100)
points_2 = PointList(Points=pt_5, Size=Slider(1, range=0..1))
conndir_5 = Wasp_ConnectionFromDirection(GEO=geo_4, CEN=pt_5, UP=crv_6)  # -> CONN, PLN_OUT; inputs CEN: list of Point3d, UP: list of Curve, T: list; plug-in component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
points_3 = PointList(Points=pt_8, Size=Slider(1, range=0..1))
conndir_6 = Wasp_ConnectionFromDirection(GEO=geo_3, CEN=pt_8, UP=crv_9)  # -> CONN, PLN_OUT; inputs CEN: list of Point3d, UP: list of Curve, T: list; plug-in component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
contour = Contour(Shape=item, Point=Point(0, 0, 0), Direction=Vector(0, 0, 1), Distance="50")
sdivide = DivideSurface(Surface=rectangle.Rectangle, UCount=number_slider_2, VCount=number_slider_2)  # -> Points, Normals, Parameters
part_3 = Wasp_BasicPart(NAME="REC", GEO=geo_4, CONN=flatten(conndir_5.CONN))  # -> PART; inputs GEO: Mesh, CONN: list, ATTR: list; plug-in component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
number_slider_3 = Slider(5, range=0..100)
part_4 = Wasp_BasicPart(NAME="CUBE", GEO=geo_3, CONN=flatten(conndir_6.CONN))  # -> PART; inputs GEO: Mesh, CONN: list, ATTR: list; plug-in component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
line = LineSDL(Start=sdivide.Points, Direction=Vector(0, 0, 1), Length="10000")
number_slider_4 = Slider(2, range=0..100)
number_slider_5 = Slider(0.25, range=0..1)
swatch_2 = ColourSwatch(SwatchColor=RGB(28, 28, 28))
number_slider_6 = Slider(0.25, range=0..1)
previewlw_2 = CustomPreviewLineweights(Geometry=contour, Shader=ColourSwatch(SwatchColor=RGB(64, 64, 64)), Absolute=False)
mcx = MeshCurve(Mesh=item_2, Curve=line)  # -> flatten(Points), Faces
srfgrid = SurfaceFromPoints(Points=mcx.Points, UCount=expr("x+1", number_slider_2), Interpolate=False)
panel_3 = Panel("""OCTO|0_REC|0 
OCTO|1_REC|1
REC|1_OCTO|1
REC|0_OCTO|0
REC|2_CUBE|2
CUBE|2_CUBE|3 
CUBE|3_CUBE|2
REC|1_CUBE|0""")
previewlw_3 = CustomPreviewLineweights(Geometry=mmx, Shader=ColourSwatch(SwatchColor=RGB(166, 0, 0)), Thickness=Slider(2, range=0..10), Absolute=False)
panel_4 = Panel("""OCTO|0_REC|0 
OCTO|1_REC|1
REC|1_OCTO|1
REC|0_OCTO|0
REC|3_CUBE|2
CUBE|2_CUBE|3 
CUBE|0_OCTO|2
CUBE|1_OCTO|3""")
merge_2 = Merge(Data1=part_2, Data2=part_4, Data3=part_3)
panel_5 = Panel("""CUBEV|0_CUBEV|1 
CUBEV|1_CUBEV|0""")
panel_6 = Panel("""OCTO|0_CUBE|0 
OCTO|1_CUBE|1
CUBE|0_CUBE|1 
CUBE|1_CUBE|0""")
previewmat = CustomPreviewMaterials(Geometry=srfgrid, DiffuseColor=swatch, Transparency=Slider(0.634, range=0..1))
ruletxt = Wasp_RuleFromText(TXT=panel_4)  # -> R; plug-in component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
stochasticaggregation = Wasp_StochasticAggregation(PART=flatten(merge_2), N=Slider(1000, range=0..1000), RULES=ruletxt, RESET=Button())  # -> AGGR, PART_OUT; inputs PART: list, PREV: list, N: Int32, RULES: list, SEED: Int32, MODE: Int32, GC: list, RESET: Boolean; plug-in component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
partgeo = Wasp_GetPartGeometry(PART=stochasticaggregation.PART_OUT)  # -> GEO; plug-in component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
preview = CustomPreview(
    Geometry=partgeo,
    Material={diffuse=RGB(221, 160, 221), emission=RGB(66, 48, 66), shine=0.5, specular=RGB(255, 255, 255), transparency=0})
# 2_11_Combining_Fields
geo_6 = Geometry(<brep referenced from the Rhino model>)

# ---- group: ROAD CURVES
crv_10 = Curve([<curve referenced from the Rhino model> x3])

# ----
pt_9 = Point([<point referenced from the Rhino model> x6])
crv_11 = Curve([<curve referenced from the Rhino model> x6])
pt_10 = Point([<point referenced from the Rhino model> x2])
crv_12 = Curve([<curve referenced from the Rhino model> x2])
pt_11 = Point([<point referenced from the Rhino model> x3])
crv_13 = Curve([<curve referenced from the Rhino model> x3])
conndir_7 = Wasp_ConnectionFromDirection(GEO=geo_6, CEN=pt_11, UP=crv_13, T="TOP")  # -> CONN, PLN_OUT; inputs CEN: list of Point3d, UP: list of Curve, T: list; plug-in component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
conndir_8 = Wasp_ConnectionFromDirection(GEO=geo_6, CEN=pt_10, UP=crv_12, T="BOTTOM")  # -> CONN, PLN_OUT; inputs CEN: list of Point3d, UP: list of Curve, T: list; plug-in component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
conndir_9 = Wasp_ConnectionFromDirection(GEO=geo_6, CEN=pt_9, UP=crv_11, T="SIDES")  # -> CONN, PLN_OUT; inputs CEN: list of Point3d, UP: list of Curve, T: list; plug-in component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
merge_3 = Merge(Data1=conndir_9.CONN, Data2=conndir_8.CONN, Data3=conndir_7.CONN)

geo_7 = Geometry(<brep referenced from the Rhino model>)
attribute_2 = Wasp_Attribute(ID="house", VAL=geo_7, TR=Toggle(True))  # -> ATTR; inputs VAL: list, TR: Boolean; plug-in component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

part_5 = Wasp_BasicPart(NAME="BLOCK01", GEO=geo_6, CONN=flatten(merge_3))  # -> PART; inputs GEO: Mesh, CONN: list, ATTR: list; plug-in component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
swatch_3 = ColourSwatch(SwatchColor=RGB(64, 64, 64))  # disabled

panel_7 = Panel(" ")  # disabled
panel_8 = Panel("M")  # disabled
number_slider_7 = Slider(353, range=0..10000)  # disabled
panel_9 = Panel("{0,0,-1000}")  # disabled
panel_10 = Panel("10000")  # disabled
Z = UnitZ(Factor=expr("-x", number_slider_7))  # disabled
Z_2 = UnitZ(Factor=panel_10)  # disabled
project_2 = Project(Geometry=item, Plane=Z)  # -> Geometry, Transform; disabled
bbox = BoundingBox(Content=project_2.Geometry, Plane=PlaneXY(0, 0, 0))  # -> Box, Box_2; disabled
debrep = DeconstructBrep(Brep=bbox.Box)  # -> Faces, Edges, Vertices; disabled
move = Move(Geometry=debrep.Vertices, Motion=Z_2)  # -> Geometry, Transform; disabled
medges = MeshEdges(Mesh=project_2.Geometry)  # -> NakedEdges, InteriorEdges, NonManifoldEdges; disabled
ln = Line(StartPoint=debrep.Vertices, EndPoint=move.Geometry)  # disabled
number_slider_8 = Slider(51, range=0..100)  # disabled
mcx_2 = MeshCurve(Mesh=item, Curve=ln)  # -> flatten(Points), Faces; disabled
number_slider_9 = Slider(72, range=0..100)  # disabled
ln_2 = Line(StartPoint=debrep.Vertices, EndPoint=mcx_2.Points)  # disabled
midpt = CurveMiddle(Curve=ln_2)  # disabled
len = Length(Curve=ln_2)  # disabled
round = Round(Number=len)  # -> Nearest, Floor, Ceiling; disabled
concat = Concatenate(FragmentA=round.Nearest, FragmentB=panel_7, FragmentC=panel_8)  # disabled
tag = TextTag(Location=midpt, Text=concat, Colour=swatch_3)  # disabled
panel_11 = Panel(len)  # disabled
swatch_4 = ColourSwatch(SwatchColor=RGB(224, 0, 0))  # disabled
popgeo = PopulateGeometry(Geometry=item, Count=number_slider_8, Seed=1)  # disabled
sph = Sphere(Base=popgeo, Radius=500)  # disabled
cso = CreateSpeckleObject(selectedKitName="Objects")  # disabled
cso_2 = CreateSpeckleObject(selectedKitName="Objects")  # disabled
mesh_2 = Mesh(sph)  # disabled
number_slider_10 = Slider(3, range=0..10)  # disabled
mmx_2 = MeshMesh(MeshA=item, MeshB=mesh_2)  # disabled
panel_12 = Panel("https://macad.speckle.xyz/streams/5963382190/branches/all-available-data")  # disabled
cso_3 = CreateSpeckleObject(Level1=cso, Level2=cso_2, selectedKitName="Objects")  # disabled
swatch_5 = ColourSwatch(SwatchColor=RGB(143, 26, 26))  # disabled
divide = DivideCurve(Curve=mmx_2, Count=10, Kinks=False)  # -> Points, Tangents, Parameters; disabled
panel_13 = Panel("360")  # disabled
panel_14 = Panel("Add All geometry to branch 1 all sorted data")  # disabled
pdecon = Deconstruct(Point=divide.Points)  # -> XComponent, YComponent, ZComponent; disabled
previewlw_4 = CustomPreviewLineweights(Geometry=mmx_2, Shader=swatch_5, Thickness=number_slider_10, Absolute=False)  # disabled
bnd = Bounds(Numbers=pdecon.ZComponent)  # disabled
panel_15 = Panel(bnd)  # disabled
panel_16 = Panel(cso_3)  # disabled
dedomain = DeconstructDomain(Domain=bnd)  # -> Start, End; disabled
equals = Equality(FirstNumber=pdecon.ZComponent, SecondNumber=dedomain.Start)  # -> Equality, Inequality; disabled
send = Send(
    Stream=panel_12,
    Message=panel_14,
    Data=cso_3,
    AutoSend=False,
    BaseId="a36274ef0466ee3dbb588743f432b874",
    CurrentComponentState="expired",
    KitName="Objects",
    OutputWrappers="https://macad.speckle.xyz\t5963382190\t2e59024224",
    UseDefaultCache=True,
    selectedKitName="Objects")  # disabled
cull = CullPattern(List=divide.Points, CullPattern=equals.Equality)  # -> flatten(List); disabled
vec2pt = Vector2Pt(PointA=popgeo, PointB=cull, Unitize=False)  # -> Vector, Length; disabled
project_3 = Project(Geometry=cull, Plane=popgeo)  # -> Geometry, Transform; disabled
vec2pt_2 = Vector2Pt(PointA=popgeo, PointB=project_3.Geometry, Unitize=False)  # -> Vector, Length; disabled
angle = Angle(VectorA=vec2pt_2.Vector, VectorB=vec2pt.Vector)  # -> Angle, Reflex; disabled
vec2pt_3 = Vector2Pt(PointA=popgeo, PointB=cull, Unitize=False)  # -> Vector, Length; disabled
deg = Degrees(Radians=angle.Reflex)  # disabled
abs = Absolute(Value=deg)  # disabled
subtraction = Subtraction(A=panel_13, B=abs)  # disabled
ln_3 = Line(StartPoint=popgeo, EndPoint=cull)  # disabled
midpt_2 = CurveMiddle(Curve=ln_3)  # disabled
panel_17 = Panel("1")  # disabled
roundd = RoundToDecimalPlace(NumberX=subtraction, DecimalPlace=panel_17, RoundType=0)  # -> Rounded, Difference; disabled
tag_2 = TextTag(Location=midpt_2, Text=roundd.Rounded, Colour=swatch_3)  # disabled

# ----
# Enable To Upload Geomtry to Speckle Server
toggle = GroupToggle(ToggleActive=True, ToggleVisible=False)  # disabled
link_to_upload_to_our_speckle_server = Panel("https://macad.speckle.xyz/streams/4975f9f0a8/branches/students%2Fg06-site_locations")  # disabled
panel_18 = Panel("SiteLocationSelection")  # disabled
send_2 = Send(
    Stream=link_to_upload_to_our_speckle_server,
    Message=panel_18,
    AutoSend=False,
    CurrentComponentState="needs_input",
    KitName="Objects",
    UseDefaultCache=True,
    selectedKitName="Objects")  # disabled

geo_8 = Geometry(srfgrid)
bbox_2 = BoundingBox(Content=geo_8, Plane=PlaneXY(0, 0, 0))  # -> Box, Box_2
volume_2 = Volume(Geometry=bbox_2.Box)  # -> Volume, Centroid
scale_nu = ScaleNU(
    Geometry=bbox_2.Box,
    Plane=volume_2.Centroid,
    ScaleX=Slider(1, range=0..10),
    ScaleY=Slider(1, range=0..10),
    ScaleZ=Slider(2.17, range=0..10))  # -> Geometry, Transform
fieldpts = Wasp_FieldPoints(BOU=scale_nu.Geometry, RES=Slider(2.5, range=0..10))  # -> E_FIELD, PTS; inputs BOU: list of Mesh, PLN: Plane; plug-in component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

contour_2 = Contour(Shape=geo_8, Point=Point(0, 0, 0), Direction=Vector(0, 0, 1), Distance=Slider(0.5, range=0..1))
preview_2 = CustomPreview(Geometry=geo_8, Material=ColourSwatch(SwatchColor=RGB(194, 194, 194)))
preview_3 = CustomPreview(Geometry=contour_2, Material=ColourSwatch(SwatchColor=RGB(0, 0, 0)))

geo_9 = Geometry(geo_8)
pull = PullPoint(Point=fieldpts.PTS, Geometry=geo_9, ClosestOnly=True)  # -> ClosestPoint, Distance
pdecon_2 = Deconstruct(Point=fieldpts.PTS)  # -> XComponent, YComponent, ZComponent
pdecon_3 = Deconstruct(Point=pull.ClosestPoint)  # -> XComponent, YComponent, ZComponent
smaller = SmallerThan(FirstNumber=pdecon_2.ZComponent, SecondNumber=pdecon_3.ZComponent)  # -> SmallerThan, OrEqualTo
dispatch = Dispatch(List=pull.Distance, DispatchPattern=smaller.SmallerThan)  # -> ListA, ListB
dom_2 = ConstructDomain(DomainStart=Slider(1, range=0..1), DomainEnd=Slider(0, range=0..100))
bnd_2 = Bounds(Numbers=dispatch.ListB)
remap = RemapNumbers(Value=dispatch.ListB, Source=bnd_2, Target=dom_2)  # -> Mapped, Clipped
lng = ListLength(List=dispatch.ListA)
graph = GraphMapper(
    remap.Mapped,
    x0=0,
    x1=1,
    y0=0,
    y1=1,
    container_name="Bezier",
    cpx=[0, 0.6471909881, 0.9011235833, 1],
    cpy=[0, 0.07142859697, 0.428571403, 1])
repeat = RepeatData(Data=Slider(0, range=0..100), Length=lng)
weave = Weave(Pattern=smaller.SmallerThan, Stream0=graph, Stream1=repeat, NullGaps=False)

geo_10 = Geometry(geo_8)
project_4 = Project(Curve=crv_5, Brep=geo_10, Direction=Vector(0, 0, 1))
pt_12 = Point(fieldpts.PTS)
pull_2 = PullPoint(Point=pt_12, Geometry=flatten(project_4), ClosestOnly=True)  # -> ClosestPoint, Distance
dom_3 = ConstructDomain(DomainStart=Slider(1, range=0..1), DomainEnd=Slider(0, range=0..100))
bnd_3 = Bounds(Numbers=dispatch.ListB)
remap_2 = RemapNumbers(Value=pull_2.Distance, Source=bnd_3, Target=dom_3)  # -> Mapped, Clipped
graph_2 = GraphMapper(
    remap_2.Mapped,
    x0=0,
    x1=1,
    y0=0,
    y1=1,
    container_name="Bezier",
    cpx=[0, 0.6471909881, 0.9011235833, 1],
    cpy=[0, 0.07142859697, 0.428571403, 1])

pt_13 = Point(fieldpts.PTS)
geo_11 = Geometry(geo_8)
srf_cp = SurfaceClosestPoint(Point=pt_13, Surface=geo_11)  # -> Point, UVPoint, Distance
evalsrf = EvaluateSurface(Surface=geo_11, Point=srf_cp.UVPoint)  # -> Point, Normal, UDirection, VDirection, Frame
Z_3 = UnitZ(Factor=1)
angle_2 = Angle(VectorA=Z_3, VectorB=evalsrf.Normal)  # -> Angle, Reflex
bnd_4 = Bounds(Numbers=angle_2.Angle)
remap_3 = RemapNumbers(Value=angle_2.Angle, Source=bnd_4, Target="1 To 0")  # -> Mapped, Clipped
graph_3 = GraphMapper(remap_3.Mapped, x0=0, x1=1, y0=0, y1=1, container_name="Bezier", cpx=[0, 0.25, 0.75, 1], cpy=[0, 0.25, 0.75, 1])

gradient = Gradient(LowerLimit=0, UpperLimit=1, Parameter=weave, stops=[0: RGB(0, 128, 0), 0.5: RGB(255, 255, 0), 1: RGB(255, 0, 0)])
preview_4 = CustomPreview(Material=gradient)  # disabled

gradient_2 = Gradient(LowerLimit=0, UpperLimit=1, Parameter=graph_3, stops=[0: RGB(0, 128, 0), 0.5: RGB(255, 255, 0), 1: RGB(255, 0, 0)])  # disabled
preview_5 = CustomPreview(Geometry=evalsrf.Point, Material=gradient_2)  # disabled

gradient_3 = Gradient(LowerLimit=0, UpperLimit=1, Parameter=graph_2, stops=[0: RGB(0, 128, 0), 0.5: RGB(255, 255, 0), 1: RGB(255, 0, 0)])  # disabled
preview_6 = CustomPreview(Material=gradient_3)  # disabled

multiplication = Multiplication(A=weave, B=graph_2, C=graph_3)

field = Wasp_Field(NAME="srfField", E_FIELD=fieldpts.E_FIELD, VAL=multiplication)  # -> FIELD; inputs VAL: list; plug-in component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

number_slider_11 = Slider(35, range=0..50)
panel_19 = Panel("""SIDES>SIDES
TOP>BOTTOM
BOTTOM>TOP""")
rulegen = Wasp_RulesGenerator(PART=part, GR=panel_19)  # -> R; inputs PART: list, SELF_P: Boolean, SELF_C: Boolean, TYP: Boolean, GR: list; plug-in component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
fieldaggregation = Wasp_FieldDrivenAggregation(PART=flatten(part), N=Slider(0, range=0..500), RULES=rulegen, FIELD=field, RESET=Button())  # -> AGGR, PART_OUT; inputs PART: list, PREV: list, N: Int32, RULES: list, FIELD: list, MODE: Int32, GC: list, RESET: Boolean; plug-in component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

series = Series(Start=0, Step=1, Count="3")
bnd_5 = Bounds(Numbers=series)
dedomain_2 = DeconstructDomain(Domain=bnd_5)  # -> Start, End
gradient_4 = Gradient(
    LowerLimit=dedomain_2.Start,
    UpperLimit=dedomain_2.End,
    Parameter=series,
    stops=[0.15: RGB(255, 130, 160), 0.85: RGB(220, 0, 40)])
lng_2 = ListLength(List=fieldaggregation.PART_OUT)
getattr = Wasp_GetAttributeByName(PART=fieldaggregation.PART_OUT, ID="house")  # -> VAL; plug-in component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
random = Random(Range=Slider(2, range=0..10), Number=lng_2, Seed=2, Integers=True)
item_3 = ListItem(List=gradient_4, Index=random, Wrap=True)
preview_7 = CustomPreview(Geometry=flatten(getattr), Material=item_3)

gradient_5 = Gradient(
    LowerLimit=0,
    UpperLimit=1,
    Parameter=multiplication,
    stops=[0: RGB(0, 128, 0), 0.5: RGB(255, 255, 0), 1: RGB(255, 0, 0)])  # disabled
preview_8 = CustomPreview(Material=gradient_5)  # disabled

geo_12 = Geometry(srfgrid)
bbox_3 = BoundingBox(Content=geo_12, Plane=PlaneXY(0, 0, 0))  # -> Box, Box_2
volume_3 = Volume(Geometry=bbox_3.Box)  # -> Volume, Centroid
scale_nu_2 = ScaleNU(
    Geometry=bbox_3.Box,
    Plane=volume_3.Centroid,
    ScaleX=Slider(1, range=0..10),
    ScaleY=Slider(1, range=0..10),
    ScaleZ=Slider(2.17, range=0..10))  # -> Geometry, Transform
fieldpts_2 = Wasp_FieldPoints(BOU=scale_nu_2.Geometry, RES=Slider(2.5, range=0..10))  # -> E_FIELD, PTS; inputs BOU: list of Mesh, PLN: Plane; plug-in component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

contour_3 = Contour(Shape=geo_12, Point=Point(0, 0, 0), Direction=Vector(0, 0, 1), Distance=Slider(0.5, range=0..1))
preview_9 = CustomPreview(Geometry=geo_12, Material=ColourSwatch(SwatchColor=RGB(194, 194, 194)))
preview_10 = CustomPreview(Geometry=contour_3, Material=ColourSwatch(SwatchColor=RGB(0, 0, 0)))

geo_13 = Geometry(geo_12)
pull_3 = PullPoint(Point=fieldpts_2.PTS, Geometry=geo_13, ClosestOnly=True)  # -> ClosestPoint, Distance
pdecon_4 = Deconstruct(Point=fieldpts_2.PTS)  # -> XComponent, YComponent, ZComponent
pdecon_5 = Deconstruct(Point=pull_3.ClosestPoint)  # -> XComponent, YComponent, ZComponent
smaller_2 = SmallerThan(FirstNumber=pdecon_4.ZComponent, SecondNumber=pdecon_5.ZComponent)  # -> SmallerThan, OrEqualTo
dispatch_2 = Dispatch(List=pull_3.Distance, DispatchPattern=smaller_2.SmallerThan)  # -> ListA, ListB
dom_4 = ConstructDomain(DomainStart=Slider(1, range=0..1), DomainEnd=Slider(0, range=0..100))
bnd_6 = Bounds(Numbers=dispatch_2.ListB)
remap_4 = RemapNumbers(Value=dispatch_2.ListB, Source=bnd_6, Target=dom_4)  # -> Mapped, Clipped
lng_3 = ListLength(List=dispatch_2.ListA)
repeat_2 = RepeatData(Data=Slider(0, range=0..100), Length=lng_3)
graph_4 = GraphMapper(
    remap_4.Mapped,
    x0=0,
    x1=1,
    y0=0,
    y1=1,
    container_name="Bezier",
    cpx=[0, 0.6471909881, 0.9011235833, 1],
    cpy=[0, 0.07142859697, 0.428571403, 1])
weave_2 = Weave(Pattern=smaller_2.SmallerThan, Stream0=graph_4, Stream1=repeat_2, NullGaps=False)

geo_14 = Geometry(geo_12)
project_5 = Project(Curve=crv_10, Brep=geo_14, Direction=Vector(0, 0, 1))
pt_14 = Point(fieldpts_2.PTS)
pull_4 = PullPoint(Point=pt_14, Geometry=flatten(project_5), ClosestOnly=True)  # -> ClosestPoint, Distance
dom_5 = ConstructDomain(DomainStart=Slider(1, range=0..1), DomainEnd=Slider(0, range=0..100))
bnd_7 = Bounds(Numbers=dispatch_2.ListB)
remap_5 = RemapNumbers(Value=pull_4.Distance, Source=bnd_7, Target=dom_5)  # -> Mapped, Clipped
graph_5 = GraphMapper(
    remap_5.Mapped,
    x0=0,
    x1=1,
    y0=0,
    y1=1,
    container_name="Bezier",
    cpx=[0, 0.6471909881, 0.9011235833, 1],
    cpy=[0, 0.07142859697, 0.428571403, 1])

pt_15 = Point(fieldpts_2.PTS)
geo_15 = Geometry(geo_12)
srf_cp_2 = SurfaceClosestPoint(Point=pt_15, Surface=geo_15)  # -> Point, UVPoint, Distance
evalsrf_2 = EvaluateSurface(Surface=geo_15, Point=srf_cp_2.UVPoint)  # -> Point, Normal, UDirection, VDirection, Frame
Z_4 = UnitZ(Factor=1)
angle_3 = Angle(VectorA=Z_4, VectorB=evalsrf_2.Normal)  # -> Angle, Reflex
bnd_8 = Bounds(Numbers=angle_3.Angle)
remap_6 = RemapNumbers(Value=angle_3.Angle, Source=bnd_8, Target="1 To 0")  # -> Mapped, Clipped
graph_6 = GraphMapper(remap_6.Mapped, x0=0, x1=1, y0=0, y1=1, container_name="Bezier", cpx=[0, 0.25, 0.75, 1], cpy=[0, 0.25, 0.75, 1])

gradient_6 = Gradient(LowerLimit=0, UpperLimit=1, Parameter=weave_2, stops=[0: RGB(0, 128, 0), 0.5: RGB(255, 255, 0), 1: RGB(255, 0, 0)])
preview_11 = CustomPreview(Geometry=fieldpts_2.PTS, Material=gradient_6)

gradient_7 = Gradient(LowerLimit=0, UpperLimit=1, Parameter=graph_6, stops=[0: RGB(0, 128, 0), 0.5: RGB(255, 255, 0), 1: RGB(255, 0, 0)])
preview_12 = CustomPreview(Geometry=evalsrf_2.Point, Material=gradient_7)

gradient_8 = Gradient(LowerLimit=0, UpperLimit=1, Parameter=graph_5, stops=[0: RGB(0, 128, 0), 0.5: RGB(255, 255, 0), 1: RGB(255, 0, 0)])
preview_13 = CustomPreview(Geometry=pt_14, Material=gradient_8)

multiplication_2 = Multiplication(A=weave_2, B=graph_5, C=graph_6)

field_2 = Wasp_Field(NAME="srfField", E_FIELD=fieldpts_2.E_FIELD, VAL=multiplication_2)  # -> FIELD; inputs VAL: list; plug-in component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

panel_20 = Panel("""SIDES>SIDES
TOP>BOTTOM
BOTTOM>TOP""")
rulegen_2 = Wasp_RulesGenerator(PART=part_5, GR=panel_20)  # -> R; inputs PART: list, SELF_P: Boolean, SELF_C: Boolean, TYP: Boolean, GR: list; plug-in component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
fieldaggregation_2 = Wasp_FieldDrivenAggregation(PART=flatten(part_5), N=Slider(266, range=0..1000), RULES=rulegen_2, FIELD=field_2, RESET=Button())  # -> AGGR, PART_OUT; inputs PART: list, PREV: list, N: Int32, RULES: list, FIELD: list, MODE: Int32, GC: list, RESET: Boolean; plug-in component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

gradient_9 = Gradient(
    LowerLimit=0,
    UpperLimit=1,
    Parameter=multiplication_2,
    stops=[0: RGB(0, 128, 0), 0.5: RGB(255, 255, 0), 1: RGB(255, 0, 0)])
preview_14 = CustomPreview(Geometry=fieldpts_2.PTS, Material=gradient_9)

lng_4 = ListLength(List=fieldaggregation_2.PART_OUT)
getattr_2 = Wasp_GetAttributeByName(PART=fieldaggregation_2.PART_OUT, ID="house")  # -> VAL; plug-in component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
random_2 = Random(Range=Slider(2, range=0..10), Number=lng_4, Seed=2, Integers=True)
merge_4 = Merge(
    Data1=ColourSwatch(SwatchColor=RGB(42, 181, 14)),
    Data2=ColourSwatch(SwatchColor=RGB(110, 255, 0)),
    Data3=ColourSwatch(SwatchColor=RGB(207, 255, 77)))
item_4 = ListItem(List=merge_4, Index=random_2, Wrap=True)
preview_15 = CustomPreview(Geometry=flatten(getattr_2), Material=item_4)
