# Grasshopper definition polyhedra.gh (Grasshopper 1.0.7)
# plug-ins: Parakeet, MeshEdit Components, Weaverbird

# ---- group: single curve in plan
crv = Curve(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)

# ----
line = Line(crv)
num = Number(line)
midpt = CurveMiddle(Curve=line)
end = EndPoints(Curve=line)  # -> Start, End
expression = Expression(m=num, Expression="(2/(-1+Sqrt(5)))*m")
vec2pt = Vector2Pt(PointA=end.Start, PointB=end.End, Unitize=False)  # -> Vector, Length
xy = XYPlane(Origin=midpt)
align = AlignPlane(Plane=xy, Direction=vec2pt.Vector)  # -> Plane, Angle
division = Division(A=expression, B=Slider(2, range=1..10))
neg = Negative(Value=division)
dom = ConstructDomain(DomainStart=neg, DomainEnd=division)
planesrf = PlaneSurface(Plane=align.Plane, XSize=dom, YSize=dom)
boxrec = BoxRectangle(Rectangle=planesrf, Height=expression)

debrep = DeconstructBrep(Brep=boxrec)  # -> reparameterize(Faces), Edges, Vertices
srf_cp = SurfaceClosestPoint(Point=midpt, Surface=debrep.Faces)  # -> Point, UVPoint, Distance
int = Integer(srf_cp.Distance)
equals = Equality(FirstNumber=int, SecondNumber=0)  # -> Equality, Inequality
panel = Panel("""0
90""")
cull = CullPattern(List=debrep.Faces, CullPattern=equals.Equality)
cull_2 = CullPattern(List=srf_cp.UVPoint, CullPattern=equals.Equality)
lng = ListLength(List=debrep.Faces)
evalsrf = EvaluateSurface(Surface=cull, Point=cull_2)  # -> Point, Normal, UDirection, VDirection, Frame
repeat = RepeatData(Data=panel, Length=lng)
rotate = Rotate(Geometry=line, Angle=degrees(repeat), Plane=evalsrf.Frame)  # -> graft(Geometry), Transform
graft = GraftTree(Tree=debrep.Faces, IncludeEmptyLists=True, IncludeNullItems=True)
end_2 = EndPoints(Curve=rotate.Geometry)  # -> Start, End
srf_cp_2 = SurfaceClosestPoint(Point=[end_2.Start, end_2.End], Surface=cull)  # -> Point, UVPoint, Distance
evalsrf_2 = EvaluateSurface(Surface=graft, Point=srf_cp_2.UVPoint)  # -> Point, Normal, UDirection, VDirection, Frame
nurbs = NurbsCurve(Vertices=evalsrf_2.Point, Degree=1, Periodic=False)  # -> Curve, Length, Domain

tiling_f_sr = TruncatedTrihexagonal(Plane=PlaneXY(0, 0, 0), Size=1, ExtendX=<missing>, ExtendY=<missing>)
klein_surface = KleinSurface(UDivision=100, Radius1=<missing>, Radius2=<missing>)  # -> KleinSurface, KleinSurfacePoints, KleinSurfaceMesh
tiling_f_sr_2 = TruncatedTrihexagonal(Plane=PlaneXY(0, 0, 0), Size=1, ExtendX=<missing>, ExtendY=<missing>)
klein_surface_2 = KleinSurface(UDivision=100, Radius1=<missing>, Radius2=<missing>)  # -> KleinSurface, KleinSurfacePoints, KleinSurfaceMesh
_2tilinga = _2UniformTilingA(Plane=PlaneXY(0, 0, 0), Size=1, ExtendX=<missing>, ExtendY=<missing>)
starpatterni = StarPatternI(BaseGrid=tiling_f_sr, Angle=<missing>, Distance=<missing>, ShiftSize=0, BulgeFactor=0)
patterngenl_pt = PatternGenotypeLPT(BasePolylines=tiling_f_sr_2, RotationFactor=<missing>, ScaleFactor=<missing>)
quadsubm = MirroredSubdivideQuad(BasePolylineS=<missing>, Mirror=True)
starpatterni_2 = StarPatternI(BaseGrid=_2tilinga, Angle=<missing>, Distance=<missing>, ShiftSize=0, BulgeFactor=0)
patterngene = PatternGenotypeE(BasePolylines=quadsubm, Factor=<missing>)
number_slider = Slider(0.4, range=0..1)
number_slider_2 = Slider(4, range=0..4)
number_slider_3 = Slider(100, range=0..100)
midpt_2 = CurveMiddle(Curve=nurbs.Curve)
item = ListItem(Index=0, Wrap=True)  # disabled
cps = ClosestPoints(Point=midpt_2, Cloud=flatten(evalsrf_2.Point), Count=Slider(4, range=0..100))  # -> ClosestPoint, CPIndex, Distance
bang = ExplodeTree(Data=cps.ClosestPoint)  # -> _00000, _00010, _00020, _00030, _00040, _00050
item_2 = ListItem(Index=0, Wrap=True)  # disabled
item_3 = ListItem(Index=0, Wrap=True)  # disabled
number_slider_4 = Slider(180, range=0..1000)
number_slider_5 = Slider(220, range=0..1000)  # disabled
pt = Point(bang._00000)
sort = SortList(Keys=cps.Distance, ValuesA=cps.ClosestPoint)  # -> Keys, reverse(ValuesA)
split = SplitList(List=sort.ValuesA, Index=Slider(2, range=0..10))  # -> ListA, ListB
extr = ExtrudePoint(Base=graft(nurbs.Curve), Point=split.ListA)
rot3d = Rotate3D(Geometry=extr, Angle=degrees(number_slider_5), Center=midpt_2, Axis=nurbs.Curve)  # -> Geometry, Transform; disabled
join = BrepJoin(Breps=extr)  # -> Breps, Closed
number_slider_6 = Slider(1, range=0..100)
pt_2 = Point(split.ListA)
join_2 = BrepJoin(Breps=flatten(extr))  # -> Breps, Closed
flatten = FlattenTree(Tree=nurbs.Curve, Path="{0}")
sort_2 = SortList(Keys=flatten(sort.ValuesA), ValuesA=flatten(sort.ValuesA))  # -> Keys, ValuesA; disabled
edges = BrepEdges(Brep=join.Breps)  # -> Naked, Interior, NonManifold
edges_2 = BrepEdges(Brep=join_2.Breps)  # -> Naked, Interior, NonManifold; disabled
end_3 = EndPoints(Curve=nurbs.Curve)  # -> Start, End
pline = PolyLine(Vertices=sort_2.ValuesA, Closed=False)  # disabled
bang_2 = ExplodeTree(Data=end_3.End)  # -> _0000, _0001, _0002, _0003, _0004, _0005
bang_3 = ExplodeTree(Data=end_3.Start)  # -> _0000, _0001, _0002, _0003, _0004, _0005
wbweave = WeaverbirdsMeshFromLinesWeaveBack(Lines=flatten([edges_2.Naked, edges_2.Interior]), MaximumValence=20)  # disabled
explode = Explode(Curve=pline, Recursive=True)  # -> Segments, Vertices; disabled
explode_2 = MeshExplode(Mesh=wbweave, Interpolate=False)  # disabled
ln = Line(StartPoint=bang_2._0000, EndPoint=flatten([bang_3._0001, bang_3._0004, bang_3._0005, bang_2._0001]))
merge = Merge(
    Data1=flatten(bang_2._0004),
    Data2=flatten(bang_2._0002),
    Data3=flatten(bang_2._0003),
    Data4=flatten(bang_3._0005),
    Data5=flatten(bang_2._0001),
    Data6=flatten(bang_3._0001))
ln_2 = Line(StartPoint=bang_2._0004, EndPoint=flatten([bang_3._0004, bang_3._0001]))
ln_3 = Line(StartPoint=bang_3._0002, EndPoint=flatten([bang_3._0001, bang_2._0001, bang_2._0002, bang_2._0004, bang_2._0005]))
ln_4 = Line(StartPoint=bang_3._0003, EndPoint=flatten([bang_2._0002, bang_2._0003, bang_2._0004, bang_3._0004]))
ln_5 = Line(StartPoint=bang_2._0005, EndPoint=flatten([bang_2._0001, bang_2._0002, bang_2._0003, bang_3._0005]))
ln_6 = Line(StartPoint=bang_3._0000, EndPoint=flatten([bang_2._0000, bang_2._0003, bang_3._0003, bang_3._0004, bang_3._0005]))
ln_7 = Line(StartPoint=bang_3._0004, EndPoint=bang_3._0001)
demesh = DeconstructMesh(Mesh=explode_2)  # -> Vertices, Faces, Colours, Normals; disabled
pline_2 = PolyLine(Vertices=merge, Closed=False)
item_4 = ListItem(List=demesh.Vertices, Index=0, Wrap=True)  # -> Item, Item1, Item2; disabled
merge_2 = Merge(Data1=ln_6, Data2=ln_3, Data3=ln_4, Data4=ln_5, Data5=ln, Data6=ln_2, Data7=ln_7, Data8=pline_2)  # -> flatten(Result)
srf4pt = _4PointSurface(CornerA=item_4.Item, CornerB=item_4.Item1, CornerC=item_4.Item2)  # disabled
explode_3 = Explode(Curve=merge_2, Recursive=True)  # -> Segments, flatten(Vertices)
end_4 = EndPoints(Curve=merge_2)  # -> Start, End
mesh = Mesh(merge_2)
midpt_3 = CurveMiddle(Curve=edges.Naked)
del = DelaunayMesh(Points=explode_3.Vertices, Plane=PlaneXY(0, 0, 0))
number_slider_7 = Slider(0.499, range=0..1)
panel_2 = Panel("2")
cps_2 = ClosestPoints(Point=flatten(midpt_3), Cloud=flatten([end_4.Start, end_4.End]), Count=Slider(3, range=0..10))  # -> ClosestPoint, CPIndex, Distance
volume = Volume(Geometry=boxrec)  # -> Volume, Centroid
sort_3 = SortList(Keys=cps_2.ClosestPoint, ValuesA=cps_2.ClosestPoint)  # -> Keys, ValuesA
prox = Proximity3D(Points=flatten(midpt_3), Group=Slider(0, range=0..4))  # -> Links, Topology
pline_3 = PolyLine(Vertices=sort_3.ValuesA, Closed=True)
cps_3 = ClosestPoints(Point=volume.Centroid, Cloud=flatten(midpt_3), Count=3)  # -> ClosestPoint, CPIndex, Distance
crv_2 = Curve()  # disabled
