# Grasshopper definition Studio - Aggregation & Units.gh (Grasshopper 1.0.7)
# plug-ins: Pufferfish, Human, MetaHopper, ShapeDiverForGrasshopper, Kangaroo2 Components, MeshEdit Components

sddp = ShapeDiverDocumentPayload({AbsoluteTolerance=0, AngleTolerance=0, DistanceDisplayPrecision=0, GltfVersion="Gltf2", GrasshopperVersion="1.0.0007", InputGroups="{}", OutputGroups="{}", RelativeTolerance=0, RhinoVersion="7.36.23346.16351", UnitSystem=0, VersionCreated="1.14.0.0", VersionSaved="1.14.0.0"})
mesh = Mesh(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)
mesh_2 = Mesh(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)
msplit = MeshSplit(Mesh=mesh, Splitters=mesh_2)

item = ListItem(List=msplit, Index="1", Wrap=True)
Z = UnitZ(Factor=1)
move = Move(Geometry=item, Motion=Z)  # -> Geometry, Transform
medges = MeshEdges(Mesh=move.Geometry)  # -> NakedEdges, InteriorEdges, NonManifoldEdges
previewlw = CustomPreviewLineweights(
    Geometry=medges.NakedEdges,
    Shader=ColourSwatch(SwatchColor=RGB(0, 0, 0)),
    Thickness=Slider(2, range=0..100),
    Absolute=False)

contour = Contour(Shape=item, Point=Point(0, 0, 0), Direction=Vector(0, 0, 1), Distance=Slider(5, range=0..50))
patch = Patch(Curves=flatten(contour), Spans=20, Flexibility=1, Trim=True)

preview = CustomPreview(Geometry=item, Material=ColourSwatch(SwatchColor=RGB(194, 194, 194)))  # disabled
dom = ConstructDomain(DomainStart=Slider(0.3, range=0..1), DomainEnd=Slider(0.46, range=0..1))
dom_2 = ConstructDomain(DomainStart=Slider(0.15, range=0..1), DomainEnd=Slider(0.33, range=0..1))
dom² = ConstructDomain²(DomainU=dom_2, DomainV=dom)
subsrf = Isotrim(Surface=patch, Domain=dom²)

# ---- group: Terrain from Sample
# Terrain
geo = Geometry(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)

# ---- group: Project Terrain
geo_2 = Geometry(subsrf)

# ----
contour_2 = Contour(Shape=geo_2, Point=Point(0, 0, 0), Direction=Vector(0, 0, 1), Distance=Slider(5, range=0..50))
preview_2 = CustomPreview(Geometry=geo_2, Material=ColourSwatch(SwatchColor=RGB(214, 214, 214)))
preview_3 = CustomPreview(Geometry=contour_2, Material=ColourSwatch(SwatchColor=RGB(0, 0, 0)))

connections_centers = Point([<point referenced from the Rhino model> x3])
connections_x_axis = Curve([<curve referenced from the Rhino model> x3])

connections_centers_2 = Point(<point referenced from the Rhino model>)
connections_x_axis_2 = Curve(<curve referenced from the Rhino model>)

connections_x_axis_3 = Curve([<curve referenced from the Rhino model> x2])
connections_centers_3 = Point([<point referenced from the Rhino model> x2])

connections_x_axis_4 = Curve(<curve referenced from the Rhino model>)
connections_centers_4 = Point(<point referenced from the Rhino model>)

connections_centers_5 = Point(<point referenced from the Rhino model>)
connections_x_axis_5 = Curve(<curve referenced from the Rhino model>)

connections_centers_6 = Point([<point referenced from the Rhino model> x2])
connections_x_axis_6 = Curve([<curve referenced from the Rhino model> x2])

connections_centers_7 = Point([<point referenced from the Rhino model> x3])
connections_x_axis_7 = Curve([<curve referenced from the Rhino model> x3])

connections_centers_8 = Point(<point referenced from the Rhino model>)
connections_x_axis_8 = Curve(<curve referenced from the Rhino model>)

connections_x_axis_9 = Curve(<curve referenced from the Rhino model>)
connections_centers_9 = Point(<point referenced from the Rhino model>)

connections_x_axis_10 = Curve([<curve referenced from the Rhino model> x2])
connections_centers_10 = Point([<point referenced from the Rhino model> x2])

connections_x_axis_11 = Curve([<curve referenced from the Rhino model> x2])
connections_centers_11 = Point([<point referenced from the Rhino model> x2])

subd = SubD(<subd referenced from the Rhino model>)
mesh_3 = Mesh(<mesh referenced from the Rhino model>)
qrmesh = QuadRemesh(Mesh=mesh_3, Settings={aqc=True, as=50, dhe=True, gci=0, null=False, pme=0, sa=0, tqc=2000})
merge = Merge(Data1=subd, Data2=qrmesh)
medges_2 = MeshEdges(Mesh=qrmesh)  # -> NakedEdges, InteriorEdges, NonManifoldEdges

mesh_4 = Mesh(<mesh referenced from the Rhino model>)
subd_2 = SubD(<subd referenced from the Rhino model>)
qrmesh_2 = QuadRemesh(Mesh=mesh_4, Settings={aqc=True, as=50, dhe=True, gci=0, null=False, pme=0, sa=0, tqc=2000})
merge_2 = Merge(Data1=subd_2, Data2=qrmesh_2)

geo_3 = Geometry([<brep referenced from the Rhino model>, <mesh referenced from the Rhino model>])
attribute = Wasp_Attribute(ID="UNITC", VAL=merge, TR=Toggle(True))  # -> ATTR; inputs VAL: list, TR: Boolean; plug-in component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

# ----
# CUBES
panel = Panel("CUBE_TOP")
# Attributes Geometry
panel_2 = Panel("CUBE_BOTTOM")
part_geometry = Brep(<brep referenced from the Rhino model>)
points = PointList(Points=connections_centers_3, Size=Slider(1, range=0..10))
conndir = Wasp_ConnectionFromDirection(GEO=part_geometry, CEN=connections_centers_3, UP=connections_x_axis_3, T="CUBE_SIDE")  # -> CONN, PLN_OUT; inputs CEN: list of Point3d, UP: list of Curve, T: list; plug-in component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
conndir_2 = Wasp_ConnectionFromDirection(GEO=part_geometry, CEN=connections_centers_2, UP=connections_x_axis_2, T=panel)  # -> CONN, PLN_OUT; inputs CEN: list of Point3d, UP: list of Curve, T: list; plug-in component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
conndir_3 = Wasp_ConnectionFromDirection(GEO=part_geometry, CEN=connections_centers_4, UP=connections_x_axis_4, T=panel_2)  # -> CONN, PLN_OUT; inputs CEN: list of Point3d, UP: list of Curve, T: list; plug-in component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
merge_3 = Merge(Data1=conndir.CONN, Data2=conndir_2.CONN, Data3=conndir_3.CONN)
part_name = Panel("CUBE")
part = Wasp_BasicPart(NAME=part_name, GEO=part_geometry, CONN=flatten(merge_3), ATTR=attribute)  # -> PART; inputs GEO: Mesh, CONN: list, ATTR: list; plug-in component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

geo_4 = Geometry([<brep referenced from the Rhino model>, <mesh referenced from the Rhino model>])
attribute_2 = Wasp_Attribute(ID="UNITO", VAL=merge_2, TR=Toggle(True))  # -> ATTR; inputs VAL: list, TR: Boolean; plug-in component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

# ----
# OCTAGONS
panel_3 = Panel("OCT_SIDE")
part_geometry_2 = Brep(<brep referenced from the Rhino model>)
points_2 = PointList(Points=connections_centers_6, Size=Slider(1, range=0..10))
conndir_4 = Wasp_ConnectionFromDirection(GEO=part_geometry_2, CEN=connections_centers_6, UP=connections_x_axis_6, T=panel_3)  # -> CONN, PLN_OUT; inputs CEN: list of Point3d, UP: list of Curve, T: list; plug-in component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
part_name_2 = Panel("OCT")
part_2 = Wasp_BasicPart(NAME=part_name_2, GEO=part_geometry_2, CONN=flatten(conndir_4.CONN), ATTR=attribute_2)  # -> PART; inputs GEO: Mesh, CONN: list, ATTR: list; plug-in component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

# ---- group: Guide Curve
crv = Curve(<curve referenced from the Rhino model>)

crv_2 = Curve(<curve referenced from the Rhino model>)

# ---- group: Terrain
geo_5 = Geometry(geo_2)

# ----
dom_3 = ConstructDomain(DomainStart=Slider(1, range=0..3), DomainEnd=Slider(0, range=0..100))
merge_4 = Merge(Data1=part_2, Data2=part)

toggle = GroupToggle(ToggleActive=True, ToggleVisible=False)  # disabled
p_p = Panel("""OCT_SIDE>CUBE_SIDE
CUBE_SIDE>OCT_SIDE
OCT_SIDE>VCUBE_SIDE
VCUBE_SIDE>OCT_SIDE""")  # disabled
number_slider = Slider(25, range=0..200)  # disabled
rulegen = Wasp_RulesGenerator(PART=merge_4, GR=p_p)  # -> R; inputs PART: list, SELF_P: Boolean, SELF_C: Boolean, TYP: Boolean, GR: list; disabled; plug-in component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
button = Button()  # disabled
# Test Aggregation
stochasticaggregation = Wasp_StochasticAggregation(PART=flatten(merge_4), N=number_slider, RULES=rulegen, RESET=button)  # -> AGGR, PART_OUT; inputs PART: list, PREV: list, N: Int32, RULES: list, SEED: Int32, MODE: Int32, GC: list, RESET: Boolean; disabled; plug-in component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

partgeo = Wasp_GetPartGeometry(PART=stochasticaggregation.PART_OUT)  # -> GEO; plug-in component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
Z_2 = UnitZ(Factor=Slider(-4.5, range=-10..0))
move_2 = Move(Geometry=partgeo, Motion=Z_2)  # -> Geometry, Transform
preview_4 = CustomPreview(Geometry=move_2.Geometry, Material=ColourSwatch(SwatchColor=RGB(255, 255, 255)))

getattr = Wasp_GetAttributeByName(PART=stochasticaggregation.PART_OUT, ID="UNITO")  # -> VAL; plug-in component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
preview_5 = CustomPreview(Geometry=getattr, Material=ColourSwatch(SwatchColor=RGB(176, 125, 125)))
offsrf = OffsetSurface(Surface=subsrf, Distance=Slider(7.3, range=0..20), BothSides=0, CreateSolid=True)

# ----
# Mesh Constraint
mesh_5 = MeshBrep(
    Brep=offsrf,
    Settings={GridMaxCount=0, GridMinCount=16, JaggedSeams=False, MaxEdgeLength=0, MinEdgeLength=0.0001, MinTolerance=0, Refine=True, RefineAngle=0, RelativeTolerance=0.65, SimplePlanes=True, Tolerance=0})
panel_4 = Panel("""OCT
CUBE""")
meshconst = Wasp_MeshConstraint(GEO=mesh_5, IN=Toggle(True), SOFT=Toggle(True), REQ=Toggle(True), PART=panel_4)  # -> GC; inputs GEO: Mesh, IN: Boolean, SOFT: Boolean, REQ: Boolean, PART: list; plug-in component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

brep = Brep([<brep referenced from the Rhino model> x16])
crv_3 = Curve(<curve referenced from the Rhino model>)
Y = UnitY(Factor=Slider(26, range=0..100))
move_3 = Move(Geometry=crv_3, Motion=Y)  # -> Geometry, Transform
crv_4 = Curve(<curve referenced from the Rhino model>)

# ---- group: Rough
crv_5 = Curve(<curve referenced from the Rhino model>)

crv_6 = Curve(<curve referenced from the Rhino model>)

# ----
crv_7 = Curve(move_3.Geometry)
p_p_2 = Panel("""HEX_SIDE>CUBE_SIDE
CUBE_SIDE>HEX_SIDE
CUBE_BOTTOM>CUBE_TOP
CUBE_TOP>CUBE_BOTTOM""")
p_p_3 = Panel("""OCT_SIDE>CUBE_SIDE
CUBE_SIDE>OCT_SIDE
OCT_SIDE>VCUBE_SIDE
VCUBE_SIDE>OCT_SIDE""")
panel_5 = Panel("""HEX|0_CUBE|0
HEX|0_CUBE|1
HEX|1_CUBE|0
HEX|1_CUBE|1
HEX|2_CUBE|0
HEX|2_CUBE|1
CUBE|0_HEX|0
CUBE|0_HEX|1
CUBE|0_HEX|2
CUBE|1_HEX|0
CUBE|1_HEX|1
CUBE|1_HEX|2
CUBE|3_CUBE|2
CUBE|2_CUBE|3""")
relay = Relay()

lng = ListLength(List=relay)
getattr_2 = Wasp_GetAttributeByName(PART=relay, ID="house")  # -> VAL; plug-in component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
random = Random(Range=Slider(2, range=0..10), Number=lng, Seed=2, Integers=True)
merge_5 = Merge(
    Data1=ColourSwatch(SwatchColor=RGB(42, 181, 14)),
    Data2=ColourSwatch(SwatchColor=RGB(110, 255, 0)),
    Data3=ColourSwatch(SwatchColor=RGB(207, 255, 77)))
item_2 = ListItem(List=merge_5, Index=random, Wrap=True)
preview_6 = CustomPreview(Geometry=flatten(getattr_2), Material=item_2)

# ----
# HEXAGONS
panel_6 = Panel("HEX_SIDE")
part_geometry_3 = Brep(<brep referenced from the Rhino model>)
conndir_5 = Wasp_ConnectionFromDirection(GEO=part_geometry_3, CEN=connections_centers, UP=connections_x_axis, T=panel_6)  # -> CONN, PLN_OUT; inputs CEN: list of Point3d, UP: list of Curve, T: list; plug-in component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
points_3 = PointList(Points=connections_centers, Size=Slider(1, range=0..10))
part_name_3 = Panel("HEX")

geo_6 = Geometry(part_geometry_3)
attribute_3 = Wasp_Attribute(ID="HEX", VAL=geo_6, TR=Toggle(True))  # -> ATTR; inputs VAL: list, TR: Boolean; plug-in component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

part_3 = Wasp_BasicPart(NAME=part_name_3, GEO=part_geometry_3, CONN=flatten(conndir_5.CONN), ATTR=attribute_3)  # -> PART; inputs GEO: Mesh, CONN: list, ATTR: list; plug-in component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

merge_6 = Merge(Data1=part_3, Data2=part)

part_geometry_4 = Brep(<brep referenced from the Rhino model>)
part_geometry_5 = Brep(<brep referenced from the Rhino model>)
points_4 = PointList(Points=connections_centers_8, Size=Slider(1, range=0..10))
conndir_6 = Wasp_ConnectionFromDirection(GEO=part_geometry_4, CEN=connections_centers_7, UP=connections_x_axis_7, T="HEX_SIDE")  # -> CONN, PLN_OUT; inputs CEN: list of Point3d, UP: list of Curve, T: list; plug-in component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
conndir_7 = Wasp_ConnectionFromDirection(GEO=part_geometry_5, CEN=connections_centers_8, UP=connections_x_axis_8, T="CUBE_SIDE")  # -> CONN, PLN_OUT; inputs CEN: list of Point3d, UP: list of Curve, T: list; plug-in component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
conndir_8 = Wasp_ConnectionFromDirection(GEO=part_geometry_5, CEN=connections_centers_5, UP=connections_x_axis_5, T="CUBE_TOP")  # -> CONN, PLN_OUT; inputs CEN: list of Point3d, UP: list of Curve, T: list; plug-in component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
conndir_9 = Wasp_ConnectionFromDirection(GEO=part_geometry_5, CEN=connections_centers_9, UP=connections_x_axis_9, T="CUBE_BOTTOM")  # -> CONN, PLN_OUT; inputs CEN: list of Point3d, UP: list of Curve, T: list; plug-in component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
points_5 = PointList(Points=connections_centers_7, Size=Slider(2, range=0..10))
merge_7 = Merge(Data1=conndir_7.CONN, Data2=conndir_8.CONN, Data3=conndir_9.CONN)
part_name_4 = Panel("CUBE")
part_name_5 = Panel("HEX")

geo_7 = Geometry(part_geometry_5)
attribute_4 = Wasp_Attribute(ID="CUBE", VAL=geo_7, TR=Toggle(True))  # -> ATTR; inputs VAL: list, TR: Boolean; plug-in component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

geo_8 = Geometry(part_geometry_4)
attribute_5 = Wasp_Attribute(ID="HEX", VAL=geo_8, TR=Toggle(True))  # -> ATTR; inputs VAL: list, TR: Boolean; plug-in component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

part_4 = Wasp_BasicPart(NAME=part_name_5, GEO=part_geometry_4, CONN=flatten(conndir_6.CONN), ATTR=attribute_5)  # -> PART; inputs GEO: Mesh, CONN: list, ATTR: list; plug-in component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
part_5 = Wasp_BasicPart(NAME=part_name_4, GEO=part_geometry_5, CONN=flatten(merge_7), ATTR=attribute_4)  # -> PART; inputs GEO: Mesh, CONN: list, ATTR: list; plug-in component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

merge_8 = Merge(Data1=part_4, Data2=part_5)

# ----
# OTHER CUBES
panel_7 = Panel("CUBE_SIDE")
# Units 2
panel_8 = Panel("VCUBE_SIDE")
part_geometry_6 = Brep(<brep referenced from the Rhino model>)
part_geometry_7 = Brep(<brep referenced from the Rhino model>)
points_6 = PointList(Points=connections_centers_11, Size=Slider(1, range=0..10))
conndir_10 = Wasp_ConnectionFromDirection(GEO=part_geometry_6, CEN=connections_centers_11, UP=connections_x_axis_11, T=panel_8)  # -> CONN, PLN_OUT; inputs CEN: list of Point3d, UP: list of Curve, T: list; plug-in component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
conndir_11 = Wasp_ConnectionFromDirection(GEO=part_geometry_7, CEN=connections_centers_10, UP=connections_x_axis_10, T=panel_7)  # -> CONN, PLN_OUT; inputs CEN: list of Point3d, UP: list of Curve, T: list; plug-in component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
points_7 = PointList(Points=connections_centers_10, Size=Slider(1, range=0..10))
part_name_6 = Panel("VCUBE")
part_name_7 = Panel("CUBE")

geo_9 = Geometry(part_geometry_6)
attribute_6 = Wasp_Attribute(ID="VCUBE", VAL=geo_9, TR=Toggle(True))  # -> ATTR; inputs VAL: list, TR: Boolean; plug-in component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

geo_10 = Geometry(part_geometry_7)
attribute_7 = Wasp_Attribute(ID="CUBE", VAL=geo_10, TR=Toggle(True))  # -> ATTR; inputs VAL: list, TR: Boolean; plug-in component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

part_6 = Wasp_BasicPart(NAME=part_name_6, GEO=part_geometry_6, CONN=flatten(conndir_10.CONN), ATTR=attribute_6)  # -> PART; inputs GEO: Mesh, CONN: list, ATTR: list; plug-in component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
part_7 = Wasp_BasicPart(NAME=part_name_7, GEO=part_geometry_7, CONN=flatten(conndir_11.CONN), ATTR=attribute_7)  # -> PART; inputs GEO: Mesh, CONN: list, ATTR: list; plug-in component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

bbox = BoundingBox(Content=geo_2, Plane=PlaneXY(0, 0, 0))  # -> Box, Box_2
volume = Volume(Geometry=bbox.Box)  # -> Volume, Centroid
scale_nu = ScaleNU(
    Geometry=bbox.Box,
    Plane=volume.Centroid,
    ScaleX=Slider(1, range=0..10),
    ScaleY=Slider(1, range=0..10),
    ScaleZ=Slider(1.19, range=0..10))  # -> Geometry, Transform
# Fields
fieldpts = Wasp_FieldPoints(BOU=scale_nu.Geometry, RES=Slider(6, range=0..50))  # -> E_FIELD, PTS; inputs BOU: list of Mesh, PLN: Plane; plug-in component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
panel_9 = Panel("srfField")

# ----
# Height Field Values
pt = Point(fieldpts.PTS)
pdecon = Deconstruct(Point=pt)  # -> XComponent, YComponent, ZComponent
bnd = Bounds(Numbers=pdecon.ZComponent)
dom_4 = ConstructDomain(DomainStart=Slider(2, range=0..2), DomainEnd=Slider(1, range=0..2))
remap = RemapNumbers(Value=pdecon.ZComponent, Source=bnd, Target=dom_4)  # -> Mapped, Clipped
graph = GraphMapper(remap.Mapped, x0=0, x1=1, y0=0, y1=1, container_name="Bezier", cpx=[0, 0.3765036762, 0.6050803661, 1], cpy=[0, 0, 1, 1])

geo_11 = Geometry(geo_2)  # disabled
# Surface Slope Field Values (Not used here)
pt_2 = Point(fieldpts.PTS)  # disabled
# Any Additional Fields
toggle_2 = GroupToggle(ToggleActive=True, ToggleVisible=False)  # disabled
srf_cp = SurfaceClosestPoint(Point=pt_2, Surface=geo_11)  # -> Point, UVPoint, Distance; disabled
evalsrf = EvaluateSurface(Surface=geo_11, Point=srf_cp.UVPoint)  # -> Point, Normal, UDirection, VDirection, Frame; disabled
Z_3 = UnitZ(Factor=1)  # disabled
angle = Angle(VectorA=Z_3, VectorB=evalsrf.Normal)  # -> Angle, Reflex; disabled
bnd_2 = Bounds(Numbers=angle.Angle)  # disabled
panel_10 = Panel("1 To 0")  # disabled
remap_2 = RemapNumbers(Value=angle.Angle, Source=bnd_2, Target=panel_10)  # -> Mapped, Clipped; disabled
graph_2 = GraphMapper(remap_2.Mapped, x0=0, x1=1, y0=0, y1=1, container_name="Bezier", cpx=[0, 0.25, 0.75, 1], cpy=[0, 0.25, 0.75, 1])  # disabled

geo_12 = Geometry(geo_2)
pull = PullPoint(Point=fieldpts.PTS, Geometry=geo_12, ClosestOnly=True)  # -> ClosestPoint, Distance
pdecon_2 = Deconstruct(Point=pull.ClosestPoint)  # -> XComponent, YComponent, ZComponent
# Surface Field Values (Terrain)
pdecon_3 = Deconstruct(Point=fieldpts.PTS)  # -> XComponent, YComponent, ZComponent
smaller = SmallerThan(FirstNumber=pdecon_3.ZComponent, SecondNumber=pdecon_2.ZComponent)  # -> SmallerThan, OrEqualTo
dispatch = Dispatch(List=pull.Distance, DispatchPattern=smaller.SmallerThan)  # -> ListA, ListB
dom_5 = ConstructDomain(DomainStart=Slider(1, range=0..1), DomainEnd=Slider(0, range=0..100))
bnd_3 = Bounds(Numbers=dispatch.ListB)
lng_2 = ListLength(List=dispatch.ListA)
remap_3 = RemapNumbers(Value=dispatch.ListB, Source=bnd_3, Target=dom_5)  # -> Mapped, Clipped
repeat = RepeatData(Data=Slider(0, range=0..100), Length=lng_2)
graph_3 = GraphMapper(remap_3.Mapped, x0=0, x1=1, y0=0, y1=1, container_name="Bezier", cpx=[0, 1, 1, 1], cpy=[0, 0, 0.07525634766, 1])
weave = Weave(Pattern=smaller.SmallerThan, Stream0=graph_3, Stream1=repeat, NullGaps=False)

project = Project(Curve=crv, Brep=geo_5, Direction=Vector(0, 0, 1))
# Curve Field Values
pt_3 = Point(fieldpts.PTS)
pull_2 = PullPoint(Point=pt_3, Geometry=flatten(project), ClosestOnly=True)  # -> ClosestPoint, Distance
bnd_4 = Bounds(Numbers=dispatch.ListB)
dom_6 = ConstructDomain(DomainStart=Slider(1, range=0..1), DomainEnd=Slider(0, range=0..100))
remap_4 = RemapNumbers(Value=pull_2.Distance, Source=bnd_4, Target=dom_6)  # -> Mapped, Clipped
graph_4 = GraphMapper(remap_4.Mapped, x0=0, x1=1, y0=0, y1=1, container_name="Bezier", cpx=[0, 1, 1, 1], cpy=[0, 0, 0.1247724891, 1])

curvepoint = PointOnCurve(project, parameter=0)
pipe = Pipe(Curve=project, Radius=Slider(4, range=0..100), Caps=2)  # disabled
cap = CapHoles(Brep=pipe)  # disabled
pull_3 = PullPoint(Point=pt_3, Geometry=flatten(curvepoint), ClosestOnly=True)  # -> ClosestPoint, Distance
bnd_5 = Bounds(Numbers=pull_3.Distance)
remap_5 = RemapNumbers(Value=pull_3.Distance, Source=bnd_5, Target=dom_3)  # -> Mapped, Clipped

lng_3 = ListLength(List=dispatch.ListB)
repeat_2 = RepeatData(Data=Slider(1, range=0..1), Length=lng_3)

# ---- group: Preview Field Points
gradient = Gradient(LowerLimit=0, UpperLimit=1, Parameter=weave, stops=[0: RGB(0, 128, 0), 0.5: RGB(255, 255, 0), 1: RGB(255, 0, 0)])
preview_7 = CustomPreview(Geometry=fieldpts.PTS, Material=gradient)

gradient_2 = Gradient(LowerLimit=0, UpperLimit=1, Parameter=graph_2, stops=[0: RGB(255, 0, 0), 0.5: RGB(255, 255, 0), 1: RGB(0, 128, 0)])
preview_8 = CustomPreview(Geometry=evalsrf.Point, Material=gradient_2)

# ----
multiplication = Multiplication(A=graph_4, B=Slider(7.01, range=0..10))
multiplication_2 = Multiplication(A=graph, B=Slider(1.37, range=0..10))

# ---- group: Preview Field Points
gradient_3 = Gradient(LowerLimit=0, UpperLimit=1, Parameter=graph, stops=[0: RGB(0, 128, 0), 0.5: RGB(255, 255, 0), 1: RGB(255, 0, 0)])
preview_9 = CustomPreview(Geometry=pt, Material=gradient_3)

gradient_4 = Gradient(
    LowerLimit=0,
    UpperLimit=1,
    Parameter=multiplication,
    stops=[0: RGB(0, 128, 0), 0.5: RGB(255, 255, 0), 1: RGB(255, 0, 0)])
preview_10 = CustomPreview(Geometry=pt_3, Material=gradient_4)

# ---- group: Combining Fields Inputs
multiplication_3 = Multiplication(A=weave, B=multiplication)

# ---- group: Preview Field Points
gradient_5 = Gradient(
    LowerLimit=0,
    UpperLimit=1,
    Parameter=multiplication_3,
    stops=[0: RGB(0, 128, 0), 0.5: RGB(255, 255, 0), 1: RGB(255, 0, 0)])
preview_11 = CustomPreview(Geometry=fieldpts.PTS, Material=gradient_5)

# ----
# Combined
# Fields
field = Wasp_Field(E_FIELD=fieldpts.E_FIELD, VAL=multiplication_3)  # -> FIELD; inputs VAL: list; plug-in component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

# ----
# Aggregation and Rules (Grammar)
panel_11 = Panel("""HEX_SIDE>CUBE_SIDE
CUBE_SIDE>HEX_SIDE
CUBE_BOTTOM>CUBE_TOP
CUBE_TOP>CUBE_BOTTOM""")
rulegen_2 = Wasp_RulesGenerator(PART=merge_6, GR=panel_11)  # -> R; inputs PART: list, SELF_P: Boolean, SELF_C: Boolean, TYP: Boolean, GR: list; plug-in component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
fieldaggregation = Wasp_FieldDrivenAggregation(
    PART=flatten(merge_6),
    N=Slider(244, range=0..1200),
    RULES=rulegen_2,
    FIELD=field,
    MODE=Slider(2, range=0..3),
    GC=meshconst,
    RESET=Button())  # -> AGGR, PART_OUT; inputs PART: list, PREV: list, N: Int32, RULES: list, FIELD: list, MODE: Int32, GC: list, RESET: Boolean; plug-in component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

# ----
# Aggregation and Rules (Grammar)
p_p_4 = Panel("""OCT_SIDE>CUBE_SIDE
CUBE_SIDE>OCT_SIDE
CUBE_BOTTOM>CUBE_TOP
CUBE_TOP>CUBE_BOTTOM""")
rulegen_3 = Wasp_RulesGenerator(PART=merge_4, GR=p_p_4)  # -> R; inputs PART: list, SELF_P: Boolean, SELF_C: Boolean, TYP: Boolean, GR: list; plug-in component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
fieldaggregation_2 = Wasp_FieldDrivenAggregation(
    PART=flatten(merge_4),
    N=Slider(161, range=0..1200),
    RULES=rulegen_3,
    FIELD=field,
    MODE=Slider(2, range=0..3),
    GC=meshconst,
    RESET=Button())  # -> AGGR, PART_OUT; inputs PART: list, PREV: list, N: Int32, RULES: list, FIELD: list, MODE: Int32, GC: list, RESET: Boolean; plug-in component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

filter = StreamFilter(Gate=Slider(1, range=0..1), Stream0=fieldaggregation.PART_OUT, Stream1=fieldaggregation_2.PART_OUT)

# ----
# Saved Aggregations
toggle_3 = GroupToggle(ToggleActive=True, ToggleVisible=False)  # disabled
panel_12 = Panel("D:\FAD\MaCAD\Studio 2\Models\Wasp Exploration\Saved Aggregations")  # disabled
button_2 = Button()  # disabled
panel_13 = Panel("Main Cells O")  # disabled
path = FilePath(panel_12)  # disabled
saveaggr = Wasp_SaveAggregationToFile(AGGR=fieldaggregation_2.AGGR, PATH=path, NAME=panel_13, SAVE=button_2)  # -> TXT, FILE; inputs SAVE: Boolean; disabled; plug-in component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
loadaggr = Wasp_LoadAggregationFromFile(PART=merge_4, FILE=saveaggr.FILE)  # -> PART_OUT; inputs PART: list, RENUM: Boolean; disabled; plug-in component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
partgeo_2 = Wasp_GetPartGeometry(PART=loadaggr)  # -> GEO; disabled; plug-in component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

# ----
# Saved Aggregations
toggle_4 = GroupToggle(ToggleActive=True, ToggleVisible=False)  # disabled
panel_14 = Panel("D:\FAD\MaCAD\Studio 2\Models\Wasp Exploration\Saved Aggregations")  # disabled
panel_15 = Panel("Main Cells OCT 4")  # disabled
button_3 = Button()  # disabled
path_2 = FilePath(panel_14)  # disabled
saveaggr_2 = Wasp_SaveAggregationToFile(AGGR=fieldaggregation_2.AGGR, PATH=path_2, NAME=panel_15, SAVE=button_3)  # -> TXT, FILE; inputs SAVE: Boolean; disabled; plug-in component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
loadaggr_2 = Wasp_LoadAggregationFromFile(PART=merge_4, FILE=saveaggr_2.FILE)  # -> PART_OUT; inputs PART: list, RENUM: Boolean; disabled; plug-in component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
partgeo_3 = Wasp_GetPartGeometry(PART=loadaggr_2)  # -> GEO; disabled; plug-in component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

# ----
# Output Preview
partgeo_4 = Wasp_GetPartGeometry(PART=filter)  # -> GEO; plug-in component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
Z_4 = UnitZ(Factor=Slider(-4.13, range=-10..0))
move_4 = Move(Geometry=partgeo_4, Motion=Z_4)  # -> Geometry, Transform
preview_12 = CustomPreview(Geometry=move_4.Geometry, Material=ColourSwatch(SwatchColor=RGB(255, 255, 255)))  # disabled

# ----
# Handle with Care!
# 
# - Turn off before modifying the aggregation.
# - Turn off before modifying Kangaroo.
# Attributes  (Detailed Units)
toggle_5 = GroupToggle(ToggleActive=True, ToggleVisible=False)  # disabled
getattr_3 = Wasp_GetAttributeByName(PART=fieldaggregation_2.PART_OUT, ID="UNITC")  # -> VAL; plug-in component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
getattr_4 = Wasp_GetAttributeByName(PART=fieldaggregation_2.PART_OUT, ID="UNITO")  # -> VAL; plug-in component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
move_5 = Move(Geometry=getattr_4, Motion=Z_4)  # -> Geometry, Transform
move_6 = Move(Geometry=getattr_3, Motion=Z_4)  # -> Geometry, Transform
preview_13 = CustomPreview(Geometry=move_6.Geometry, Material=ColourSwatch(SwatchColor=RGB(176, 125, 125)))
preview_14 = CustomPreview(Geometry=move_5.Geometry, Material=ColourSwatch(SwatchColor=RGB(255, 255, 255)))

angsplitmsh = AngleSplitMesh(Mesh=move_4.Geometry, Angle=0, Opposite=False)  # -> Split, R
medges_3 = MeshEdges(Mesh=angsplitmsh.Split)  # -> NakedEdges, InteriorEdges, NonManifoldEdges
geo_13 = Geometry(medges_3.NakedEdges)
previewlw_2 = CustomPreviewLineweights(Geometry=geo_13, Shader=ColourSwatch(SwatchColor=RGB(0, 0, 0)), Thickness=Slider(1, range=0..100), Absolute=False)

# ----
# Kangaroo
disc = Discontinuity(Curve=crv_3, Level=1)  # -> Points, Parameters
avr = Average(Input=disc.Points)
lng_4 = ListLength(List=disc.Points)
dup = DuplicateData(Data=avr, Number=lng_4, Order=True)
ln = Line(StartPoint=disc.Points, EndPoint=avr)
number_slider_2 = Slider(0, range=0..2)
ext = ExtendCurve(Curve=ln, Type=number_slider_2, Start=number_slider_2, End=Slider(-0.4, range=-1..0))
shift = ShiftList(List=ext, Shift=1, Wrap=True)
rulesrf = RuledSurface(CurveA=shift, CurveB=ext)
mesh_uv = MeshSurface(Surface=rulesrf, UCount=5, VCount=5, Overhang=True, Equalize=False)
mjoin = MeshJoin(Meshes=mesh_uv)
weldvertices = MeshWeldVertices(Mesh=mjoin, Tolerance=0.01)  # -> RuntimeMessage, Mesh
nv = NakedVertices(Mesh=weldvertices.Mesh)  # -> ClothedIndex, NakedIndex, ClothedPts, NakedPts
medges_4 = MeshEdges(Mesh=weldvertices.Mesh)  # -> NakedEdges, InteriorEdges, NonManifoldEdges
demesh = DeconstructMesh(Mesh=weldvertices.Mesh)  # -> Vertices, Faces, Colours, Normals
midpt = CurveMiddle(Curve=medges_4.NakedEdges)
pull_4 = PullPoint(Point=nv.NakedPts, Geometry=crv_3, ClosestOnly=True)  # -> ClosestPoint, Distance
avr_2 = Average(Input=midpt)
smaller_2 = SmallerThan(FirstNumber=pull_4.Distance, SecondNumber=Slider(0.1, range=0.1..0.11))  # -> SmallerThan, OrEqualTo
dist = Distance(PointA=midpt, PointB=avr_2)
smaller_3 = SmallerThan(FirstNumber=dist, SecondNumber=Slider(3.18, range=0..5))  # -> SmallerThan, OrEqualTo
cull = CullPattern(List=nv.NakedPts, CullPattern=smaller_2.SmallerThan)
cull_2 = CullPattern(List=medges_4.NakedEdges, CullPattern=smaller_3.SmallerThan)
len = Length(Curve=medges_4.InteriorEdges)
len_2 = Length(Curve=cull_2)
Z_5 = UnitZ(Factor=Slider(1.67, range=0..10))
anchor = Anchor(Point=cull, Strength=10000)
load = Load(Point=demesh.Vertices, ForceVector=Z_5, Weighting=1)
show = Show(G=weldvertices.Mesh)

# ---- group: All other segments
multiplication_4 = Multiplication(A=len, B=Slider(1, range=0..1))
length_line = LengthLine(Line=medges_4.InteriorEdges, Length=multiplication_4, Strength=Slider(34, range=0..100))

# ---- group: Central Ring
multiplication_5 = Multiplication(A=len_2, B=Slider(0, range=0..1))
length_line_2 = LengthLine(Line=cull_2, Length=multiplication_5, Strength=Slider(10000, range=0..10000))

# ----
entwine = Entwine(Branch00=show, Branch01=length_line, Branch02=length_line_2, Branch03=load, Branch04=anchor, FlattenInputs=True)
bouncysolver = BouncySolver(GoalObjects=entwine, Reset=Button(), Threshold=1e-15, Tolerance=0.0001, Damping=0.99, Iterations=10, On=Toggle(True))  # -> I, V, O
item_3 = ListItem(List=bouncysolver.O, Index=0, Wrap=True)
medges_5 = MeshEdges(Mesh=item_3)  # -> NakedEdges, InteriorEdges, NonManifoldEdges
preview_15 = CustomPreview(Geometry=item_3, Material=ColourSwatch(SwatchColor=RGB(255, 255, 255)))

disc_2 = Discontinuity(Curve=crv_7, Level=1)  # -> Points, Parameters
avr_3 = Average(Input=disc_2.Points)
lng_5 = ListLength(List=disc_2.Points)
dup_2 = DuplicateData(Data=avr_3, Number=lng_5, Order=True)
ln_2 = Line(StartPoint=disc_2.Points, EndPoint=avr_3)
number_slider_3 = Slider(0, range=0..2)
ext_2 = ExtendCurve(Curve=ln_2, Type=number_slider_3, Start=number_slider_3, End=Slider(-0.4, range=-1..0))
shift_2 = ShiftList(List=ext_2, Shift=1, Wrap=True)
rulesrf_2 = RuledSurface(CurveA=shift_2, CurveB=ext_2)
mesh_uv_2 = MeshSurface(Surface=rulesrf_2, UCount=5, VCount=5, Overhang=True, Equalize=False)
mjoin_2 = MeshJoin(Meshes=mesh_uv_2)
weldvertices_2 = MeshWeldVertices(Mesh=mjoin_2, Tolerance=0.01)  # -> RuntimeMessage, Mesh
nv_2 = NakedVertices(Mesh=weldvertices_2.Mesh)  # -> ClothedIndex, NakedIndex, ClothedPts, NakedPts
medges_6 = MeshEdges(Mesh=weldvertices_2.Mesh)  # -> NakedEdges, InteriorEdges, NonManifoldEdges
demesh_2 = DeconstructMesh(Mesh=weldvertices_2.Mesh)  # -> Vertices, Faces, Colours, Normals
midpt_2 = CurveMiddle(Curve=medges_6.NakedEdges)
pull_5 = PullPoint(Point=nv_2.NakedPts, Geometry=crv_7, ClosestOnly=True)  # -> ClosestPoint, Distance
avr_4 = Average(Input=midpt_2)
smaller_4 = SmallerThan(FirstNumber=pull_5.Distance, SecondNumber=Slider(0.1, range=0.1..0.11))  # -> SmallerThan, OrEqualTo
dist_2 = Distance(PointA=midpt_2, PointB=avr_4)
smaller_5 = SmallerThan(FirstNumber=dist_2, SecondNumber=Slider(3.18, range=0..5))  # -> SmallerThan, OrEqualTo
cull_3 = CullPattern(List=nv_2.NakedPts, CullPattern=smaller_4.SmallerThan)
cull_4 = CullPattern(List=medges_6.NakedEdges, CullPattern=smaller_5.SmallerThan)
len_3 = Length(Curve=medges_6.InteriorEdges)
len_4 = Length(Curve=cull_4)
Z_6 = UnitZ(Factor=Slider(1.67, range=0..10))
anchor_2 = Anchor(Point=cull_3, Strength=10000)
load_2 = Load(Point=demesh_2.Vertices, ForceVector=Z_6, Weighting=1)
show_2 = Show(G=weldvertices_2.Mesh)

# ---- group: All other segments
multiplication_6 = Multiplication(A=len_3, B=Slider(0.14, range=0..1))
length_line_3 = LengthLine(Line=medges_6.InteriorEdges, Length=multiplication_6, Strength=Slider(12, range=0..100))

# ---- group: Central Ring
multiplication_7 = Multiplication(A=len_4, B=Slider(0, range=0..1))
length_line_4 = LengthLine(Line=cull_4, Length=multiplication_7, Strength=Slider(10000, range=0..10000))

# ----
entwine_2 = Entwine(Branch00=show_2, Branch01=length_line_3, Branch02=length_line_4, Branch03=load_2, Branch04=anchor_2, FlattenInputs=True)
bouncysolver_2 = BouncySolver(GoalObjects=entwine_2, Reset=Button(), Threshold=1e-15, Tolerance=0.0001, Damping=0.99, Iterations=10, On=Toggle(True))  # -> I, V, O
item_4 = ListItem(List=bouncysolver_2.O, Index=0, Wrap=True)
medges_7 = MeshEdges(Mesh=item_4)  # -> NakedEdges, InteriorEdges, NonManifoldEdges
preview_16 = CustomPreview(Geometry=item_4, Material=ColourSwatch(SwatchColor=RGB(255, 255, 255)))

disc_3 = Discontinuity(Curve=crv_5, Level=1)  # -> Points, Parameters
avr_5 = Average(Input=disc_3.Points)
lng_6 = ListLength(List=disc_3.Points)
dup_3 = DuplicateData(Data=avr_5, Number=lng_6, Order=True)
ln_3 = Line(StartPoint=disc_3.Points, EndPoint=avr_5)
number_slider_4 = Slider(0, range=0..2)
ext_3 = ExtendCurve(Curve=ln_3, Type=number_slider_4, Start=number_slider_4, End=Slider(-0.4, range=-1..0))
shift_3 = ShiftList(List=ext_3, Shift=1, Wrap=True)
rulesrf_3 = RuledSurface(CurveA=shift_3, CurveB=ext_3)
mesh_uv_3 = MeshSurface(Surface=rulesrf_3, UCount=5, VCount=5, Overhang=True, Equalize=False)
mjoin_3 = MeshJoin(Meshes=mesh_uv_3)
weldvertices_3 = MeshWeldVertices(Mesh=mjoin_3, Tolerance=0.01)  # -> RuntimeMessage, Mesh
nv_3 = NakedVertices(Mesh=weldvertices_3.Mesh)  # -> ClothedIndex, NakedIndex, ClothedPts, NakedPts
medges_8 = MeshEdges(Mesh=weldvertices_3.Mesh)  # -> NakedEdges, InteriorEdges, NonManifoldEdges
demesh_3 = DeconstructMesh(Mesh=weldvertices_3.Mesh)  # -> Vertices, Faces, Colours, Normals
midpt_3 = CurveMiddle(Curve=medges_8.NakedEdges)
pull_6 = PullPoint(Point=nv_3.NakedPts, Geometry=crv_5, ClosestOnly=True)  # -> ClosestPoint, Distance
avr_6 = Average(Input=midpt_3)
smaller_6 = SmallerThan(FirstNumber=pull_6.Distance, SecondNumber=Slider(0.1, range=0.1..0.11))  # -> SmallerThan, OrEqualTo
dist_3 = Distance(PointA=midpt_3, PointB=avr_6)
smaller_7 = SmallerThan(FirstNumber=dist_3, SecondNumber=Slider(3.18, range=0..5))  # -> SmallerThan, OrEqualTo
cull_5 = CullPattern(List=nv_3.NakedPts, CullPattern=smaller_6.SmallerThan)
cull_6 = CullPattern(List=medges_8.NakedEdges, CullPattern=smaller_7.SmallerThan)
len_5 = Length(Curve=medges_8.InteriorEdges)
len_6 = Length(Curve=cull_6)
vec = VectorXYZ(XComponent=Slider(0.68, range=-10..10), YComponent=0, ZComponent=Slider(2.3, range=0..10))  # -> Vector, Length
anchor_3 = Anchor(Point=cull_5, Strength=10000)
load_3 = Load(Point=demesh_3.Vertices, ForceVector=vec.Vector, Weighting=1)
show_3 = Show(G=weldvertices_3.Mesh)

# ---- group: All other segments
multiplication_8 = Multiplication(A=len_5, B=Slider(0, range=0..1))
length_line_5 = LengthLine(Line=medges_8.InteriorEdges, Length=multiplication_8, Strength=Slider(16, range=0..100))

# ---- group: Central Ring
multiplication_9 = Multiplication(A=len_6, B=Slider(0, range=0..1))
length_line_6 = LengthLine(Line=cull_6, Length=multiplication_9, Strength=Slider(10000, range=0..10000))

# ----
entwine_3 = Entwine(Branch00=show_3, Branch01=length_line_5, Branch02=length_line_6, Branch03=load_3, Branch04=anchor_3, FlattenInputs=True)
bouncysolver_3 = BouncySolver(GoalObjects=entwine_3, Reset=Button(), Threshold=1e-15, Tolerance=0.0001, Damping=0.99, Iterations=10, On=Toggle(True))  # -> I, V, O
item_5 = ListItem(List=bouncysolver_3.O, Index=0, Wrap=True)
medges_9 = MeshEdges(Mesh=item_5)  # -> NakedEdges, InteriorEdges, NonManifoldEdges
preview_17 = CustomPreview(Geometry=item_5, Material=ColourSwatch(SwatchColor=RGB(255, 255, 255)))
