# Grasshopper definition Studio - Wasp Combined Fields.gh (Grasshopper 1.0.7)
# plug-ins: Pufferfish, Human, MetaHopper, ShapeDiverForGrasshopper

sddp = ShapeDiverDocumentPayload({AbsoluteTolerance=0, AngleTolerance=0, DistanceDisplayPrecision=0, GltfVersion="Gltf2", GrasshopperVersion="1.0.0007", InputGroups="{}", OutputGroups="{}", RelativeTolerance=0, RhinoVersion="7.36.23346.16351", UnitSystem=0, VersionCreated="1.14.0.0", VersionSaved="1.14.0.0"})
mesh = Mesh(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)
mesh_2 = Mesh(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)
msplit = MeshSplit(Mesh=mesh, Splitters=mesh_2)

item = ListItem(List=msplit, Index="1", Wrap=True)
Z = UnitZ(Factor=1)
move = Move(Geometry=item, Motion=Z)  # -> Geometry, Transform
medges = MeshEdges(Mesh=move.Geometry)  # -> NakedEdges, InteriorEdges, NonManifoldEdges
previewlw = CustomPreviewLineweights(
    Geometry=medges.NakedEdges,
    Shader=ColourSwatch(SwatchColor=RGB(0, 0, 0)),
    Thickness=Slider(2, range=0..100),
    Absolute=False)

contour = Contour(Shape=item, Point=Point(0, 0, 0), Direction=Vector(0, 0, 1), Distance=Slider(5, range=0..50))
patch = Patch(Curves=flatten(contour), Spans=20, Flexibility=1, Trim=True)

preview = CustomPreview(Geometry=item, Material=ColourSwatch(SwatchColor=RGB(194, 194, 194)))  # disabled

connections_centers = Point(<point referenced from the Rhino model>)
connections_x_axis = Curve(<curve referenced from the Rhino model>)

connections_centers_2 = Point([<point referenced from the Rhino model> x3])
connections_x_axis_2 = Curve([<curve referenced from the Rhino model> x3])

connections_centers_3 = Point([<point referenced from the Rhino model> x2])
connections_x_axis_3 = Curve([<curve referenced from the Rhino model> x2])

connections_x_axis_4 = Curve(<curve referenced from the Rhino model>)
connections_centers_4 = Point(<point referenced from the Rhino model>)

connections_centers_5 = Point(<point referenced from the Rhino model>)
connections_x_axis_5 = Curve(<curve referenced from the Rhino model>)

connections_x_axis_6 = Curve(<curve referenced from the Rhino model>)
connections_centers_6 = Point(<point referenced from the Rhino model>)

connections_x_axis_7 = Curve([<curve referenced from the Rhino model> x2])
connections_centers_7 = Point([<point referenced from the Rhino model> x2])

connections_centers_8 = Point([<point referenced from the Rhino model> x3])
connections_x_axis_8 = Curve([<curve referenced from the Rhino model> x3])

connections_centers_9 = Point([<point referenced from the Rhino model> x2])
connections_x_axis_9 = Curve([<curve referenced from the Rhino model> x2])

part_geometry = Brep(<brep referenced from the Rhino model>)

connections_centers_10 = Point(<point referenced from the Rhino model>)
connections_x_axis_10 = Curve(<curve referenced from the Rhino model>)

connections_x_axis_11 = Curve([<curve referenced from the Rhino model> x2])
connections_centers_11 = Point([<point referenced from the Rhino model> x2])

dom = ConstructDomain(DomainStart=Slider(0.3, range=0..1), DomainEnd=Slider(0.46, range=0..1))
dom_2 = ConstructDomain(DomainStart=Slider(0.15, range=0..1), DomainEnd=Slider(0.33, range=0..1))
dom² = ConstructDomain²(DomainU=dom_2, DomainV=dom)
subsrf = Isotrim(Surface=patch, Domain=dom²)
points = PointList(Points=connections_centers_11, Size=Slider(1, range=0..10))

# ---- group: Terrain from Sample
# Terrain
geo = Geometry(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)

# ---- group: Project Terrain
geo_2 = Geometry(subsrf)

# ----
geo_3 = Geometry(part_geometry)
attribute = Wasp_Attribute(ID="VCUBE", VAL=geo_3, TR=Toggle(True))  # -> ATTR; inputs VAL: list, TR: Boolean; plug-in component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

part_name = Panel("VCUBE")

contour_2 = Contour(Shape=geo_2, Point=Point(0, 0, 0), Direction=Vector(0, 0, 1), Distance=Slider(5, range=0..50))
preview_2 = CustomPreview(Geometry=geo_2, Material=ColourSwatch(SwatchColor=RGB(214, 214, 214)))
preview_3 = CustomPreview(Geometry=contour_2, Material=ColourSwatch(SwatchColor=RGB(0, 0, 0)))

mesh_3 = MeshBrep(
    Brep=subsrf,
    Settings={GridMaxCount=0, GridMinCount=16, JaggedSeams=False, MaxEdgeLength=0, MinEdgeLength=0.0001, MinTolerance=0, Refine=True, RefineAngle=0, RelativeTolerance=0.65, SimplePlanes=True, Tolerance=0})

geo_4 = Geometry(<brep referenced from the Rhino model>)
attribute_2 = Wasp_Attribute(ID="OCTA", VAL=geo_4, TR=Toggle(True))  # -> ATTR; inputs VAL: list, TR: Boolean; plug-in component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

offmsh = OffsetMesh(Mesh=mesh_3, Distance=Slider(5.9, range=0..50), BothSides=0, CreateSolid=True)
toggle = BooleanToggle(True)
panel = Panel("""OCT
CUBE""")
advpart = Wasp_AdvancedPart()  # -> PART; inputs GEO: Mesh, CONN: list, HI: list, ATTR: list, SUP: list, AEC: list, OC: list; plug-in component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
meshconst = Wasp_MeshConstraint(GEO=offmsh, IN=Toggle(True), SOFT=Toggle(True), PART=panel)  # -> GC; inputs GEO: Mesh, IN: Boolean, SOFT: Boolean, REQ: Boolean, PART: list; plug-in component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
advpart_2 = Wasp_AdvancedPart()  # -> PART; inputs GEO: Mesh, CONN: list, HI: list, ATTR: list, SUP: list, AEC: list, OC: list; plug-in component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

# ---- group: Guide Curve
crv = Curve(<curve referenced from the Rhino model>)

crv_2 = Curve(<curve referenced from the Rhino model>)

# ---- group: Terrain
geo_5 = Geometry(geo_2)

# ----
relay = Relay()
relay_2 = Relay()
dom_3 = ConstructDomain(DomainStart=Slider(1, range=0..3), DomainEnd=Slider(0, range=0..100))
p_p = Panel("""OCT_SIDE>CUBE_SIDE
CUBE_SIDE>OCT_SIDE
OCT_SIDE>VCUBE_SIDE
VCUBE_SIDE>OCT_SIDE""")
p_p_2 = Panel("""OCT_SIDE>CUBE_SIDE
CUBE_SIDE>OCT_SIDE
CUBE_BOTTOM>CUBE_TOP
CUBE_TOP>CUBE_BOTTOM""")
panel_2 = Panel("""HEX|0_CUBE|0
HEX|0_CUBE|1
HEX|1_CUBE|0
HEX|1_CUBE|1
HEX|2_CUBE|0
HEX|2_CUBE|1
CUBE|0_HEX|0
CUBE|0_HEX|1
CUBE|0_HEX|2
CUBE|1_HEX|0
CUBE|1_HEX|1
CUBE|1_HEX|2
CUBE|3_CUBE|2
CUBE|2_CUBE|3""")
ruletxt = Wasp_RuleFromText(TXT=panel_2)  # -> R; plug-in component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

# ----
# 1. Build Part
# Parts are the building blocks of Wasp.
# The most basic way of initializing a part is to define t he geometry (as brep or mesh),
# and the connection faces (center and orientation - with a line). Parts must be named
# to be identifyed in the aggregation rules.
panel_3 = Panel("CUBE_TOP")
# Units
part_geometry_2 = Brep(<brep referenced from the Rhino model>)
part_geometry_3 = Brep(<brep referenced from the Rhino model>)
points_2 = PointList(Points=connections_centers_3, Size=Slider(1, range=0..10))
conndir = Wasp_ConnectionFromDirection(GEO=part_geometry_2, CEN=connections_centers_2, UP=connections_x_axis_2, T="HEX_SIDE")  # -> CONN, PLN_OUT; inputs CEN: list of Point3d, UP: list of Curve, T: list; plug-in component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
conndir_2 = Wasp_ConnectionFromDirection(GEO=part_geometry_3, CEN=connections_centers_3, UP=connections_x_axis_3, T="CUBE_SIDE")  # -> CONN, PLN_OUT; inputs CEN: list of Point3d, UP: list of Curve, T: list; plug-in component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
conndir_3 = Wasp_ConnectionFromDirection(GEO=part_geometry_3, CEN=connections_centers, UP=connections_x_axis, T=panel_3)  # -> CONN, PLN_OUT; inputs CEN: list of Point3d, UP: list of Curve, T: list; plug-in component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
conndir_4 = Wasp_ConnectionFromDirection(GEO=part_geometry_3, CEN=connections_centers_4, UP=connections_x_axis_4, T="CUBE_BOTTOM")  # -> CONN, PLN_OUT; inputs CEN: list of Point3d, UP: list of Curve, T: list; plug-in component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
points_3 = PointList(Points=connections_centers_2, Size=Slider(1, range=0..10))
merge = Merge(Data1=conndir_2.CONN, Data2=conndir_3.CONN, Data3=conndir_4.CONN)
part_name_2 = Panel("CUBE")
part_name_3 = Panel("HEX")

geo_6 = Geometry(part_geometry_3)
attribute_3 = Wasp_Attribute(ID="CUBE", VAL=geo_6, TR=Toggle(True))  # -> ATTR; inputs VAL: list, TR: Boolean; plug-in component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

geo_7 = Geometry(part_geometry_2)
attribute_4 = Wasp_Attribute(ID="HEX", VAL=geo_7, TR=Toggle(True))  # -> ATTR; inputs VAL: list, TR: Boolean; plug-in component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

part = Wasp_BasicPart(NAME=part_name_3, GEO=part_geometry_2, CONN=flatten(conndir.CONN), ATTR=attribute_4)  # -> PART; inputs GEO: Mesh, CONN: list, ATTR: list; plug-in component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
part_2 = Wasp_BasicPart(NAME=part_name_2, GEO=part_geometry_3, CONN=flatten(merge), ATTR=attribute_3)  # -> PART; inputs GEO: Mesh, CONN: list, ATTR: list; plug-in component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

merge_2 = Merge(Data1=part, Data2=part_2)

# ----
# Units 2
part_geometry_4 = Brep(<brep referenced from the Rhino model>)
part_geometry_5 = Brep(<brep referenced from the Rhino model>)
points_4 = PointList(Points=connections_centers_6, Size=Slider(1, range=0..10))
conndir_5 = Wasp_ConnectionFromDirection(GEO=part_geometry_4, CEN=connections_centers_8, UP=connections_x_axis_8, T="HEX_SIDE")  # -> CONN, PLN_OUT; inputs CEN: list of Point3d, UP: list of Curve, T: list; plug-in component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
conndir_6 = Wasp_ConnectionFromDirection(GEO=part_geometry_5, CEN=connections_centers_6, UP=connections_x_axis_6, T="CUBE_SIDE")  # -> CONN, PLN_OUT; inputs CEN: list of Point3d, UP: list of Curve, T: list; plug-in component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
conndir_7 = Wasp_ConnectionFromDirection(GEO=part_geometry_5, CEN=connections_centers_5, UP=connections_x_axis_5, T="CUBE_TOP")  # -> CONN, PLN_OUT; inputs CEN: list of Point3d, UP: list of Curve, T: list; plug-in component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
conndir_8 = Wasp_ConnectionFromDirection(GEO=part_geometry_5, CEN=connections_centers_10, UP=connections_x_axis_10, T="CUBE_BOTTOM")  # -> CONN, PLN_OUT; inputs CEN: list of Point3d, UP: list of Curve, T: list; plug-in component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
points_5 = PointList(Points=connections_centers_8, Size=Slider(2, range=0..10))
merge_3 = Merge(Data1=conndir_6.CONN, Data2=conndir_7.CONN, Data3=conndir_8.CONN)
part_name_4 = Panel("CUBE")
part_name_5 = Panel("HEX")

geo_8 = Geometry(part_geometry_5)
attribute_5 = Wasp_Attribute(ID="CUBE", VAL=geo_8, TR=Toggle(True))  # -> ATTR; inputs VAL: list, TR: Boolean; plug-in component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

geo_9 = Geometry(part_geometry_4)
attribute_6 = Wasp_Attribute(ID="HEX", VAL=geo_9, TR=Toggle(True))  # -> ATTR; inputs VAL: list, TR: Boolean; plug-in component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

part_3 = Wasp_BasicPart(NAME=part_name_5, GEO=part_geometry_4, CONN=flatten(conndir_5.CONN), ATTR=attribute_6)  # -> PART; inputs GEO: Mesh, CONN: list, ATTR: list; plug-in component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
part_4 = Wasp_BasicPart(NAME=part_name_4, GEO=part_geometry_5, CONN=flatten(merge_3), ATTR=attribute_5)  # -> PART; inputs GEO: Mesh, CONN: list, ATTR: list; plug-in component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

merge_4 = Merge(Data1=part_3, Data2=part_4)

# ----
# Units 3
part_geometry_6 = Brep(<brep referenced from the Rhino model>)
part_geometry_7 = Brep(<brep referenced from the Rhino model>)
points_6 = PointList(Points=connections_centers_9, Size=Slider(2, range=0..10))
points_7 = PointList(Points=connections_centers_7, Size=Slider(1, range=0..10))
conndir_9 = Wasp_ConnectionFromDirection(GEO=part_geometry, CEN=connections_centers_11, UP=connections_x_axis_11, T="VCUBE_SIDE")  # -> CONN, PLN_OUT; inputs CEN: list of Point3d, UP: list of Curve, T: list; plug-in component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
conndir_10 = Wasp_ConnectionFromDirection(GEO=part_geometry_6, CEN=connections_centers_9, UP=connections_x_axis_9, T="OCT_SIDE")  # -> CONN, PLN_OUT; inputs CEN: list of Point3d, UP: list of Curve, T: list; plug-in component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
conndir_11 = Wasp_ConnectionFromDirection(GEO=part_geometry_7, CEN=connections_centers_7, UP=connections_x_axis_7, T="CUBE_SIDE")  # -> CONN, PLN_OUT; inputs CEN: list of Point3d, UP: list of Curve, T: list; plug-in component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
part_name_6 = Panel("CUBE")
part_name_7 = Panel("OCT")
part_5 = Wasp_BasicPart(NAME=part_name_7, GEO=part_geometry_6, CONN=flatten(conndir_10.CONN), ATTR=attribute_2)  # -> PART; inputs GEO: Mesh, CONN: list, ATTR: list; plug-in component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

geo_10 = Geometry(part_geometry_7)
attribute_7 = Wasp_Attribute(ID="CUBE", VAL=geo_10, TR=Toggle(True))  # -> ATTR; inputs VAL: list, TR: Boolean; plug-in component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

part_6 = Wasp_BasicPart(NAME=part_name, GEO=part_geometry, CONN=flatten(conndir_9.CONN), ATTR=attribute)  # -> PART; inputs GEO: Mesh, CONN: list, ATTR: list; plug-in component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

part_7 = Wasp_BasicPart(NAME=part_name_6, GEO=part_geometry_7, CONN=flatten(conndir_11.CONN), ATTR=attribute_7)  # -> PART; inputs GEO: Mesh, CONN: list, ATTR: list; plug-in component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

merge_5 = Merge(Data1=part_5, Data2=part_2)

p_p_3 = Panel("""OCT_SIDE>CUBE_SIDE
CUBE_SIDE>OCT_SIDE
OCT_SIDE>VCUBE_SIDE
VCUBE_SIDE>OCT_SIDE""")
rulegen = Wasp_RulesGenerator(PART=merge_5, GR=p_p_3)  # -> R; inputs PART: list, SELF_P: Boolean, SELF_C: Boolean, TYP: Boolean, GR: list; plug-in component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
stochasticaggregation = Wasp_StochasticAggregation(PART=flatten(merge_5), N=Slider(11, range=0..200), RULES=rulegen, RESET=Button())  # -> AGGR, PART_OUT; inputs PART: list, PREV: list, N: Int32, RULES: list, SEED: Int32, MODE: Int32, GC: list, RESET: Boolean; plug-in component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

partgeo = Wasp_GetPartGeometry(PART=stochasticaggregation.PART_OUT)  # -> GEO; plug-in component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
Z_2 = UnitZ(Factor=Slider(-4.5, range=-10..0))
move_2 = Move(Geometry=partgeo, Motion=Z_2)  # -> Geometry, Transform
preview_4 = CustomPreview(Geometry=move_2.Geometry, Material=ColourSwatch(SwatchColor=RGB(255, 255, 255)))

rulegen_2 = Wasp_RulesGenerator(PART=merge_5, SELF_P=Toggle(False))  # -> R; inputs PART: list, SELF_P: Boolean, SELF_C: Boolean, TYP: Boolean, GR: list; plug-in component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

bbox = BoundingBox(Content=geo_2, Plane=PlaneXY(0, 0, 0))  # -> Box, Box_2
volume = Volume(Geometry=bbox.Box)  # -> Volume, Centroid
scale_nu = ScaleNU(
    Geometry=bbox.Box,
    Plane=volume.Centroid,
    ScaleX=Slider(1, range=0..10),
    ScaleY=Slider(1, range=0..10),
    ScaleZ=Slider(1.19, range=0..10))  # -> Geometry, Transform
# Fields
fieldpts = Wasp_FieldPoints(BOU=scale_nu.Geometry, RES=Slider(6, range=0..50))  # -> E_FIELD, PTS; inputs BOU: list of Mesh, PLN: Plane; plug-in component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
panel_4 = Panel("srfField")

# ----
# Height Field Values
pt = Point(fieldpts.PTS)
pdecon = Deconstruct(Point=pt)  # -> XComponent, YComponent, ZComponent
bnd = Bounds(Numbers=pdecon.ZComponent)
dom_4 = ConstructDomain(DomainStart=Slider(2, range=0..2), DomainEnd=Slider(1, range=0..2))
remap = RemapNumbers(Value=pdecon.ZComponent, Source=bnd, Target=dom_4)  # -> Mapped, Clipped
graph = GraphMapper(remap.Mapped, x0=0, x1=1, y0=0, y1=1, container_name="Bezier", cpx=[0, 0.3765036762, 0.6050803661, 1], cpy=[0, 0, 1, 1])

geo_11 = Geometry(geo_2)  # disabled
# Surface Slope Field Values (Not used here)
pt_2 = Point(fieldpts.PTS)  # disabled
# Any Additional Fields
toggle_2 = GroupToggle(ToggleActive=True, ToggleVisible=False)  # disabled
srf_cp = SurfaceClosestPoint(Point=pt_2, Surface=geo_11)  # -> Point, UVPoint, Distance; disabled
evalsrf = EvaluateSurface(Surface=geo_11, Point=srf_cp.UVPoint)  # -> Point, Normal, UDirection, VDirection, Frame; disabled
Z_3 = UnitZ(Factor=1)  # disabled
angle = Angle(VectorA=Z_3, VectorB=evalsrf.Normal)  # -> Angle, Reflex; disabled
bnd_2 = Bounds(Numbers=angle.Angle)  # disabled
panel_5 = Panel("1 To 0")  # disabled
remap_2 = RemapNumbers(Value=angle.Angle, Source=bnd_2, Target=panel_5)  # -> Mapped, Clipped; disabled
graph_2 = GraphMapper(remap_2.Mapped, x0=0, x1=1, y0=0, y1=1, container_name="Bezier", cpx=[0, 0.25, 0.75, 1], cpy=[0, 0.25, 0.75, 1])  # disabled

geo_12 = Geometry(geo_2)
pull = PullPoint(Point=fieldpts.PTS, Geometry=geo_12, ClosestOnly=True)  # -> ClosestPoint, Distance
pdecon_2 = Deconstruct(Point=pull.ClosestPoint)  # -> XComponent, YComponent, ZComponent
# Surface Field Values (Terrain)
pdecon_3 = Deconstruct(Point=fieldpts.PTS)  # -> XComponent, YComponent, ZComponent
smaller = SmallerThan(FirstNumber=pdecon_3.ZComponent, SecondNumber=pdecon_2.ZComponent)  # -> SmallerThan, OrEqualTo
dispatch = Dispatch(List=pull.Distance, DispatchPattern=smaller.SmallerThan)  # -> ListA, ListB
dom_5 = ConstructDomain(DomainStart=Slider(1, range=0..1), DomainEnd=Slider(0, range=0..100))
bnd_3 = Bounds(Numbers=dispatch.ListB)
remap_3 = RemapNumbers(Value=dispatch.ListB, Source=bnd_3, Target=dom_5)  # -> Mapped, Clipped
lng = ListLength(List=dispatch.ListA)
repeat = RepeatData(Data=Slider(0, range=0..100), Length=lng)
graph_3 = GraphMapper(
    remap_3.Mapped,
    x0=0,
    x1=1,
    y0=0,
    y1=1,
    container_name="Bezier",
    cpx=[0, 0.8434559107, 1, 1],
    cpy=[0, 0, 0.07525634766, 1])
weave = Weave(Pattern=smaller.SmallerThan, Stream0=graph_3, Stream1=repeat, NullGaps=False)

project = Project(Curve=crv, Brep=geo_5, Direction=Vector(0, 0, 1))
# Curve Field Values
pt_3 = Point(fieldpts.PTS)
pull_2 = PullPoint(Point=pt_3, Geometry=flatten(project), ClosestOnly=True)  # -> ClosestPoint, Distance
bnd_4 = Bounds(Numbers=dispatch.ListB)
dom_6 = ConstructDomain(DomainStart=Slider(1, range=0..1), DomainEnd=Slider(0, range=0..100))
remap_4 = RemapNumbers(Value=pull_2.Distance, Source=bnd_4, Target=dom_6)  # -> Mapped, Clipped
graph_4 = GraphMapper(remap_4.Mapped, x0=0, x1=1, y0=0, y1=1, container_name="Bezier", cpx=[0, 1, 1, 1], cpy=[0, 0, 0.1247724891, 1])

curvepoint = PointOnCurve(project, parameter=0)
pipe = Pipe(Curve=project, Radius=Slider(4, range=0..100), Caps=2)  # disabled
cap = CapHoles(Brep=pipe)  # disabled
pull_3 = PullPoint(Point=pt_3, Geometry=flatten(curvepoint), ClosestOnly=True)  # -> ClosestPoint, Distance
bnd_5 = Bounds(Numbers=pull_3.Distance)
remap_5 = RemapNumbers(Value=pull_3.Distance, Source=bnd_5, Target=dom_3)  # -> Mapped, Clipped

# ---- group: Preview Field Points
gradient = Gradient(LowerLimit=0, UpperLimit=1, Parameter=weave, stops=[0: RGB(0, 128, 0), 0.5: RGB(255, 255, 0), 1: RGB(255, 0, 0)])
preview_5 = CustomPreview(Geometry=fieldpts.PTS, Material=gradient)

gradient_2 = Gradient(LowerLimit=0, UpperLimit=1, Parameter=graph_2, stops=[0: RGB(255, 0, 0), 0.5: RGB(255, 255, 0), 1: RGB(0, 128, 0)])
preview_6 = CustomPreview(Geometry=evalsrf.Point, Material=gradient_2)

# ----
multiplication = Multiplication(A=graph, B=Slider(1.37, range=0..10))

# ---- group: Preview Field Points
gradient_3 = Gradient(LowerLimit=0, UpperLimit=1, Parameter=graph, stops=[0: RGB(0, 128, 0), 0.5: RGB(255, 255, 0), 1: RGB(255, 0, 0)])
preview_7 = CustomPreview(Geometry=pt, Material=gradient_3)

# ----
multiplication_2 = Multiplication(A=graph_4, B=Slider(4.98, range=0..10))

# ---- group: Preview Field Points
gradient_4 = Gradient(
    LowerLimit=0,
    UpperLimit=1,
    Parameter=multiplication_2,
    stops=[0: RGB(0, 128, 0), 0.5: RGB(255, 255, 0), 1: RGB(255, 0, 0)])
preview_8 = CustomPreview(Geometry=pt_3, Material=gradient_4)

# ---- group: Combining Fields Inputs
multiplication_3 = Multiplication(A=weave, B=multiplication_2, C=multiplication)

# ----
# Combined
# Fields
field = Wasp_Field(E_FIELD=fieldpts.E_FIELD, VAL=multiplication_3)  # -> FIELD; inputs VAL: list; plug-in component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

p_p_4 = Panel("""HEX_SIDE>CUBE_SIDE
CUBE_SIDE>HEX_SIDE
CUBE_BOTTOM>CUBE_TOP
CUBE_TOP>CUBE_BOTTOM""")
# Aggregation and Rules (Grammar)
number_slider = Slider(514, range=0..1200)
rulegen_3 = Wasp_RulesGenerator(PART=merge_5, GR=p_p_2)  # -> R; inputs PART: list, SELF_P: Boolean, SELF_C: Boolean, TYP: Boolean, GR: list; plug-in component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
fieldaggregation = Wasp_FieldDrivenAggregation(
    PART=flatten(merge_5),
    N=number_slider,
    RULES=rulegen_3,
    FIELD=field,
    MODE=Slider(0, range=0..3),
    GC=meshconst,
    RESET=Button())  # -> AGGR, PART_OUT; inputs PART: list, PREV: list, N: Int32, RULES: list, FIELD: list, MODE: Int32, GC: list, RESET: Boolean; plug-in component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

# ---- group: Preview Field Points
gradient_5 = Gradient(
    LowerLimit=0,
    UpperLimit=1,
    Parameter=multiplication_3,
    stops=[0: RGB(0, 128, 0), 0.5: RGB(255, 255, 0), 1: RGB(255, 0, 0)])
preview_9 = CustomPreview(Geometry=fieldpts.PTS, Material=gradient_5)

# ----
lng_2 = ListLength(List=fieldaggregation.PART_OUT)
getattr = Wasp_GetAttributeByName(PART=fieldaggregation.PART_OUT, ID="house")  # -> VAL; plug-in component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
random = Random(Range=Slider(2, range=0..10), Number=lng_2, Seed=2, Integers=True)
merge_6 = Merge(
    Data1=ColourSwatch(SwatchColor=RGB(42, 181, 14)),
    Data2=ColourSwatch(SwatchColor=RGB(110, 255, 0)),
    Data3=ColourSwatch(SwatchColor=RGB(207, 255, 77)))
item_2 = ListItem(List=merge_6, Index=random, Wrap=True)
preview_10 = CustomPreview(Geometry=flatten(getattr), Material=item_2)

# ----
# Output Preview
partgeo_2 = Wasp_GetPartGeometry(PART=fieldaggregation.PART_OUT)  # -> GEO; plug-in component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
Z_4 = UnitZ(Factor=Slider(-5.43, range=-10..0))
move_3 = Move(Geometry=partgeo_2, Motion=Z_4)  # -> Geometry, Transform
preview_11 = CustomPreview(Geometry=move_3.Geometry, Material=ColourSwatch(SwatchColor=RGBA(255, 255, 255, 99)))

getattr_2 = Wasp_GetAttributeByName(PART=fieldaggregation.PART_OUT, ID="OCTA")  # -> VAL; plug-in component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
move_4 = Move(Geometry=getattr_2, Motion=Z_4)  # -> Geometry, Transform
preview_12 = CustomPreview(Geometry=move_4.Geometry, Material=ColourSwatch(SwatchColor=RGB(117, 0, 0)))  # disabled
angsplitmsh = AngleSplitMesh(Mesh=move_3.Geometry, Angle=0, Opposite=False)  # -> Split, R
medges_2 = MeshEdges(Mesh=angsplitmsh.Split)  # -> NakedEdges, InteriorEdges, NonManifoldEdges
geo_13 = Geometry(medges_2.NakedEdges)
previewlw_2 = CustomPreviewLineweights(Geometry=geo_13, Shader=ColourSwatch(SwatchColor=RGB(0, 0, 0)), Thickness=Slider(2, range=0..100), Absolute=False)
