# Grasshopper definition agree1.gh (Grasshopper 1.0.7)
# plug-ins: Human, Pufferfish, Speckle 2, MeshEdit Components, treesloth01, MetaHopper

# ----
# Press the button to make sure the file is
# updated to latest Wasp version on your pc.
button = Button()
# # Wasp: Discrete Design with Grasshopper plug-in (GPL) initiated by Andrea Rossi
# 
# 
# This file is part of Wasp.
# 
# Copyright (c) 2021, Andrea Rossi <a.rossi.andrea@gmail.com>
# 
# Wasp is free software; you can redistribute it and/or modify it under the terms of the GNU General Public License as published by the Free Software Foundation; either version 3 of the License, or (at your option) any later version.
# 
# Wasp is distributed in the hope that it will be useful, but WITHOUT ANY WARRANTY; without even the implied warranty of MERCHANTABILITY or FITNESS FOR A PARTICULAR PURPOSE. See the GNU General Public License for more details. You should have received a copy of the GNU General Public License
#  along with Wasp; If not, see <http://www.gnu.org/licenses/>.
# 
# license GPL-3.0 <https://www.gnu.org/licenses/gpl.html>
# 
# Significant parts of Wasp have been developed by Andrea Rossi as part of research on digital materials and discrete design at DDU Digital Design Unit - Prof. Oliver Tessmann - Technische Universität Darmstadt
updatefile = Wasp_UpdateFile(UPDATE=button)  # -> LOG; inputs UPDATE: Boolean; plug-in component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

# ----
# GetSiteGeometry
panel = Panel("https://macad.speckle.xyz/streams/4975f9f0a8/branches/site%2F00-federated-model")
receive = Receive(
    Stream=panel,
    AutoReceive=False,
    CurrentComponentState="up_to_date",
    ExpandOutput=True,
    LastInfoMessage="James McBennett @ 01/19/2024 01:06:29: Pushed 38 elements from Grasshopper. (id:b5d4e56588)",
    ReceiveOnOpen=False,
    ReceivedCommitId="b5d4e56588",
    StreamWrapper="https://macad.speckle.xyz/streams/4975f9f0a8/branches/site/00-federated-model",
    selectedKitName="Objects")  # -> Info, CollectionType, Elements, Info_2, Levels, Name, Types
dso = DeconstructSpeckleObject(SpeckleObject=receive.Elements, selectedKitName="Objects")  # -> CollectionType, Elements, Name
dso_2 = DeconstructSpeckleObject(SpeckleObject=dso.Elements, selectedKitName="Objects")  # -> BaseGeometry, BaseLine, BuiltInCategory, Category, DisplayValue, ElementId, IsRevitLinkedModel, Label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

panel_2 = Panel("https://macad.speckle.xyz/streams/4975f9f0a8/commits/6c185bed15")
receive_2 = Receive(
    Stream=panel_2,
    AutoReceive=False,
    CurrentComponentState="up_to_date",
    ExpandOutput=True,
    LastInfoMessage="James McBennett @ 01/20/2024 17:54:06: Pushed 5 elements from Grasshopper. (id:6c185bed15)",
    ReceiveOnOpen=False,
    ReceivedCommitId="6c185bed15",
    StreamWrapper="https://macad.speckle.xyz/streams/4975f9f0a8/commits/6c185bed15",
    selectedKitName="Objects")  # -> Info, Data
dso_3 = DeconstructSpeckleObject(SpeckleObject=receive_2.Data, selectedKitName="Objects")  # -> GROUPNAME, SPHERELOCATION
volume = MeshVolume(Mesh=dso_3.SPHERELOCATION)  # -> Volume, Centroid
mesh = Mesh(dso_3.SPHERELOCATION)
pt = Point(Point(5162.282679, 9203.55205, 6173.502166))
crv = Curve(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)
panel_3 = Panel("https://macad.speckle.xyz/streams/4975f9f0a8/branches/site%2F00-federated-model")
panel_4 = Panel("https://macad.speckle.xyz/streams/4975f9f0a8/commits/6c185bed15")
swatch = ColourSwatch(SwatchColor=RGB(255, 0, 0))  # disabled
receive_3 = Receive(
    Stream=panel_4,
    AutoReceive=False,
    CurrentComponentState="up_to_date",
    ExpandOutput=True,
    LastInfoMessage="James McBennett @ 01/20/2024 17:54:06: Pushed 5 elements from Grasshopper. (id:6c185bed15)",
    ReceiveOnOpen=False,
    ReceivedCommitId="6c185bed15",
    StreamWrapper="https://macad.speckle.xyz/streams/4975f9f0a8/commits/6c185bed15",
    selectedKitName="Objects")  # -> Info, Data
receive_4 = Receive(
    Stream=panel_3,
    AutoReceive=False,
    CurrentComponentState="up_to_date",
    ExpandOutput=True,
    LastInfoMessage="James McBennett @ 01/19/2024 01:06:29: Pushed 38 elements from Grasshopper. (id:b5d4e56588)",
    ReceiveOnOpen=False,
    ReceivedCommitId="b5d4e56588",
    StreamWrapper="https://macad.speckle.xyz/streams/4975f9f0a8/branches/site/00-federated-model",
    selectedKitName="Objects")  # -> Info, CollectionType, Elements, Info_2, Levels, Name, Types
dso_4 = DeconstructSpeckleObject(SpeckleObject=receive_3.Data, selectedKitName="Objects")  # -> GROUPNAME, SPHERELOCATION
previewmat = CustomPreviewMaterials(Geometry=mesh, DiffuseColor=swatch, Transparency=Slider(0.747, range=0..1))  # disabled
volume_2 = MeshVolume(Mesh=dso_4.SPHERELOCATION)  # -> Volume, Centroid

pt_2 = Point([<point referenced from the Rhino model> x3])
crv_2 = Curve([<curve referenced from the Rhino model> x3])
# 0_07_Save_Load_Aggregation
geo = Geometry(<brep referenced from the Rhino model>)
pt_3 = Point([<point referenced from the Rhino model> x4])
crv_3 = Curve([<curve referenced from the Rhino model> x4])
geo_2 = Geometry(<brep referenced from the Rhino model>)
volume_3 = Volume(Geometry=geo)  # -> Volume, Centroid
stack = StackTrees(Data0=geo, Data1=pt_2, Data2=crv_2, Reduce=True)
avr = Average(Input=volume_3.Centroid)
stack_2 = StackTrees(Data0=geo_2, Data1=pt_3, Data2=crv_3, Reduce=True)
move2pt = MoveToPoint(Geometry=stack, PointA=avr, PointB=volume_2.Centroid)  # -> simplify(Moved), Vector, Transform
move2pt_2 = MoveToPoint(Geometry=stack_2, PointA=avr, PointB=volume_2.Centroid)  # -> simplify(Moved), Vector, Transform
bang = ExplodeTree(Data=move2pt.Moved)  # -> Branch0, Branch1, Branch2
bang_2 = ExplodeTree(Data=move2pt_2.Moved)  # -> Branch0, Branch1, Branch2
conndir = Wasp_ConnectionFromDirection(GEO=bang.Branch0, CEN=bang.Branch1, UP=bang.Branch2)  # -> CONN, PLN_OUT; inputs CEN: list of Point3d, UP: list of Curve, T: list; plug-in component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
conndir_2 = Wasp_ConnectionFromDirection(GEO=bang_2.Branch0, CEN=bang_2.Branch1, UP=bang_2.Branch2)  # -> CONN, PLN_OUT; inputs CEN: list of Point3d, UP: list of Curve, T: list; plug-in component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
part = Wasp_BasicPart(NAME="HEX", GEO=bang.Branch0, CONN=flatten(conndir.CONN))  # -> PART; inputs GEO: Mesh, CONN: list, ATTR: list; plug-in component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
part_2 = Wasp_BasicPart(NAME="CUB", GEO=bang_2.Branch0, CONN=flatten(conndir_2.CONN))  # -> PART; inputs GEO: Mesh, CONN: list, ATTR: list; plug-in component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
merge = Merge(Data1=part, Data2=part_2)

mesh_2 = Mesh(dso_4.SPHERELOCATION)
clean = CleanTree(RemoveNulls=True, RemoveInvalid=True, RemoveEmpty=True, Tree=dso_2.BaseLine)
swatch_2 = ColourSwatch(SwatchColor=RGB(138, 138, 138))
clean_2 = CleanTree(RemoveNulls=True, RemoveInvalid=True, RemoveEmpty=True, Tree=dso_2.DisplayValue)  # -> flatten(Tree)
dso_5 = DeconstructSpeckleObject(SpeckleObject=receive_4.Elements, selectedKitName="Objects")  # -> CollectionType, Elements, Name
panel_5 = Panel("{0,0,-1000}")
panel_6 = Panel("""100
200""")
Z = UnitZ(Factor=expr("-x", Slider(353, range=0..10000)))
previewlw = CustomPreviewLineweights(Geometry=clean, Shader=swatch_2, Absolute=False)  # disabled
Z_2 = UnitZ(Factor="10000")
rulegen = Wasp_RulesGenerator(PART=merge, SELF_P=Toggle(False))  # -> R; inputs PART: list, SELF_P: Boolean, SELF_C: Boolean, TYP: Boolean, GR: list; plug-in component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
dso_6 = DeconstructSpeckleObject(SpeckleObject=dso_5.Elements, selectedKitName="Objects")  # -> BaseGeometry, BaseLine, BuiltInCategory, Category, DisplayValue, ElementId, IsRevitLinkedModel, Label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

stochasticaggregation = Wasp_StochasticAggregation(PART=flatten(merge), N=Slider(27, range=1..50), RULES=rulegen, RESET=Button())  # -> AGGR, PART_OUT; inputs PART: list, PREV: list, N: Int32, RULES: list, SEED: Int32, MODE: Int32, GC: list, RESET: Boolean; plug-in component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
partgeo = Wasp_GetPartGeometry(PART=stochasticaggregation.PART_OUT)  # -> GEO; plug-in component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

number_slider = Slider(0.747, range=0..1)  # disabled
item = ListItem(List=clean_2, Index=Slider(0, range=0..2), Wrap=True)
mmx = MeshMesh(MeshA=item, MeshB=mesh)
project = Project(Geometry=item, Plane=Z)  # -> Geometry, Transform
bbox = BoundingBox(Content=project.Geometry, Plane=PlaneXY(0, 0, 0))  # -> Box, Box_2
debrep = DeconstructBrep(Brep=bbox.Box)  # -> Faces, Edges, Vertices
move = Move(Geometry=debrep.Vertices, Motion=Z_2)  # -> Geometry, Transform
swatch_3 = ColourSwatch(SwatchColor=RGB(64, 64, 64))
swatch_4 = ColourSwatch(SwatchColor=RGB(191, 23, 23))
medges = MeshEdges(Mesh=project.Geometry)  # -> NakedEdges, InteriorEdges, NonManifoldEdges
ln = Line(StartPoint=debrep.Vertices, EndPoint=move.Geometry)
mcx = MeshCurve(Mesh=item, Curve=ln)  # -> flatten(Points), Faces
previewmat_2 = CustomPreviewMaterials(Geometry=mesh_2, DiffuseColor=swatch_4, Transparency=number_slider)  # disabled
number_slider_2 = Slider(72, range=0..100)  # disabled
ln_2 = Line(StartPoint=debrep.Vertices, EndPoint=mcx.Points)
# GetSiteGeometry
midpt = CurveMiddle(Curve=ln_2)
len = Length(Curve=ln_2)
round = Round(Number=len)  # -> Nearest, Floor, Ceiling
concat = Concatenate(FragmentA=round.Nearest, FragmentB=" ", FragmentC="M")
tag = TextTag(Location=midpt, Text=concat, Colour=swatch_3)
panel_7 = Panel(len)  # disabled
clean_3 = CleanTree(RemoveNulls=True, RemoveInvalid=True, RemoveEmpty=True, Tree=dso_6.BaseLine)
swatch_5 = ColourSwatch(SwatchColor=RGB(224, 0, 0))  # disabled
swatch_6 = ColourSwatch(SwatchColor=RGB(138, 138, 138))
clean_4 = CleanTree(RemoveNulls=True, RemoveInvalid=True, RemoveEmpty=True, Tree=dso_6.DisplayValue)  # -> flatten(Tree)
contour = Contour(Shape=item, Point=Point(0, 0, 0), Direction=Vector(0, 0, 1), Distance="50")
Z_3 = UnitZ(Factor=expr("-x", Slider(353, range=0..10000)))
previewmat_3 = CustomPreviewMaterials(Geometry=item, DiffuseColor=swatch_2, Transparency=Slider(0.872, range=0..1))
previewlw_2 = CustomPreviewLineweights(Geometry=clean_3, Shader=swatch_6, Absolute=False)
item_2 = ListItem(List=clean_4, Index=Slider(0, range=0..2), Wrap=True)
mmx_2 = MeshMesh(MeshA=item_2, MeshB=mesh_2)
project_2 = Project(Geometry=mmx_2, Plane=PlaneXY(0, 0, 0))  # -> Geometry, Transform
divide = DivideCurve(Curve=project_2.Geometry, Count=4, Kinks=False)  # -> Points, Tangents, Parameters
item_3 = ListItem(List=divide.Points, Index=0, Wrap=True)
popgeo = PopulateGeometry(Geometry=item_2, Count=Slider(51, range=0..100), Seed=1)
sph = Sphere(Base=popgeo, Radius=500)
project_3 = Project(Geometry=item_2, Plane=Z_3)  # -> Geometry, Transform
mesh_3 = Mesh(sph)
angsplitmsh = AngleSplitMesh(Mesh=partgeo, Angle=0, Opposite=False)  # -> Split, R
contour_2 = Contour(Shape=item_2, Point=Point(0, 0, 0), Direction=Vector(0, 0, 1), Distance="50")
medges_2 = MeshEdges(Mesh=project_3.Geometry)  # -> NakedEdges, InteriorEdges, NonManifoldEdges
medges_3 = MeshEdges(Mesh=angsplitmsh.Split)  # -> NakedEdges, InteriorEdges, NonManifoldEdges
previewmat_4 = CustomPreviewMaterials(Geometry=item_2, DiffuseColor=swatch_6, Transparency=Slider(0.623, range=0..1))  # disabled
previewlw_3 = CustomPreviewLineweights(Geometry=[contour_2, medges_2.NakedEdges], Shader=ColourSwatch(SwatchColor=RGB(64, 64, 64)), Absolute=False)
previewlw_4 = CustomPreviewLineweights(Geometry=project_2.Geometry, Shader=swatch_4, Thickness=Slider(3, range=0..10), Absolute=False)
previewmat_5 = CustomPreviewMaterials(
    Geometry=partgeo,
    DiffuseColor=ColourSwatch(SwatchColor=RGBA(255, 255, 255, 204)),
    Transparency=Slider(0.402, range=0..1))
previewlw_5 = CustomPreviewLineweights(Geometry=medges_3.NakedEdges, Shader=ColourSwatch(SwatchColor=RGB(0, 0, 0)), Absolute=False)
mmx_3 = MeshMesh(MeshA=item_2, MeshB=mesh_3)
divide_2 = DivideCurve(Curve=mmx_2, Count=10, Kinks=False)  # -> Points, Tangents, Parameters
msplit = MeshSplit(Mesh=item_2, Splitters=mesh_2)
pdecon = Deconstruct(Point=divide_2.Points)  # -> XComponent, YComponent, ZComponent
item_4 = ListItem(List=msplit, Index=Slider(1, range=0..1), Wrap=True)
bnd = Bounds(Numbers=pdecon.ZComponent)

# ----
# Enable To Upload Geomtry to Speckle Server
toggle = GroupToggle(ToggleActive=True, ToggleVisible=False)  # disabled
link_to_upload_to_our_speckle_server = Panel("https://macad.speckle.xyz/streams/4975f9f0a8/branches/students%2Fg06-site_locations")  # disabled
panel_9 = Panel("SiteLocationSelection")  # disabled
send = Send(
    Stream=link_to_upload_to_our_speckle_server,
    Message=panel_9,
    AutoSend=False,
    CurrentComponentState="needs_input",
    KitName="Objects",
    UseDefaultCache=True,
    selectedKitName="Objects")  # disabled

dedomain = DeconstructDomain(Domain=bnd)  # -> Start, End
previewlw_6 = CustomPreviewLineweights(Geometry=mmx_2, Shader=ColourSwatch(SwatchColor=RGB(143, 26, 26)), Thickness=Slider(3, range=0..10), Absolute=False)
equals = Equality(FirstNumber=pdecon.ZComponent, SecondNumber=dedomain.Start)  # -> Equality, Inequality
panel_10 = Panel(bnd)
cull = CullPattern(List=divide_2.Points, CullPattern=equals.Equality)  # -> flatten(List)
project_4 = Project(Geometry=cull, Plane=popgeo)  # -> Geometry, Transform
vec2pt = Vector2Pt(PointA=volume_2.Centroid, PointB=cull, Unitize=False)  # -> Vector, Length
ln_3 = Line(StartPoint=volume_2.Centroid, EndPoint=cull)
vec2pt_2 = Vector2Pt(PointA=popgeo, PointB=cull, Unitize=False)  # -> Vector, Length
midpt_2 = CurveMiddle(Curve=ln_3)
vec2pt_3 = Vector2Pt(PointA=volume_2.Centroid, PointB=cull, Unitize=False)  # -> Vector, Length
angle = Angle(VectorA=vec2pt.Vector, VectorB=vec2pt_3.Vector)  # -> Angle, Reflex
deg = Degrees(Radians=angle.Reflex)
offset = OffsetCurve(Curve=project_2.Geometry, Distance=expr("-x", panel_6), Corners=1)  # -> flatten(Curve)
ln_4 = Line(StartPoint=item_3, EndPoint=volume_2.Centroid)
abs = Absolute(Value=deg)
len_2 = Length(Curve=ln_4)
crvprox = CurveProximity(CurveA=offset, CurveB=ln_4)  # -> PointA, PointB, Distance
subtraction = Subtraction(A="360", B=abs)
shatter = Shatter()
midpt_3 = CurveMiddle(Curve=ln_4)
roundd = RoundToDecimalPlace(NumberX=len_2, DecimalPlace="1", RoundType=0)  # -> Rounded, Difference
previewlw_7 = CustomPreviewLineweights(Geometry=flatten(ln_4), Shader=swatch_3, Absolute=False)
tag_2 = TextTag(Location=midpt_3, Text=roundd.Rounded, Colour=swatch_3)
