# Grasshopper definition UnitsAggregationStudies_v1.gh (Grasshopper 1.0.7)
# plug-ins: Human, Pufferfish, Speckle 2, MeshEdit Components, MetaHopper, treesloth01, ShapeDiverForGrasshopper, Rhino.Inside for Autodesk Revit

get_from = Panel("https://macad.speckle.xyz/streams/6ba03db5f8/commits/4bfdabba08")  # disabled
receive = Receive(
    Stream=get_from,
    AutoReceive=False,
    CurrentComponentState="expired",
    ExpandOutput=True,
    ReceiveOnOpen=False,
    ReceivedCommitId="4bfdabba08",
    StreamWrapper="https://macad.speckle.xyz/streams/6ba03db5f8/commits/4bfdabba08",
    selectedKitName="Objects")  # -> Info, CollectionType, Elements, Name; disabled
dso = DeconstructSpeckleObject(SpeckleObject=receive.Elements, selectedKitName="Objects")  # disabled
clean = CleanTree(RemoveNulls=True, RemoveInvalid=True, RemoveEmpty=True, Tree=dso)  # -> simplify(Tree); disabled
bang = ExplodeTree(Data=clean)  # -> Branch0, Branch1, Branch2, Branch3, Branch4, Branch5, Branch6, Branch7, Branch8; disabled
geo = Geometry(bang.Branch4)  # disabled
geo_2 = Geometry(bang.Branch1)  # disabled
sddp = ShapeDiverDocumentPayload()

# ----
# Enable To Upload Geomtry to Speckle Server
toggle = GroupToggle(ToggleActive=True, ToggleVisible=False)  # disabled
link_to_upload_to_our_speckle_server = Panel("https://macad.speckle.xyz/streams/4975f9f0a8/branches/students%2Fg06-site_locations")  # disabled
panel = Panel("SiteLocationSelection")  # disabled
send = Send(
    Stream=link_to_upload_to_our_speckle_server,
    Message=panel,
    AutoSend=False,
    CurrentComponentState="needs_input",
    KitName="Objects",
    UseDefaultCache=True,
    selectedKitName="Objects")  # disabled

# ----
# Get Topo from Speckle
panel_2 = Panel("https://macad.speckle.xyz/streams/4975f9f0a8/branches/site%2F00-federated-model")
receive_2 = Receive(
    Stream=panel_2,
    AutoReceive=False,
    CurrentComponentState="expired",
    ExpandOutput=True,
    LastInfoMessage="James McBennett @ 01/19/2024 01:06:29: Pushed 38 elements from Grasshopper. (id:b5d4e56588)",
    ReceiveOnOpen=False,
    ReceivedCommitId="b5d4e56588",
    StreamWrapper="https://macad.speckle.xyz/streams/4975f9f0a8/branches/site/00-federated-model",
    selectedKitName="Objects")  # -> Info, CollectionType, Elements, Info_2, Levels, Name, Types
dso_2 = DeconstructSpeckleObject(SpeckleObject=receive_2.Elements, selectedKitName="Objects")  # -> CollectionType, Elements, Name
dso_3 = DeconstructSpeckleObject(SpeckleObject=dso_2.Elements, selectedKitName="Objects")  # -> BaseGeometry, BaseLine, BuiltInCategory, Category, DisplayValue, ElementId, IsRevitLinkedModel, Label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
clean_2 = CleanTree(RemoveNulls=True, RemoveInvalid=True, RemoveEmpty=True, Tree=dso_3.BaseLine)
swatch = ColourSwatch(SwatchColor=RGB(138, 138, 138))
clean_3 = CleanTree(RemoveNulls=True, RemoveInvalid=True, RemoveEmpty=True, Tree=dso_3.DisplayValue)  # -> flatten(Tree)
previewlw = CustomPreviewLineweights(Geometry=clean_2, Shader=swatch, Absolute=False)
item = ListItem(List=clean_3, Index=Slider(0, range=0..2), Wrap=True)

# ----
# Get SiteLocation from Speckle
panel_3 = Panel("https://macad.speckle.xyz/streams/4975f9f0a8/commits/6c185bed15")
receive_3 = Receive(
    Stream=panel_3,
    AutoReceive=False,
    CurrentComponentState="expired",
    ExpandOutput=True,
    ReceiveOnOpen=False,
    ReceivedCommitId="6c185bed15",
    StreamWrapper="https://macad.speckle.xyz/streams/4975f9f0a8/commits/6c185bed15",
    selectedKitName="Objects")  # -> Info, Data
dso_4 = DeconstructSpeckleObject(SpeckleObject=receive_3.Data, selectedKitName="Objects")  # -> GROUPNAME, SPHERELOCATION

mesh = Mesh(dso_4.SPHERELOCATION)
clean_4 = CleanTree(RemoveNulls=True, RemoveInvalid=True, RemoveEmpty=True, Tree=dso_3.DisplayValue)  # -> flatten(Tree)
volume = MeshVolume(Mesh=dso_4.SPHERELOCATION)  # -> Volume, Centroid

# ---- group: Site Contours
Z = UnitZ(Factor=expr("-x", Slider(353, range=0..10000)))
project = Project(Geometry=item, Plane=Z)  # -> Geometry, Transform
medges = MeshEdges(Mesh=project.Geometry)  # -> NakedEdges, InteriorEdges, NonManifoldEdges
contour = Contour(Shape=item, Point=Point(0, 0, 0), Direction=Vector(0, 0, 1), Distance="50")
previewlw_2 = CustomPreviewLineweights(Geometry=[contour, medges.NakedEdges], Shader=ColourSwatch(SwatchColor=RGB(64, 64, 64)), Absolute=False)

# ---- group: Populate surface
number_slider = Slider(51, range=0..100)  # disabled
popgeo = PopulateGeometry(Geometry=item, Count=number_slider, Seed=1)  # disabled
sph = Sphere(Base=popgeo, Radius=500)  # disabled
mesh_2 = Mesh(sph)  # disabled

# ---- group: Surface topo
number_slider_2 = Slider(0.623, range=0..1)  # disabled
previewmat = CustomPreviewMaterials(Geometry=item, DiffuseColor=swatch, Transparency=number_slider_2)  # disabled

# ----
mmx = MeshMesh(MeshA=item, MeshB=mesh)
divide = DivideCurve(Curve=mmx, Count=10, Kinks=False)  # -> Points, Tangents, Parameters
item_2 = ListItem(List=clean_4, Index=Slider(0, range=0..2), Wrap=True)

# ---- group: Site Perimeter Sphere
number_slider_3 = Slider(0.747, range=0..1)  # disabled
number_slider_4 = Slider(3, range=0..10)  # disabled
swatch_2 = ColourSwatch(SwatchColor=RGB(143, 26, 26))  # disabled
previewmat_2 = CustomPreviewMaterials(Geometry=mesh, DiffuseColor=swatch_2, Transparency=number_slider_3)  # disabled
previewlw_3 = CustomPreviewLineweights(Geometry=mmx, Shader=swatch_2, Thickness=number_slider_4, Absolute=False)  # disabled

# ---- group: Height of side of full site
panel_4 = Panel("{0,0,-1000}")
Z_2 = UnitZ(Factor=expr("-x", Slider(353, range=0..10000)))
project_2 = Project(Geometry=item_2, Plane=Z_2)  # -> Geometry, Transform
bbox = BoundingBox(Content=project_2.Geometry, Plane=PlaneXY(0, 0, 0))  # -> Box, Box_2
debrep = DeconstructBrep(Brep=bbox.Box)  # -> Faces, Edges, Vertices
Z_3 = UnitZ(Factor="10000")
move = Move(Geometry=debrep.Vertices, Motion=Z_3)  # -> Geometry, Transform
ln = Line(StartPoint=debrep.Vertices, EndPoint=move.Geometry)
mcx = MeshCurve(Mesh=item_2, Curve=ln)  # -> flatten(Points), Faces
ln_2 = Line(StartPoint=debrep.Vertices, EndPoint=mcx.Points)
len = Length(Curve=ln_2)
round = Round(Number=len)  # -> Nearest, Floor, Ceiling
midpt = CurveMiddle(Curve=ln_2)
concat = Concatenate(FragmentA=round.Nearest, FragmentB=" ", FragmentC="M")
tag = TextTag(Location=midpt, Text=concat, Colour=ColourSwatch(SwatchColor=RGB(64, 64, 64)))

# ---- group: Generate clean surface for aggregation
number_slider_5 = Slider(60, range=0..500)
dom = ConstructDomain(DomainStart=expr("-x", number_slider_5), DomainEnd=number_slider_5)
project_3 = Project(Geometry=volume.Centroid, Plane=PlaneXY(0, 0, 0))  # -> Geometry, Transform
rectangle = Rectangle(Plane=project_3.Geometry, XSize=dom, YSize=dom, Radius=0)  # -> Rectangle, Length
number_slider_6 = Slider(30, range=0..100)
msplit = MeshSplit(Mesh=item_2, Splitters=mesh)
sdivide = DivideSurface(Surface=rectangle.Rectangle, UCount=number_slider_6, VCount=number_slider_6)  # -> Points, Normals, Parameters
item_3 = ListItem(List=msplit, Index=Slider(1, range=0..1), Wrap=True)
line = LineSDL(Start=sdivide.Points, Direction=Vector(0, 0, 1), Length="10000")
mcx_2 = MeshCurve(Mesh=item_3, Curve=line)  # -> flatten(Points), Faces
srfgrid = SurfaceFromPoints(Points=mcx_2.Points, UCount=expr("x+1", number_slider_6), Interpolate=False)
previewmat_3 = CustomPreviewMaterials(Geometry=srfgrid, DiffuseColor=RGB(255, 255, 255), Transparency=Slider(0.634, range=0..1))

# ----
pdecon = Deconstruct(Point=divide.Points)  # -> XComponent, YComponent, ZComponent
bnd = Bounds(Numbers=pdecon.ZComponent)
panel_5 = Panel(bnd)
dedomain = DeconstructDomain(Domain=bnd)  # -> Start, End
equals = Equality(FirstNumber=pdecon.ZComponent, SecondNumber=dedomain.Start)  # -> Equality, Inequality
cull = CullPattern(List=divide.Points, CullPattern=equals.Equality)  # -> flatten(List)
vec2pt = Vector2Pt(PointA=volume.Centroid, PointB=cull, Unitize=False)  # -> Vector, Length
vec2pt_2 = Vector2Pt(PointA=volume.Centroid, PointB=cull, Unitize=False)  # -> Vector, Length
angle = Angle(VectorA=vec2pt.Vector, VectorB=vec2pt_2.Vector)  # -> Angle, Reflex
deg = Degrees(Radians=angle.Reflex)
abs = Absolute(Value=deg)
subtraction = Subtraction(A="360", B=abs)

# ----
# Press the button to make sure the file is
# updated to latest Wasp version on your pc.
button = Button()
updatefile = Wasp_UpdateFile(UPDATE=button)  # -> LOG; inputs UPDATE: Boolean; plug-in component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

number_slider_7 = Slider(0.4, range=0..1)
number_slider_8 = Slider(0.4, range=0..1)

# ---- group: ROAD CURVES
crv = Curve(<curve referenced from the Rhino model>)

# ----
project_4 = Project(Curve=crv, Brep=srfgrid, Direction=Vector(0, 0, 1))

# ---- group: M4
crv_2 = Curve([<curve referenced from the Rhino model> x2])
geo_3 = Geometry(<brep referenced from the Rhino model>)
pt = Point([<point referenced from the Rhino model> x2])
points = PointList(Points=pt, Size=number_slider_7)
stack = StackTrees(Data0=geo_3, Data1=pt, Data2=crv_2, Reduce=True)

# ---- group: M3
geo_4 = Geometry(<brep referenced from the Rhino model>)
pt_2 = Point([<point referenced from the Rhino model> x3])
crv_3 = Curve([<curve referenced from the Rhino model> x3])
points_2 = PointList(Points=pt_2, Size=number_slider_7)
stack_2 = StackTrees(Data0=geo_4, Data1=pt_2, Data2=crv_3, Reduce=True)

# ---- group: M1
geo_5 = Geometry(<brep referenced from the Rhino model>)
pt_3 = Point(<point referenced from the Rhino model>)
crv_4 = Curve(<curve referenced from the Rhino model>)
points_3 = PointList(Points=pt_3, Size=number_slider_7)
stack_3 = StackTrees(Data0=geo_5, Data1=pt_3, Data2=crv_4, Reduce=True)

# ---- group: M2
geo_6 = Geometry(<brep referenced from the Rhino model>)
pt_4 = Point([<point referenced from the Rhino model> x2])
crv_5 = Curve([<curve referenced from the Rhino model> x2])
points_4 = PointList(Points=pt_4, Size=number_slider_7)
stack_4 = StackTrees(Data0=geo_6, Data1=pt_4, Data2=crv_5, Reduce=True)

# ---- group: M3
geo_7 = Geometry(<brep referenced from the Rhino model>)
pt_5 = Point([<point referenced from the Rhino model> x3])
crv_6 = Curve([<curve referenced from the Rhino model> x3])
points_5 = PointList(Points=pt_5, Size=number_slider_7)
stack_5 = StackTrees(Data0=geo_7, Data1=pt_5, Data2=crv_6, Reduce=True)

# ---- group: M4
geo_8 = Geometry(<brep referenced from the Rhino model>)
pt_6 = Point([<point referenced from the Rhino model> x2])
crv_7 = Curve([<curve referenced from the Rhino model> x2])
points_6 = PointList(Points=pt_6, Size=number_slider_7)
stack_6 = StackTrees(Data0=geo_8, Data1=pt_6, Data2=crv_7, Reduce=True)

# ---- group: M1
geo_9 = Geometry(<brep referenced from the Rhino model>)
pt_7 = Point([<point referenced from the Rhino model> x3])
crv_8 = Curve([<curve referenced from the Rhino model> x3])
points_7 = PointList(Points=pt_7, Size=number_slider_8)
stack_7 = StackTrees(Data0=geo_9, Data1=pt_7, Data2=crv_8, Reduce=True)

# ---- group: M2
geo_10 = Geometry(<brep referenced from the Rhino model>)
pt_8 = Point([<point referenced from the Rhino model> x2])
crv_9 = Curve([<curve referenced from the Rhino model> x2])
points_8 = PointList(Points=pt_8, Size=number_slider_8)
stack_8 = StackTrees(Data0=geo_10, Data1=pt_8, Data2=crv_9, Reduce=True)

# ---- group: M3
geo_11 = Geometry(<brep referenced from the Rhino model>)
pt_9 = Point([<point referenced from the Rhino model> x2])
crv_10 = Curve([<curve referenced from the Rhino model> x2])
points_9 = PointList(Points=pt_9, Size=number_slider_8)
stack_9 = StackTrees(Data0=geo_11, Data1=pt_9, Data2=crv_10, Reduce=True)

# ---- group: M4
geo_12 = Geometry(<brep referenced from the Rhino model>)
pt_10 = Point([<point referenced from the Rhino model> x2])
crv_11 = Curve([<curve referenced from the Rhino model> x2])
points_10 = PointList(Points=pt_10, Size=number_slider_8)
stack_10 = StackTrees(Data0=geo_12, Data1=pt_10, Data2=crv_11, Reduce=True)

# ----
volume_2 = Volume(Geometry=geo_6)  # -> Volume, Centroid
bang_2 = ExplodeTree(Data=stack_4)  # -> Branch0, Branch1, Branch2
conndir = Wasp_ConnectionFromDirection(GEO=bang_2.Branch0, CEN=bang_2.Branch1, UP=bang_2.Branch2)  # -> CONN, PLN_OUT; inputs CEN: list of Point3d, UP: list of Curve, T: list; plug-in component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
tag_2 = TextTag(Location=volume_2.Centroid, Text="KIT")
geo_13 = Geometry()
attribute = Wasp_Attribute(ID="KIT", VAL=geo_13, TR=Toggle(True))  # -> ATTR; inputs VAL: list, TR: Boolean; plug-in component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
part = Wasp_BasicPart(NAME="KIT", GEO=bang_2.Branch0, CONN=flatten(conndir.CONN))  # -> PART; inputs GEO: Mesh, CONN: list, ATTR: list; plug-in component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

volume_3 = Volume(Geometry=geo_7)  # -> Volume, Centroid
bang_3 = ExplodeTree(Data=stack_5)  # -> Branch0, Branch1, Branch2
conndir_2 = Wasp_ConnectionFromDirection(GEO=bang_3.Branch0, CEN=bang_3.Branch1, UP=bang_3.Branch2)  # -> CONN, PLN_OUT; inputs CEN: list of Point3d, UP: list of Curve, T: list; plug-in component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
tag_3 = TextTag(Location=volume_3.Centroid, Text="VOID1")
geo_14 = Geometry()
attribute_2 = Wasp_Attribute(ID="VOID1", VAL=geo_14, TR=Toggle(True))  # -> ATTR; inputs VAL: list, TR: Boolean; plug-in component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
part_2 = Wasp_BasicPart(NAME="VOID1", GEO=bang_3.Branch0, CONN=flatten(conndir_2.CONN))  # -> PART; inputs GEO: Mesh, CONN: list, ATTR: list; plug-in component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

volume_4 = Volume(Geometry=geo_4)  # -> Volume, Centroid
bang_4 = ExplodeTree(Data=stack_2)  # -> Branch0, Branch1, Branch2
conndir_3 = Wasp_ConnectionFromDirection(GEO=bang_4.Branch0, CEN=bang_4.Branch1, UP=bang_4.Branch2)  # -> CONN, PLN_OUT; inputs CEN: list of Point3d, UP: list of Curve, T: list; plug-in component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
tag_4 = TextTag(Location=volume_4.Centroid, Text="CIR1")
geo_15 = Geometry()
attribute_3 = Wasp_Attribute(ID="CIR1", VAL=geo_15, TR=Toggle(True))  # -> ATTR; inputs VAL: list, TR: Boolean; plug-in component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
part_3 = Wasp_BasicPart(NAME="CIR1", GEO=bang_4.Branch0, CONN=flatten(conndir_3.CONN))  # -> PART; inputs GEO: Mesh, CONN: list, ATTR: list; plug-in component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

volume_5 = Volume(Geometry=geo_8)  # -> Volume, Centroid
bang_5 = ExplodeTree(Data=stack_6)  # -> Branch0, Branch1, Branch2
conndir_4 = Wasp_ConnectionFromDirection(GEO=bang_5.Branch0, CEN=bang_5.Branch1, UP=bang_5.Branch2)  # -> CONN, PLN_OUT; inputs CEN: list of Point3d, UP: list of Curve, T: list; plug-in component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
geo_16 = Geometry()
tag_5 = TextTag(Location=volume_5.Centroid, Text="CIR2")
attribute_4 = Wasp_Attribute(ID="CIR2", VAL=geo_16, TR=Toggle(True))  # -> ATTR; inputs VAL: list, TR: Boolean; plug-in component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
part_4 = Wasp_BasicPart(NAME="CIR2", GEO=bang_5.Branch0, CONN=flatten(conndir_4.CONN))  # -> PART; inputs GEO: Mesh, CONN: list, ATTR: list; plug-in component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

geo_17 = Geometry(<brep referenced from the Rhino model>)

volume_6 = Volume(Geometry=geo_3)  # -> Volume, Centroid
bang_6 = ExplodeTree(Data=stack)  # -> Branch0, Branch1, Branch2
conndir_5 = Wasp_ConnectionFromDirection(GEO=bang_6.Branch0, CEN=bang_6.Branch1, UP=bang_6.Branch2)  # -> CONN, PLN_OUT; inputs CEN: list of Point3d, UP: list of Curve, T: list; plug-in component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
geo_18 = Geometry()
tag_6 = TextTag(Location=volume_6.Centroid, Text="VOID2")
attribute_5 = Wasp_Attribute(ID="VOID2", VAL=geo_18, TR=Toggle(True))  # -> ATTR; inputs VAL: list, TR: Boolean; plug-in component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
part_5 = Wasp_BasicPart(NAME="VOID2", GEO=bang_6.Branch0, CONN=flatten(conndir_5.CONN))  # -> PART; inputs GEO: Mesh, CONN: list, ATTR: list; plug-in component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

pt_11 = Point([<point referenced from the Rhino model> x6])
crv_12 = Curve([<curve referenced from the Rhino model> x6])
pt_12 = Point([<point referenced from the Rhino model> x2])
crv_13 = Curve([<curve referenced from the Rhino model> x2])
pt_13 = Point([<point referenced from the Rhino model> x3])
crv_14 = Curve([<curve referenced from the Rhino model> x3])
conndir_6 = Wasp_ConnectionFromDirection(GEO=geo_17, CEN=pt_13, UP=crv_14, T="TOP")  # -> CONN, PLN_OUT; inputs CEN: list of Point3d, UP: list of Curve, T: list; plug-in component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
conndir_7 = Wasp_ConnectionFromDirection(GEO=geo_17, CEN=pt_12, UP=crv_13, T="BOTTOM")  # -> CONN, PLN_OUT; inputs CEN: list of Point3d, UP: list of Curve, T: list; plug-in component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
conndir_8 = Wasp_ConnectionFromDirection(GEO=geo_17, CEN=pt_11, UP=crv_12, T="SIDES")  # -> CONN, PLN_OUT; inputs CEN: list of Point3d, UP: list of Curve, T: list; plug-in component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
merge = Merge(Data1=conndir_8.CONN, Data2=conndir_7.CONN, Data3=conndir_6.CONN)

bang_7 = ExplodeTree(Data=stack_8)  # -> Branch0, Branch1, Branch2
conndir_9 = Wasp_ConnectionFromDirection(GEO=bang_7.Branch0, CEN=bang_7.Branch1, UP=bang_7.Branch2)  # -> CONN, PLN_OUT; inputs CEN: list of Point3d, UP: list of Curve, T: list; plug-in component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
geo_19 = Geometry()
attribute_6 = Wasp_Attribute(ID="KIT", VAL=geo_19, TR=Toggle(True))  # -> ATTR; inputs VAL: list, TR: Boolean; plug-in component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
part_6 = Wasp_BasicPart(NAME="KIT", GEO=bang_7.Branch0, CONN=flatten(conndir_9.CONN))  # -> PART; inputs GEO: Mesh, CONN: list, ATTR: list; plug-in component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

bang_8 = ExplodeTree(Data=stack_9)  # -> Branch0, Branch1, Branch2
conndir_10 = Wasp_ConnectionFromDirection(GEO=bang_8.Branch0, CEN=bang_8.Branch1, UP=bang_8.Branch2)  # -> CONN, PLN_OUT; inputs CEN: list of Point3d, UP: list of Curve, T: list; plug-in component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
geo_20 = Geometry()
attribute_7 = Wasp_Attribute(ID="CIR1", VAL=geo_20, TR=Toggle(True))  # -> ATTR; inputs VAL: list, TR: Boolean; plug-in component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
part_7 = Wasp_BasicPart(NAME="CIR1", GEO=bang_8.Branch0, CONN=flatten(conndir_10.CONN))  # -> PART; inputs GEO: Mesh, CONN: list, ATTR: list; plug-in component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

bang_9 = ExplodeTree(Data=stack_10)  # -> Branch0, Branch1, Branch2
conndir_11 = Wasp_ConnectionFromDirection(GEO=bang_9.Branch0, CEN=bang_9.Branch1, UP=bang_9.Branch2)  # -> CONN, PLN_OUT; inputs CEN: list of Point3d, UP: list of Curve, T: list; plug-in component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
geo_21 = Geometry()
attribute_8 = Wasp_Attribute(ID="CIR2", VAL=geo_21, TR=Toggle(True))  # -> ATTR; inputs VAL: list, TR: Boolean; plug-in component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
part_8 = Wasp_BasicPart(NAME="CIR2", GEO=bang_9.Branch0, CONN=flatten(conndir_11.CONN))  # -> PART; inputs GEO: Mesh, CONN: list, ATTR: list; plug-in component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

volume_7 = Volume(Geometry=geo_5)  # -> Volume, Centroid
bang_10 = ExplodeTree(Data=stack_3)  # -> Branch0, Branch1, Branch2
conndir_12 = Wasp_ConnectionFromDirection(GEO=bang_10.Branch0, CEN=bang_10.Branch1, UP=bang_10.Branch2)  # -> CONN, PLN_OUT; inputs CEN: list of Point3d, UP: list of Curve, T: list; plug-in component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
tag_7 = TextTag(Location=volume_7.Centroid, Text="MECH")
geo_22 = Geometry(<brep referenced from the Rhino model>)
attribute_9 = Wasp_Attribute(ID="MECHd", VAL=geo_22, TR=Toggle(True))  # -> ATTR; inputs VAL: list, TR: Boolean; plug-in component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
part_9 = Wasp_BasicPart(NAME="MECH", GEO=bang_10.Branch0, CONN=flatten(conndir_12.CONN))  # -> PART; inputs GEO: Mesh, CONN: list, ATTR: list; plug-in component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

bang_11 = ExplodeTree(Data=stack_7)  # -> Branch0, Branch1, Branch2
conndir_13 = Wasp_ConnectionFromDirection(GEO=bang_11.Branch0, CEN=bang_11.Branch1, UP=bang_11.Branch2)  # -> CONN, PLN_OUT; inputs CEN: list of Point3d, UP: list of Curve, T: list; plug-in component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
geo_23 = Geometry(<brep referenced from the Rhino model>)
attribute_10 = Wasp_Attribute(ID="MECHd", VAL=geo_23, TR=Toggle(True))  # -> ATTR; inputs VAL: list, TR: Boolean; plug-in component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
part_10 = Wasp_BasicPart(NAME="MECH", GEO=bang_11.Branch0, CONN=flatten(conndir_13.CONN), ATTR=attribute_10)  # -> PART; inputs GEO: Mesh, CONN: list, ATTR: list; plug-in component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

geo_24 = Geometry(<brep referenced from the Rhino model>)
attribute_11 = Wasp_Attribute(ID="house", VAL=geo_24, TR=Toggle(True))  # -> ATTR; inputs VAL: list, TR: Boolean; plug-in component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

part_11 = Wasp_BasicPart(NAME="BLOCK01", GEO=geo_17, CONN=flatten(merge))  # -> PART; inputs GEO: Mesh, CONN: list, ATTR: list; plug-in component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
merge_2 = Merge(Data1=part_9, Data2=part, Data3=part_2, Data4=part_4, Data5=part_3, Data6=part_5)
merge_3 = Merge(Data1=part_10, Data2=part_6, Data3=part_7, Data4=part_8)
panel_6 = Panel("""MECH|0_CIR2|1
CRIT2|0_VOID1|0
VOID1|1_VOID2|1
VOID1|2_KIT|1
VOID2|0_CIR1|2
KIT|0_CIR1|1""")
toggle_2 = BooleanToggle(False)
rulegen = Wasp_RulesGenerator(PART=merge_2, SELF_P=toggle_2)  # -> R; inputs PART: list, SELF_P: Boolean, SELF_C: Boolean, TYP: Boolean, GR: list; plug-in component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
ruletxt = Wasp_RuleFromText(TXT=panel_6)  # -> R; plug-in component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
stochasticaggregation = Wasp_StochasticAggregation(PART=flatten(merge_2), N=Slider(6, range=1..50), RULES=rulegen, RESET=Button())  # -> AGGR, PART_OUT; inputs PART: list, PREV: list, N: Int32, RULES: list, SEED: Int32, MODE: Int32, GC: list, RESET: Boolean; disabled; plug-in component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

series = Series(Start=0, Step=1, Count="3")
bnd_2 = Bounds(Numbers=series)
dedomain_2 = DeconstructDomain(Domain=bnd_2)  # -> Start, End
gradient = Gradient(
    LowerLimit=dedomain_2.Start,
    UpperLimit=dedomain_2.End,
    Parameter=series,
    stops=[0.15: RGB(255, 130, 160), 0.85: RGB(220, 0, 40)])
lng = ListLength(List=stochasticaggregation.PART_OUT)
getattr = Wasp_GetAttributeByName(PART=part_9, ID="MECH")  # -> VAL; plug-in component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
random = Random(Range=Slider(2, range=0..10), Number=lng, Seed=2, Integers=True)
item_4 = ListItem(List=gradient, Index=random, Wrap=True)
preview = CustomPreview(Geometry=flatten(getattr), Material=item_4)

number_slider_9 = Slider(0.25, range=0..1)  # disabled
number_slider_10 = Slider(0.589, range=0..1)
swatch_3 = ColourSwatch(SwatchColor=RGBA(255, 255, 255, 204))
swatch_4 = ColourSwatch(SwatchColor=RGB(0, 0, 0))

angsplitmsh = AngleSplitMesh(Mesh=[geo_5, geo_6, geo_7, geo_8, geo_4, geo_3], Angle=0, Opposite=False)  # -> Split, R
medges_2 = MeshEdges(Mesh=angsplitmsh.Split)  # -> NakedEdges, InteriorEdges, NonManifoldEdges
previewmat_4 = CustomPreviewMaterials(Geometry=[geo_5, geo_6, geo_7, geo_8, geo_4, geo_3], DiffuseColor=swatch_3, Transparency=number_slider_10)  # disabled
previewlw_4 = CustomPreviewLineweights(Geometry=medges_2.NakedEdges, Shader=swatch_4, Absolute=False)  # disabled

# ---- group: Create new sheets based on list
drawings = Panel("""Site Plan
Floor Plan
Section
Elevation""")
lng_2 = ListLength(List=drawings)
series_2 = Series(Start=101, Step=1, Count=lng_2)
filter = StreamFilter(Gate=Toggle(True), Stream1=drawings)
concat_2 = Concatenate(FragmentA="A", FragmentC="-", FragmentB=series_2)
sheet = AddSheet(SheetNumber=concat_2, SheetName=filter, TrackingMode=2)

# ---- group: Aggregation 1
geo_25 = Geometry([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])

# ---- group: Aggregation 2
geo_26 = Geometry()

# ----
panel_7 = Panel(rulegen)

# ---- group: Aggregation
m_shape = AddDirectShapeMesh(Mesh=geo_25, TrackingMode=2)

# ----
sheets = QuerySheets(Placeholder=False, AppearsInSheetList=True, Assembly=null)
views = QueryViews(IsDependent=False, IsTemplate=False)
number_slider_11 = Slider(101, range=0..1000)
value_picker = ValuePicker(sheets)
value_picker_2 = ValuePicker(views, SearchPattern="SECTIONS")
revisions = QueryRevisions()
revision = Revision(revisions)
panel_8 = Panel(views)
crv_15 = Curve(<curve referenced from the Rhino model>)
item_5 = ListItem(List=drawings, Index=0, Wrap=True)  # -> Item, Item1, Item2, Item3
line_2 = Line(crv_15)
param = ElementParameter()  # -> Element, Value
sectionview = AddSectionView(Frame=line_2, Name=item_5.Item2, TrackingMode=2)
passport = ElementPassport(Element=sectionview)  # -> DocumentGUID, Document, UniqueID, Id
e_name = ElementName(Element=sectionview)  # -> Element, Name
e_category = ElementCategory(Element=sectionview)  # -> Element, Category
e_type = ElementType(Element=sectionview)  # -> Element, Type
inspect = InspectElement(Element=sectionview)  # -> OtherFolder, OtherSRViewCalculationSettings, OtherSubfolder, OtherNone, DataBIG_Views_Exchange, GraphicsColorSchemeLocation, GraphicsHideAtScalesCoarserThan, GraphicsDefaultAnalysisDisplayStyle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
panel_9 = Panel(inspect.IdentityDataTitleOnSheet)
panel_10 = Panel(inspect.IdentityDataViewName)
panel_11 = Panel(inspect.GraphicsViewScale)
panel_12 = Panel(inspect.PhasingPhase)

geo_27 = Geometry(srfgrid)
bbox_2 = BoundingBox(Content=geo_27, Plane=PlaneXY(0, 0, 0))  # -> Box, Box_2
volume_8 = Volume(Geometry=bbox_2.Box)  # -> Volume, Centroid
scale_nu = ScaleNU(
    Geometry=bbox_2.Box,
    Plane=volume_8.Centroid,
    ScaleX=Slider(1, range=0..10),
    ScaleY=Slider(1, range=0..10),
    ScaleZ=Slider(2.17, range=0..10))  # -> Geometry, Transform
fieldpts = Wasp_FieldPoints(BOU=scale_nu.Geometry, RES=Slider(2.5, range=0..10))  # -> E_FIELD, PTS; inputs BOU: list of Mesh, PLN: Plane; plug-in component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

contour_2 = Contour(Shape=geo_27, Point=Point(0, 0, 0), Direction=Vector(0, 0, 1), Distance=Slider(0.5, range=0..1))
preview_2 = CustomPreview(Geometry=geo_27, Material=ColourSwatch(SwatchColor=RGB(194, 194, 194)))
preview_3 = CustomPreview(Geometry=contour_2, Material=ColourSwatch(SwatchColor=RGB(0, 0, 0)))

geo_28 = Geometry(geo_27)
pull = PullPoint(Point=fieldpts.PTS, Geometry=geo_28, ClosestOnly=True)  # -> ClosestPoint, Distance
pdecon_2 = Deconstruct(Point=fieldpts.PTS)  # -> XComponent, YComponent, ZComponent
pdecon_3 = Deconstruct(Point=pull.ClosestPoint)  # -> XComponent, YComponent, ZComponent
smaller = SmallerThan(FirstNumber=pdecon_2.ZComponent, SecondNumber=pdecon_3.ZComponent)  # -> SmallerThan, OrEqualTo
dispatch = Dispatch(List=pull.Distance, DispatchPattern=smaller.SmallerThan)  # -> ListA, ListB
dom_2 = ConstructDomain(DomainStart=Slider(1, range=0..1), DomainEnd=Slider(0, range=0..100))
bnd_3 = Bounds(Numbers=dispatch.ListB)
remap = RemapNumbers(Value=dispatch.ListB, Source=bnd_3, Target=dom_2)  # -> Mapped, Clipped
lng_3 = ListLength(List=dispatch.ListA)
repeat = RepeatData(Data=Slider(0, range=0..100), Length=lng_3)
graph = GraphMapper(
    remap.Mapped,
    x0=0,
    x1=1,
    y0=0,
    y1=1,
    container_name="Bezier",
    cpx=[0, 0.6471909881, 0.9011235833, 1],
    cpy=[0, 0.07142859697, 0.428571403, 1])
weave = Weave(Pattern=smaller.SmallerThan, Stream0=graph, Stream1=repeat, NullGaps=False)

geo_29 = Geometry(geo_27)
project_5 = Project(Curve=project_4, Brep=geo_29, Direction=Vector(0, 0, 1))
pt_14 = Point(fieldpts.PTS)
pull_2 = PullPoint(Point=pt_14, Geometry=flatten(project_5), ClosestOnly=True)  # -> ClosestPoint, Distance
dom_3 = ConstructDomain(DomainStart=Slider(1, range=0..1), DomainEnd=Slider(0, range=0..100))
bnd_4 = Bounds(Numbers=dispatch.ListB)
remap_2 = RemapNumbers(Value=pull_2.Distance, Source=bnd_4, Target=dom_3)  # -> Mapped, Clipped
graph_2 = GraphMapper(
    remap_2.Mapped,
    x0=0,
    x1=1,
    y0=0,
    y1=1,
    container_name="Bezier",
    cpx=[0, 0.6471909881, 0.9011235833, 1],
    cpy=[0, 0.07142859697, 0.428571403, 1])

pt_15 = Point(fieldpts.PTS)
geo_30 = Geometry(geo_27)
srf_cp = SurfaceClosestPoint(Point=pt_15, Surface=geo_30)  # -> Point, UVPoint, Distance
evalsrf = EvaluateSurface(Surface=geo_30, Point=srf_cp.UVPoint)  # -> Point, Normal, UDirection, VDirection, Frame
Z_4 = UnitZ(Factor=1)
angle_2 = Angle(VectorA=Z_4, VectorB=evalsrf.Normal)  # -> Angle, Reflex
bnd_5 = Bounds(Numbers=angle_2.Angle)
remap_3 = RemapNumbers(Value=angle_2.Angle, Source=bnd_5, Target="1 To 0")  # -> Mapped, Clipped
graph_3 = GraphMapper(remap_3.Mapped, x0=0, x1=1, y0=0, y1=1, container_name="Bezier", cpx=[0, 0.25, 0.75, 1], cpy=[0, 0.25, 0.75, 1])

gradient_2 = Gradient(LowerLimit=0, UpperLimit=1, Parameter=graph_2, stops=[0: RGB(0, 128, 0), 0.5: RGB(255, 255, 0), 1: RGB(255, 0, 0)])
preview_4 = CustomPreview(Geometry=pt_14, Material=gradient_2)

gradient_3 = Gradient(LowerLimit=0, UpperLimit=1, Parameter=graph_3, stops=[0: RGB(0, 128, 0), 0.5: RGB(255, 255, 0), 1: RGB(255, 0, 0)])
preview_5 = CustomPreview(Geometry=evalsrf.Point, Material=gradient_3)

gradient_4 = Gradient(LowerLimit=0, UpperLimit=1, Parameter=weave, stops=[0: RGB(0, 128, 0), 0.5: RGB(255, 255, 0), 1: RGB(255, 0, 0)])
preview_6 = CustomPreview(Geometry=fieldpts.PTS, Material=gradient_4)

multiplication = Multiplication(A=weave, B=graph_2, C=graph_3)

field = Wasp_Field(NAME="srfField", E_FIELD=fieldpts.E_FIELD, VAL=multiplication)  # -> FIELD; inputs VAL: list; plug-in component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

panel_14 = Panel("""SIDES>SIDES
TOP>BOTTOM
BOTTOM>TOP""")
rulegen_2 = Wasp_RulesGenerator(PART=merge_2, SELF_P=toggle_2)  # -> R; inputs PART: list, SELF_P: Boolean, SELF_C: Boolean, TYP: Boolean, GR: list; plug-in component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
fieldaggregation = Wasp_FieldDrivenAggregation(PART=flatten(merge_2), N=Slider(35, range=0..1000), RULES=rulegen_2, FIELD=field, RESET=Button())  # -> AGGR, PART_OUT; inputs PART: list, PREV: list, N: Int32, RULES: list, FIELD: list, MODE: Int32, GC: list, RESET: Boolean; plug-in component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

partgeo = Wasp_GetPartGeometry(PART=fieldaggregation.PART_OUT)  # -> GEO; plug-in component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

gradient_5 = Gradient(
    LowerLimit=0,
    UpperLimit=1,
    Parameter=multiplication,
    stops=[0: RGB(0, 128, 0), 0.5: RGB(255, 255, 0), 1: RGB(255, 0, 0)])
preview_7 = CustomPreview(Geometry=fieldpts.PTS, Material=gradient_5)  # disabled

brep = Brep(partgeo)
angsplitmsh_2 = AngleSplitMesh(Mesh=partgeo, Angle=0, Opposite=False)  # -> Split, R

number_slider_12 = Slider(2, range=0..10)  # disabled
panel_15 = Panel("house")  # disabled
swatch_5 = ColourSwatch(SwatchColor=RGB(42, 181, 14))  # disabled
swatch_6 = ColourSwatch(SwatchColor=RGB(207, 255, 77))  # disabled
swatch_7 = ColourSwatch(SwatchColor=RGB(110, 255, 0))  # disabled
lng_4 = ListLength(List=fieldaggregation.PART_OUT)  # disabled
getattr_2 = Wasp_GetAttributeByName(PART=fieldaggregation.PART_OUT, ID=panel_15)  # -> VAL; disabled; plug-in component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
random_2 = Random(Range=number_slider_12, Number=lng_4, Seed=2, Integers=True)  # disabled
merge_4 = Merge(Data1=swatch_5, Data2=swatch_7, Data3=swatch_6)  # disabled
item_6 = ListItem(List=merge_4, Index=random_2, Wrap=True)  # disabled
preview_8 = CustomPreview(Geometry=flatten(getattr_2), Material=item_6)  # disabled

medges_3 = MeshEdges(Mesh=angsplitmsh_2.Split)  # -> NakedEdges, InteriorEdges, NonManifoldEdges
previewmat_5 = CustomPreviewMaterials(Geometry=partgeo, DiffuseColor=swatch_3, Transparency=number_slider_10)
previewlw_5 = CustomPreviewLineweights(Geometry=medges_3.NakedEdges, Shader=swatch_4, Absolute=False)
