# Grasshopper definition Inflatables_WEEK 02_BEYOND BIM 24 (1).gh (Grasshopper 1.0.7)
# plug-ins: Kangaroo2 Components, ShapeDiverForGrasshopper, Weaverbird, Pufferfish, MeshEdit Components, LunchBox

# ---- group: Input
data = Data(0)

# ---- group: Control
data_2 = Data(0)

# ---- group: Operation
data_3 = Data(0)

# ---- group: Output
data_4 = Data(0)

# ---- group: Check
data_5 = Data(0)

# ----
# Inflated pillow - Solid Collision
number_slider = Slider(50, range=0..100)
# Inflated pillow - base setup
sddp = ShapeDiverDocumentPayload({AbsoluteTolerance=0, AngleTolerance=0, DistanceDisplayPrecision=0, GltfVersion="Gltf2", GrasshopperVersion="1.0.0007", InputGroups="{}", OutputGroups="{}", RelativeTolerance=0, RhinoVersion="7.35.23346.11001", UnitSystem=0, VersionCreated="1.16.0.0", VersionSaved="1.16.0.0"})
number_slider_2 = Slider(50, range=0..100)
# Inflated pillow - Predefined creases
number_slider_3 = Slider(50, range=0..100)
panel = Panel("Baloon magnetic mold")

# ---- group: Mesh Resolution
number_slider_4 = Slider(20, range=0..100)

# ----
panel_2 = Panel("Tiling mesh creases")
# Inflated pillow - Edge wrinkles using points radius
number_slider_5 = Slider(50, range=0..100)
number_slider_6 = Slider(25, range=0..100)
number_slider_7 = Slider(4.5, range=0..10)  # disabled

# ---- group: Egg formula to generate a volumetric initial mesh
panel_3 = Panel("""a*cos(u)*cos(v)
b*sin(u)*cos(v)
c*sin(v)""")
width_y = Slider(10.13, range=0..50)
width_y_2 = Slider(0.43, range=0..50)
height_z = Slider(11.75, range=0..50)
cluster = Cluster(F=panel_3, a=width_y, b=width_y_2, c=height_z)

# ----
number_slider_8 = Slider(20, range=0..100)
rectangle = Rectangle(Plane=PlaneXY(0, 0, 0), XSize=number_slider_2, YSize=number_slider_2, Radius=0)  # -> Rectangle, Length
rectangle_2 = Rectangle(Plane=PlaneXY(0, 0, 0), XSize=number_slider, YSize=number_slider, Radius=0)  # -> Rectangle, Length
rectangle_3 = Rectangle(Plane=PlaneXY(0, 0, 0), XSize=number_slider_3, YSize=number_slider_3, Radius=0)  # -> Rectangle, Length
rectangle_4 = Rectangle(Plane=PlaneXY(0, 0, 0), XSize=number_slider_5, YSize=number_slider_5, Radius=0)  # -> Rectangle, Length
mobius = MobiusSurface(
    UDivisions=100,
    VDivisions=100,
    RParameter=number_slider_7,
    TParameter=0.5,
    Scale=5,
    Domain1=Domain(-3.141592654, 3.141592654),
    Domain2=Domain(-1, 1))  # disabled

# ---- group: Deconstruct/Construct Mesh
mesh_uv = MeshSurface(Surface=rectangle_2.Rectangle, UCount=number_slider_6, VCount=number_slider_6, Overhang=True, Equalize=False)

# ----
number_slider_9 = Slider(30, range=0..100)  # disabled
number_slider_10 = Slider(1, range=0..100)  # disabled
netsrf = NetOnSurface(Surface=mobius, CountU=number_slider_9, CountV=number_slider_10, Flip=False)  # disabled

xz = XZPlane(Origin=Point(0, 0, 0))
mesh_uv_2 = MeshSurface(Surface=rectangle_4.Rectangle, UCount=number_slider_8, VCount=number_slider_8, Overhang=True, Equalize=False)
boundary = BoundarySurfaces(Edges=rectangle_3.Rectangle)

# ---- group: Defining Mesh subdivision to create pre-inflation creases
crv = Curve([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])
project = Project(Geometry=crv, Plane=PlaneXY(0, 0, 0))  # -> Geometry, Transform
srfsplit = SurfaceSplit(Surface=boundary, Curves=project.Geometry)
join = BrepJoin(Breps=srfsplit)  # -> Breps, Closed

# ----
number_slider_11 = Slider(0.2, range=0..10)  # disabled
nv = NakedVertices(Mesh=mesh_uv_2)  # -> ClothedIndex, NakedIndex, ClothedPts, NakedPts
sec = BrepPlane(Brep=cluster, Plane=xz)  # -> Curves, Points
Z = UnitZ(Factor=0.1)
demesh = DeconstructMesh(Mesh=mesh_uv_2)  # -> Vertices, Faces, Colours, Normals
triremesh = TriRemesh(Geometry=cluster, Sharp=False, Features=flatten(sec.Curves), Length=Slider(0.8, range=0..10), Iterations=25)  # -> Triangulation, Dual, Creases
move = Move(Geometry=nv.ClothedPts, Motion=Z)  # -> Geometry, Transform
Z_2 = UnitZ(Factor=height_z)

# ---- group: Creating two solids elements based on surface parameters
number_slider_12 = Slider(1.04, range=0..5)
move_2 = Move(Geometry=sec.Curves, Motion=Z_2)  # -> Geometry, Transform
boundary_2 = BoundarySurfaces(Edges=move_2.Geometry)
md_slider = MDSlider(
    SliderMode=0,
    slider_value=Point(0.4782884981, 0.7011185037, 0.5),
    x_domain=Domain(0, 1),
    y_domain=Domain(0, 1),
    z_domain=Domain(0, 1))
md_slider_2 = MDSlider(
    SliderMode=0,
    slider_value=Point(0.4027250324, 0.03088919236, 0.5),
    x_domain=Domain(0, 1),
    y_domain=Domain(0, 1),
    z_domain=Domain(0, 1))
neg = Negative(Value=number_slider_12)
offset = OffsetSurface(Surface=boundary_2, Distance=[number_slider_12, neg], Retrim=True)
evalsrf = EvaluateSurface(Surface=reparameterize(graft(offset)), Point=[md_slider, md_slider_2])  # -> Point, Normal, UDirection, VDirection, Frame
number_slider_13 = Slider(0.439, range=0..1)
cir = Circle(Plane=evalsrf.Frame, Radius=[Slider(4.5, range=0..10), Slider(7.4, range=0..10)])
boundary_3 = BoundarySurfaces(Edges=cir)
neg_2 = Negative(Value=number_slider_13)
offsrf = OffsetSurface(Surface=boundary_3, Distance=number_slider_13, BothSides=neg_2, CreateSolid=True)

# ----
triremesh_2 = TriRemesh(Geometry=mobius, Length=number_slider_11, Iterations=25)  # -> Triangulation, Dual, Creases; disabled
replace = ReplaceItems(List=demesh.Vertices, Item=move.Geometry, Indices=nv.ClothedIndex, Wrap=False)
move_3 = Move(Geometry=triremesh.Triangulation, Motion=Z_2)  # -> Geometry, Transform
xy = XYPlane(Origin=Point(0, 0, 0))
number_slider_14 = Slider(0.05, range=0..1)  # disabled
nv_2 = NakedVertices(Mesh=triremesh_2.Triangulation)  # -> ClothedIndex, NakedIndex, ClothedPts, NakedPts; disabled
demesh_2 = DeconstructMesh(Mesh=triremesh_2.Triangulation)  # -> Vertices, Faces, Colours, Normals; disabled
clean = CombineClean(Meshes=move_3.Geometry)
conmesh = ConstructMesh(Vertices=replace, Faces=demesh.Faces)
triremesh_3 = TriRemesh(Geometry=join.Breps, Sharp=False, Features=project.Geometry, Length=Slider(1.5, range=0..10), Iterations=25)  # -> Triangulation, Dual, Creases
xy_2 = XYPlane(Origin=Point(0, 0, 0))
amp = Amplitude(Vector=demesh_2.Normals, Amplitude=number_slider_14)  # disabled
wbvertices = WeaverbirdsVerticesComponent(MeshClosedPolylinesGroup=clean, Weld=True)

pdecon = Deconstruct(Point=wbvertices)  # -> XComponent, YComponent, ZComponent
smaller = SmallerThan(FirstNumber=pdecon.ZComponent, SecondNumber=Slider(0.3, range=0..10))  # -> SmallerThan, OrEqualTo
cull = CullPattern(List=wbvertices, CullPattern=smaller.SmallerThan)
project_2 = Project(Geometry=cull, Plane=PlaneXY(0, 0, 0))  # -> Geometry, Transform
anchor = Anchor(Point=cull, Target=project_2.Geometry, Strength=10000)

medges = MeshEdges(Mesh=clean)  # -> NakedEdges, InteriorEdges, NonManifoldEdges
len = Length(Curve=medges.InteriorEdges)
avr = Average(Input=len)
multiplication = Multiplication(A=avr, B=Slider(0.2, range=0..10))
sc = SphereCollide(Points=wbvertices, Radius=multiplication, Strength="50")

mirror = Mirror(Geometry=conmesh, Plane=xy_2)  # -> Geometry, Transform

# ---- group: Crease Pipes
xy_3 = XYPlane(Origin=Point(0, 0, 0))
crv_2 = Curve(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)
mirror_2 = Mirror(Geometry=crv_2, Plane=xy_3)  # -> Geometry, Transform
number_slider_15 = Slider(1.2, range=0..10)
entwine = Entwine(Branch00=crv_2, Branch01=mirror_2.Geometry, FlattenInputs=True)
mp = MultiPipe(
    Curves=entwine,
    NodeSize=number_slider_15,
    EndOffset=1,
    StrutSize=number_slider_15,
    Segment=0,
    KinkAngle=0.6,
    CubeFit=0,
    Caps=2)
meshsubd = MeshFromSubD(SubD=mp, Density=Slider(1, range=0..10))  # -> flatten(Mesh)

# ----
move_4 = Move(Geometry=demesh_2.Vertices, Motion=amp)  # -> Geometry, Transform; disabled
replace_2 = ReplaceItems(List=move_4.Geometry, Item=nv_2.NakedPts, Indices=nv_2.NakedIndex, Wrap=False)  # disabled
volume = Volume(Geometry=clean)  # -> Volume, Centroid
clean_2 = CombineClean(Meshes=[conmesh, mirror.Geometry])
conmesh_2 = ConstructMesh(Vertices=replace_2, Faces=demesh_2.Faces)  # disabled

# ---- group: Extract anchor points
wires = BrepWireframe(Brep=mobius, Density=-1)  # disabled
number_slider_16 = Slider(0.1, range=0..1)  # disabled
wbvertices_2 = WeaverbirdsVerticesComponent(MeshClosedPolylinesGroup=conmesh_2, Weld=True)  # disabled
wbvertices_3 = WeaverbirdsVerticesComponent(MeshClosedPolylinesGroup=triremesh_2.Triangulation, Weld=True)  # disabled
pull = PullPoint(Point=wbvertices_3, Geometry=flatten([netsrf, wires]), ClosestOnly=True)  # -> ClosestPoint, Distance; disabled
larger = LargerThan(FirstNumber=pull.Distance, SecondNumber=number_slider_16)  # -> LargerThan, OrEqualTo; disabled
cull_2 = CullPattern(List=wbvertices_2, CullPattern=invert(larger.LargerThan))  # disabled
cull_3 = CullPattern(List=wbvertices_3, CullPattern=invert(larger.LargerThan))  # disabled

# ----
flip = MeshFlip(Mesh=triremesh_2.Triangulation)  # disabled
flip_2 = MeshFlip(Mesh=conmesh_2)  # disabled

medges_2 = MeshEdges(Mesh=clean)  # -> NakedEdges, InteriorEdges, NonManifoldEdges
length_line = LengthLine(Line=medges_2.InteriorEdges, Strength=10)

multiplication_2 = Multiplication(A=volume.Volume, B=Slider(46, range=0..50))

floor = FloorFriction(Points=wbvertices, Limit=0.1, Strength="500")

volume_2 = Volume(Strength=1)
length_line_2 = LengthLine(Strength=10)
clean_3 = CombineClean(Meshes=flatten([flip_2, triremesh_2.Triangulation]))  # disabled
volume_3 = Volume(Mesh=clean, Volume=multiplication_2, Strength=1)
show = Show(G=clean)
spc = SolidPointCollide(Points=wbvertices, Solid=flatten(offsrf), Interior=False, Unidirectional=True, Strength="50000")
volume_4 = Volume(Geometry=clean_2)  # -> Volume, Centroid
nv_3 = NakedVertices(Mesh=mirror.Geometry)  # -> ClothedIndex, NakedIndex, ClothedPts, NakedPts

# ---- group: Points sphere radius
medges_3 = MeshEdges(Mesh=clean_2)  # -> NakedEdges, InteriorEdges, NonManifoldEdges
len_2 = Length(Curve=medges_3.InteriorEdges)
avr_2 = Average(Input=len_2)
multiplication_3 = Multiplication(A=avr_2, B=Slider(1.5, range=0..10))
sc_2 = SphereCollide(Points=nv_3.ClothedPts, Radius=multiplication_3, Strength=Slider(50, range=0..100))

# ----
merge = Merge(Data1=show, Data2=length_line, Data5=volume_3, Data6=floor, Data7=anchor, Data8=spc, Data9=sc)
clean_4 = CombineClean(Meshes=clean_3)  # disabled
wbvertices_4 = WeaverbirdsVerticesComponent(MeshClosedPolylinesGroup=clean_4, Weld=True)  # disabled
xy_4 = XYPlane(Origin=Point(0, 0, 0))
multiplication_4 = Multiplication(A=Slider(6.7, range=0..10), B=volume_4.Volume)
panel_4 = Panel("0.000001")
edgelengths = EdgeLengths(Mesh=clean_2, LengthFactor=1, Strength=1)
volume_5 = Volume(Mesh=clean_2, Volume=multiplication_4, Strength=Slider(10, range=0..100))
anchor_2 = Anchor(Point=nv_3.NakedPts, Strength="1000")
show_2 = Show(G=clean_2)
bouncysolver = BouncySolver(
    GoalObjects=merge,
    Reset=Button(),
    Threshold=1e-15,
    Tolerance=1e-05,
    Damping=Slider(0.423, range=0..1),
    Iterations=10,
    On=Toggle(False))  # -> I, V, O
number_slider_17 = Slider(50, range=0..50)  # disabled
number_slider_18 = Slider(200, range=0..1000)  # disabled
merge_2 = Merge(Data1=cull_2, Data2=cull_3)  # -> flatten(Result); disabled
flip_3 = MeshFlip(Mesh=clean_4)  # disabled
merge_3 = Merge(Data1=show_2, Data2=edgelengths, Data3=volume_5, Data4=anchor_2, Data5=sc_2)
volume_6 = Volume(Geometry=clean_4)  # -> Volume, Centroid; disabled
number_slider_19 = Slider(1, range=0..1)  # disabled
item = ListItem(List=bouncysolver.O, Index=0, Wrap=True)
number_slider_20 = Slider(0.15, range=0..1)  # disabled
wbvertices_5 = WeaverbirdsVerticesComponent(MeshClosedPolylinesGroup=clean_4, Weld=True)  # disabled
number_slider_21 = Slider(3.5, range=0..10)  # disabled

medges_4 = MeshEdges(Mesh=flatten(clean_4))  # -> NakedEdges, InteriorEdges, NonManifoldEdges; disabled
number_slider_22 = Slider(0.5, range=0..10)  # disabled
len_3 = Length(Curve=medges_4.InteriorEdges)  # disabled
avr_3 = Average(Input=flatten(len_3))  # disabled
multiplication_5 = Multiplication(A=avr_3, B=number_slider_22)  # disabled
panel_5 = Panel("5")  # disabled
sc_3 = SphereCollide(Points=flatten(wbvertices_4), Radius=number_slider_21, Strength=panel_5)  # disabled

medges_5 = MeshEdges(Mesh=clean_4)  # -> NakedEdges, InteriorEdges, NonManifoldEdges; disabled
length_line_3 = LengthLine(Line=medges_5.InteriorEdges, Strength=10)  # disabled

multiplication_6 = Multiplication(A=volume_6.Volume, B=number_slider_18)  # disabled
wbloop = WeaverbirdsLoopSubdivision(MeshCurves=item, Level=1, SmoothNakedEdges=1)

panel_6 = Panel("500")  # disabled
floor_2 = FloorFriction(Points=wbvertices_4, Limit=0.1, Strength=panel_6)  # disabled

bouncysolver_2 = BouncySolver(
    GoalObjects=merge_3,
    Reset=Button(),
    Threshold=1e-15,
    Tolerance=0.0001,
    Damping=Slider(0.964, range=0..1),
    Iterations=10,
    On=Toggle(False))  # -> I, V, O
panel_7 = Panel("50000")  # disabled
volume_7 = Volume(Mesh=clean_4, Volume=multiplication_6, Strength=1)  # disabled
anchor_3 = Anchor(Point=merge_2, Strength=10000)  # disabled
unweld = UnweldMesh(Mesh=wbloop, Angle=1)
show_3 = Show(G=clean_4)  # disabled
item_2 = ListItem(List=bouncysolver_2.O, Index=0, Wrap=True)

# ---- group: MESH PREVIEW
preview = CustomPreview(
    Geometry=unweld,
    Material={diffuse=RGB(221, 160, 221), emission=RGB(66, 48, 66), shine=0.5, specular=RGB(255, 255, 255), transparency=0})

# ----
show_4 = Show(G=merge_2)  # disabled
wbcatmullclark = WeaverbirdsCatmullClarkSubdivision(MeshCurves=item_2, Level=1, SmoothNakedEdges=1)
entwine_2 = Entwine(
    Branch00=show_3,
    Branch01=length_line_3,
    Branch02=volume_7,
    Branch03=floor_2,
    Branch04=sc_3,
    Branch05=anchor_3,
    Branch06=show_4,
    FlattenInputs=True)  # disabled
number_slider_23 = Slider(0.3, range=0..1)  # disabled
panel_8 = Panel("0.000001")  # disabled
button = Button()  # disabled
toggle = BooleanToggle(False)  # disabled
button_2 = Button()  # disabled
unweld_2 = UnweldMesh(Mesh=wbcatmullclark, Angle=degrees(1))
bouncysolver_3 = BouncySolver(
    GoalObjects=entwine_2,
    Reset=button,
    Threshold=1e-15,
    Tolerance=1e-05,
    Damping=number_slider_23,
    Iterations=10,
    On=toggle)  # -> I, V, O; disabled

# ---- group: GEOMETRY PREVIEW
preview_2 = CustomPreview(Geometry=unweld_2, Material=ColourSwatch(SwatchColor=RGB(176, 176, 176)))

# ----
item_3 = ListItem(List=bouncysolver_3.O, Index=0, Wrap=True)  # disabled
number_slider_24 = Slider(2, range=0..10)  # disabled
wblaplace = WeaverbirdsLaplacianSmoothing(MeshCurves=item_3, Level=1, SmoothNakedEdges=1, Thin=1)  # disabled
wbloop_2 = WeaverbirdsLoopSubdivision(MeshCurves=item_3, Level=number_slider_24, SmoothNakedEdges=1)  # disabled
unweld_3 = UnweldMesh(Mesh=wbloop_2, Angle=degrees(1.570796327))  # disabled
preview_3 = CustomPreview(
    Geometry=unweld_3,
    Material={diffuse=RGB(221, 160, 221), emission=RGB(66, 48, 66), shine=0.5, specular=RGB(255, 255, 255), transparency=0})  # disabled

# ---- group: Deconstruct/Construct Mesh
mesh_uv_3 = MeshSurface(Surface=rectangle.Rectangle, UCount=number_slider_4, VCount=number_slider_4, Overhang=True, Equalize=False)
demesh_3 = DeconstructMesh(Mesh=mesh_uv_3)  # -> Vertices, Faces, Colours, Normals

# ---- group: Adding depth to the mesh
nv_4 = NakedVertices(Mesh=mesh_uv_3)  # -> ClothedIndex, NakedIndex, ClothedPts, NakedPts
Z_3 = UnitZ(Factor=0.1)
move_5 = Move(Geometry=nv_4.ClothedPts, Motion=Z_3)  # -> Geometry, Transform
replace_3 = ReplaceItems(List=demesh_3.Vertices, Item=move_5.Geometry, Indices=nv_4.ClothedIndex, Wrap=False)

# ---- group: Deconstruct/Construct Mesh (continued)
conmesh_3 = ConstructMesh(Vertices=replace_3, Faces=demesh_3.Faces)

# ---- group: Creating a double layered mesh
xy_5 = XYPlane(Origin=Point(0, 0, 0))
mirror_3 = Mirror(Geometry=conmesh_3, Plane=xy_5)  # -> Geometry, Transform
clean_5 = CombineClean(Meshes=[conmesh_3, mirror_3.Geometry])

# ----
# You can use mesh edges or length component to restrain the mesh topology
# Pressure force to move mesh faces towards the normal direction
number_slider_25 = Slider(21, range=0..1000)
edgelengths_2 = EdgeLengths(Mesh=clean_5, LengthFactor=1, Strength=number_slider_25)

# ---- group: Mesh Pressure
# Mesh creases or anchor points
number_slider_26 = Slider(0.413, range=0..1)
pressure = Pressure(M=clean_5, Strength=number_slider_26)

# ----
nv_5 = NakedVertices(Mesh=mirror_3.Geometry)  # -> ClothedIndex, NakedIndex, ClothedPts, NakedPts
anchor_4 = Anchor(Point=nv_5.NakedPts, Strength="1000")

show_5 = Show(G=clean_5)
merge_4 = Merge(Data1=show_5, Data2=edgelengths_2, Data3=pressure, Data4=anchor_4)
bouncysolver_4 = BouncySolver(
    GoalObjects=merge_4,
    Reset=Button(),
    Threshold=1e-15,
    Tolerance=0.0001,
    Damping=Slider(0.943, range=0..1),
    Iterations=10,
    On=Toggle(True))  # -> I, V, O
item_4 = ListItem(List=bouncysolver_4.O, Index=0, Wrap=True)

# ---- group: GEOMETRY PREVIEW
preview_4 = CustomPreview(Geometry=item_4, Material=ColourSwatch(SwatchColor=RGB(176, 176, 176)))

# ---- group: Adding depth to the mesh
nv_6 = NakedVertices(Mesh=mesh_uv)  # -> ClothedIndex, NakedIndex, ClothedPts, NakedPts
Z_4 = UnitZ(Factor=0.1)
move_6 = Move(Geometry=nv_6.ClothedPts, Motion=Z_4)  # -> Geometry, Transform

# ---- group: Deconstruct/Construct Mesh
demesh_4 = DeconstructMesh(Mesh=mesh_uv)  # -> Vertices, Faces, Colours, Normals

# ---- group: Adding depth to the mesh (continued)
replace_4 = ReplaceItems(List=demesh_4.Vertices, Item=move_6.Geometry, Indices=nv_6.ClothedIndex, Wrap=False)

# ---- group: Deconstruct/Construct Mesh (continued)
conmesh_4 = ConstructMesh(Vertices=replace_4, Faces=demesh_4.Faces)

# ----
mirror_4 = Mirror(Geometry=conmesh_4, Plane=xy)  # -> Geometry, Transform
clean_6 = CombineClean(Meshes=[mirror_4.Geometry, conmesh_4])
nv_7 = NakedVertices(Mesh=mirror_4.Geometry)  # -> ClothedIndex, NakedIndex, ClothedPts, NakedPts
wbvertices_6 = WeaverbirdsVerticesComponent(MeshClosedPolylinesGroup=clean_6, Weld=True)
edgelengths_3 = EdgeLengths(Mesh=clean_6, LengthFactor=1, Strength=Slider(8, range=0..10))
pressure_2 = Pressure(M=clean_6, Strength=Slider(0.613, range=0..1))
anchor_5 = Anchor(Point=nv_7.NakedPts, Strength="1000")
spc_2 = SolidPointCollide(Points=wbvertices_6, Solid=meshsubd, Interior=False, Unidirectional=True, Strength="500000")
show_6 = Show(G=clean_6)
merge_5 = Merge(Data1=show_6, Data2=edgelengths_3, Data3=pressure_2, Data4=anchor_5, Data5=spc_2)
bouncysolver_5 = BouncySolver(
    GoalObjects=merge_5,
    Reset=Button(),
    Threshold=1e-15,
    Tolerance=0.0001,
    Damping=Slider(0.866, range=0..1),
    Iterations=10,
    On=Toggle(False))  # -> I, V, O
item_5 = ListItem(List=bouncysolver_5.O, Index=0, Wrap=True)
wbcatmullclark_2 = WeaverbirdsCatmullClarkSubdivision(MeshCurves=item_5, Level=1, SmoothNakedEdges=1)

# ---- group: GEOMETRY PREVIEW
preview_5 = CustomPreview(
    Geometry=wbcatmullclark_2,
    Material={diffuse=RGB(221, 160, 221), emission=RGB(66, 48, 66), shine=0.5, specular=RGB(255, 255, 255), transparency=0})

# ---- group: Adding depth to the mesh
nv_8 = NakedVertices(Mesh=triremesh_3.Triangulation)  # -> ClothedIndex, NakedIndex, ClothedPts, NakedPts
Z_5 = UnitZ(Factor=0.1)
move_7 = Move(Geometry=nv_8.ClothedPts, Motion=Z_5)  # -> Geometry, Transform

# ----
data_6 = Data(nv_8.NakedPts)

# ---- group: Deconstruct/Construct Mesh
demesh_5 = DeconstructMesh(Mesh=triremesh_3.Triangulation)  # -> Vertices, Faces, Colours, Normals

# ---- group: Adding depth to the mesh (continued)
replace_5 = ReplaceItems(List=demesh_5.Vertices, Item=move_7.Geometry, Indices=nv_8.ClothedIndex, Wrap=False)

# ---- group: Deconstruct/Construct Mesh (continued)
conmesh_5 = ConstructMesh(Vertices=replace_5, Faces=demesh_5.Faces)

# ----
mirror_5 = Mirror(Geometry=conmesh_5, Plane=xy_4)  # -> Geometry, Transform
clean_7 = CombineClean(Meshes=[mirror_5.Geometry, conmesh_5])
medges_6 = MeshEdges(Mesh=clean_7)  # -> NakedEdges, InteriorEdges, NonManifoldEdges
wbvertices_7 = WeaverbirdsVerticesComponent(MeshClosedPolylinesGroup=clean_7, Weld=True)
len_4 = Length(Curve=medges_6.InteriorEdges)
avr_4 = Average(Input=len_4)
nv_9 = NakedVertices(Mesh=mirror_5.Geometry)  # -> ClothedIndex, NakedIndex, ClothedPts, NakedPts
multiplication_7 = Multiplication(A=avr_4, B=Slider(0.6, range=0..10))
edgelengths_4 = EdgeLengths(Mesh=clean_7, LengthFactor=1, Strength=Slider(8, range=0..10))
show_7 = Show(G=clean_7)
pressure_3 = Pressure(M=clean_7, Strength=Slider(0.76, range=0..1))
anchor_6 = Anchor(Point=nv_9.NakedPts, Strength="1000")
sc_4 = SphereCollide(Points=wbvertices_7, Radius=multiplication_7, Strength=Slider(50, range=0..100))
merge_6 = Merge(Data1=show_7, Data2=edgelengths_4, Data3=pressure_3, Data4=anchor_6, Data5=sc_4)
bouncysolver_6 = BouncySolver(
    GoalObjects=merge_6,
    Reset=Button(),
    Threshold=1e-15,
    Tolerance=0.0001,
    Damping=Slider(0.913, range=0..1),
    Iterations=10,
    On=Toggle(False))  # -> I, V, O
item_6 = ListItem(List=bouncysolver_6.O, Index=0, Wrap=True)
wbcatmullclark_3 = WeaverbirdsCatmullClarkSubdivision(MeshCurves=item_6, Level=1, SmoothNakedEdges=1)
unweld_4 = UnweldMesh(Mesh=wbcatmullclark_3, Angle=1)

# ---- group: GEOMETRY PREVIEW
preview_6 = CustomPreview(
    Geometry=unweld_4,
    Material={diffuse=RGB(221, 160, 221), emission=RGB(66, 48, 66), shine=0.5, specular=RGB(255, 255, 255), transparency=0})

# ==== cluster Cluster
pi = Pi(Factor="0")
pi_2 = Pi(Factor="2")
neg = Negative(Value="0.5")
pi_3 = Pi(Factor=neg)
pi_4 = Pi(Factor="0.5")
dom = ConstructDomain(DomainStart=pi, DomainEnd=pi_2)
dom_2 = ConstructDomain(DomainStart=pi_3, DomainEnd=pi_4)
range = Range(Domain=dom_2, Steps=10)
range_2 = Range(Domain=dom, Steps="30")
crossref = CrossReference(ListA=range, ListB=range_2, CrossMode=1)  # -> ListA, ListB
F = ClusterInput()
a = ClusterInput()
b = ClusterInput()
c = ClusterInput()
eval = Evaluate(F=graft(F), a=a, b=b, c=c, v=crossref.ListA, u=crossref.ListB)
bang = ExplodeTree(Data=eval)  # -> Branch0, Branch1, Branch2
pt = ConstructPoint(XCoordinate=bang.Branch0, YCoordinate=bang.Branch1, ZCoordinate=bang.Branch2)
srfgrid = SurfaceFromPoints(Points=pt, UCount=expr("X+1", "30"), Interpolate=invert(False))
S = ClusterOutput(srfgrid)
