# Grasshopper definition for testing inflatables.gh (Grasshopper 1.0.7)
# plug-ins: Human, Pufferfish, Speckle 2, MeshEdit Components, MetaHopper, treesloth01, ShapeDiverForGrasshopper, Rhino.Inside for Autodesk Revit

sddp = ShapeDiverDocumentPayload()

# ----
# Enable To Upload Geomtry to Speckle Server
toggle = GroupToggle(ToggleActive=True, ToggleVisible=False)  # disabled
link_to_upload_to_our_speckle_server = Panel("https://macad.speckle.xyz/streams/4975f9f0a8/branches/students%2Fg06-site_locations")  # disabled
panel = Panel("SiteLocationSelection")  # disabled
send = Send(
    Stream=link_to_upload_to_our_speckle_server,
    Message=panel,
    AutoSend=False,
    CurrentComponentState="needs_input",
    KitName="Objects",
    UseDefaultCache=True,
    selectedKitName="Objects")  # disabled

# ----
# Get Topo from Speckle
panel_2 = Panel("https://macad.speckle.xyz/streams/4975f9f0a8/branches/site%2F00-federated-model")
receive = Receive(
    Stream=panel_2,
    AutoReceive=False,
    CurrentComponentState="up_to_date",
    ExpandOutput=True,
    LastInfoMessage="James McBennett @ 01/19/2024 01:06:29: Pushed 38 elements from Grasshopper. (id:b5d4e56588)",
    ReceiveOnOpen=False,
    ReceivedCommitId="b5d4e56588",
    StreamWrapper="https://macad.speckle.xyz/streams/4975f9f0a8/branches/site/00-federated-model",
    selectedKitName="Objects")  # -> Info, CollectionType, Elements, Info_2, Levels, Name, Types
dso = DeconstructSpeckleObject(SpeckleObject=receive.Elements, selectedKitName="Objects")  # -> CollectionType, Elements, Name
dso_2 = DeconstructSpeckleObject(SpeckleObject=dso.Elements, selectedKitName="Objects")  # -> BaseGeometry, BaseLine, BuiltInCategory, Category, DisplayValue, ElementId, IsRevitLinkedModel, Label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
clean = CleanTree(RemoveNulls=True, RemoveInvalid=True, RemoveEmpty=True, Tree=dso_2.BaseLine)
clean_2 = CleanTree(RemoveNulls=True, RemoveInvalid=True, RemoveEmpty=True, Tree=dso_2.DisplayValue)  # -> flatten(Tree)
previewlw = CustomPreviewLineweights(Geometry=clean, Shader=ColourSwatch(SwatchColor=RGB(138, 138, 138)), Absolute=False)
item = ListItem(List=clean_2, Index=Slider(0, range=0..2), Wrap=True)

# ----
# Get SiteLocation from Speckle
panel_3 = Panel("https://macad.speckle.xyz/streams/4975f9f0a8/commits/6c185bed15")
receive_2 = Receive(
    Stream=panel_3,
    AutoReceive=False,
    CurrentComponentState="up_to_date",
    ExpandOutput=True,
    LastInfoMessage="James McBennett @ 01/20/2024 17:54:06: Pushed 5 elements from Grasshopper. (id:6c185bed15)",
    ReceiveOnOpen=False,
    ReceivedCommitId="6c185bed15",
    StreamWrapper="https://macad.speckle.xyz/streams/4975f9f0a8/commits/6c185bed15",
    selectedKitName="Objects")  # -> Info, Data
dso_3 = DeconstructSpeckleObject(SpeckleObject=receive_2.Data, selectedKitName="Objects")  # -> GROUPNAME, SPHERELOCATION

mesh = Mesh(dso_3.SPHERELOCATION)
clean_3 = CleanTree(RemoveNulls=True, RemoveInvalid=True, RemoveEmpty=True, Tree=dso_2.DisplayValue)  # -> flatten(Tree)
volume = MeshVolume(Mesh=dso_3.SPHERELOCATION)  # -> Volume, Centroid

# ---- group: Site Contours
Z = UnitZ(Factor=expr("-x", Slider(353, range=0..10000)))
project = Project(Geometry=item, Plane=Z)  # -> Geometry, Transform
swatch = ColourSwatch(SwatchColor=RGB(64, 64, 64))
medges = MeshEdges(Mesh=project.Geometry)  # -> NakedEdges, InteriorEdges, NonManifoldEdges
contour = Contour(Shape=item, Point=Point(0, 0, 0), Direction=Vector(0, 0, 1), Distance="50")
previewlw_2 = CustomPreviewLineweights(Geometry=[contour, medges.NakedEdges], Shader=swatch, Absolute=False)

# ---- group: Populate surface
number_slider = Slider(51, range=0..100)  # disabled
popgeo = PopulateGeometry(Geometry=item, Count=number_slider, Seed=1)  # disabled
sph = Sphere(Base=popgeo, Radius=500)  # disabled
mesh_2 = Mesh(sph)  # disabled

# ----
mmx = MeshMesh(MeshA=item, MeshB=mesh)
divide = DivideCurve(Curve=mmx, Count=10, Kinks=False)  # -> Points, Tangents, Parameters
item_2 = ListItem(List=clean_3, Index=Slider(0, range=0..2), Wrap=True)

# ---- group: Site Perimeter Sphere
number_slider_2 = Slider(0.747, range=0..1)  # disabled
number_slider_3 = Slider(3, range=0..10)  # disabled
swatch_2 = ColourSwatch(SwatchColor=RGB(143, 26, 26))  # disabled
previewmat = CustomPreviewMaterials(Geometry=mesh, DiffuseColor=swatch_2, Transparency=number_slider_2)  # disabled
previewlw_3 = CustomPreviewLineweights(Geometry=mmx, Shader=swatch_2, Thickness=number_slider_3, Absolute=False)  # disabled

# ---- group: Generate clean surface for aggregation
number_slider_4 = Slider(318, range=0..500)
dom = ConstructDomain(DomainStart=expr("-x", number_slider_4), DomainEnd=number_slider_4)
project_2 = Project(Geometry=volume.Centroid, Plane=PlaneXY(0, 0, 0))  # -> Geometry, Transform
rectangle = Rectangle(Plane=project_2.Geometry, XSize=dom, YSize=dom, Radius=0)  # -> Rectangle, Length
number_slider_5 = Slider(30, range=0..100)
msplit = MeshSplit(Mesh=item_2, Splitters=mesh)
sdivide = DivideSurface(Surface=rectangle.Rectangle, UCount=number_slider_5, VCount=number_slider_5)  # -> Points, Normals, Parameters
item_3 = ListItem(List=msplit, Index=Slider(1, range=0..1), Wrap=True)
line = LineSDL(Start=sdivide.Points, Direction=Vector(0, 0, 1), Length="10000")
mcx = MeshCurve(Mesh=item_3, Curve=line)  # -> flatten(Points), Faces
srfgrid = SurfaceFromPoints(Points=mcx.Points, UCount=expr("x+1", number_slider_5), Interpolate=False)
previewmat_2 = CustomPreviewMaterials(Geometry=srfgrid, DiffuseColor=RGB(255, 255, 255), Transparency=Slider(0.772, range=0..1))

# ---- group: Height of side of full site
Z_2 = UnitZ(Factor=expr("-x", Slider(353, range=0..10000)))
project_3 = Project(Geometry=item_2, Plane=Z_2)  # -> Geometry, Transform
bbox = BoundingBox(Content=project_3.Geometry, Plane=PlaneXY(0, 0, 0))  # -> Box, Box_2
debrep = DeconstructBrep(Brep=bbox.Box)  # -> Faces, Edges, Vertices
Z_3 = UnitZ(Factor="10000")
move = Move(Geometry=debrep.Vertices, Motion=Z_3)  # -> Geometry, Transform
ln = Line(StartPoint=debrep.Vertices, EndPoint=move.Geometry)
mcx_2 = MeshCurve(Mesh=item_2, Curve=ln)  # -> flatten(Points), Faces
ln_2 = Line(StartPoint=debrep.Vertices, EndPoint=mcx_2.Points)
len = Length(Curve=ln_2)
round = Round(Number=len)  # -> Nearest, Floor, Ceiling
midpt = CurveMiddle(Curve=ln_2)
concat = Concatenate(FragmentA=round.Nearest, FragmentB=" ", FragmentC="M")
tag = TextTag(Location=midpt, Text=concat, Colour=ColourSwatch(SwatchColor=RGB(64, 64, 64)))

# ----
pdecon = Deconstruct(Point=divide.Points)  # -> XComponent, YComponent, ZComponent
bnd = Bounds(Numbers=pdecon.ZComponent)
panel_4 = Panel(bnd)
dedomain = DeconstructDomain(Domain=bnd)  # -> Start, End
equals = Equality(FirstNumber=pdecon.ZComponent, SecondNumber=dedomain.Start)  # -> Equality, Inequality
cull = CullPattern(List=divide.Points, CullPattern=equals.Equality)  # -> flatten(List)
vec2pt = Vector2Pt(PointA=volume.Centroid, PointB=cull, Unitize=False)  # -> Vector, Length
vec2pt_2 = Vector2Pt(PointA=volume.Centroid, PointB=cull, Unitize=False)  # -> Vector, Length
angle = Angle(VectorA=vec2pt.Vector, VectorB=vec2pt_2.Vector)  # -> Angle, Reflex
deg = Degrees(Radians=angle.Reflex)
abs = Absolute(Value=deg)
subtraction = Subtraction(A="360", B=abs)

number_slider_6 = Slider(0.25, range=0..1)
wires = BrepWireframe(Brep=srfgrid, Density=-1)
previewlw_4 = CustomPreviewLineweights(Geometry=wires, Shader=swatch, Absolute=False)
wires_2 = BrepWireframe(Brep=srfgrid, Density=-1)
join = JoinCurves(Curves=wires_2, Preserve=False)

number_of_possible_locations = Slider(4, range=1..4)
# 5 MAIN PROGRAM SELECTION BASED ON SLOPE CONSTRAINTS
select_slope_for_main_site_limit = Panel("14")

# ---- group: populate site with 50 possible locations
popgeo_2 = PopulateGeometry(Geometry=srfgrid, Count=Slider(800, range=0..1000), Seed=1)
sph_2 = Sphere(Base=popgeo_2, Radius="10")
mesh_3 = Mesh(sph_2)
mmx_2 = MeshMesh(MeshA=item, MeshB=mesh_3)  # -> flatten(Intersections)
volume_2 = MeshVolume(Mesh=mesh_3)  # -> Volume, Centroid
project_4 = Project(Geometry=mmx_2, Plane=PlaneXY(0, 0, 0))  # -> Geometry, Transform
Z_4 = UnitZ(Factor=expr("-x", "10000"))
move_2 = Move(Geometry=project_4.Geometry, Motion=Z_4)  # -> Geometry, Transform
divide_2 = DivideCurve(Curve=move_2.Geometry, Count=4, Kinks=False)  # -> Points, Tangents, Parameters
item_4 = ListItem(List=divide_2.Points, Index=0, Wrap=True)
ln_3 = Line(StartPoint=flatten(item_4), EndPoint=volume_2.Centroid)

# ----
addition = Addition(A="10", B="30")
# next closest point with limitation of 40 as min
panel_5 = Panel(addition)

divide_3 = DivideCurve(Curve=flatten(mmx_2), Count=10, Kinks=False)  # -> Points, Tangents, Parameters
pdecon_2 = Deconstruct(Point=divide_3.Points)  # -> XComponent, YComponent, ZComponent
bnd_2 = Bounds(Numbers=pdecon_2.ZComponent)
dedomain_2 = DeconstructDomain(Domain=bnd_2)  # -> Start, End
equals_2 = Equality(FirstNumber=pdecon_2.ZComponent, SecondNumber=dedomain_2.Start)  # -> Equality, Inequality
cull_2 = CullPattern(List=divide_3.Points, CullPattern=equals_2.Equality)  # -> flatten(List)

# ---- group: get slope angle of all main sites
pt = Point(volume_2.Centroid)
pt_2 = Point(cull_2)

Z_5 = UnitZ(Factor="10000")
move_3 = Move(Geometry=pt_2, Motion=Z_5)  # -> Geometry, Transform
ln_4 = Line(StartPoint=pt_2, EndPoint=move_3.Geometry)
crv_cp = CurveClosestPoint(Point=pt, Curve=ln_4)  # -> Point, Parameter, Distance
vec2pt_3 = Vector2Pt(PointA=pt, PointB=crv_cp.Point, Unitize=False)  # -> Vector, Length
vec2pt_4 = Vector2Pt(PointA=pt, PointB=pt_2, Unitize=False)  # -> Vector, Length
angle_2 = Angle(VectorA=vec2pt_4.Vector, VectorB=vec2pt_3.Vector)  # -> Angle, Reflex
deg_2 = Degrees(Radians=angle_2.Angle)
int = Integer(deg_2)

# ----
vdis = VectorDisplay(Anchor=pt, Vector=vec2pt_3.Vector)
len_2 = Length(Curve=ln_3)
swatch_3 = ColourSwatch(SwatchColor=RGB(64, 64, 64))
shatter = Shatter()
midpt_2 = CurveMiddle(Curve=ln_3)
roundd = RoundToDecimalPlace(NumberX=len_2, DecimalPlace="1", RoundType=0)  # -> Rounded, Difference
previewlw_5 = CustomPreviewLineweights(Geometry=flatten(ln_3), Shader=swatch_3, Absolute=False)
tag_2 = TextTag(Location=midpt_2, Text=roundd.Rounded, Colour=swatch_3)

# ---- group: ROAD CURVES
crv = Curve(<curve referenced from the Rhino model>)

# ----
# Press the button to make sure the file is
# updated to latest Wasp version on your pc.
button = Button()  # disabled
updatefile = Wasp_UpdateFile(UPDATE=button)  # -> LOG; inputs UPDATE: Boolean; disabled; plug-in component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

project_5 = Project(Curve=crv, Brep=srfgrid, Direction=Vector(0, 0, 1))  # disabled
number_slider_7 = Slider(0.4, range=0..1)  # disabled
previewlw_6 = CustomPreviewLineweights(Geometry=mmx, Shader=ColourSwatch(SwatchColor=RGB(143, 26, 26)), Thickness=Slider(3, range=0..10), Absolute=False)
number_slider_8 = Slider(0.4, range=0..1)  # disabled

# ---- group: M4
crv_2 = Curve([<curve referenced from the Rhino model> x2])
geo = Geometry(<brep referenced from the Rhino model>)
pt_3 = Point([<point referenced from the Rhino model> x2])
points = PointList(Points=pt_3, Size=number_slider_7)
stack = StackTrees(Data0=geo, Data1=pt_3, Data2=crv_2, Reduce=True)

# ---- group: M3
geo_2 = Geometry(<brep referenced from the Rhino model>)  # disabled
pt_4 = Point([<point referenced from the Rhino model> x3])  # disabled
crv_3 = Curve([<curve referenced from the Rhino model> x3])  # disabled
points_2 = PointList(Points=pt_4, Size=number_slider_7)  # disabled
stack_2 = StackTrees(Data0=geo_2, Data1=pt_4, Data2=crv_3, Reduce=True)  # disabled

# ---- group: M4
geo_3 = Geometry(<brep referenced from the Rhino model>)  # disabled
pt_5 = Point([<point referenced from the Rhino model> x2])  # disabled
crv_4 = Curve([<curve referenced from the Rhino model> x2])  # disabled
points_3 = PointList(Points=pt_5, Size=number_slider_7)  # disabled
stack_3 = StackTrees(Data0=geo_3, Data1=pt_5, Data2=crv_4, Reduce=True)  # disabled

# ---- group: M3
geo_4 = Geometry(<brep referenced from the Rhino model>)  # disabled
pt_6 = Point([<point referenced from the Rhino model> x3])  # disabled
crv_5 = Curve([<curve referenced from the Rhino model> x3])  # disabled
points_4 = PointList(Points=pt_6, Size=number_slider_7)  # disabled
stack_4 = StackTrees(Data0=geo_4, Data1=pt_6, Data2=crv_5, Reduce=True)  # disabled

# ---- group: M1
geo_5 = Geometry(<brep referenced from the Rhino model>)  # disabled
pt_7 = Point(<point referenced from the Rhino model>)  # disabled
crv_6 = Curve(<curve referenced from the Rhino model>)  # disabled
points_5 = PointList(Points=pt_7, Size=number_slider_7)  # disabled
stack_5 = StackTrees(Data0=geo_5, Data1=pt_7, Data2=crv_6, Reduce=True)  # disabled

# ---- group: M2
geo_6 = Geometry(<brep referenced from the Rhino model>)  # disabled
pt_8 = Point([<point referenced from the Rhino model> x2])  # disabled
crv_7 = Curve([<curve referenced from the Rhino model> x2])  # disabled
points_6 = PointList(Points=pt_8, Size=number_slider_7)  # disabled
stack_6 = StackTrees(Data0=geo_6, Data1=pt_8, Data2=crv_7, Reduce=True)  # disabled

# ---- group: M1
geo_7 = Geometry(<brep referenced from the Rhino model>)  # disabled
pt_9 = Point([<point referenced from the Rhino model> x3])  # disabled
crv_8 = Curve([<curve referenced from the Rhino model> x3])  # disabled
points_7 = PointList(Points=pt_9, Size=number_slider_8)  # disabled
stack_7 = StackTrees(Data0=geo_7, Data1=pt_9, Data2=crv_8, Reduce=True)  # disabled

# ---- group: M2
geo_8 = Geometry(<brep referenced from the Rhino model>)  # disabled
pt_10 = Point([<point referenced from the Rhino model> x2])  # disabled
crv_9 = Curve([<curve referenced from the Rhino model> x2])  # disabled
points_8 = PointList(Points=pt_10, Size=number_slider_8)  # disabled
stack_8 = StackTrees(Data0=geo_8, Data1=pt_10, Data2=crv_9, Reduce=True)  # disabled

# ---- group: M3
geo_9 = Geometry(<brep referenced from the Rhino model>)  # disabled
pt_11 = Point([<point referenced from the Rhino model> x2])  # disabled
crv_10 = Curve([<curve referenced from the Rhino model> x2])  # disabled
points_9 = PointList(Points=pt_11, Size=number_slider_8)  # disabled
stack_9 = StackTrees(Data0=geo_9, Data1=pt_11, Data2=crv_10, Reduce=True)  # disabled

# ---- group: M4
geo_10 = Geometry(<brep referenced from the Rhino model>)  # disabled
pt_12 = Point([<point referenced from the Rhino model> x2])  # disabled
crv_11 = Curve([<curve referenced from the Rhino model> x2])  # disabled
points_10 = PointList(Points=pt_12, Size=number_slider_8)  # disabled
stack_10 = StackTrees(Data0=geo_10, Data1=pt_12, Data2=crv_11, Reduce=True)  # disabled

# ----
volume_3 = Volume(Geometry=geo_6)  # -> Volume, Centroid; disabled
bang = ExplodeTree(Data=stack_6)  # -> Branch0, Branch1, Branch2; disabled
conndir = Wasp_ConnectionFromDirection(GEO=bang.Branch0, CEN=bang.Branch1, UP=bang.Branch2)  # -> CONN, PLN_OUT; inputs CEN: list of Point3d, UP: list of Curve, T: list; disabled; plug-in component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
toggle_2 = BooleanToggle(True)  # disabled
panel_6 = Panel("KIT")  # disabled
tag_3 = TextTag(Location=volume_3.Centroid, Text=panel_6)  # disabled
geo_11 = Geometry()  # disabled
attribute = Wasp_Attribute(ID=panel_6, VAL=geo_11, TR=toggle_2)  # -> ATTR; inputs VAL: list, TR: Boolean; disabled; plug-in component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
part = Wasp_BasicPart(NAME=panel_6, GEO=bang.Branch0, CONN=flatten(conndir.CONN))  # -> PART; inputs GEO: Mesh, CONN: list, ATTR: list; disabled; plug-in component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

volume_4 = Volume(Geometry=geo_2)  # -> Volume, Centroid; disabled
bang_2 = ExplodeTree(Data=stack_2)  # -> Branch0, Branch1, Branch2; disabled
conndir_2 = Wasp_ConnectionFromDirection(GEO=bang_2.Branch0, CEN=bang_2.Branch1, UP=bang_2.Branch2)  # -> CONN, PLN_OUT; inputs CEN: list of Point3d, UP: list of Curve, T: list; disabled; plug-in component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
toggle_3 = BooleanToggle(True)  # disabled
geo_12 = Geometry()  # disabled
panel_7 = Panel("VOID1")  # disabled
tag_4 = TextTag(Location=volume_4.Centroid, Text=panel_7)  # disabled
attribute_2 = Wasp_Attribute(ID=panel_7, VAL=geo_12, TR=toggle_3)  # -> ATTR; inputs VAL: list, TR: Boolean; disabled; plug-in component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
part_2 = Wasp_BasicPart(NAME=panel_7, GEO=bang_2.Branch0, CONN=flatten(conndir_2.CONN))  # -> PART; inputs GEO: Mesh, CONN: list, ATTR: list; disabled; plug-in component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

volume_5 = Volume(Geometry=geo_4)  # -> Volume, Centroid; disabled
bang_3 = ExplodeTree(Data=stack_4)  # -> Branch0, Branch1, Branch2; disabled
conndir_3 = Wasp_ConnectionFromDirection(GEO=bang_3.Branch0, CEN=bang_3.Branch1, UP=bang_3.Branch2)  # -> CONN, PLN_OUT; inputs CEN: list of Point3d, UP: list of Curve, T: list; disabled; plug-in component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
toggle_4 = BooleanToggle(True)  # disabled
panel_8 = Panel("CIR1")  # disabled
tag_5 = TextTag(Location=volume_5.Centroid, Text=panel_8)  # disabled
geo_13 = Geometry()  # disabled
attribute_3 = Wasp_Attribute(ID=panel_8, VAL=geo_13, TR=toggle_4)  # -> ATTR; inputs VAL: list, TR: Boolean; disabled; plug-in component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
part_3 = Wasp_BasicPart(NAME=panel_8, GEO=bang_3.Branch0, CONN=flatten(conndir_3.CONN))  # -> PART; inputs GEO: Mesh, CONN: list, ATTR: list; disabled; plug-in component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

volume_6 = Volume(Geometry=geo_3)  # -> Volume, Centroid; disabled
bang_4 = ExplodeTree(Data=stack_3)  # -> Branch0, Branch1, Branch2; disabled
conndir_4 = Wasp_ConnectionFromDirection(GEO=bang_4.Branch0, CEN=bang_4.Branch1, UP=bang_4.Branch2)  # -> CONN, PLN_OUT; inputs CEN: list of Point3d, UP: list of Curve, T: list; disabled; plug-in component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
toggle_5 = BooleanToggle(True)  # disabled
geo_14 = Geometry()  # disabled
panel_9 = Panel("CIR2")  # disabled
tag_6 = TextTag(Location=volume_6.Centroid, Text=panel_9)  # disabled
attribute_4 = Wasp_Attribute(ID=panel_9, VAL=geo_14, TR=toggle_5)  # -> ATTR; inputs VAL: list, TR: Boolean; disabled; plug-in component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
part_4 = Wasp_BasicPart(NAME=panel_9, GEO=bang_4.Branch0, CONN=flatten(conndir_4.CONN))  # -> PART; inputs GEO: Mesh, CONN: list, ATTR: list; disabled; plug-in component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

volume_7 = Volume(Geometry=geo)  # -> Volume, Centroid
bang_5 = ExplodeTree(Data=stack)  # -> Branch0, Branch1, Branch2
conndir_5 = Wasp_ConnectionFromDirection(GEO=bang_5.Branch0, CEN=bang_5.Branch1, UP=bang_5.Branch2)  # -> CONN, PLN_OUT; inputs CEN: list of Point3d, UP: list of Curve, T: list; plug-in component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
geo_15 = Geometry()
tag_7 = TextTag(Location=volume_7.Centroid, Text="VOID2")
attribute_5 = Wasp_Attribute(ID="VOID2", VAL=geo_15, TR=Toggle(True))  # -> ATTR; inputs VAL: list, TR: Boolean; plug-in component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
part_5 = Wasp_BasicPart(NAME="VOID2", GEO=bang_5.Branch0, CONN=flatten(conndir_5.CONN))  # -> PART; inputs GEO: Mesh, CONN: list, ATTR: list; plug-in component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

bang_6 = ExplodeTree(Data=stack_8)  # -> Branch0, Branch1, Branch2; disabled
conndir_6 = Wasp_ConnectionFromDirection(GEO=bang_6.Branch0, CEN=bang_6.Branch1, UP=bang_6.Branch2)  # -> CONN, PLN_OUT; inputs CEN: list of Point3d, UP: list of Curve, T: list; disabled; plug-in component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
toggle_6 = BooleanToggle(True)  # disabled
panel_10 = Panel("KIT")  # disabled
geo_16 = Geometry()  # disabled
attribute_6 = Wasp_Attribute(ID=panel_10, VAL=geo_16, TR=toggle_6)  # -> ATTR; inputs VAL: list, TR: Boolean; disabled; plug-in component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
part_6 = Wasp_BasicPart(NAME=panel_10, GEO=bang_6.Branch0, CONN=flatten(conndir_6.CONN))  # -> PART; inputs GEO: Mesh, CONN: list, ATTR: list; disabled; plug-in component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

bang_7 = ExplodeTree(Data=stack_9)  # -> Branch0, Branch1, Branch2; disabled
conndir_7 = Wasp_ConnectionFromDirection(GEO=bang_7.Branch0, CEN=bang_7.Branch1, UP=bang_7.Branch2)  # -> CONN, PLN_OUT; inputs CEN: list of Point3d, UP: list of Curve, T: list; disabled; plug-in component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
toggle_7 = BooleanToggle(True)  # disabled
panel_11 = Panel("CIR1")  # disabled
geo_17 = Geometry()  # disabled
attribute_7 = Wasp_Attribute(ID=panel_11, VAL=geo_17, TR=toggle_7)  # -> ATTR; inputs VAL: list, TR: Boolean; disabled; plug-in component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
part_7 = Wasp_BasicPart(NAME=panel_11, GEO=bang_7.Branch0, CONN=flatten(conndir_7.CONN))  # -> PART; inputs GEO: Mesh, CONN: list, ATTR: list; disabled; plug-in component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

bang_8 = ExplodeTree(Data=stack_10)  # -> Branch0, Branch1, Branch2; disabled
conndir_8 = Wasp_ConnectionFromDirection(GEO=bang_8.Branch0, CEN=bang_8.Branch1, UP=bang_8.Branch2)  # -> CONN, PLN_OUT; inputs CEN: list of Point3d, UP: list of Curve, T: list; disabled; plug-in component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
toggle_8 = BooleanToggle(True)  # disabled
geo_18 = Geometry()  # disabled
panel_12 = Panel("CIR2")  # disabled
attribute_8 = Wasp_Attribute(ID=panel_12, VAL=geo_18, TR=toggle_8)  # -> ATTR; inputs VAL: list, TR: Boolean; disabled; plug-in component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
part_8 = Wasp_BasicPart(NAME=panel_12, GEO=bang_8.Branch0, CONN=flatten(conndir_8.CONN))  # -> PART; inputs GEO: Mesh, CONN: list, ATTR: list; disabled; plug-in component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

panel_13 = Panel("MECHd")  # disabled

volume_8 = Volume(Geometry=geo_5)  # -> Volume, Centroid; disabled
bang_9 = ExplodeTree(Data=stack_5)  # -> Branch0, Branch1, Branch2; disabled
conndir_9 = Wasp_ConnectionFromDirection(GEO=bang_9.Branch0, CEN=bang_9.Branch1, UP=bang_9.Branch2)  # -> CONN, PLN_OUT; inputs CEN: list of Point3d, UP: list of Curve, T: list; disabled; plug-in component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
panel_14 = Panel("MECH")  # disabled
tag_8 = TextTag(Location=volume_8.Centroid, Text=panel_14)  # disabled
toggle_9 = BooleanToggle(True)  # disabled
geo_19 = Geometry(<brep referenced from the Rhino model>)  # disabled
attribute_9 = Wasp_Attribute(ID=panel_13, VAL=geo_19, TR=toggle_9)  # -> ATTR; inputs VAL: list, TR: Boolean; disabled; plug-in component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
part_9 = Wasp_BasicPart(NAME=panel_14, GEO=bang_9.Branch0, CONN=flatten(conndir_9.CONN))  # -> PART; inputs GEO: Mesh, CONN: list, ATTR: list; disabled; plug-in component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

panel_15 = Panel("MECHd")  # disabled

bang_10 = ExplodeTree(Data=stack_7)  # -> Branch0, Branch1, Branch2; disabled
conndir_10 = Wasp_ConnectionFromDirection(GEO=bang_10.Branch0, CEN=bang_10.Branch1, UP=bang_10.Branch2)  # -> CONN, PLN_OUT; inputs CEN: list of Point3d, UP: list of Curve, T: list; disabled; plug-in component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
panel_16 = Panel("MECH")  # disabled
toggle_10 = BooleanToggle(True)  # disabled
geo_20 = Geometry(<brep referenced from the Rhino model>)  # disabled
attribute_10 = Wasp_Attribute(ID=panel_15, VAL=geo_20, TR=toggle_10)  # -> ATTR; inputs VAL: list, TR: Boolean; disabled; plug-in component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
part_10 = Wasp_BasicPart(NAME=panel_16, GEO=bang_10.Branch0, CONN=flatten(conndir_10.CONN), ATTR=attribute_10)  # -> PART; inputs GEO: Mesh, CONN: list, ATTR: list; disabled; plug-in component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

merge = Merge(Data1=part_9, Data2=part, Data3=part_2, Data4=part_4, Data5=part_3, Data6=part_5)  # disabled
merge_2 = Merge(Data1=part_10, Data2=part_6, Data3=part_7, Data4=part_8)  # disabled
number_slider_9 = Slider(6, range=1..50)  # disabled
panel_17 = Panel("""MECH|0_CIR2|1
CRIT2|0_VOID1|0
VOID1|1_VOID2|1
VOID1|2_KIT|1
VOID2|0_CIR1|2
KIT|0_CIR1|1""")  # disabled
toggle_11 = BooleanToggle(False)  # disabled
rulegen = Wasp_RulesGenerator(PART=merge, SELF_P=toggle_11)  # -> R; inputs PART: list, SELF_P: Boolean, SELF_C: Boolean, TYP: Boolean, GR: list; disabled; plug-in component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
button_2 = Button()  # disabled
ruletxt = Wasp_RuleFromText(TXT=panel_17)  # -> R; disabled; plug-in component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
stochasticaggregation = Wasp_StochasticAggregation(PART=flatten(merge), N=number_slider_9, RULES=rulegen, RESET=button_2)  # -> AGGR, PART_OUT; inputs PART: list, PREV: list, N: Int32, RULES: list, SEED: Int32, MODE: Int32, GC: list, RESET: Boolean; disabled; plug-in component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
number_slider_10 = Slider(87, range=0..100)  # disabled
number_slider_11 = Slider(0.25, range=0..1)  # disabled

panel_18 = Panel("3")  # disabled
series = Series(Start=0, Step=1, Count=panel_18)  # disabled
bnd_3 = Bounds(Numbers=series)  # disabled
dedomain_3 = DeconstructDomain(Domain=bnd_3)  # -> Start, End; disabled
gradient = Gradient(
    LowerLimit=dedomain_3.Start,
    UpperLimit=dedomain_3.End,
    Parameter=series,
    stops=[0.15: RGB(255, 130, 160), 0.85: RGB(220, 0, 40)])  # disabled
number_slider_12 = Slider(2, range=0..10)  # disabled
lng = ListLength(List=stochasticaggregation.PART_OUT)  # disabled
getattr = Wasp_GetAttributeByName(PART=part_9, ID=panel_14)  # -> VAL; disabled; plug-in component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
random = Random(Range=number_slider_12, Number=lng, Seed=2, Integers=True)  # disabled
item_5 = ListItem(List=gradient, Index=random, Wrap=True)  # disabled
preview = CustomPreview(Geometry=flatten(getattr), Material=item_5)  # disabled

number_slider_13 = Slider(0.589, range=0..1)  # disabled
swatch_4 = ColourSwatch(SwatchColor=RGBA(255, 255, 255, 204))  # disabled
swatch_5 = ColourSwatch(SwatchColor=RGB(0, 0, 0))  # disabled

angsplitmsh = AngleSplitMesh(Mesh=[geo_5, geo_6, geo_2, geo_3, geo_4, geo], Angle=0, Opposite=False)  # -> Split, R; disabled
medges_2 = MeshEdges(Mesh=angsplitmsh.Split)  # -> NakedEdges, InteriorEdges, NonManifoldEdges; disabled
previewmat_3 = CustomPreviewMaterials(Geometry=[geo_5, geo_6, geo_2, geo_3, geo_4, geo], DiffuseColor=swatch_4, Transparency=number_slider_13)  # disabled
previewlw_7 = CustomPreviewLineweights(Geometry=medges_2.NakedEdges, Shader=swatch_5, Absolute=False)  # disabled

# ---- group: Create new sheets based on list
toggle_12 = BooleanToggle(False)  # disabled
drawings = Panel("""Site Plan
Floor Plan
Section
Elevation""")  # disabled
lng_2 = ListLength(List=drawings)  # disabled
series_2 = Series(Start=101, Step=1, Count=lng_2)  # disabled
panel_19 = Panel("-")  # disabled
panel_20 = Panel("A")  # disabled
filter = StreamFilter(Gate=toggle_12, Stream1=drawings)  # disabled
concat_2 = Concatenate(FragmentA=panel_20, FragmentC=panel_19, FragmentB=series_2)  # disabled
sheet = AddSheet(SheetNumber=concat_2, SheetName=filter, TrackingMode=2)  # disabled

# ---- group: Aggregation 1
geo_21 = Geometry([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])  # disabled

# ---- group: Aggregation 2
geo_22 = Geometry()  # disabled

# ----
panel_21 = Panel(rulegen)  # disabled

# ---- group: Aggregation
m_shape = AddDirectShapeMesh(Mesh=geo_21, TrackingMode=2)  # disabled

# ----
m_shape_2 = AddDirectShapeMesh(Mesh=geo_22, TrackingMode=2)  # disabled
sheets = QuerySheets(Placeholder=False, AppearsInSheetList=True, Assembly=null)  # disabled
views = QueryViews(IsDependent=False, IsTemplate=False)  # disabled
number_slider_14 = Slider(101, range=0..1000)  # disabled
value_picker = ValuePicker(sheets)  # disabled
value_picker_2 = ValuePicker(views, SearchPattern="SECTIONS")  # disabled
revisions = QueryRevisions()  # disabled
revision = Revision(revisions)  # disabled
panel_22 = Panel(views)  # disabled
crv_12 = Curve(<curve referenced from the Rhino model>)  # disabled
item_6 = ListItem(List=drawings, Index=0, Wrap=True)  # -> Item, Item1, Item2, Item3; disabled
line_2 = Line(crv_12)  # disabled
param = ElementParameter()  # -> Element, Value; disabled
sectionview = AddSectionView(Frame=line_2, Name=item_6.Item2, TrackingMode=2)  # disabled
passport = ElementPassport(Element=sectionview)  # -> DocumentGUID, Document, UniqueID, Id; disabled
e_name = ElementName(Element=sectionview)  # -> Element, Name; disabled
e_category = ElementCategory(Element=sectionview)  # -> Element, Category; disabled
e_type = ElementType(Element=sectionview)  # -> Element, Type; disabled
inspect = InspectElement(Element=sectionview)  # -> OtherFolder, OtherSRViewCalculationSettings, OtherSubfolder, OtherNone, DataBIG_Views_Exchange, GraphicsColorSchemeLocation, GraphicsHideAtScalesCoarserThan, GraphicsDefaultAnalysisDisplayStyle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; disabled
panel_23 = Panel(inspect.IdentityDataTitleOnSheet)  # disabled
panel_24 = Panel(inspect.IdentityDataViewName)  # disabled
panel_25 = Panel(inspect.GraphicsViewScale)  # disabled
panel_26 = Panel(inspect.PhasingPhase)  # disabled

# ---- group: Dispatch locations based on set degree limit of slope and picks the best 3 options
smaller = SmallerThan(FirstNumber=int, SecondNumber=expr("x+0.2", select_slope_for_main_site_limit))  # -> SmallerThan, OrEqualTo
dispatch = Dispatch(List=mmx_2, DispatchPattern=smaller.SmallerThan)  # -> ListA, ListB
project_6 = Project(Geometry=dispatch.ListA, Plane=PlaneXY(0, 0, 0))  # -> Geometry, Transform
len_3 = Length(Curve=project_6.Geometry)
sort = SortList(Keys=len_3, ValuesA=dispatch.ListA)  # -> Keys, reverse(ValuesA)
series_3 = Series(Start=0, Step=1, Count=number_of_possible_locations)
item_7 = ListItem(List=sort.ValuesA, Index=series_3, Wrap=True)

# ----
dispatch_2 = Dispatch(List=vec2pt_3.Vector, DispatchPattern=smaller.SmallerThan)  # -> ListA, ListB

# ---- group: Dispatch locations based on set degree limit of slope and picks the best 3 options (continued)
sort_2 = SortList(Keys=len_3, ValuesA=dispatch_2.ListA)  # -> Keys, reverse(ValuesA)
item_8 = ListItem(List=sort_2.ValuesA, Index=series_3, Wrap=True)

# ---- group: Get 5 location points on sites surface
divide_4 = DivideCurve(Curve=item_7, Count=10, Kinks=False)  # -> Points, Tangents, Parameters
avr = Average(Input=divide_4.Points)  # -> flatten(ArithmeticMean)
Z_6 = UnitZ(Factor="1000")
pdecon_3 = Deconstruct(Point=avr)  # -> XComponent, YComponent, ZComponent
project_7 = Project(Geometry=avr, Plane=PlaneXY(0, 0, 0))  # -> Geometry, Transform
move_4 = Move(Geometry=avr, Motion=Z_6)  # -> Geometry, Transform
sort_3 = SortList(Keys=pdecon_3.YComponent, ValuesA=avr)  # -> Keys, ValuesA
shift = ShiftList(List=sort_3.ValuesA, Shift=1, Wrap=False)
ln_5 = Line(StartPoint=sort_3.ValuesA, EndPoint=shift)
len_4 = Length(Curve=ln_5)
panel_28 = Panel(len_4)
ln_6 = Line(StartPoint=project_7.Geometry, EndPoint=move_4.Geometry)
bcx = BrepCurve(Brep=srfgrid, Curve=ln_6)  # -> Curves, Points

# ----
vdis_2 = VectorDisplay(Anchor=avr, Vector=item_8)
pt_13 = Point(bcx.Curves)
pline = PolyLine(Vertices=flatten(bcx.Points), Closed=False)

geo_23 = Geometry(srfgrid)  # disabled
bbox_2 = BoundingBox(Content=geo_23, Plane=PlaneXY(0, 0, 0))  # -> Box, Box_2; disabled
number_slider_15 = Slider(1, range=0..10)  # disabled
number_slider_16 = Slider(1, range=0..10)  # disabled
number_slider_17 = Slider(1, range=0..10)  # disabled
volume_9 = Volume(Geometry=bbox_2.Box)  # -> Volume, Centroid; disabled
scale_nu = ScaleNU(Geometry=bbox_2.Box, Plane=volume_9.Centroid, ScaleX=number_slider_15, ScaleY=number_slider_16, ScaleZ=number_slider_17)  # -> Geometry, Transform; disabled
number_slider_18 = Slider(2.5, range=0..10)  # disabled
fieldpts = Wasp_FieldPoints(BOU=scale_nu.Geometry, RES=number_slider_18)  # -> E_FIELD, PTS; inputs BOU: list of Mesh, PLN: Plane; disabled; plug-in component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
panel_29 = Panel("srfField")  # disabled

number_slider_19 = Slider(0.5, range=0..1)  # disabled
contour_2 = Contour(Shape=geo_23, Point=Point(0, 0, 0), Direction=Vector(0, 0, 1), Distance=number_slider_19)  # disabled
swatch_6 = ColourSwatch(SwatchColor=RGB(0, 0, 0))  # disabled
preview_2 = CustomPreview(Geometry=contour_2, Material=swatch_6)  # disabled

geo_24 = Geometry(geo_23)  # disabled
pull = PullPoint(Point=fieldpts.PTS, Geometry=geo_24, ClosestOnly=True)  # -> ClosestPoint, Distance; disabled
pdecon_4 = Deconstruct(Point=fieldpts.PTS)  # -> XComponent, YComponent, ZComponent; disabled
pdecon_5 = Deconstruct(Point=pull.ClosestPoint)  # -> XComponent, YComponent, ZComponent; disabled
smaller_2 = SmallerThan(FirstNumber=pdecon_4.ZComponent, SecondNumber=pdecon_5.ZComponent)  # -> SmallerThan, OrEqualTo; disabled
number_slider_20 = Slider(1, range=0..1)  # disabled
number_slider_21 = Slider(0, range=0..100)  # disabled
dispatch_3 = Dispatch(List=pull.Distance, DispatchPattern=smaller_2.SmallerThan)  # -> ListA, ListB; disabled
dom_2 = ConstructDomain(DomainStart=number_slider_20, DomainEnd=number_slider_21)  # disabled
bnd_4 = Bounds(Numbers=dispatch_3.ListB)  # disabled
number_slider_22 = Slider(0, range=0..100)  # disabled
remap = RemapNumbers(Value=dispatch_3.ListB, Source=bnd_4, Target=dom_2)  # -> Mapped, Clipped; disabled
lng_3 = ListLength(List=dispatch_3.ListA)  # disabled
repeat = RepeatData(Data=number_slider_22, Length=lng_3)  # disabled
graph = GraphMapper(
    remap.Mapped,
    x0=0,
    x1=1,
    y0=0,
    y1=1,
    container_name="Bezier",
    cpx=[0, 0.6471909881, 0.9011235833, 1],
    cpy=[0, 0.07142859697, 0.428571403, 1])  # disabled
weave = Weave(Pattern=smaller_2.SmallerThan, Stream0=graph, Stream1=repeat, NullGaps=False)  # disabled

geo_25 = Geometry(geo_23)  # disabled
project_8 = Project(Curve=project_5, Brep=geo_25, Direction=Vector(0, 0, 1))  # disabled
pt_14 = Point(fieldpts.PTS)  # disabled
pull_2 = PullPoint(Point=pt_14, Geometry=flatten(project_8), ClosestOnly=True)  # -> ClosestPoint, Distance; disabled
number_slider_23 = Slider(1, range=0..1)  # disabled
number_slider_24 = Slider(0, range=0..100)  # disabled
dom_3 = ConstructDomain(DomainStart=number_slider_23, DomainEnd=number_slider_24)  # disabled
bnd_5 = Bounds(Numbers=dispatch_3.ListB)  # disabled
remap_2 = RemapNumbers(Value=pull_2.Distance, Source=bnd_5, Target=dom_3)  # -> Mapped, Clipped; disabled
graph_2 = GraphMapper(
    remap_2.Mapped,
    x0=0,
    x1=1,
    y0=0,
    y1=1,
    container_name="Bezier",
    cpx=[0, 0.6471909881, 0.9011235833, 1],
    cpy=[0, 0.07142859697, 0.428571403, 1])  # disabled

pt_15 = Point(fieldpts.PTS)  # disabled
geo_26 = Geometry(geo_23)  # disabled
srf_cp = SurfaceClosestPoint(Point=pt_15, Surface=geo_26)  # -> Point, UVPoint, Distance; disabled
evalsrf = EvaluateSurface(Surface=geo_26, Point=srf_cp.UVPoint)  # -> Point, Normal, UDirection, VDirection, Frame; disabled
Z_7 = UnitZ(Factor=1)  # disabled
angle_3 = Angle(VectorA=Z_7, VectorB=evalsrf.Normal)  # -> Angle, Reflex; disabled
bnd_6 = Bounds(Numbers=angle_3.Angle)  # disabled
panel_30 = Panel("1 To 0")  # disabled
remap_3 = RemapNumbers(Value=angle_3.Angle, Source=bnd_6, Target=panel_30)  # -> Mapped, Clipped; disabled
graph_3 = GraphMapper(remap_3.Mapped, x0=0, x1=1, y0=0, y1=1, container_name="Bezier", cpx=[0, 0.25, 0.75, 1], cpy=[0, 0.25, 0.75, 1])  # disabled

gradient_2 = Gradient(LowerLimit=0, UpperLimit=1, Parameter=graph_2, stops=[0: RGB(0, 128, 0), 0.5: RGB(255, 255, 0), 1: RGB(255, 0, 0)])  # disabled
preview_3 = CustomPreview(Geometry=pt_14, Material=gradient_2)  # disabled

gradient_3 = Gradient(LowerLimit=0, UpperLimit=1, Parameter=graph_3, stops=[0: RGB(0, 128, 0), 0.5: RGB(255, 255, 0), 1: RGB(255, 0, 0)])  # disabled
preview_4 = CustomPreview(Geometry=evalsrf.Point, Material=gradient_3)  # disabled

gradient_4 = Gradient(LowerLimit=0, UpperLimit=1, Parameter=weave, stops=[0: RGB(0, 128, 0), 0.5: RGB(255, 255, 0), 1: RGB(255, 0, 0)])  # disabled
preview_5 = CustomPreview(Geometry=fieldpts.PTS, Material=gradient_4)  # disabled

multiplication = Multiplication(A=weave, B=graph_2, C=graph_3)  # disabled

field = Wasp_Field(NAME=panel_29, E_FIELD=fieldpts.E_FIELD, VAL=multiplication)  # -> FIELD; inputs VAL: list; disabled; plug-in component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

number_slider_25 = Slider(338, range=0..1000)  # disabled
panel_31 = Panel("""SIDES>SIDES
TOP>BOTTOM
BOTTOM>TOP""")  # disabled
rulegen_2 = Wasp_RulesGenerator(PART=merge, SELF_P=toggle_11)  # -> R; inputs PART: list, SELF_P: Boolean, SELF_C: Boolean, TYP: Boolean, GR: list; disabled; plug-in component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
button_3 = Button()  # disabled
fieldaggregation = Wasp_FieldDrivenAggregation(PART=flatten(merge), N=number_slider_10, RULES=rulegen_2, FIELD=field, RESET=button_3)  # -> AGGR, PART_OUT; inputs PART: list, PREV: list, N: Int32, RULES: list, FIELD: list, MODE: Int32, GC: list, RESET: Boolean; disabled; plug-in component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

gradient_5 = Gradient(
    LowerLimit=0,
    UpperLimit=1,
    Parameter=multiplication,
    stops=[0: RGB(0, 128, 0), 0.5: RGB(255, 255, 0), 1: RGB(255, 0, 0)])  # disabled
preview_6 = CustomPreview(Geometry=fieldpts.PTS, Material=gradient_5)  # disabled

panel_32 = Panel(rulegen_2)  # disabled
partgeo = Wasp_GetPartGeometry(PART=fieldaggregation.PART_OUT)  # -> GEO; disabled; plug-in component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
geo_27 = Geometry(partgeo)  # disabled
angsplitmsh_2 = AngleSplitMesh(Mesh=partgeo, Angle=0, Opposite=False)  # -> Split, R; disabled

number_slider_26 = Slider(2, range=0..10)  # disabled
panel_33 = Panel("house")  # disabled
swatch_7 = ColourSwatch(SwatchColor=RGB(42, 181, 14))  # disabled
swatch_8 = ColourSwatch(SwatchColor=RGB(207, 255, 77))  # disabled
swatch_9 = ColourSwatch(SwatchColor=RGB(110, 255, 0))  # disabled
lng_4 = ListLength(List=fieldaggregation.PART_OUT)  # disabled
getattr_2 = Wasp_GetAttributeByName(PART=fieldaggregation.PART_OUT, ID=panel_33)  # -> VAL; disabled; plug-in component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
random_2 = Random(Range=number_slider_26, Number=lng_4, Seed=2, Integers=True)  # disabled
merge_3 = Merge(Data1=swatch_7, Data2=swatch_9, Data3=swatch_8)  # disabled
item_9 = ListItem(List=merge_3, Index=random_2, Wrap=True)  # disabled
preview_7 = CustomPreview(Geometry=flatten(getattr_2), Material=item_9)  # disabled

medges_3 = MeshEdges(Mesh=angsplitmsh_2.Split)  # -> NakedEdges, InteriorEdges, NonManifoldEdges; disabled
getattr_3 = Wasp_GetAttributeByName(PART=fieldaggregation.PART_OUT, ID=panel_14)  # -> VAL; disabled; plug-in component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
previewmat_4 = CustomPreviewMaterials(Geometry=partgeo, DiffuseColor=swatch_4, Transparency=number_slider_13)  # disabled
previewlw_8 = CustomPreviewLineweights(Geometry=medges_3.NakedEdges, Shader=swatch_5, Absolute=False)  # disabled
