# Grasshopper definition inflatables.gh (Grasshopper 1.0.7)
# plug-ins: Kangaroo2 Components, Bifocals, Weaverbird, MeshEdit Components, DendroGH, Human, MetaHopper

crv = Curve(<curve referenced from the Rhino model>)
crv_2 = Curve(<curve referenced from the Rhino model>)

# ---- group: boundary curve
crv_3 = Curve(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)

# ----
loft = Loft(Curves=[crv, crv_2], Options={Adjust=False, Closed=False, LoftEnds=0, LoftSimp=0, LoftType=0, Rebuild=10, Refit=0.01})

number_slider = Slider(11, range=0..100)  # disabled
number_slider_2 = Slider(0.88, range=0..1)  # disabled
number_slider_3 = Slider(2.91, range=0..10)  # disabled
rectangle = Rectangle(Plane=PlaneXY(0, 0, 0), XSize=number_slider, YSize=number_slider, Radius=0)  # -> Rectangle, Length; disabled
number_slider_4 = Slider(7, range=0..10)  # disabled
dom = ConstructDomain(DomainStart=number_slider_2, DomainEnd=number_slider_3)  # disabled
pop2d = Populate2D(Region=rectangle.Rectangle, Count=number_slider_4, Seed=1)  # disabled
lng = ListLength(List=pop2d)  # disabled
random = Random(Range=lng, Number=dom, Seed=2)  # disabled
number_slider_5 = Slider(3, range=0..10)  # disabled
cir = Circle(Plane=pop2d, Radius=random)  # disabled
Z = UnitZ(Factor=number_slider_5)  # disabled
number_slider_6 = Slider(0.18, range=0..1)  # disabled
runion = RegionUnion(Curves=cir)  # disabled
number_slider_7 = Slider(0.06, range=0..0.1)  # disabled
Z_2 = UnitZ(Factor=number_slider_6)  # disabled
boundary = BoundarySurfaces(Edges=runion)  # disabled
move = Move(Geometry=runion, Motion=Z)  # -> Geometry, Transform; disabled
number_slider_8 = Slider(30, range=0..100)  # disabled
boundary_2 = BoundarySurfaces(Edges=move.Geometry)  # disabled
extr = Extrude(Base=boundary, Direction=Z_2)  # disabled
number_slider_9 = Slider(2, range=0..10)  # disabled
mesh = Mesh(boundary_2)  # disabled
divide = DivideCurve(Curve=move.Geometry, Count=number_slider_8, Kinks=False)  # -> Points, Tangents, Parameters; disabled
number_slider_10 = Slider(0.08, range=0..0.1)  # disabled
number_slider_11 = Slider(0.18, range=0..1)  # disabled
pipe = Pipe(Curve=move.Geometry, Radius=number_slider_7, Caps=0)  # disabled
nv = NakedVertices(Mesh=mesh)  # -> ClothedIndex, NakedIndex, ClothedPts, NakedPts; disabled
Z_3 = UnitZ(Factor=number_slider_9)  # disabled
show = Show(G=mesh)  # disabled
edgelengths = EdgeLengths(Mesh=mesh, LengthFactor=number_slider_10, Strength=1)  # disabled
dispatch = Dispatch(List=divide.Points, DispatchPattern=[True, False])  # -> ListA, ListB; disabled
anchor = Anchor(Point=nv.NakedPts, Strength=10000)  # disabled
pt = ConstructPoint(XCoordinate=0, YCoordinate=0, ZCoordinate=number_slider_11)  # disabled
number_slider_12 = Slider(14, range=0..100)  # disabled
load = Load(Point=nv.ClothedPts, ForceVector=Z_3, Weighting=1)  # disabled
button = Button()  # disabled
geo = Geometry(dispatch.ListA)  # disabled
geo_2 = Geometry(dispatch.ListB)  # disabled
toggle = BooleanToggle(True)  # disabled
shift = ShiftList(List=geo_2, Shift=number_slider_12, Wrap=True)  # disabled
project = Project(Geometry=geo, Plane=pt)  # -> Geometry, Transform; disabled
solver = Solver(GoalObjects=[show, edgelengths, load, anchor], Reset=button, Threshold=1e-15, Tolerance=0.01, On=toggle)  # -> I, V, O; disabled
bang = ExplodeTree(Data=solver.O)  # -> _0000, _00000; disabled
ln = Line(StartPoint=geo_2, EndPoint=project.Geometry)  # disabled
ln_2 = Line(StartPoint=project.Geometry, EndPoint=shift)  # disabled
number_slider_13 = Slider(1000, range=0..1000)  # disabled
mesh_2 = Mesh(bang._0000)  # disabled
join = JoinCurves(Curves=flatten([ln_2, ln]), Preserve=False)  # disabled
wbloop = WeaverbirdsLoopSubdivision(MeshCurves=mesh_2, Level=1, SmoothNakedEdges=1)  # disabled
divide_2 = DivideCurve(Curve=join, Count=number_slider_13, Kinks=False)  # -> Points, Tangents, Parameters; disabled
number_slider_14 = Slider(0.045, range=0..0.1)  # disabled
intcrv = Interpolate(Vertices=divide_2.Points, Degree=3, Periodic=invert(False), KnotStyle=1)  # -> Curve, Length, Domain; disabled
wbframe = WeaverbirdsPictureFrame(MeshPolylines=wbloop, Distance=5, InsetType=0)  # disabled
number_slider_15 = Slider(0.06, range=0..0.1)  # disabled
pipe_2 = Pipe(Curve=intcrv.Curve, Radius=number_slider_14, Caps=0)  # disabled
wbthicken = WeaverbirdsMeshThicken(MeshCurves=wbframe, Distance=number_slider_15, OffsetType=0)  # disabled
number_slider_16 = Slider(3, range=0..10)  # disabled
# comprueba: es la casa da musica?
wbcatmullclark = WeaverbirdsCatmullClarkSubdivision(MeshCurves=wbthicken, Level=number_slider_16, SmoothNakedEdges=1)  # disabled

mesh_3 = Mesh(crv_3)
mesh_4 = Mesh(crv)
triremesh = TriRemesh(Geometry=mesh_4, Length=1, Iterations=25)  # -> Triangulation, Dual, Creases
neg = Negative(Value=Slider(1252.659, range=0..20101))
nv_2 = NakedVertices(Mesh=triremesh.Triangulation)  # -> ClothedIndex, NakedIndex, ClothedPts, NakedPts
# LAST INFLATABLE, WORKING FINE
number_slider_17 = Slider(14.57, range=0..100)
# got this data from rhino
#  geom see how to make
#  itr parametrical
number_slider_18 = Slider(0.5, range=0..1)
pt_2 = Point(Point(5285.7853, 10525.48167, 6208.9387))
edgelengths_2 = EdgeLengths(Mesh=triremesh.Triangulation, LengthFactor=Slider(0.67, range=0..1), Strength=1)
number_slider_19 = Slider(20, range=0..100)
number_slider_20 = Slider(10, range=0..10)
volume = Volume(Mesh=triremesh.Triangulation, Volume=neg, Strength=1)
anchor_2 = Anchor(Point=nv_2.NakedPts, Strength=10000)
show_2 = Show(G=triremesh.Triangulation)
# half sphere script (NEED FIXING)
number_slider_21 = Slider(10, range=0..10)  # disabled
multiplication = Multiplication(A=number_slider_17, B=number_slider_18)
number_slider_22 = Slider(855, range=0..1000)  # disabled
number_slider_23 = Slider(34, range=0..1000)

# ----
# not sure this is really parametric
number_slider_24 = Slider(20, range=0..100)  # disabled
# CUBE
number_slider_25 = Slider(10, range=0..10)  # disabled
box = CenterBox(Base=PlaneXY(0, 0, 0), X=number_slider_24, Y=number_slider_24, Z=number_slider_24)  # disabled
debrep = DeconstructBrep(Brep=box)  # -> Faces, Edges, Vertices; disabled
area = Area(Geometry=debrep.Faces)  # -> Area, Centroid; disabled
number_slider_26 = Slider(0.1, range=0..0.1)  # disabled
pln = Plane(area.Centroid)  # disabled
number_slider_27 = Slider(25, range=0..100)  # disabled
pdecon = Deconstruct(Point=area.Centroid)  # -> XComponent, YComponent, ZComponent; disabled
abs = Absolute(Value=pdecon.ZComponent)  # disabled
smaller = SmallerThan(FirstNumber=abs, SecondNumber=number_slider_26)  # -> SmallerThan, OrEqualTo; disabled
sph = Sphere(Base=PlaneXY(0, 0, 0), Radius=number_slider_27)  # disabled
cull = CullPattern(List=debrep.Faces, CullPattern=smaller.SmallerThan)  # disabled
panel = Panel(smaller.SmallerThan)  # disabled
cull_2 = CullPattern(List=area.Centroid, CullPattern=smaller.SmallerThan)  # disabled
item = ListItem(List=cull, Index=0, Wrap=True)  # -> Item, Item1, Item2, Item3; disabled
panel_2 = Panel("{0.5, 0.5, 0}")  # disabled
number_slider_28 = Slider(10, range=0..10)  # disabled
brep = Brep(box)  # disabled
evalsrf = EvaluateSurface(Surface=reparameterize(cull), Point=panel_2)  # -> Point, Normal, UDirection, VDirection, Frame; disabled
number_slider_29 = Slider(9, range=0..10)  # disabled
amp = Amplitude(Vector=evalsrf.Normal, Amplitude=number_slider_28)  # disabled
pt_3 = Point(evalsrf.Point)  # disabled
srf_cp = SurfaceClosestPoint(Point=pt_3, Surface=sph)  # -> Point, UVPoint, Distance; disabled
pln_2 = Plane(evalsrf.Frame)  # disabled
rectangle_2 = Rectangle(Plane=pln_2, XSize=number_slider_29, YSize=number_slider_29, Radius=0)  # -> Rectangle, Length; disabled
move_2 = Move(Geometry=pt_3, Motion=amp)  # -> Geometry, Transform; disabled
area_2 = Area(Geometry=rectangle_2.Rectangle)  # -> Area, Centroid; disabled
orient = Orient(Geometry=rectangle_2.Rectangle, Source=area_2.Centroid, Target=pt_3)  # -> Geometry, Transform; disabled
ln_3 = Line(StartPoint=pt_3, EndPoint=move_2.Geometry)  # disabled
extrcrv = ExtrudeAlong(Base=orient.Geometry, Curve=ln_3)  # disabled
area_3 = Area(Geometry=extrcrv)  # -> Area, Centroid; disabled
orient_2 = Orient(Geometry=extrcrv, Source=area_3.Centroid, Target=pt_3)  # -> Geometry, Transform; disabled
sdiff = SolidDifference(BrepsA=orient_2.Geometry, BrepsB=brep)  # disabled
splitmul = SplitBrepMultiple(Brep=orient_2.Geometry, Cutters=brep)  # disabled
splitmul_2 = SplitBrepMultiple(Brep=brep, Cutters=orient_2.Geometry)  # disabled
item_2 = ListItem(List=splitmul, Index=0, Wrap=True)  # -> flatten(Item); disabled
item_3 = ListItem(List=splitmul_2, Index=0, Wrap=True)  # disabled
panel_3 = Panel(item_2)  # disabled
mesh_5 = Mesh(item_3)  # disabled
mesh_6 = Mesh(item_2)  # disabled
merge = Merge(Data1=mesh_5, Data2=mesh_6)  # -> flatten(Result); disabled
mjoin = MeshJoin(Meshes=merge)  # disabled
panel_4 = Panel(mjoin)  # disabled
weldvertices = MeshWeldVertices(Mesh=mjoin, Tolerance=0.01)  # -> RuntimeMessage, Mesh; disabled
unifynormals = MeshUnifyNormals(Mesh=weldvertices.Mesh)  # disabled
mesh_7 = Mesh(unifynormals)  # disabled
nv_3 = NakedVertices(Mesh=mesh_7)  # -> ClothedIndex, NakedIndex, ClothedPts, NakedPts; disabled
pt_4 = Point(nv_3.NakedPts)  # disabled
refine = Refine(Mesh=mesh_7, Level=1)  # disabled
mesh_8 = Mesh(refine)  # disabled
medges = MeshEdges(Mesh=mesh_8)  # -> NakedEdges, InteriorEdges, NonManifoldEdges; disabled
line = Line(medges.NakedEdges)  # disabled
panel_5 = Panel("""0
11
14
19""")  # disabled
join_2 = JoinCurves(Curves=line, Preserve=False)  # disabled
number_slider_30 = Slider(4, range=0..10)  # disabled
item_4 = ListItem(List=join_2, Index=panel_5, Wrap=True)  # disabled
panel_6 = Panel("4")  # disabled
multiplication_2 = Multiplication(A=number_slider_30, B=panel_6)  # disabled
explode = Explode(Curve=item_4, Recursive=True)  # -> Segments, Vertices; disabled
divide_3 = DivideCurve(Curve=item_4, Count=multiplication_2, Kinks=False)  # -> Points, Tangents, Parameters; disabled
duppt = RemoveDuplicatePts(Points=divide_3.Points, Tolerance=0.01)  # disabled
plfit = PlaneFit(Points=duppt)  # -> Plane, Deviation; disabled
avr = Average(Input=duppt)  # disabled
number_slider_31 = Slider(10, range=0..10)  # disabled
pl_origin = PlaneOrigin(Base=plfit.Plane, Origin=avr)  # disabled
cir_2 = Circle(Plane=pl_origin, Radius=number_slider_31)  # disabled
crv_cp = CurveClosestPoint(Point=duppt, Curve=cir_2)  # -> Point, Parameter, Distance; disabled
number_slider_32 = Slider(0.501, range=0..1)  # disabled
pt_5 = Point(simplify(crv_cp.Point))  # disabled
pt_6 = Point(simplify(duppt))  # disabled
edgelengths_3 = EdgeLengths(Mesh=mesh_8, LengthFactor=number_slider_32, Strength=1)  # disabled
anchor_3 = Anchor(Point=pt_6, Target=pt_5, Strength=10000)  # disabled
ln_4 = Line(StartPoint=pt_6, EndPoint=pt_5)  # disabled
show_3 = Show(G=mesh_8)  # disabled
merge_2 = Merge(Data1=flatten(show_3), Data2=flatten(edgelengths_3), Data3=flatten(anchor_3))  # disabled
toggle_2 = BooleanToggle(False)  # disabled
button_2 = Button()  # disabled
number_slider_33 = Slider(0.72, range=0..1)  # disabled
toggle_3 = GroupToggle(ToggleActive=True, ToggleVisible=False)  # disabled
bouncysolver = BouncySolver(
    GoalObjects=merge_2,
    Reset=button_2,
    Threshold=1e-15,
    Tolerance=0.0001,
    Damping=number_slider_33,
    Iterations=10,
    On=toggle_2)  # -> I, V, O; disabled
previewmat = CustomPreviewMaterials(Geometry=bouncysolver.O, DiffuseColor=RGB(255, 255, 255))  # disabled

xy = XYPlane(Origin=Point(0, 0, 0))  # disabled
entwine = Entwine(Branch00=show_2, Branch01=[anchor_2, volume, edgelengths_2], FlattenInputs=True)

number_slider_34 = Slider(0.5, range=0..1)  # disabled
number_slider_35 = Slider(14.57, range=0..100)  # disabled

num = Number(multiplication)
xy_2 = XYPlane(Origin=pt_2)
box_2 = CenterBox(Base=pt_2, X=multiplication, Y=multiplication, Z=multiplication)
sph_2 = Sphere(Base=PlaneXY(0, 0, 0), Radius=number_slider_21)  # disabled
rectangle_3 = Rectangle(Plane=xy, XSize=number_slider_22, YSize=number_slider_22, Radius=0)  # -> Rectangle, Length; disabled
multiplication_3 = Multiplication(A=num, B=Slider(0.88, range=0..1))
rectangle_4 = Rectangle(Plane=xy_2, XSize=number_slider_23, YSize=number_slider_23, Radius=0)  # -> Rectangle, Length
rotate = Rotate(Geometry=box_2, Angle=degrees(Slider(45, range=0..100)), Plane=pt_2)  # -> Geometry, Transform
debrep_2 = DeconstructBrep(Brep=box_2)  # -> Faces, Edges, Vertices
solver_2 = Solver(GoalObjects=entwine, Reset=Button(), Threshold=1e-15, Tolerance=0.01, On=Toggle(True))  # -> I, V, O
area_4 = Area(Geometry=rectangle_3.Rectangle)  # -> Area, Centroid; disabled
area_5 = Area(Geometry=rectangle_4.Rectangle)  # -> Area, Centroid
area_6 = Area(Geometry=debrep_2.Faces)  # -> Area, Centroid
number_slider_36 = Slider(192, range=0..200)  # disabled
bang_2 = ExplodeTree(Data=solver_2.O)  # -> Branch0, Branch1
orient_3 = Orient(Geometry=rectangle_4.Rectangle, Source=area_5.Centroid, Target=pt_2)  # -> Geometry, Transform
orient_4 = Orient(Geometry=rectangle_3.Rectangle, Source=area_4.Centroid, Target=xy)  # -> Geometry, Transform; disabled
sph_3 = Sphere(Base=pt_2, Radius=multiplication_3)
xy_3 = XYPlane(Origin=Point(0, 0, 0))  # disabled
pdecon_2 = Deconstruct(Point=area_6.Centroid)  # -> XComponent, YComponent, ZComponent
orient_5 = Orient(Source=PlaneXY(0, 0, 0), Target=PlaneXY(0, 0, 0))  # -> Geometry, Transform
boundary_3 = BoundarySurfaces(Edges=orient_3.Geometry)
mesh_9 = Mesh(bang_2.Branch0)
boundary_4 = BoundarySurfaces(Edges=orient_4.Geometry)  # disabled
sint = SolidIntersection(BrepsA=sph_3, BrepsB=boundary_3)
larger = LargerThan(FirstNumber=pdecon_2.ZComponent, SecondNumber=Slider(1, range=0..1))  # -> LargerThan, OrEqualTo
preview = CustomPreview(
    Geometry=mesh_9,
    Material={diffuse=RGB(0, 128, 0), emission=RGB(0, 0, 0), shine=0.5, specular=RGB(255, 255, 255), transparency=0.1})
rectangle_5 = Rectangle(Plane=xy_3, XSize=number_slider_36, YSize=number_slider_36, Radius=0)  # -> Rectangle, Length; disabled
number_slider_37 = Slider(4, range=0..10)  # disabled
number_slider_38 = Slider(76, range=0..100)  # disabled
debrep_3 = DeconstructBrep(Brep=sint)  # -> Faces, Edges, Vertices
split = SplitBrep(Brep=sph_2, Cutter=boundary_4)  # disabled
cull_3 = CullPattern(List=area_6.Centroid, CullPattern=larger.LargerThan)
item_5 = ListItem(List=debrep_3.Edges, Index=0, Wrap=True)  # -> Item, Item1
item_6 = ListItem(List=split, Index=0, Wrap=True)  # disabled
xy_4 = XYPlane(Origin=Point(0, 0, 0))  # disabled
crv_4 = Curve(item_5.Item1)
brep_2 = Brep(item_6)  # disabled
pop2d_2 = Populate2D(Region=rectangle_5.Rectangle, Count=number_slider_38, Seed=number_slider_37)  # disabled
pt_7 = Point(cull_3)
divide_4 = DivideCurve(Curve=crv_4, Count=Slider(8, range=0..10), Kinks=False)  # -> Points, Tangents, Parameters
del = DelaunayMesh(Points=pop2d_2, Plane=xy_4)  # disabled
hull = ConvexHull(Points=pop2d_2, Plane=xy_4)  # -> Hull, HullZ, Indices; disabled
srf_cp_2 = SurfaceClosestPoint(Surface=sph_3)  # -> Point, UVPoint, Distance
number_slider_39 = Slider(50, range=0..100)  # disabled
debrep_4 = DeconstructBrep(Brep=brep_2)  # -> Faces, Edges, Vertices; disabled
number_slider_40 = Slider(53.6, range=0..100)  # disabled
ln_5 = Line(StartPoint=pt_2, EndPoint=divide_4.Points)
end = EndPoints(Curve=ln_5)  # -> Start, End
demesh = DeconstructMesh(Mesh=del)  # -> Vertices, Faces, Colours, Normals; disabled
brep_3 = Brep(sph_3)
item_7 = ListItem(List=debrep_4.Edges, Index=0, Wrap=True)  # disabled
pt_8 = Point(end.End)
panel_7 = Panel("4")  # disabled
neg_2 = Negative(Value=number_slider_40)  # disabled
divide_5 = DivideCurve(Curve=item_7, Count=panel_7, Kinks=False)  # -> Points, Tangents, Parameters; disabled
avr_2 = Average(Input=demesh.Vertices)  # disabled
pframe = PerpFrame(Curve=ln_5, Parameter=Slider(1, range=0..1))

number_slider_41 = Slider(2.5, range=0..10)
rectangle_6 = Rectangle(Plane=pframe, XSize=number_slider_41, YSize=number_slider_41, Radius=0)  # -> Rectangle, Length
area_7 = Area(Geometry=rectangle_6.Rectangle)  # -> Area, Centroid
orient_6 = Orient(Geometry=rectangle_6.Rectangle, Source=area_7.Centroid, Target=pt_8)  # -> Geometry, Transform
vec2pt = Vector2Pt(PointA=end.End, PointB=end.Start, Unitize=False)  # -> Vector, Length
extrcrv_2 = ExtrudeAlong(Base=orient_6.Geometry, Curve=ln_5)
brep_4 = Brep()
amp_2 = Amplitude(Vector=vec2pt.Vector, Amplitude=Slider(4, range=-10..10))
move_3 = Move(Geometry=extrcrv_2, Motion=amp_2)  # -> Geometry, Transform
# not sure this is really parametric
area_8 = Area(Geometry=move_3.Geometry)  # -> Area, Centroid

number_slider_42 = Slider(0.4, range=0..1)  # disabled
Z_4 = UnitZ(Factor=neg_2)  # disabled
crv_cp_2 = CurveClosestPoint(Point=demesh.Vertices, Curve=hull.Hull)  # -> Point, Parameter, Distance; disabled
move_4 = Move(Geometry=avr_2, Motion=Z_4)  # -> Geometry, Transform; disabled
shatter = Shatter(Curve=item_7, Parameters=divide_5.Parameters)  # disabled
bool = Boolean(crv_cp_2.Distance)  # disabled
number_slider_43 = Slider(100, range=0..100)  # disabled
vec2pt_2 = Vector2Pt(PointA=move_4.Geometry, PointB=demesh.Vertices, Unitize=False)  # -> Vector, Length; disabled
eval = EvaluateCurve(Curve=reparameterize(shatter), Parameter=number_slider_42)  # -> Point, Tangent, Angle; disabled
panel_8 = Panel("0")  # disabled
int = Integer(bool)  # disabled
dist = Distance(PointA=divide_5.Points, PointB=eval.Point)  # disabled
bnd = Bounds(Numbers=vec2pt_2.Length)  # disabled
round = Round(Number=dist)  # -> Nearest, Floor, Ceiling; disabled

# ---- group: define height
ln_6 = Line(StartPoint=divide_5.Points, EndPoint=eval.Point)  # disabled
panel_9 = Panel("0.5")  # disabled
multiplication_4 = Multiplication(A=round.Nearest, B=panel_9)  # disabled
midpt = CurveMiddle(Curve=ln_6)  # disabled
Z_5 = UnitZ(Factor=multiplication_4)  # disabled
move_5 = Move(Geometry=midpt, Motion=Z_5)  # -> Geometry, Transform; disabled

# ----
dom_2 = ConstructDomain(DomainStart=number_slider_43, DomainEnd=panel_8)  # disabled
panel_10 = Panel(round.Nearest)  # disabled
remap = RemapNumbers(Value=vec2pt_2.Vector, Source=bnd, Target=dom_2)  # -> Mapped, Clipped; disabled
multiplication_5 = Multiplication(A=int, B=remap.Mapped)  # disabled
arc = Arc3Pt(PointA=divide_5.Points, PointB=move_5.Geometry, PointC=eval.Point)  # -> Arc, Plane, Radius; disabled
amp_3 = Amplitude(Vector=vec2pt_2.Vector, Amplitude=multiplication_5)  # disabled
move_6 = Move(Geometry=demesh.Vertices, Motion=amp_3)  # -> Geometry, Transform; disabled
number_slider_44 = Slider(-3, range=-10..10)  # disabled
pln_3 = Plane(arc.Plane)  # disabled
vec = Vector(pln_3)  # disabled
conmesh = ConstructMesh(Vertices=move_6.Geometry, Faces=demesh.Faces)  # disabled
move_7 = Move(Geometry=arc.Arc, Motion=vec)  # -> Geometry, Transform; disabled
amp_4 = Amplitude(Vector=vec, Amplitude=number_slider_44)  # disabled
faceb = FaceBoundaries(Mesh=conmesh)  # disabled
number_slider_45 = Slider(0.1, range=0..0.3)  # disabled
planar = IsPlanar(Surface=faceb, Interior=True)  # -> Planar, Plane; disabled

# ---- group: unifying meshed
# not sure this is really parametric
extr_2 = Extrude(Base=move_7.Geometry, Direction=amp_4)  # disabled
brep_5 = Brep(brep_2)  # disabled
sdiff_2 = SolidDifference(BrepsA=extr_2, BrepsB=brep_5)  # disabled
splitmul_3 = SplitBrepMultiple(Brep=extr_2, Cutters=brep_5)  # disabled
splitmul_4 = SplitBrepMultiple(Brep=brep_5, Cutters=extr_2)  # disabled
item_8 = ListItem(List=splitmul_3, Index=0, Wrap=True)  # -> flatten(Item); disabled
item_9 = ListItem(List=splitmul_4, Index=0, Wrap=True)  # disabled

# ----
sdiff_3 = SolidDifference(BrepsA=move_3.Geometry, BrepsB=brep_3)
offset = OffsetCurve(Curve=faceb, Distance=expr("-x", number_slider_45), Plane=planar.Plane, Corners=1)  # disabled
splitmul_5 = SplitBrepMultiple(Brep=move_3.Geometry, Cutters=brep_3)
splitmul_6 = SplitBrepMultiple(Brep=brep_3, Cutters=move_3.Geometry)
explode_2 = Explode(Curve=offset, Recursive=True)  # -> graft(Segments), Vertices; disabled
item_10 = ListItem(List=splitmul_5, Index=0, Wrap=True)  # -> flatten(Item)
item_11 = ListItem(List=splitmul_6, Index=0, Wrap=True)
panel_11 = Panel(item_10)
midpt_2 = CurveMiddle(Curve=explode_2.Segments)  # disabled
end_2 = EndPoints(Curve=explode_2.Segments)  # -> Start, End; disabled
number_slider_46 = Slider(0.12, range=0..0.3)  # disabled
meshcp = MeshClosestPoint(Point=midpt_2, Mesh=conmesh)  # -> Point, Index, Parameter; disabled
panel_12 = Panel(item_8)  # disabled
meval = MeshEval(Mesh=conmesh, Parameter=meshcp.Parameter)  # -> Point, Normal, Colour; disabled
len = Length(Curve=explode_2.Segments)  # disabled
mesh_10 = Mesh(item_11)
multiplication_6 = Multiplication(A=len, B=number_slider_46)  # disabled
mesh_11 = Mesh(item_10)
amp_5 = Amplitude(Vector=meval.Normal, Amplitude=multiplication_6)  # disabled
mesh_12 = Mesh(item_9)  # disabled
mesh_13 = Mesh(item_8)  # disabled
merge_3 = Merge(Data1=mesh_10, Data2=mesh_11)  # -> flatten(Result)
move_8 = Move(Geometry=midpt_2, Motion=amp_5)  # -> Geometry, Transform; disabled
arc_2 = Arc3Pt(PointA=end_2.Start, PointB=move_8.Geometry, PointC=end_2.End)  # -> simplify(Arc), Plane, Radius; disabled
merge_4 = Merge(Data1=mesh_12, Data2=mesh_13)  # -> flatten(Result); disabled
mjoin_2 = MeshJoin(Meshes=merge_3)
pshift = ShiftPaths(Data=arc_2.Arc, Offset=-1)  # disabled
panel_13 = Panel(mjoin_2)
mjoin_3 = MeshJoin(Meshes=merge_4)  # disabled
weldvertices_2 = MeshWeldVertices(Mesh=mjoin_2, Tolerance=0.01)  # -> RuntimeMessage, Mesh
item_12 = ListItem(List=pshift, Index=0, Wrap=True)  # -> Item, Item1, Item2; disabled
panel_14 = Panel(mjoin_3)  # disabled
unifynormals_2 = MeshUnifyNormals(Mesh=weldvertices_2.Mesh)
weldvertices_3 = MeshWeldVertices(Mesh=mjoin_3, Tolerance=0.01)  # -> RuntimeMessage, Mesh; disabled
edgesrf = EdgeSurface(CurveA=item_12.Item, CurveB=item_12.Item1, CurveC=item_12.Item2)  # disabled
mesh_14 = Mesh(unifynormals_2)
unifynormals_3 = MeshUnifyNormals(Mesh=weldvertices_3.Mesh)  # disabled
preview_2 = CustomPreview(
    Geometry=edgesrf,
    Material={diffuse=RGB(221, 160, 221), emission=RGB(66, 48, 66), shine=0.5, specular=RGB(255, 255, 255), transparency=0})  # disabled
nv_4 = NakedVertices(Mesh=unifynormals_3)  # -> ClothedIndex, NakedIndex, ClothedPts, NakedPts; disabled
nv_5 = NakedVertices(Mesh=mesh_14)  # -> ClothedIndex, NakedIndex, ClothedPts, NakedPts
pt_9 = Point(nv_4.NakedPts)  # disabled
refine_2 = Refine(Mesh=mesh_14, Level=1)
pt_10 = Point(nv_5.NakedPts)
refine_3 = Refine(Mesh=unifynormals_3, Level=1)  # disabled
mesh_15 = Mesh(refine_2)

# ---- group: dendro settings / voxel size
number_slider_47 = Slider(0.81, range=0..1)  # disabled
number_slider_48 = Slider(0.747, range=0..10)  # disabled
vsettings = CreateSettings(VoxelSize=number_slider_48, Bandwidth=1, Isovalue=0, Adaptivity=number_slider_47)  # disabled

# ----
medges_2 = MeshEdges(Mesh=mesh_15)  # -> NakedEdges, InteriorEdges, NonManifoldEdges
mesh_16 = Mesh(refine_3)  # disabled
line_2 = Line(medges_2.NakedEdges)
medges_3 = MeshEdges(Mesh=mesh_16)  # -> NakedEdges, InteriorEdges, NonManifoldEdges; disabled

vmesh = MeshToVolume(Settings=vsettings)  # disabled
vunion = VolumeUnion(Volumes=vmesh)  # disabled
mvolume = VolumeToMesh(Volume=vunion, VolumeSettings=vsettings)  # disabled
number_slider_49 = Slider(2, range=0..10)  # disabled
wbcatmullclark_2 = WeaverbirdsCatmullClarkSubdivision(MeshCurves=mvolume, Level=1, SmoothNakedEdges=1)  # disabled
triremesh_2 = TriRemesh(Geometry=wbcatmullclark_2, Length=number_slider_49, Iterations=25)  # -> Triangulation, Dual, Creases; disabled
mesh_17 = Mesh(triremesh_2.Triangulation)  # disabled

join_3 = JoinCurves(Curves=line_2, Preserve=False)
line_3 = Line(medges_3.NakedEdges)  # disabled
panel_15 = Panel("""0
11
14
19""")  # disabled
join_4 = JoinCurves(Curves=line_3, Preserve=False)  # disabled
item_13 = ListItem(Index=0, Wrap=True)  # disabled
item_14 = ListItem(List=join_4, Index=panel_15, Wrap=True)  # disabled
number_slider_50 = Slider(2, range=0..10)  # disabled
multiplication_7 = Multiplication(A=Slider(4, range=0..10), B="4")
number_slider_51 = Slider(4, range=0..10)  # disabled
explode_3 = Explode(Curve=join_3, Recursive=True)  # -> Segments, Vertices
panel_16 = Panel("4")  # disabled
divide_6 = DivideCurve(Curve=join_3, Count=multiplication_7, Kinks=False)  # -> Points, Tangents, Parameters
multiplication_8 = Multiplication(A=number_slider_51, B=panel_16)  # disabled
explode_4 = Explode(Curve=item_14, Recursive=True)  # -> Segments, Vertices; disabled
duppt_2 = RemoveDuplicatePts(Points=divide_6.Points, Tolerance=0.01)
divide_7 = DivideCurve(Curve=item_14, Count=multiplication_8, Kinks=False)  # -> Points, Tangents, Parameters; disabled
plfit_2 = PlaneFit(Points=duppt_2)  # -> Plane, Deviation
avr_3 = Average(Input=duppt_2)
duppt_3 = RemoveDuplicatePts(Points=divide_7.Points, Tolerance=0.01)  # disabled
pl_origin_2 = PlaneOrigin(Base=plfit_2.Plane, Origin=avr_3)
plfit_3 = PlaneFit(Points=duppt_3)  # -> Plane, Deviation; disabled
avr_4 = Average(Input=duppt_3)  # disabled
number_slider_52 = Slider(10, range=0..10)  # disabled
cir_3 = Circle(Plane=pl_origin_2, Radius=Slider(1.6, range=0..10))
pl_origin_3 = PlaneOrigin(Base=plfit_3.Plane, Origin=avr_4)  # disabled
cir_4 = Circle(Plane=pl_origin_3, Radius=number_slider_52)  # disabled
crv_cp_3 = CurveClosestPoint(Point=duppt_2, Curve=cir_3)  # -> Point, Parameter, Distance
panel_17 = Panel("-1")  # disabled
crv_cp_4 = CurveClosestPoint(Point=duppt_3, Curve=cir_4)  # -> Point, Parameter, Distance; disabled
pt_11 = Point(simplify(crv_cp_3.Point))
pt_12 = Point(simplify(duppt_2))
number_slider_53 = Slider(0.5, range=0..1)  # disabled
pt_13 = Point(simplify(crv_cp_4.Point))  # disabled
pt_14 = Point(simplify(duppt_3))  # disabled
edgelengths_4 = EdgeLengths(Mesh=mesh_15, LengthFactor=Slider(0.501, range=0..1), Strength=1)
anchor_4 = Anchor(Point=pt_12, Target=pt_11, Strength=10000)
anchor_5 = Anchor(Target=pt_7, Strength=10000)
ln_7 = Line(StartPoint=pt_12, EndPoint=pt_11)
show_4 = Show(G=mesh_15)
Z_6 = UnitZ(Factor=1)  # disabled
edgelengths_5 = EdgeLengths(Mesh=mesh_16, LengthFactor=number_slider_53, Strength=1)  # disabled
anchor_6 = Anchor(Point=pt_14, Target=pt_13, Strength=10000)  # disabled
load_2 = Load(ForceVector=Z_6, Weighting=1)  # disabled
show_5 = Show(G=mesh_16)  # disabled
ln_8 = Line(StartPoint=pt_14, EndPoint=pt_13)  # disabled
merge_5 = Merge(Data1=flatten(show_4), Data2=flatten(edgelengths_4), Data3=flatten(anchor_4), Data4=flatten(anchor_5))
merge_6 = Merge(Data1=flatten(show_5), Data2=flatten(edgelengths_5), Data3=flatten(anchor_6))  # disabled
toggle_4 = BooleanToggle(False)  # disabled
number_slider_54 = Slider(0.45, range=0..1)  # disabled
button_3 = Button()  # disabled
bouncysolver_2 = BouncySolver(
    GoalObjects=merge_5,
    Reset=Button(),
    Threshold=1e-15,
    Tolerance=0.0001,
    Damping=Slider(0.36, range=0..1),
    Iterations=10,
    On=Toggle(False))  # -> I, V, O
number_slider_55 = Slider(0.5, range=0..1)
bouncysolver_3 = BouncySolver(
    GoalObjects=merge_6,
    Reset=button_3,
    Threshold=1e-15,
    Tolerance=0.0001,
    Damping=number_slider_54,
    Iterations=10,
    On=toggle_4)  # -> I, V, O; disabled
previewmat_2 = CustomPreviewMaterials(Geometry=bouncysolver_2.O, DiffuseColor=RGB(255, 255, 255))
previewmat_3 = CustomPreviewMaterials(Geometry=bouncysolver_3.O, DiffuseColor=RGB(255, 255, 255))  # disabled
number_slider_56 = Slider(10, range=0..10)  # disabled
number_slider_57 = Slider(855, range=0..1000)  # disabled
xy_5 = XYPlane(Origin=Point(0, 0, 0))  # disabled
sph_4 = Sphere(Base=PlaneXY(0, 0, 0), Radius=number_slider_56)  # disabled
rectangle_7 = Rectangle(Plane=xy_5, XSize=number_slider_57, YSize=number_slider_57, Radius=0)  # -> Rectangle, Length; disabled
area_9 = Area(Geometry=rectangle_7.Rectangle)  # -> Area, Centroid; disabled
orient_7 = Orient(Geometry=rectangle_7.Rectangle, Source=area_9.Centroid, Target=xy_5)  # -> Geometry, Transform; disabled
boundary_5 = BoundarySurfaces(Edges=orient_7.Geometry)  # disabled
split_2 = SplitBrep(Brep=sph_4, Cutter=boundary_5)  # disabled
item_15 = ListItem(List=split_2, Index=0, Wrap=True)  # disabled
brep_6 = Brep(item_15)  # disabled
debrep_5 = DeconstructBrep(Brep=brep_6)  # -> Faces, Edges, Vertices; disabled
item_16 = ListItem(List=debrep_5.Edges, Index=0, Wrap=True)  # disabled
panel_18 = Panel("4")  # disabled
divide_8 = DivideCurve(Curve=item_16, Count=panel_18, Kinks=False)  # -> Points, Tangents, Parameters; disabled
number_slider_58 = Slider(0.4, range=0..1)  # disabled
shatter_2 = Shatter(Curve=item_16, Parameters=divide_8.Parameters)  # disabled
eval_2 = EvaluateCurve(Curve=reparameterize(shatter_2), Parameter=number_slider_58)  # -> Point, Tangent, Angle; disabled
dist_2 = Distance(PointA=divide_8.Points, PointB=eval_2.Point)  # disabled
ln_9 = Line(StartPoint=divide_8.Points, EndPoint=eval_2.Point)  # disabled
panel_19 = Panel("0.5")  # disabled
round_2 = Round(Number=dist_2)  # -> Nearest, Floor, Ceiling; disabled
multiplication_9 = Multiplication(A=round_2.Nearest, B=panel_19)  # disabled
midpt_3 = CurveMiddle(Curve=ln_9)  # disabled
panel_20 = Panel(round_2.Nearest)  # disabled
Z_7 = UnitZ(Factor=multiplication_9)  # disabled
move_9 = Move(Geometry=midpt_3, Motion=Z_7)  # -> Geometry, Transform; disabled
arc_3 = Arc3Pt(PointA=divide_8.Points, PointB=move_9.Geometry, PointC=eval_2.Point)  # -> Arc, Plane, Radius; disabled
number_slider_59 = Slider(-3, range=-10..10)  # disabled
pln_4 = Plane(arc_3.Plane)  # disabled
vec_2 = Vector(pln_4)  # disabled
amp_6 = Amplitude(Vector=vec_2, Amplitude=number_slider_59)  # disabled
move_10 = Move(Geometry=arc_3.Arc, Motion=vec_2)  # -> Geometry, Transform; disabled
# not sure this is really parametric
extr_3 = Extrude(Base=move_10.Geometry, Direction=amp_6)  # disabled
brep_7 = Brep(brep_6)  # disabled
sdiff_4 = SolidDifference(BrepsA=extr_3, BrepsB=brep_7)  # disabled
splitmul_7 = SplitBrepMultiple(Brep=brep_7, Cutters=extr_3)  # disabled
splitmul_8 = SplitBrepMultiple(Brep=extr_3, Cutters=brep_7)  # disabled
item_17 = ListItem(List=splitmul_8, Index=0, Wrap=True)  # -> flatten(Item); disabled
item_18 = ListItem(List=splitmul_7, Index=0, Wrap=True)  # disabled
panel_21 = Panel(item_17)  # disabled
mesh_18 = Mesh(item_18)  # disabled
mesh_19 = Mesh(item_17)  # disabled
merge_7 = Merge(Data1=mesh_18, Data2=mesh_19)  # -> flatten(Result); disabled
mjoin_4 = MeshJoin(Meshes=merge_7)  # disabled
panel_22 = Panel(mjoin_4)  # disabled
weldvertices_4 = MeshWeldVertices(Mesh=mjoin_4, Tolerance=0.01)  # -> RuntimeMessage, Mesh; disabled
unifynormals_4 = MeshUnifyNormals(Mesh=weldvertices_4.Mesh)  # disabled
project_2 = Project(Geometry=unifynormals_4, Plane=PlaneXY(0, 0, 0))  # -> Geometry, Transform; disabled
nv_6 = NakedVertices(Mesh=unifynormals_4)  # -> ClothedIndex, NakedIndex, ClothedPts, NakedPts; disabled
pt_15 = Point(nv_6.NakedPts)  # disabled
refine_4 = Refine(Mesh=unifynormals_4, Level=1)  # disabled
mesh_20 = Mesh(refine_4)  # disabled
medges_4 = MeshEdges(Mesh=mesh_20)  # -> NakedEdges, InteriorEdges, NonManifoldEdges; disabled
line_4 = Line(medges_4.NakedEdges)  # disabled
panel_23 = Panel("""0
11
14
19""")  # disabled
join_5 = JoinCurves(Curves=line_4, Preserve=False)  # disabled
item_19 = ListItem(Index=0, Wrap=True)  # disabled
item_20 = ListItem(List=join_5, Index=panel_23, Wrap=True)  # disabled
number_slider_60 = Slider(4, range=0..10)  # disabled
panel_24 = Panel("4")  # disabled
multiplication_10 = Multiplication(A=number_slider_60, B=panel_24)  # disabled
explode_5 = Explode(Curve=item_20, Recursive=True)  # -> Segments, Vertices; disabled
crv_5 = Curve(join_5)  # disabled
mesh_21 = Mesh(project_2.Geometry)  # disabled
divide_9 = DivideCurve(Curve=item_20, Count=multiplication_10, Kinks=False)  # -> Points, Tangents, Parameters; disabled
nv_7 = NakedVertices(Mesh=mesh_21)  # -> ClothedIndex, NakedIndex, ClothedPts, NakedPts; disabled
number_slider_61 = Slider(0.007, range=0..0.01)  # disabled
duppt_4 = RemoveDuplicatePts(Points=divide_9.Points, Tolerance=0.01)  # disabled
number_slider_62 = Slider(1.249, range=0..1.5)  # disabled
plfit_4 = PlaneFit(Points=duppt_4)  # -> Plane, Deviation; disabled
avr_5 = Average(Input=duppt_4)  # disabled
neg_3 = Negative()  # disabled
pt_16 = Point(nv_7.NakedPts)  # disabled
number_slider_63 = Slider(10, range=0..10)  # disabled
pl_origin_4 = PlaneOrigin(Base=plfit_4.Plane, Origin=avr_5)  # disabled

# ---- group: Curve Closest Point
# this is failing
crv_cp_5 = CurveClosestPoint(Point=nv_7.NakedPts, Curve=crv_5)  # -> Point, Parameter, Distance; disabled

# ----
edgelengths_6 = EdgeLengths(Mesh=mesh_21, LengthFactor=number_slider_62, Strength=1)  # disabled
vertexloads = VertexLoads(Mesh=mesh_21, Strength=number_slider_61)  # disabled
show_6 = Show(G=mesh_21)  # disabled
cir_5 = Circle(Plane=pl_origin_4, Radius=number_slider_63)  # disabled
anchor_7 = Anchor(Point=nv_7.NakedPts, Target=crv_cp_5.Point, Strength=10000)  # disabled
merge_8 = Merge(Data1=flatten(vertexloads), Data2=flatten(show_6), Data3=flatten(edgelengths_6), Data4=flatten(anchor_7))  # disabled
crv_cp_6 = CurveClosestPoint(Point=duppt_4, Curve=cir_5)  # -> Point, Parameter, Distance; disabled
number_slider_64 = Slider(0.265, range=0..0.5)  # disabled
number_slider_65 = Slider(0.5, range=0..1)  # disabled
button_4 = Button()  # disabled
toggle_5 = BooleanToggle(True)  # disabled
pt_17 = Point(simplify(crv_cp_6.Point))  # disabled
pt_18 = Point(simplify(duppt_4))  # disabled
Z_8 = UnitZ(Factor=1)  # disabled
edgelengths_7 = EdgeLengths(Mesh=mesh_20, LengthFactor=number_slider_65, Strength=1)  # disabled
solver_3 = Solver(GoalObjects=merge_8, Reset=button_4, Threshold=1e-15, Tolerance=0.0001, On=toggle_5)  # -> I, V, O; disabled
anchor_8 = Anchor(Point=pt_18, Target=pt_17, Strength=10000)  # disabled
load_3 = Load(ForceVector=Z_8, Weighting=1)  # disabled
show_7 = Show(G=mesh_20)  # disabled
ln_10 = Line(StartPoint=pt_18, EndPoint=pt_17)  # disabled
previewmat_4 = CustomPreviewMaterials(Geometry=solver_3.O, DiffuseColor=RGB(255, 255, 255))  # disabled
merge_9 = Merge(Data1=flatten(show_7), Data2=flatten(edgelengths_7), Data3=flatten(anchor_8))  # disabled
toggle_6 = BooleanToggle(False)  # disabled
number_slider_66 = Slider(0.45, range=0..1)  # disabled
button_5 = Button()  # disabled
bouncysolver_4 = BouncySolver(
    GoalObjects=merge_9,
    Reset=button_5,
    Threshold=1e-15,
    Tolerance=0.0001,
    Damping=number_slider_66,
    Iterations=10,
    On=toggle_6)  # -> I, V, O; disabled
previewmat_5 = CustomPreviewMaterials(Geometry=bouncysolver_4.O, DiffuseColor=RGB(255, 255, 255))  # disabled

# ----
# sphere
# not sure this is really parametric
# got this data from rhino
#  geom see how to make
#  itr parametrical
pt_19 = Point(Point(5285.7853, 10525.48167, 6208.9387))  # disabled
number_slider_67 = Slider(20, range=0..100)  # disabled
number_slider_68 = Slider(10, range=0..10)  # disabled
multiplication_11 = Multiplication(A=number_slider_35, B=number_slider_34)  # disabled
number_slider_69 = Slider(34, range=0..1000)  # disabled
number_slider_70 = Slider(45, range=0..100)  # disabled
xy_6 = XYPlane(Origin=pt_19)  # disabled
box_3 = CenterBox(Base=pt_19, X=multiplication_11, Y=multiplication_11, Z=multiplication_11)  # disabled
rectangle_8 = Rectangle(Plane=xy_6, XSize=number_slider_69, YSize=number_slider_69, Radius=0)  # -> Rectangle, Length; disabled
rotate_2 = Rotate(Geometry=box_3, Angle=degrees(number_slider_70), Plane=pt_19)  # -> Geometry, Transform; disabled
debrep_6 = DeconstructBrep(Brep=box_3)  # -> Faces, Edges, Vertices; disabled
area_10 = Area(Geometry=rectangle_8.Rectangle)  # -> Area, Centroid; disabled
area_11 = Area(Geometry=debrep_6.Faces)  # -> Area, Centroid; disabled
number_slider_71 = Slider(0.1, range=0..0.1)  # disabled
pln_5 = Plane(area_11.Centroid)  # disabled
number_slider_72 = Slider(6205, range=0..10000)  # disabled
number_slider_73 = Slider(6210, range=0..10000)  # disabled
orient_8 = Orient(Geometry=rectangle_8.Rectangle, Source=area_10.Centroid, Target=pt_19)  # -> Geometry, Transform; disabled
sph_5 = Sphere(Base=pt_19, Radius=multiplication_11)  # disabled
boundary_6 = BoundarySurfaces(Edges=orient_8.Geometry)  # disabled
pdecon_3 = Deconstruct(Point=area_11.Centroid)  # -> XComponent, YComponent, ZComponent; disabled
panel_26 = Panel(pdecon_3.ZComponent)  # disabled
sdiff_5 = SolidDifference()  # disabled
sint_2 = SolidIntersection(BrepsA=sph_5, BrepsB=boundary_6)  # disabled
abs_2 = Absolute(Value=pdecon_3.ZComponent)  # disabled
debrep_7 = DeconstructBrep(Brep=sint_2)  # -> Faces, Edges, Vertices; disabled
smaller_2 = SmallerThan(FirstNumber=pdecon_3.ZComponent, SecondNumber=number_slider_73)  # -> SmallerThan, OrEqualTo; disabled
larger_2 = LargerThan(FirstNumber=pdecon_3.ZComponent, SecondNumber=number_slider_72)  # -> LargerThan, OrEqualTo; disabled
item_21 = ListItem(List=debrep_7.Edges, Index=0, Wrap=True)  # -> Item, Item1; disabled
number_slider_74 = Slider(8, range=0..10)  # disabled
and = GateAnd(A=smaller_2.SmallerThan, B=larger_2.LargerThan)  # disabled
panel_27 = Panel(and)  # disabled
cull_4 = CullPattern(List=debrep_6.Faces, CullPattern=panel_27)  # disabled
crv_6 = Curve(item_21.Item1)  # disabled
item_22 = ListItem(List=cull_4, Index=0, Wrap=True)  # -> Item, Item1, Item2, Item3; disabled
panel_28 = Panel("{0.5, 0.5, 0}")  # disabled
divide_10 = DivideCurve(Curve=crv_6, Count=number_slider_74, Kinks=False)  # -> Points, Tangents, Parameters; disabled
number_slider_75 = Slider(10, range=0..10)  # disabled
brep_8 = Brep(sph_5)  # disabled
evalsrf_2 = EvaluateSurface(Surface=reparameterize(cull_4), Point=panel_28)  # -> Point, Normal, UDirection, VDirection, Frame; disabled
number_slider_76 = Slider(4, range=0..10)  # disabled
amp_7 = Amplitude(Vector=evalsrf_2.Normal, Amplitude=number_slider_75)  # disabled
number_slider_77 = Slider(20, range=0..100)  # disabled
pt_20 = Point(evalsrf_2.Point)  # disabled
srf_cp_3 = SurfaceClosestPoint(Point=pt_20, Surface=sph_5)  # -> Point, UVPoint, Distance; disabled
pln_6 = Plane(evalsrf_2.Frame)  # disabled
move_11 = Move(Geometry=pt_20, Motion=amp_7)  # -> Geometry, Transform; disabled
rectangle_9 = Rectangle(Plane=pln_6, XSize=number_slider_76, YSize=number_slider_76, Radius=0)  # -> Rectangle, Length; disabled
area_12 = Area(Geometry=rectangle_9.Rectangle)  # -> Area, Centroid; disabled
orient_9 = Orient(Geometry=rectangle_9.Rectangle, Source=area_12.Centroid, Target=pt_20)  # -> Geometry, Transform; disabled
ln_11 = Line(StartPoint=pt_20, EndPoint=move_11.Geometry)  # disabled
extrcrv_3 = ExtrudeAlong(Base=orient_9.Geometry, Curve=ln_11)  # disabled
area_13 = Area(Geometry=extrcrv_3)  # -> Area, Centroid; disabled
sdiff_6 = SolidDifference(BrepsA=extrcrv_3, BrepsB=brep_8)  # disabled
splitmul_9 = SplitBrepMultiple(Brep=extrcrv_3, Cutters=brep_8)  # disabled
splitmul_10 = SplitBrepMultiple(Brep=brep_8, Cutters=extrcrv_3)  # disabled
item_23 = ListItem(List=splitmul_9, Index=0, Wrap=True)  # -> flatten(Item); disabled
item_24 = ListItem(List=splitmul_10, Index=0, Wrap=True)  # disabled
panel_29 = Panel(item_23)  # disabled
mesh_22 = Mesh(item_24)  # disabled
mesh_23 = Mesh(item_23)  # disabled
merge_10 = Merge(Data1=mesh_22, Data2=mesh_23)  # -> flatten(Result); disabled
mjoin_5 = MeshJoin(Meshes=merge_10)  # disabled
panel_30 = Panel(mjoin_5)  # disabled
weldvertices_5 = MeshWeldVertices(Mesh=mjoin_5, Tolerance=0.01)  # -> RuntimeMessage, Mesh; disabled
unifynormals_5 = MeshUnifyNormals(Mesh=weldvertices_5.Mesh)  # disabled
mesh_24 = Mesh(unifynormals_5)  # disabled
nv_8 = NakedVertices(Mesh=mesh_24)  # -> ClothedIndex, NakedIndex, ClothedPts, NakedPts; disabled
refine_5 = Refine(Mesh=mesh_24, Level=1)  # disabled
pt_21 = Point(nv_8.NakedPts)  # disabled
number_slider_78 = Slider(0.81, range=0..1)  # disabled
mesh_25 = Mesh(refine_5)  # disabled
medges_5 = MeshEdges(Mesh=mesh_25)  # -> NakedEdges, InteriorEdges, NonManifoldEdges; disabled
line_5 = Line(medges_5.NakedEdges)  # disabled
join_6 = JoinCurves(Curves=line_5, Preserve=False)  # disabled
number_slider_79 = Slider(4, range=0..10)  # disabled
panel_31 = Panel("4")  # disabled
multiplication_12 = Multiplication(A=number_slider_79, B=panel_31)  # disabled
explode_6 = Explode(Curve=join_6, Recursive=True)  # -> Segments, Vertices; disabled
divide_11 = DivideCurve(Curve=join_6, Count=multiplication_12, Kinks=False)  # -> Points, Tangents, Parameters; disabled
duppt_5 = RemoveDuplicatePts(Points=divide_11.Points, Tolerance=0.01)  # disabled
plfit_5 = PlaneFit(Points=duppt_5)  # -> Plane, Deviation; disabled
avr_6 = Average(Input=duppt_5)  # disabled
number_slider_80 = Slider(10, range=0..10)  # disabled
pl_origin_5 = PlaneOrigin(Base=plfit_5.Plane, Origin=avr_6)  # disabled
cir_6 = Circle(Plane=pl_origin_5, Radius=number_slider_80)  # disabled
crv_cp_7 = CurveClosestPoint(Point=duppt_5, Curve=cir_6)  # -> Point, Parameter, Distance; disabled
number_slider_81 = Slider(0.501, range=0..1)  # disabled
pt_22 = Point(simplify(crv_cp_7.Point))  # disabled
pt_23 = Point(simplify(duppt_5))  # disabled
edgelengths_8 = EdgeLengths(Mesh=mesh_25, LengthFactor=number_slider_81, Strength=1)  # disabled
anchor_9 = Anchor(Point=pt_23, Target=pt_22, Strength=10000)  # disabled
ln_12 = Line(StartPoint=pt_23, EndPoint=pt_22)  # disabled
show_8 = Show(G=mesh_25)  # disabled
toggle_7 = BooleanToggle(False)  # disabled
number_slider_82 = Slider(0.97, range=0..1)  # disabled
button_6 = Button()  # disabled
toggle_8 = GroupToggle(ToggleActive=True, ToggleVisible=False)  # disabled
number_slider_83 = Slider(0.5, range=0..1)  # disabled

number_slider_84 = Slider(1, range=0..1)  # disabled
larger_3 = LargerThan(FirstNumber=pdecon_3.ZComponent, SecondNumber=number_slider_84)  # -> LargerThan, OrEqualTo; disabled
cull_5 = CullPattern(List=area_11.Centroid, CullPattern=larger_3.LargerThan)  # disabled

pt_24 = Point(cull_5)  # disabled
anchor_10 = Anchor(Target=pt_24, Strength=10000)  # disabled
merge_11 = Merge(Data1=flatten(show_8), Data2=flatten(edgelengths_8), Data3=flatten(anchor_9), Data4=flatten(anchor_10))  # disabled
bouncysolver_5 = BouncySolver(
    GoalObjects=merge_11,
    Reset=button_6,
    Threshold=1e-15,
    Tolerance=0.0001,
    Damping=number_slider_82,
    Iterations=10,
    On=toggle_7)  # -> I, V, O; disabled
previewmat_6 = CustomPreviewMaterials(Geometry=bouncysolver_5.O, DiffuseColor=RGB(255, 255, 255), Transparency=number_slider_83)  # disabled
