# Grasshopper definition inflatables2.gh (Grasshopper 1.0.7)
# plug-ins: Kangaroo2 Components, Bifocals, Weaverbird, MeshEdit Components, DendroGH, Human, MetaHopper, Nautilus, Pufferfish, Sasquatch

crv = Curve(<curve referenced from the Rhino model>)
crv_2 = Curve(<curve referenced from the Rhino model>)

# ---- group: boundary curve
crv_3 = Curve(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)

# ----
number_slider = Slider(11, range=0..100)  # disabled
# Inflated pillow - Predefined creases
number_slider_2 = Slider(0.88, range=0..1)  # disabled
number_slider_3 = Slider(2.91, range=0..10)  # disabled
rectangle = Rectangle(Plane=PlaneXY(0, 0, 0), XSize=number_slider, YSize=number_slider, Radius=0)  # -> Rectangle, Length; disabled
number_slider_4 = Slider(7, range=0..10)  # disabled
dom = ConstructDomain(DomainStart=number_slider_2, DomainEnd=number_slider_3)  # disabled
pop2d = Populate2D(Region=rectangle.Rectangle, Count=number_slider_4, Seed=1)  # disabled
lng = ListLength(List=pop2d)  # disabled
random = Random(Range=lng, Number=dom, Seed=2)  # disabled
number_slider_5 = Slider(3, range=0..10)  # disabled
cir = Circle(Plane=pop2d, Radius=random)  # disabled
Z = UnitZ(Factor=number_slider_5)  # disabled
number_slider_6 = Slider(0.18, range=0..1)  # disabled
runion = RegionUnion(Curves=cir)  # disabled
number_slider_7 = Slider(0.06, range=0..0.1)  # disabled
Z_2 = UnitZ(Factor=number_slider_6)  # disabled
boundary = BoundarySurfaces(Edges=runion)  # disabled
move = Move(Geometry=runion, Motion=Z)  # -> Geometry, Transform; disabled
number_slider_8 = Slider(30, range=0..100)  # disabled
boundary_2 = BoundarySurfaces(Edges=move.Geometry)  # disabled
extr = Extrude(Base=boundary, Direction=Z_2)  # disabled
number_slider_9 = Slider(2, range=0..10)  # disabled
mesh = Mesh(boundary_2)  # disabled
divide = DivideCurve(Curve=move.Geometry, Count=number_slider_8, Kinks=False)  # -> Points, Tangents, Parameters; disabled
number_slider_10 = Slider(0.08, range=0..0.1)  # disabled
pipe = Pipe(Curve=move.Geometry, Radius=number_slider_7, Caps=0)  # disabled
number_slider_11 = Slider(0.18, range=0..1)  # disabled
nv = NakedVertices(Mesh=mesh)  # -> ClothedIndex, NakedIndex, ClothedPts, NakedPts; disabled
Z_3 = UnitZ(Factor=number_slider_9)  # disabled
show = Show(G=mesh)  # disabled
edgelengths = EdgeLengths(Mesh=mesh, LengthFactor=number_slider_10, Strength=1)  # disabled
dispatch = Dispatch(List=divide.Points, DispatchPattern=[True, False])  # -> ListA, ListB; disabled
anchor = Anchor(Point=nv.NakedPts, Strength=10000)  # disabled
pt = ConstructPoint(XCoordinate=0, YCoordinate=0, ZCoordinate=number_slider_11)  # disabled
load = Load(Point=nv.ClothedPts, ForceVector=Z_3, Weighting=1)  # disabled
number_slider_12 = Slider(14, range=0..100)  # disabled
button = Button()  # disabled
geo = Geometry(dispatch.ListA)  # disabled
geo_2 = Geometry(dispatch.ListB)  # disabled
toggle = BooleanToggle(True)  # disabled
shift = ShiftList(List=geo_2, Shift=number_slider_12, Wrap=True)  # disabled
project = Project(Geometry=geo, Plane=pt)  # -> Geometry, Transform; disabled
solver = Solver(GoalObjects=[show, edgelengths, load, anchor], Reset=button, Threshold=1e-15, Tolerance=0.01, On=toggle)  # -> I, V, O; disabled
bang = ExplodeTree(Data=solver.O)  # -> _0000, _00000; disabled
ln = Line(StartPoint=geo_2, EndPoint=project.Geometry)  # disabled
ln_2 = Line(StartPoint=project.Geometry, EndPoint=shift)  # disabled
number_slider_13 = Slider(1000, range=0..1000)  # disabled
mesh_2 = Mesh(bang._0000)  # disabled
join = JoinCurves(Curves=flatten([ln_2, ln]), Preserve=False)  # disabled
wbloop = WeaverbirdsLoopSubdivision(MeshCurves=mesh_2, Level=1, SmoothNakedEdges=1)  # disabled
divide_2 = DivideCurve(Curve=join, Count=number_slider_13, Kinks=False)  # -> Points, Tangents, Parameters; disabled
number_slider_14 = Slider(0.045, range=0..0.1)  # disabled
intcrv = Interpolate(Vertices=divide_2.Points, Degree=3, Periodic=invert(False), KnotStyle=1)  # -> Curve, Length, Domain; disabled
wbframe = WeaverbirdsPictureFrame(MeshPolylines=wbloop, Distance=5, InsetType=0)  # disabled
number_slider_15 = Slider(0.06, range=0..0.1)  # disabled
pipe_2 = Pipe(Curve=intcrv.Curve, Radius=number_slider_14, Caps=0)  # disabled
wbthicken = WeaverbirdsMeshThicken(MeshCurves=wbframe, Distance=number_slider_15, OffsetType=0)  # disabled
number_slider_16 = Slider(3, range=0..10)  # disabled
wbcatmullclark = WeaverbirdsCatmullClarkSubdivision(MeshCurves=wbthicken, Level=number_slider_16, SmoothNakedEdges=1)  # disabled

loft = Loft(Curves=[crv_2, crv], Options={Adjust=False, Closed=False, LoftEnds=0, LoftSimp=0, LoftType=0, Rebuild=10, Refit=0.01})
mesh_3 = Mesh(crv_3)
mesh_4 = Mesh(crv_2)
triremesh = TriRemesh(Geometry=mesh_4, Length=1, Iterations=25)  # -> Triangulation, Dual, Creases
neg = Negative(Value=Slider(1252.659, range=0..20101))
nv_2 = NakedVertices(Mesh=triremesh.Triangulation)  # -> ClothedIndex, NakedIndex, ClothedPts, NakedPts
# LAST INFLATABLE, WORKING FINE
number_slider_17 = Slider(0.5, range=0..1)  # disabled
number_slider_18 = Slider(14.57, range=0..100)  # disabled
# got this data from rhino
#  geom see how to make
#  itr parametrical
pt_2 = Point(Point(5285.7853, 10525.48167, 6208.9387))  # disabled
edgelengths_2 = EdgeLengths(Mesh=triremesh.Triangulation, LengthFactor=Slider(0.67, range=0..1), Strength=1)
volume = Volume(Mesh=triremesh.Triangulation, Volume=neg, Strength=1)
anchor_2 = Anchor(Point=nv_2.NakedPts, Strength=10000)
show_2 = Show(G=triremesh.Triangulation)
# half sphere script (NEED FIXING)
number_slider_19 = Slider(10, range=0..10)  # disabled
multiplication = Multiplication(A=number_slider_18, B=number_slider_17)  # disabled
number_slider_20 = Slider(0.88, range=0..1)  # disabled
number_slider_21 = Slider(855, range=0..1000)  # disabled
number_slider_22 = Slider(34, range=0..1000)  # disabled

# ----
# not sure this is really parametric
number_slider_23 = Slider(20, range=0..100)  # disabled
# CUBE
number_slider_24 = Slider(10, range=0..10)  # disabled
box = CenterBox(Base=PlaneXY(0, 0, 0), X=number_slider_23, Y=number_slider_23, Z=number_slider_23)  # disabled
debrep = DeconstructBrep(Brep=box)  # -> Faces, Edges, Vertices; disabled
area = Area(Geometry=debrep.Faces)  # -> Area, Centroid; disabled
number_slider_25 = Slider(0.1, range=0..0.1)  # disabled
pln = Plane(area.Centroid)  # disabled
number_slider_26 = Slider(25, range=0..100)  # disabled
pdecon = Deconstruct(Point=area.Centroid)  # -> XComponent, YComponent, ZComponent; disabled
abs = Absolute(Value=pdecon.ZComponent)  # disabled
smaller = SmallerThan(FirstNumber=abs, SecondNumber=number_slider_25)  # -> SmallerThan, OrEqualTo; disabled
sph = Sphere(Base=PlaneXY(0, 0, 0), Radius=number_slider_26)  # disabled
cull = CullPattern(List=debrep.Faces, CullPattern=smaller.SmallerThan)  # disabled
panel = Panel(smaller.SmallerThan)  # disabled
cull_2 = CullPattern(List=area.Centroid, CullPattern=smaller.SmallerThan)  # disabled
item = ListItem(List=cull, Index=0, Wrap=True)  # -> Item, Item1, Item2, Item3; disabled
panel_2 = Panel("{0.5, 0.5, 0}")  # disabled
number_slider_27 = Slider(10, range=0..10)  # disabled
brep = Brep(box)  # disabled
evalsrf = EvaluateSurface(Surface=reparameterize(cull), Point=panel_2)  # -> Point, Normal, UDirection, VDirection, Frame; disabled
number_slider_28 = Slider(9, range=0..10)  # disabled
amp = Amplitude(Vector=evalsrf.Normal, Amplitude=number_slider_27)  # disabled
pt_3 = Point(evalsrf.Point)  # disabled
srf_cp = SurfaceClosestPoint(Point=pt_3, Surface=sph)  # -> Point, UVPoint, Distance; disabled
pln_2 = Plane(evalsrf.Frame)  # disabled
rectangle_2 = Rectangle(Plane=pln_2, XSize=number_slider_28, YSize=number_slider_28, Radius=0)  # -> Rectangle, Length; disabled
move_2 = Move(Geometry=pt_3, Motion=amp)  # -> Geometry, Transform; disabled
area_2 = Area(Geometry=rectangle_2.Rectangle)  # -> Area, Centroid; disabled
orient = Orient(Geometry=rectangle_2.Rectangle, Source=area_2.Centroid, Target=pt_3)  # -> Geometry, Transform; disabled
ln_3 = Line(StartPoint=pt_3, EndPoint=move_2.Geometry)  # disabled
extrcrv = ExtrudeAlong(Base=orient.Geometry, Curve=ln_3)  # disabled
area_3 = Area(Geometry=extrcrv)  # -> Area, Centroid; disabled
orient_2 = Orient(Geometry=extrcrv, Source=area_3.Centroid, Target=pt_3)  # -> Geometry, Transform; disabled
sdiff = SolidDifference(BrepsA=orient_2.Geometry, BrepsB=brep)  # disabled
splitmul = SplitBrepMultiple(Brep=orient_2.Geometry, Cutters=brep)  # disabled
splitmul_2 = SplitBrepMultiple(Brep=brep, Cutters=orient_2.Geometry)  # disabled
item_2 = ListItem(List=splitmul, Index=0, Wrap=True)  # -> flatten(Item); disabled
item_3 = ListItem(List=splitmul_2, Index=0, Wrap=True)  # disabled
panel_3 = Panel(item_2)  # disabled
mesh_5 = Mesh(item_3)  # disabled
mesh_6 = Mesh(item_2)  # disabled
merge = Merge(Data1=mesh_5, Data2=mesh_6)  # -> flatten(Result); disabled
mjoin = MeshJoin(Meshes=merge)  # disabled
panel_4 = Panel(mjoin)  # disabled
weldvertices = MeshWeldVertices(Mesh=mjoin, Tolerance=0.01)  # -> RuntimeMessage, Mesh; disabled
unifynormals = MeshUnifyNormals(Mesh=weldvertices.Mesh)  # disabled
mesh_7 = Mesh(unifynormals)  # disabled
nv_3 = NakedVertices(Mesh=mesh_7)  # -> ClothedIndex, NakedIndex, ClothedPts, NakedPts; disabled
pt_4 = Point(nv_3.NakedPts)  # disabled
refine = Refine(Mesh=mesh_7, Level=1)  # disabled
mesh_8 = Mesh(refine)  # disabled
medges = MeshEdges(Mesh=mesh_8)  # -> NakedEdges, InteriorEdges, NonManifoldEdges; disabled
line = Line(medges.NakedEdges)  # disabled
panel_5 = Panel("""0
11
14
19""")  # disabled
join_2 = JoinCurves(Curves=line, Preserve=False)  # disabled
number_slider_29 = Slider(4, range=0..10)  # disabled
item_4 = ListItem(List=join_2, Index=panel_5, Wrap=True)  # disabled
panel_6 = Panel("4")  # disabled
multiplication_2 = Multiplication(A=number_slider_29, B=panel_6)  # disabled
explode = Explode(Curve=item_4, Recursive=True)  # -> Segments, Vertices; disabled
divide_3 = DivideCurve(Curve=item_4, Count=multiplication_2, Kinks=False)  # -> Points, Tangents, Parameters; disabled
duppt = RemoveDuplicatePts(Points=divide_3.Points, Tolerance=0.01)  # disabled
plfit = PlaneFit(Points=duppt)  # -> Plane, Deviation; disabled
avr = Average(Input=duppt)  # disabled
number_slider_30 = Slider(10, range=0..10)  # disabled
pl_origin = PlaneOrigin(Base=plfit.Plane, Origin=avr)  # disabled
cir_2 = Circle(Plane=pl_origin, Radius=number_slider_30)  # disabled
crv_cp = CurveClosestPoint(Point=duppt, Curve=cir_2)  # -> Point, Parameter, Distance; disabled
number_slider_31 = Slider(0.501, range=0..1)  # disabled
pt_5 = Point(simplify(crv_cp.Point))  # disabled
pt_6 = Point(simplify(duppt))  # disabled
edgelengths_3 = EdgeLengths(Mesh=mesh_8, LengthFactor=number_slider_31, Strength=1)  # disabled
anchor_3 = Anchor(Point=pt_6, Target=pt_5, Strength=10000)  # disabled
ln_4 = Line(StartPoint=pt_6, EndPoint=pt_5)  # disabled
show_3 = Show(G=mesh_8)  # disabled
merge_2 = Merge(Data1=flatten(show_3), Data2=flatten(edgelengths_3), Data3=flatten(anchor_3))  # disabled
toggle_2 = BooleanToggle(False)  # disabled
button_2 = Button()  # disabled
number_slider_32 = Slider(0.72, range=0..1)  # disabled
toggle_3 = GroupToggle(ToggleActive=True, ToggleVisible=False)  # disabled
bouncysolver = BouncySolver(
    GoalObjects=merge_2,
    Reset=button_2,
    Threshold=1e-15,
    Tolerance=0.0001,
    Damping=number_slider_32,
    Iterations=10,
    On=toggle_2)  # -> I, V, O; disabled
previewmat = CustomPreviewMaterials(Geometry=bouncysolver.O, DiffuseColor=RGB(255, 255, 255))  # disabled

number_slider_33 = Slider(45, range=0..100)  # disabled
xy = XYPlane(Origin=Point(0, 0, 0))  # disabled
entwine = Entwine(Branch00=show_2, Branch01=[anchor_2, volume, edgelengths_2], FlattenInputs=True)

number_slider_34 = Slider(0.5, range=0..1)  # disabled
number_slider_35 = Slider(14.57, range=0..100)  # disabled

num = Number(multiplication)  # disabled
xy_2 = XYPlane(Origin=pt_2)  # disabled
box_2 = CenterBox(Base=pt_2, X=multiplication, Y=multiplication, Z=multiplication)  # disabled
sph_2 = Sphere(Base=PlaneXY(0, 0, 0), Radius=number_slider_19)  # disabled
rectangle_3 = Rectangle(Plane=xy, XSize=number_slider_21, YSize=number_slider_21, Radius=0)  # -> Rectangle, Length; disabled
multiplication_3 = Multiplication(A=num, B=number_slider_20)  # disabled
rectangle_4 = Rectangle(Plane=xy_2, XSize=number_slider_22, YSize=number_slider_22, Radius=0)  # -> Rectangle, Length; disabled
rotate = Rotate(Geometry=box_2, Angle=degrees(number_slider_33), Plane=pt_2)  # -> Geometry, Transform; disabled
debrep_2 = DeconstructBrep(Brep=box_2)  # -> Faces, Edges, Vertices; disabled
solver_2 = Solver(GoalObjects=entwine, Reset=Button(), Threshold=1e-15, Tolerance=0.01, On=Toggle(True))  # -> I, V, O
area_4 = Area(Geometry=rectangle_3.Rectangle)  # -> Area, Centroid; disabled
area_5 = Area(Geometry=rectangle_4.Rectangle)  # -> Area, Centroid; disabled
area_6 = Area(Geometry=debrep_2.Faces)  # -> Area, Centroid; disabled
number_slider_36 = Slider(1, range=0..1)  # disabled
number_slider_37 = Slider(192, range=0..200)  # disabled
bang_2 = ExplodeTree(Data=solver_2.O)  # -> Branch0, Branch1
orient_3 = Orient(Geometry=rectangle_4.Rectangle, Source=area_5.Centroid, Target=pt_2)  # -> Geometry, Transform; disabled
orient_4 = Orient(Geometry=rectangle_3.Rectangle, Source=area_4.Centroid, Target=xy)  # -> Geometry, Transform; disabled
sph_3 = Sphere(Base=pt_2, Radius=multiplication_3)  # disabled
xy_3 = XYPlane(Origin=Point(0, 0, 0))  # disabled
pdecon_2 = Deconstruct(Point=area_6.Centroid)  # -> XComponent, YComponent, ZComponent; disabled
boundary_3 = BoundarySurfaces(Edges=orient_3.Geometry)  # disabled
boundary_4 = BoundarySurfaces(Edges=orient_4.Geometry)  # disabled
mesh_9 = Mesh(bang_2.Branch0)
brep_2 = Brep(sph_3)  # disabled
sint = SolidIntersection(BrepsA=sph_3, BrepsB=boundary_3)  # disabled
larger = LargerThan(FirstNumber=pdecon_2.ZComponent, SecondNumber=number_slider_36)  # -> LargerThan, OrEqualTo; disabled
preview = CustomPreview(
    Geometry=mesh_9,
    Material={diffuse=RGB(0, 128, 0), emission=RGB(0, 0, 0), shine=0.5, specular=RGB(255, 255, 255), transparency=0.1})
rectangle_5 = Rectangle(Plane=xy_3, XSize=number_slider_37, YSize=number_slider_37, Radius=0)  # -> Rectangle, Length; disabled
split = SplitBrep(Brep=sph_2, Cutter=boundary_4)  # disabled
debrep_3 = DeconstructBrep(Brep=sint)  # -> Faces, Edges, Vertices; disabled
number_slider_38 = Slider(4, range=0..10)  # disabled
number_slider_39 = Slider(76, range=0..100)  # disabled
number_slider_40 = Slider(8, range=0..10)  # disabled
cull_3 = CullPattern(List=area_6.Centroid, CullPattern=larger.LargerThan)  # disabled
item_5 = ListItem(List=debrep_3.Edges, Index=0, Wrap=True)  # -> Item, Item1; disabled
item_6 = ListItem(List=split, Index=0, Wrap=True)  # disabled
# LAST INFLATABLE,
# SUSCRIBED IN COURTYARD GEOMETRY
number_slider_41 = Slider(3, range=0..3)  # disabled
xy_4 = XYPlane(Origin=Point(0, 0, 0))  # disabled
crv_4 = Curve(item_5.Item1)  # disabled
pop2d_2 = Populate2D(Region=rectangle_5.Rectangle, Count=number_slider_39, Seed=number_slider_38)  # disabled
brep_3 = Brep(item_6)  # disabled
pt_7 = Point(cull_3)  # disabled
divide_4 = DivideCurve(Curve=crv_4, Count=number_slider_40, Kinks=False)  # -> Points, Tangents, Parameters; disabled
panel_7 = Panel("-2.5")  # disabled
del = DelaunayMesh(Points=pop2d_2, Plane=xy_4)  # disabled
hull = ConvexHull(Points=pop2d_2, Plane=xy_4)  # -> Hull, HullZ, Indices; disabled
# BOUNDARY CYARD
crv_5 = Curve(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)  # disabled
series = Series(Start=0, Step=panel_7, Count=number_slider_41)  # disabled
debrep_4 = DeconstructBrep(Brep=brep_3)  # -> Faces, Edges, Vertices; disabled
number_slider_42 = Slider(1, range=0..1)  # disabled
number_slider_43 = Slider(50, range=0..100)  # disabled
number_slider_44 = Slider(53.6, range=0..100)  # disabled
ln_5 = Line(StartPoint=pt_2, EndPoint=divide_4.Points)  # disabled
demesh = DeconstructMesh(Mesh=del)  # -> Vertices, Faces, Colours, Normals; disabled
item_7 = ListItem(List=debrep_4.Edges, Index=0, Wrap=True)  # disabled
panel_8 = Panel(series)  # disabled
end = EndPoints(Curve=ln_5)  # -> Start, End; disabled
Z_4 = UnitZ(Factor=series)  # disabled
panel_9 = Panel("4")  # disabled
neg_2 = Negative(Value=number_slider_44)  # disabled
divide_5 = DivideCurve(Curve=item_7, Count=panel_9, Kinks=False)  # -> Points, Tangents, Parameters; disabled
move_3 = Move(Geometry=crv_5, Motion=Z_4)  # -> Geometry, Transform; disabled
avr_2 = Average(Input=demesh.Vertices)  # disabled
pframe = PerpFrame(Curve=ln_5, Parameter=number_slider_42)  # disabled
pt_8 = Point(end.End)  # disabled

number_slider_45 = Slider(2.5, range=0..10)  # disabled
rectangle_6 = Rectangle(Plane=pframe, XSize=number_slider_45, YSize=number_slider_45, Radius=0)  # -> Rectangle, Length; disabled
area_7 = Area(Geometry=rectangle_6.Rectangle)  # -> Area, Centroid; disabled
orient_5 = Orient(Geometry=rectangle_6.Rectangle, Source=area_7.Centroid, Target=pt_8)  # -> Geometry, Transform; disabled
number_slider_46 = Slider(4, range=-10..10)  # disabled
vec2pt = Vector2Pt(PointA=end.End, PointB=end.Start, Unitize=False)  # -> Vector, Length; disabled
extrcrv_2 = ExtrudeAlong(Base=orient_5.Geometry, Curve=ln_5)  # disabled
amp_2 = Amplitude(Vector=vec2pt.Vector, Amplitude=number_slider_46)  # disabled
move_4 = Move(Geometry=extrcrv_2, Motion=amp_2)  # -> Geometry, Transform; disabled
# not sure this is really parametric
area_8 = Area(Geometry=move_4.Geometry)  # -> Area, Centroid; disabled

Z_5 = UnitZ(Factor=neg_2)  # disabled
number_slider_47 = Slider(0.4, range=0..1)  # disabled
crv_cp_2 = CurveClosestPoint(Point=demesh.Vertices, Curve=hull.Hull)  # -> Point, Parameter, Distance; disabled
item_8 = ListItem(List=move_3.Geometry, Index=0, Wrap=True)  # -> Item, Item1, Item2; disabled
move_5 = Move(Geometry=avr_2, Motion=Z_5)  # -> Geometry, Transform; disabled
shatter = Shatter(Curve=item_7, Parameters=divide_5.Parameters)  # disabled
bool = Boolean(crv_cp_2.Distance)  # disabled
number_slider_48 = Slider(100, range=0..100)  # disabled
crv_6 = Curve(item_8.Item1)  # disabled
# TOP CURVES (0.00 , -2.50)
crv_7 = Curve(item_8.Item2)  # disabled
# TOP CURVES (0.00 , -2.50)
crv_8 = Curve(item_8.Item)  # disabled
crv_9 = Curve(item_8.Item1)  # disabled
vec2pt_2 = Vector2Pt(PointA=move_5.Geometry, PointB=demesh.Vertices, Unitize=False)  # -> Vector, Length; disabled
eval = EvaluateCurve(Curve=reparameterize(shatter), Parameter=number_slider_47)  # -> Point, Tangent, Angle; disabled
panel_10 = Panel("0")  # disabled
explode_2 = Explode(Curve=crv_8, Recursive=True)  # -> Segments, Vertices; disabled
explode_3 = Explode(Curve=crv_9, Recursive=True)  # -> Segments, Vertices; disabled
int = Integer(bool)  # disabled
dist = Distance(PointA=divide_5.Points, PointB=eval.Point)  # disabled
bnd = Bounds(Numbers=vec2pt_2.Length)  # disabled
midpt = CurveMiddle(Curve=explode_2.Segments)  # -> graft(Midpoint); disabled
midpt_2 = CurveMiddle(Curve=explode_3.Segments)  # -> graft(Midpoint); disabled
round = Round(Number=dist)  # -> Nearest, Floor, Ceiling; disabled

# ---- group: define height
ln_6 = Line(StartPoint=divide_5.Points, EndPoint=eval.Point)  # disabled
panel_11 = Panel("0.5")  # disabled
multiplication_4 = Multiplication(A=round.Nearest, B=panel_11)  # disabled
midpt_3 = CurveMiddle(Curve=ln_6)  # disabled
Z_6 = UnitZ(Factor=multiplication_4)  # disabled
move_6 = Move(Geometry=midpt_3, Motion=Z_6)  # -> Geometry, Transform; disabled

# ----
dom_2 = ConstructDomain(DomainStart=number_slider_48, DomainEnd=panel_10)  # disabled
merge_3 = Merge(Data1=midpt, Data2=midpt_2)  # disabled
panel_12 = Panel(round.Nearest)  # disabled
remap = RemapNumbers(Value=vec2pt_2.Vector, Source=bnd, Target=dom_2)  # -> Mapped, Clipped; disabled
panel_13 = Panel("3")  # disabled
# FIND CENTER OF
# ATTACHING SQUARES
avr_3 = Average(Input=merge_3)  # -> flatten(ArithmeticMean); disabled
lng_2 = ListLength(List=avr_3)  # disabled

# ----
# NOT SURE HOW TO
# MAKE A RULE TO GRAB
# HE SIDES I WANT
number_slider_49 = Slider(0, range=0..24)  # disabled

multiplication_5 = Multiplication(A=int, B=remap.Mapped)  # disabled
arc = Arc3Pt(PointA=divide_5.Points, PointB=move_6.Geometry, PointC=eval.Point)  # -> Arc, Plane, Radius; disabled
division = Division(A=lng_2, B=panel_13)  # disabled
amp_3 = Amplitude(Vector=vec2pt_2.Vector, Amplitude=multiplication_5)  # disabled
series_2 = Series(Start=0, Step=panel_13, Count=division)  # disabled
move_7 = Move(Geometry=demesh.Vertices, Motion=amp_3)  # -> Geometry, Transform; disabled
number_slider_50 = Slider(-3, range=-10..10)  # disabled
# Maybe make a rule to
# select the faces i wanna
# connect and not all 8
item_9 = ListItem(List=avr_3, Index=series_2, Wrap=True)  # disabled

number_slider_51 = Slider(1, range=0..10)  # disabled
panel_14 = Panel(" 0 to 1")  # disabled
random_2 = Random(Range=panel_14, Number=number_slider_51, Seed=2)  # disabled
# this is a random rule
# to make it pick whichever
abs_2 = Absolute(Value=random_2)  # disabled
round_2 = Round(Number=random_2)  # -> Nearest, Floor, Ceiling; disabled
panel_15 = Panel(round_2.Nearest)  # disabled
cull_4 = CullPattern(List=item_9, CullPattern=panel_15)  # disabled

pln_3 = Plane(arc.Plane)  # disabled
vec = Vector(pln_3)  # disabled
conmesh = ConstructMesh(Vertices=move_7.Geometry, Faces=demesh.Faces)  # disabled
move_8 = Move(Geometry=arc.Arc, Motion=vec)  # -> Geometry, Transform; disabled
amp_4 = Amplitude(Vector=vec, Amplitude=number_slider_50)  # disabled
faceb = FaceBoundaries(Mesh=conmesh)  # disabled
number_slider_52 = Slider(0.1, range=0..0.3)  # disabled
avr_4 = Average(Input=item_9)  # disabled
planar = IsPlanar(Surface=faceb, Interior=True)  # -> Planar, Plane; disabled

# ---- group: unifying meshed
# not sure this is really parametric
extr_2 = Extrude(Base=move_8.Geometry, Direction=amp_4)  # disabled
brep_4 = Brep(brep_3)  # disabled
sdiff_2 = SolidDifference(BrepsA=extr_2, BrepsB=brep_4)  # disabled
splitmul_3 = SplitBrepMultiple(Brep=extr_2, Cutters=brep_4)  # disabled
splitmul_4 = SplitBrepMultiple(Brep=brep_4, Cutters=extr_2)  # disabled
item_10 = ListItem(List=splitmul_3, Index=0, Wrap=True)  # -> flatten(Item); disabled
item_11 = ListItem(List=splitmul_4, Index=0, Wrap=True)  # disabled

# ----
number_slider_53 = Slider(0.5, range=0..1)  # disabled
number_slider_54 = Slider(14.57, range=0..100)  # disabled
number_slider_55 = Slider(1, range=0..1)  # disabled
# FIND curves and planes for extrusion
ln_7 = Line(StartPoint=avr_4, EndPoint=cull_4)  # disabled
number_slider_56 = Slider(2.5, range=0..10)  # disabled
multiplication_6 = Multiplication(A=number_slider_54, B=number_slider_53)  # disabled
number_slider_57 = Slider(0.88, range=0..1)  # disabled
pframe_2 = PerpFrame(Curve=reparameterize(ln_7), Parameter=number_slider_55)  # disabled
eval_2 = EvaluateCurve(Curve=reparameterize(ln_7), Parameter=number_slider_55)  # -> Point, Tangent, Angle; disabled
num_2 = Number(multiplication_6)  # disabled
rectangle_7 = Rectangle(Plane=pframe_2, XSize=number_slider_56, YSize=number_slider_56, Radius=0)  # -> Rectangle, Length; disabled

splitmul_5 = SplitBrepMultiple(Brep=move_4.Geometry, Cutters=brep_2)  # disabled
splitmul_6 = SplitBrepMultiple(Brep=brep_2, Cutters=move_4.Geometry)  # disabled
item_12 = ListItem(List=splitmul_5, Index=0, Wrap=True)  # -> flatten(Item); disabled
item_13 = ListItem(List=splitmul_6, Index=0, Wrap=True)  # disabled
panel_16 = Panel(item_12)  # disabled

multiplication_7 = Multiplication(A=num_2, B=number_slider_57)  # disabled
area_9 = Area(Geometry=rectangle_7.Rectangle)  # -> Area, Centroid; disabled
number_slider_58 = Slider(-4, range=-10..10)  # disabled
offset = OffsetCurve(Curve=faceb, Distance=expr("-x", number_slider_52), Plane=planar.Plane, Corners=1)  # disabled
# point for central shape
# sphere for trying
pt_9 = Point(avr_4)  # disabled
vec2pt_3 = Vector2Pt(PointA=avr_4, PointB=eval_2.Point, Unitize=False)  # -> Vector, Length; disabled
orient_6 = Orient(Geometry=rectangle_7.Rectangle, Source=area_9.Centroid, Target=eval_2.Point)  # -> Geometry, Transform; disabled
explode_4 = Explode(Curve=offset, Recursive=True)  # -> graft(Segments), Vertices; disabled
amp_5 = Amplitude(Vector=vec2pt_3.Vector, Amplitude=number_slider_58)  # disabled
midpt_4 = CurveMiddle(Curve=explode_4.Segments)  # disabled
end_2 = EndPoints(Curve=explode_4.Segments)  # -> Start, End; disabled
box_3 = Box()  # disabled
number_slider_59 = Slider(0.12, range=0..0.3)  # disabled
meshcp = MeshClosestPoint(Point=midpt_4, Mesh=conmesh)  # -> Point, Index, Parameter; disabled
panel_17 = Panel(item_10)  # disabled
meval = MeshEval(Mesh=conmesh, Parameter=meshcp.Parameter)  # -> Point, Normal, Colour; disabled
len = Length(Curve=explode_4.Segments)  # disabled
mesh_10 = Mesh(item_13)  # disabled
mesh_11 = Mesh(item_12)  # disabled
multiplication_8 = Multiplication(A=len, B=number_slider_59)  # disabled

sph_4 = Sphere(Base=pt_9, Radius=multiplication_7)  # disabled
extr_3 = Extrude(Base=orient_6.Geometry, Direction=amp_5)  # disabled

# ----
# trim sphere bottom
panel_18 = Panel("0.5")  # disabled
number_slider_60 = Slider(22, range=0..1000)  # disabled
multiplication_9 = Multiplication(A=number_slider_56, B=panel_18)  # disabled
area_10 = Area(Geometry=sph_4)  # -> Area, Centroid; disabled
neg_3 = Negative(Value=multiplication_9)  # disabled
rectangle_8 = Rectangle(Plane=area_10.Centroid, XSize=number_slider_60, YSize=number_slider_60, Radius=0)  # -> Rectangle, Length; disabled
Z_7 = UnitZ(Factor=neg_3)  # disabled
area_11 = Area(Geometry=rectangle_8.Rectangle)  # -> Area, Centroid; disabled
orient_7 = Orient(Geometry=rectangle_8.Rectangle, Source=area_11.Centroid, Target=area_10.Centroid)  # -> Geometry, Transform; disabled
move_9 = Move(Geometry=orient_7.Geometry, Motion=Z_7)  # -> Geometry, Transform; disabled
boundary_5 = BoundarySurfaces(Edges=move_9.Geometry)  # disabled
splitmul_7 = SplitBrepMultiple(Brep=sph_4, Cutters=boundary_5)  # disabled
item_14 = ListItem(List=splitmul_7, Index=0, Wrap=True)  # disabled

number_slider_61 = Slider(0.35, range=0..1)  # disabled
amp_6 = Amplitude(Vector=meval.Normal, Amplitude=multiplication_8)  # disabled
mesh_12 = Mesh(item_11)  # disabled
mesh_13 = Mesh(item_10)  # disabled
multiplication_10 = Multiplication(A=number_slider_54, B=number_slider_61)  # disabled
merge_4 = Merge(Data1=mesh_10, Data2=mesh_11)  # -> flatten(Result); disabled
move_10 = Move(Geometry=midpt_4, Motion=amp_6)  # -> Geometry, Transform; disabled
box_4 = CenterBox(Base=pt_9, X=multiplication_10, Y=multiplication_10, Z=multiplication_10)  # disabled
arc_2 = Arc3Pt(PointA=end_2.Start, PointB=move_10.Geometry, PointC=end_2.End)  # -> simplify(Arc), Plane, Radius; disabled
merge_5 = Merge(Data1=mesh_12, Data2=mesh_13)  # -> flatten(Result); disabled
mjoin_2 = MeshJoin(Meshes=merge_4)  # disabled
facet = FacetDome()  # -> Pattern, Dome; disabled
pshift = ShiftPaths(Data=arc_2.Arc, Offset=-1)  # disabled
panel_19 = Panel(mjoin_2)  # disabled
mjoin_3 = MeshJoin(Meshes=merge_5)  # disabled
weldvertices_2 = MeshWeldVertices(Mesh=mjoin_2, Tolerance=0.01)  # -> RuntimeMessage, Mesh; disabled
srf = Surface(box_4)  # disabled
srf_2 = Surface(item_14)  # disabled
item_15 = ListItem(List=pshift, Index=0, Wrap=True)  # -> Item, Item1, Item2; disabled
panel_20 = Panel(mjoin_3)  # disabled
unifynormals_2 = MeshUnifyNormals(Mesh=weldvertices_2.Mesh)  # disabled
weldvertices_3 = MeshWeldVertices(Mesh=mjoin_3, Tolerance=0.01)  # -> RuntimeMessage, Mesh; disabled
edgesrf = EdgeSurface(CurveA=item_15.Item, CurveB=item_15.Item1, CurveC=item_15.Item2)  # disabled
mesh_14 = Mesh(unifynormals_2)  # disabled

# ----
# not sure this is really parametric
splitmul_8 = SplitBrepMultiple(Brep=extr_3, Cutters=box_4)  # disabled
splitmul_9 = SplitBrepMultiple(Brep=box_4, Cutters=extr_3)  # disabled
item_16 = ListItem(List=splitmul_8, Index=0, Wrap=True)  # -> flatten(Item); disabled
item_17 = ListItem(List=splitmul_9, Index=0, Wrap=True)  # disabled

unifynormals_3 = MeshUnifyNormals(Mesh=weldvertices_3.Mesh)  # disabled
preview_2 = CustomPreview(
    Geometry=edgesrf,
    Material={diffuse=RGB(221, 160, 221), emission=RGB(66, 48, 66), shine=0.5, specular=RGB(255, 255, 255), transparency=0})  # disabled
nv_4 = NakedVertices(Mesh=unifynormals_3)  # -> ClothedIndex, NakedIndex, ClothedPts, NakedPts; disabled
nv_5 = NakedVertices(Mesh=mesh_14)  # -> ClothedIndex, NakedIndex, ClothedPts, NakedPts; disabled
panel_21 = Panel(item_16)  # disabled
pt_10 = Point(nv_4.NakedPts)  # disabled

# ----
# meshing for kangaroo
mesh_15 = Mesh(item_17)  # disabled
mesh_16 = Mesh(item_16)  # disabled
merge_6 = Merge(Data1=mesh_15, Data2=mesh_16)  # -> flatten(Result); disabled
mjoin_4 = MeshJoin(Meshes=merge_6)  # disabled
weldvertices_4 = MeshWeldVertices(Mesh=mjoin_4, Tolerance=0.01)  # -> RuntimeMessage, Mesh; disabled
unifynormals_4 = MeshUnifyNormals(Mesh=weldvertices_4.Mesh)  # disabled
mesh_17 = Mesh(unifynormals_4)  # disabled

refine_2 = Refine(Mesh=mesh_14, Level=1)  # disabled
pt_11 = Point(nv_5.NakedPts)  # disabled
refine_3 = Refine(Mesh=unifynormals_3, Level=1)  # disabled
panel_22 = Panel("-1")  # disabled

# ---- group: dendro settings / voxel size
number_slider_62 = Slider(0.747, range=0..10)  # disabled
number_slider_63 = Slider(0.81, range=0..1)  # disabled
vsettings = CreateSettings(VoxelSize=number_slider_62, Bandwidth=1, Isovalue=0, Adaptivity=number_slider_63)  # disabled

# ----
mesh_18 = Mesh(refine_2)  # disabled
Z_8 = UnitZ(Factor=panel_22)  # disabled
panel_23 = Panel("-1")  # disabled
medges_2 = MeshEdges(Mesh=mesh_18)  # -> NakedEdges, InteriorEdges, NonManifoldEdges; disabled
mesh_19 = Mesh(refine_3)  # disabled
line_2 = Line(medges_2.NakedEdges)  # disabled
medges_3 = MeshEdges(Mesh=mesh_19)  # -> NakedEdges, InteriorEdges, NonManifoldEdges; disabled

vmesh = MeshToVolume(Settings=vsettings)  # disabled
vunion = VolumeUnion(Volumes=vmesh)  # disabled
mvolume = VolumeToMesh(Volume=vunion, VolumeSettings=vsettings)  # disabled
number_slider_64 = Slider(2, range=0..10)  # disabled
wbcatmullclark_2 = WeaverbirdsCatmullClarkSubdivision(MeshCurves=mvolume, Level=1, SmoothNakedEdges=1)  # disabled
triremesh_2 = TriRemesh(Geometry=wbcatmullclark_2, Length=number_slider_64, Iterations=25)  # -> Triangulation, Dual, Creases; disabled
mesh_20 = Mesh(triremesh_2.Triangulation)  # disabled

panel_24 = Panel(mjoin_4)  # disabled
join_3 = JoinCurves(Curves=line_2, Preserve=False)  # disabled
line_3 = Line(medges_3.NakedEdges)  # disabled
number_slider_65 = Slider(0.313, range=0..1)  # disabled
panel_25 = Panel("""0
11
14
19""")  # disabled
join_4 = JoinCurves(Curves=line_3, Preserve=False)  # disabled
item_18 = ListItem(Index=0, Wrap=True)  # disabled
number_slider_66 = Slider(4, range=0..10)  # disabled
# chack if welding is ok
nv_6 = NakedVertices(Mesh=mesh_17)  # -> ClothedIndex, NakedIndex, ClothedPts, NakedPts; disabled
number_slider_67 = Slider(8, range=0..10)

# ----
# input side length!
number_slider_68 = Slider(2.5, range=0..10)

# ----
# input side length!
number_slider_69 = Slider(2.5, range=0..10)
panel_26 = Panel("4")  # disabled
item_19 = ListItem(List=join_4, Index=panel_25, Wrap=True)  # disabled
pt_12 = Point(nv_6.NakedPts)  # disabled
number_slider_70 = Slider(2, range=0..10)  # disabled
multiplication_11 = Multiplication(A=number_slider_66, B=panel_26)  # disabled
number_slider_71 = Slider(4, range=0..10)  # disabled
pt_13 = Point(Point(6.204907427, -2.304749065, 2.003822684))
pi = Pi(Factor=1)
refine_4 = Refine(Mesh=mesh_17, Level=1)  # disabled
panel_27 = Panel("4")  # disabled
divide_6 = DivideCurve(Curve=join_3, Count=multiplication_11, Kinks=False)  # -> Points, Tangents, Parameters; disabled
multiplication_12 = Multiplication(A=number_slider_71, B=panel_27)  # disabled
division_2 = Division(A=pi, B=number_slider_67)
explode_5 = Explode(Curve=item_19, Recursive=True)  # -> Segments, Vertices; disabled
duppt_2 = RemoveDuplicatePts(Points=divide_6.Points, Tolerance=0.01)  # disabled
divide_7 = DivideCurve(Curve=item_19, Count=multiplication_12, Kinks=False)  # -> Points, Tangents, Parameters; disabled
mesh_21 = Mesh(refine_4)  # disabled
mesh_22 = Mesh(mesh_21)  # disabled
medges_4 = MeshEdges(Mesh=mesh_22)  # -> NakedEdges, InteriorEdges, NonManifoldEdges; disabled
line_4 = Line(medges_4.NakedEdges)  # disabled
tan = Tangent(Value=division_2)
multiplication_13 = Multiplication(A="2", B=tan)
division_3 = Division(A=number_slider_68, B=multiplication_13)
plfit_2 = PlaneFit(Points=duppt_2)  # -> Plane, Deviation; disabled
avr_5 = Average(Input=duppt_2)  # disabled
join_5 = JoinCurves(Curves=line_4, Preserve=False)  # disabled
duppt_3 = RemoveDuplicatePts(Points=divide_7.Points, Tolerance=0.01)  # disabled
polygon = Polygon(Plane=PlaneXY(0, 0, 0), Radius=division_3, Segments=number_slider_67, FilletRadius=0)  # -> Polygon, Length

area_12 = Area(Geometry=polygon.Polygon)  # -> Area, Centroid
pt_14 = Point(Point(4185.194014, 9214.115731, 0))
orient_8 = Orient(Geometry=polygon.Polygon, Source=area_12.Centroid, Target=pt_14)  # -> Geometry, Transform

number_slider_72 = Slider(1.6, range=0..10)  # disabled
pl_origin_2 = PlaneOrigin(Base=plfit_2.Plane, Origin=avr_5)  # disabled
subtraction = Subtraction()
plfit_3 = PlaneFit(Points=duppt_3)  # -> Plane, Deviation; disabled
avr_6 = Average(Input=duppt_3)  # disabled
medges_5 = MeshEdges(Mesh=mesh_21)  # -> NakedEdges, InteriorEdges, NonManifoldEdges; disabled
number_slider_73 = Slider(10, range=0..10)  # disabled

pt_15 = Point(Point(5.562339052, -8.513688955, 1.64779854))
area_13 = Area(Geometry=polygon.Polygon)  # -> Area, Centroid
move2pt = MoveToPoint(Geometry=polygon.Polygon, PointA=area_13.Centroid, PointB=pt_15)  # -> Moved, Vector, Transform

number_slider_74 = Slider(4, range=0..10)  # disabled
rectangle_9 = Rectangle(Plane=pt_13, XSize=number_slider_69, YSize=number_slider_69, Radius=0)  # -> Rectangle, Length
cir_3 = Circle(Plane=pl_origin_2, Radius=number_slider_72)  # disabled
pl_origin_3 = PlaneOrigin(Base=plfit_3.Plane, Origin=avr_6)  # disabled
line_5 = Line(medges_5.NakedEdges)  # disabled
panel_28 = Panel("4")  # disabled
cir_4 = Circle(Plane=pl_origin_3, Radius=number_slider_73)  # disabled
join_6 = JoinCurves(Curves=line_5, Preserve=False)  # disabled

number_slider_75 = Slider(2, range=0..2.5)  # disabled
area_14 = Area(Geometry=orient_8.Geometry)  # -> Area, Centroid; disabled
neg_4 = Negative(Value=number_slider_75)  # disabled
disc = Discontinuity(Curve=orient_8.Geometry, Level=1)  # -> Points, Parameters; disabled
ln_8 = Line(StartPoint=area_14.Centroid, EndPoint=disc.Points)  # disabled
offset_2 = OffsetCurve(Curve=orient_8.Geometry, Distance=neg_4, Corners=1)  # disabled
disc_2 = Discontinuity(Curve=offset_2, Level=1)  # -> Points, Parameters; disabled
crv_cp_3 = CurveClosestPoint(Point=disc_2.Points, Curve=ln_8)  # -> Point, Parameter, Distance; disabled
number_slider_76 = Slider(1, range=0..1)  # disabled
shatter_2 = Shatter(Curve=reparameterize(ln_8), Parameters=crv_cp_3.Parameter)  # disabled
len_2 = Length(Curve=shatter_2)  # disabled
panel_29 = Panel(len_2)  # disabled
item_20 = ListItem(List=shatter_2, Index=0, Wrap=True)  # disabled
larger_2 = LargerThan(FirstNumber=len_2, SecondNumber=number_slider_76)  # -> LargerThan, OrEqualTo; disabled
dispatch_2 = Dispatch(List=shatter_2, DispatchPattern=larger_2.LargerThan)  # -> ListA, ListB; disabled
crv_10 = Curve(dispatch_2.ListA)  # disabled

pt_16 = Point(Point(4185.194014, 9214.115731, 0))  # disabled
area_15 = Area(Geometry=rectangle_9.Rectangle)  # -> Area, Centroid; disabled
orient_9 = Orient(Geometry=rectangle_9.Rectangle, Source=area_15.Centroid, Target=pt_16)  # -> Geometry, Transform; disabled

crv_cp_4 = CurveClosestPoint(Point=duppt_2, Curve=cir_3)  # -> Point, Parameter, Distance; disabled
multiplication_14 = Multiplication(A=number_slider_74, B=panel_28)  # disabled
Z_9 = UnitZ(Factor=number_slider_68)
Z_10 = UnitZ(Factor=number_slider_69)
divide_8 = DivideCurve(Curve=join_5, Count=multiplication_14, Kinks=False)  # -> Points, Tangents, Parameters; disabled
number_slider_77 = Slider(0.501, range=0..1)  # disabled
panel_30 = Panel("-1")  # disabled
crv_cp_5 = CurveClosestPoint(Point=duppt_3, Curve=cir_4)  # -> Point, Parameter, Distance; disabled
# WALLS
extr_4 = Extrude(Base=move2pt.Moved, Direction=Z_9)
duppt_4 = RemoveDuplicatePts(Points=divide_8.Points, Tolerance=0.01)  # disabled
pt_17 = Point(simplify(duppt_2))  # disabled
pt_18 = Point(simplify(crv_cp_4.Point))  # disabled
# WALLS
extr_5 = Extrude(Base=rectangle_9.Rectangle, Direction=Z_10)
plfit_4 = PlaneFit(Points=duppt_4)  # -> Plane, Deviation; disabled
avr_7 = Average(Input=duppt_4)  # disabled
number_slider_78 = Slider(0.5, range=0..1)  # disabled
panel_31 = Panel("0.5")  # disabled
pt_19 = Point(simplify(crv_cp_5.Point))  # disabled
pt_20 = Point(simplify(duppt_3))  # disabled
edgelengths_4 = EdgeLengths(Mesh=mesh_18, LengthFactor=number_slider_77, Strength=1)  # disabled
floor = Floor(Strength=1)  # disabled
anchor_4 = Anchor(Point=pt_17, Target=pt_18, Strength=10000)  # disabled
pl_origin_4 = PlaneOrigin(Base=plfit_4.Plane, Origin=avr_7)  # disabled
multiplication_15 = Multiplication(A=number_slider_56, B=panel_31)  # disabled
anchor_5 = Anchor(Target=pt_7, Strength=10000)  # disabled
# scaffolding
cap = CapHoles(Brep=extr_4)
ln_9 = Line(StartPoint=pt_17, EndPoint=pt_18)  # disabled
show_4 = Show(G=mesh_18)  # disabled
Z_11 = UnitZ(Factor=1)  # disabled
# scaffolding
cap_2 = CapHoles(Brep=extr_5)
number_slider_79 = Slider(0.2, range=0..1)
edgelengths_5 = EdgeLengths(Mesh=mesh_19, LengthFactor=number_slider_78, Strength=1)  # disabled
cir_5 = Circle(Plane=pl_origin_4, Radius=multiplication_15)  # disabled
anchor_6 = Anchor(Point=pt_20, Target=pt_19, Strength=10000)  # disabled
load_2 = Load(ForceVector=Z_11, Weighting=1)  # disabled
# comprueba: es la casa da musica?
show_5 = Show(G=mesh_19)  # disabled
ln_10 = Line(StartPoint=pt_20, EndPoint=pt_19)  # disabled
number_slider_80 = Slider(0.2, range=0..1)
debrep_5 = DeconstructBrep(Brep=cap)  # -> Faces, Edges, Vertices
merge_7 = Merge(
    Data1=flatten(show_4),
    Data2=flatten(edgelengths_4),
    Data3=flatten(anchor_4),
    Data4=flatten(anchor_5),
    Data5=flatten(floor))  # disabled
debrep_6 = DeconstructBrep(Brep=cap_2)  # -> Faces, Edges, Vertices
filedge = FilletEdge(Shape=cap, Blend=0, Metric=0)
solidplanecollide = SolidPlaneCollide(CollisionPlane=PlaneXY(0, 0, 0), Strength=1)  # disabled
debrep_7 = DeconstructBrep(Brep=debrep_5.Faces)  # -> Faces, flatten(Edges), Vertices
filedge_2 = FilletEdge(Shape=cap_2, Blend=0, Metric=0)
toggle_4 = BooleanToggle(False)  # disabled
crv_cp_6 = CurveClosestPoint(Point=duppt_4, Curve=cir_5)  # -> Point, Parameter, Distance; disabled
number_slider_81 = Slider(0.36, range=0..1)  # disabled
button_3 = Button()  # disabled
merge_8 = Merge(Data1=flatten(show_5), Data2=flatten(edgelengths_5), Data3=flatten(anchor_6))  # disabled
debrep_8 = DeconstructBrep(Brep=debrep_6.Faces)  # -> Faces, flatten(Edges), Vertices
area_16 = Area(Geometry=debrep_5.Faces)  # -> Area, Centroid
area_17 = Area(Geometry=debrep_6.Faces)  # -> Area, Centroid
evalsrf_2 = EvaluateSurface(Surface=reparameterize(debrep_5.Faces), Point=area_16.Centroid)  # -> Point, Normal, UDirection, VDirection, Frame
number_slider_82 = Slider(0.796, range=0..1)  # disabled
rigidbodycollide = RigidBodyCollide(Strength=1)  # disabled
toggle_5 = BooleanToggle(False)  # disabled
button_4 = Button()  # disabled
number_slider_83 = Slider(0.45, range=0..1)  # disabled
join_7 = JoinCurves(Curves=debrep_7.Edges, Preserve=False)
bouncysolver_2 = BouncySolver(
    GoalObjects=merge_7,
    Reset=button_3,
    Threshold=1e-15,
    Tolerance=0.0001,
    Damping=number_slider_81,
    Iterations=10,
    On=toggle_4)  # -> I, V, O; disabled
pt_21 = Point(simplify(crv_cp_6.Point))  # disabled
number_slider_84 = Slider(500, range=0..1000)  # disabled
pt_22 = Point(simplify(duppt_4))  # disabled
evalsrf_3 = EvaluateSurface(Surface=reparameterize(debrep_6.Faces), Point=area_17.Centroid)  # -> Point, Normal, UDirection, VDirection, Frame
amp_7 = Amplitude(Vector=evalsrf_2.Normal, Amplitude=Slider(0.6, range=0..1))
number_slider_85 = Slider(0.5, range=0..1)  # disabled
scale = Scale(Geometry=join_7, Center=area_16.Centroid, Factor=Slider(0.6, range=0..1))  # -> Geometry, Transform
bouncysolver_3 = BouncySolver(
    GoalObjects=merge_8,
    Reset=button_4,
    Threshold=1e-15,
    Tolerance=0.0001,
    Damping=number_slider_83,
    Iterations=10,
    On=toggle_5)  # -> I, V, O; disabled
edgelengths_6 = EdgeLengths(Mesh=mesh_22, LengthFactor=number_slider_82, Strength=1)  # disabled
amp_8 = Amplitude(Vector=evalsrf_3.Normal, Amplitude=Slider(0.6, range=0..1))
geo_3 = Geometry(bouncysolver_2.O)  # disabled
anchor_7 = Anchor(Point=pt_22, Target=pt_21, Strength=number_slider_84)  # disabled
ln_11 = Line(StartPoint=pt_22, EndPoint=pt_21)  # disabled
move_11 = Move(Geometry=scale.Geometry, Motion=amp_7)  # -> Geometry, Transform
show_6 = Show(G=mesh_22)  # disabled
join_8 = JoinCurves(Curves=debrep_8.Edges, Preserve=False)
scale_2 = Scale(Geometry=join_8, Center=area_17.Centroid, Factor=Slider(0.6, range=0..1))  # -> Geometry, Transform
move_12 = Move(Geometry=scale_2.Geometry, Motion=amp_8)  # -> Geometry, Transform
cluster = Cluster(L=move_11.Geometry, L_2=join_7)  # -> L_12, L_11, L_10, L_6, L_7, L_8, L_5, L_3, L_9, L_4
previewmat_2 = CustomPreviewMaterials(Geometry=bouncysolver_2.O, DiffuseColor=RGB(255, 255, 255))  # disabled
previewmat_3 = CustomPreviewMaterials(Geometry=bouncysolver_3.O, DiffuseColor=RGB(255, 255, 255))  # disabled
merge_9 = Merge(Data1=flatten(show_6), Data2=flatten(edgelengths_6), Data3=flatten(anchor_7))  # disabled
solidplanecollide_2 = SolidPlaneCollide(CollisionPlane=PlaneXY(0, 0, 0), Strength=1)  # disabled
number_slider_86 = Slider(0.9, range=0..1)  # disabled
join_9 = BrepJoin(Breps=[cluster.L_12, cluster.L_11, cluster.L_10, cluster.L_6, cluster.L_7, cluster.L_8, cluster.L_5, cluster.L_3, cluster.L_9, cluster.L_4])  # -> Breps, Closed
volume_2 = Volume(Geometry=join_9.Breps)  # -> Volume, Centroid
# dont enable before
# disabling the following
# part
button_5 = Button()  # disabled
cap_3 = CapHoles(Brep=join_9.Breps)
toggle_6 = BooleanToggle(True)  # disabled
cluster_2 = Cluster_2(L=move_12.Geometry, L_2=join_8)  # -> L_8, L_7, L_6, L_3, L_4, L_5
rigidbodycollide_2 = RigidBodyCollide(Strength=1)  # disabled
scale_3 = Scale(Geometry=join_9.Breps, Center=volume_2.Centroid, Factor=Slider(1.1, range=1..1.2))  # -> Geometry, Transform
number_slider_87 = Slider(0, range=0..0.3)
number_slider_88 = Slider(0.001, range=0..0.001)
triremesh_3 = TriRemesh(Geometry=join_9.Breps, Iterations=25)  # -> Triangulation, Dual, Creases
join_10 = BrepJoin(Breps=[cluster_2.L_8, cluster_2.L_7, cluster_2.L_6, cluster_2.L_3, cluster_2.L_4, cluster_2.L_5])  # -> Breps, Closed
cap_4 = CapHoles(Brep=join_10.Breps)
volume_3 = Volume(Geometry=join_10.Breps)  # -> Volume, Centroid
debrep_9 = DeconstructBrep(Brep=scale_3.Geometry)  # -> Faces, Edges, Vertices
scale_4 = Scale(Geometry=join_10.Breps, Center=volume_3.Centroid, Factor=Slider(1.1, range=1..1.2))  # -> Geometry, Transform
mesh_23 = MeshBrep(
    Brep=join_9.Breps,
    Settings={GridMaxCount=0, GridMinCount=16, JaggedSeams=False, MaxEdgeLength=0, MinEdgeLength=0.0001, MinTolerance=0, Refine=True, RefineAngle=0, RelativeTolerance=0.65, SimplePlanes=True, Tolerance=0})
number_slider_89 = Slider(0, range=0..0.3)
number_slider_90 = Slider(0.001, range=0..0.001)
triremesh_4 = TriRemesh(Geometry=join_10.Breps, Iterations=25)  # -> Triangulation, Dual, Creases
debrep_10 = DeconstructBrep(Brep=scale_4.Geometry)  # -> Faces, Edges, Vertices
mesh_24 = MeshBrep(
    Brep=join_10.Breps,
    Settings={GridMaxCount=0, GridMinCount=16, JaggedSeams=False, MaxEdgeLength=0, MinEdgeLength=0.0001, MinTolerance=0, Refine=True, RefineAngle=0, RelativeTolerance=0.65, SimplePlanes=True, Tolerance=0})
mp = MultiPipe(
    Curves=debrep_9.Edges,
    NodeSize=Slider(0.07, range=0..0.3),
    EndOffset=1,
    StrutSize=Slider(0.36, range=0..1),
    Segment=0,
    KinkAngle=0.6,
    CubeFit=0,
    Caps=0)
bouncysolver_4 = BouncySolver(
    GoalObjects=merge_9,
    Reset=button_5,
    Threshold=1e-15,
    Tolerance=0.0001,
    Damping=number_slider_86,
    Iterations=10,
    On=toggle_6)  # -> I, V, O; disabled
wbcatmullclark_3 = WeaverbirdsCatmullClarkSubdivision(MeshCurves=triremesh_3.Triangulation, Level=Slider(2, range=0..10), SmoothNakedEdges=1)
mp_2 = MultiPipe(
    Curves=debrep_10.Edges,
    NodeSize=Slider(0.07, range=0..0.3),
    EndOffset=1,
    StrutSize=Slider(0.36, range=0..1),
    Segment=0,
    KinkAngle=0.6,
    CubeFit=0,
    Caps=0)
number_slider_91 = Slider(0.5, range=0..1)  # disabled
previewmat_4 = CustomPreviewMaterials(Geometry=wbcatmullclark_3, DiffuseColor=RGB(255, 255, 255))
previewmat_5 = CustomPreviewMaterials(Geometry=mp, DiffuseColor=RGB(255, 255, 255))
wbcatmullclark_4 = WeaverbirdsCatmullClarkSubdivision(MeshCurves=triremesh_4.Triangulation, Level=Slider(2, range=0..10), SmoothNakedEdges=1)
merge_10 = Merge(Data1=geo_3)  # -> flatten(Result); disabled
previewmat_6 = CustomPreviewMaterials(Geometry=mp_2, DiffuseColor=ColourSwatch(SwatchColor=RGB(184, 184, 184)))
previewmat_7 = CustomPreviewMaterials(Geometry=wbcatmullclark_4, DiffuseColor=ColourSwatch(SwatchColor=RGB(224, 213, 171)))
geo_4 = Geometry(bouncysolver_4.O)  # disabled
previewmat_8 = CustomPreviewMaterials(Geometry=bouncysolver_4.O, DiffuseColor=RGB(255, 255, 255))  # disabled
mesh_25 = MeshBrep(
    Brep=boundary_5,
    Settings={GridMaxCount=0, GridMinCount=16, JaggedSeams=False, MaxEdgeLength=0, MinEdgeLength=0.0001, MinTolerance=0, Refine=True, RefineAngle=0, RelativeTolerance=0.65, SimplePlanes=True, Tolerance=0})  # disabled
mjoin_5 = MeshJoin(Meshes=merge_10)  # disabled
clean = CleanTree(RemoveNulls=True, RemoveInvalid=True, RemoveEmpty=False, Tree=geo_4)  # disabled
item_21 = ListItem(List=clean, Index=0, Wrap=True)  # disabled
weldvertices_5 = MeshWeldVertices(Mesh=mjoin_5, Tolerance=0.01)  # -> RuntimeMessage, Mesh; disabled
msplit = MeshSplit(Mesh=item_21, Splitters=mesh_25)  # disabled
brep_5 = Brep(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)  # disabled
mesh_26 = Mesh(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)  # disabled
mesh_27 = MeshBrep(
    Brep=brep_5,
    Settings={GridMaxCount=0, GridMinCount=16, JaggedSeams=False, MaxEdgeLength=0, MinEdgeLength=0.0001, MinTolerance=0, Refine=True, RefineAngle=0, RelativeTolerance=0.65, SimplePlanes=True, Tolerance=0})  # disabled
item_22 = ListItem(List=msplit, Index=0, Wrap=True)  # -> Item, Item1; disabled
unifynormals_5 = MeshUnifyNormals(Mesh=weldvertices_5.Mesh)  # disabled
msplit_2 = MeshSplit(Mesh=mesh_26, Splitters=mesh_27)  # disabled
mesh_28 = Mesh(unifynormals_5)  # disabled
item_23 = ListItem(List=msplit_2, Index=0, Wrap=True)  # disabled
mjoin_6 = MeshJoin(Meshes=item_22.Item)  # disabled
mjoin_7 = MeshJoin(Meshes=item_22.Item1)  # disabled
mesh_29 = Mesh(item_23)  # disabled
mshnakededgs = MeshNakedEdges(Mesh=item_23)  # -> Naked, R; disabled
weldvertices_6 = MeshWeldVertices(Mesh=mjoin_6, Tolerance=0.01)  # -> RuntimeMessage, Mesh; disabled
pcen = PolygonCenter(Polyline=mshnakededgs.Naked)  # -> CenterV, CenterE, CenterA; disabled
weldvertices_7 = MeshWeldVertices(Mesh=mjoin_7, Tolerance=0.01)  # -> RuntimeMessage, Mesh; disabled
unifynormals_6 = MeshUnifyNormals(Mesh=weldvertices_6.Mesh)
unifynormals_7 = MeshUnifyNormals(Mesh=weldvertices_7.Mesh)
weld_mesh = WeldMesh(Mesh=item_21, Angle=3.141592654)  # disabled
# mehsing (NOT IMPORTANT )
triremesh_5 = TriRemesh(Geometry=weld_mesh, Iterations=25)  # -> Triangulation, Dual, Creases
mesh_30 = Mesh(triremesh_5.Triangulation)
face_boundaries = FaceBoundaries(Mesh=mesh_30)
boundary_surfaces = BoundarySurfaces(Edges=face_boundaries)
mp_3 = MultiPipe(
    Curves=face_boundaries,
    NodeSize=Slider(0.05, range=0..0.1),
    EndOffset=1,
    StrutSize=1,
    Segment=0,
    KinkAngle=0.6,
    CubeFit=0)
brep_join = BrepJoin(Breps=boundary_surfaces)  # -> Breps, Closed
brep_6 = Brep(brep_join.Breps)
dom_3 = ConstructDomain(DomainStart=Slider(0.99, range=0..1), DomainEnd=Slider(0.32, range=0..1))
cleanoverlapcurves = CleanOverlappingCurves(Distance=1, LimitLength=2, OverSampling=5, Method=2)  # -> Curves, Polylines
number_slider_92 = Slider(10, range=0..10)  # disabled
number_slider_93 = Slider(855, range=0..1000)  # disabled
xy_5 = XYPlane(Origin=Point(0, 0, 0))  # disabled
sph_5 = Sphere(Base=PlaneXY(0, 0, 0), Radius=number_slider_92)  # disabled
rectangle_10 = Rectangle(Plane=xy_5, XSize=number_slider_93, YSize=number_slider_93, Radius=0)  # -> Rectangle, Length; disabled
area_18 = Area(Geometry=rectangle_10.Rectangle)  # -> Area, Centroid; disabled
orient_10 = Orient(Geometry=rectangle_10.Rectangle, Source=area_18.Centroid, Target=xy_5)  # -> Geometry, Transform; disabled
boundary_6 = BoundarySurfaces(Edges=orient_10.Geometry)  # disabled
split_2 = SplitBrep(Brep=sph_5, Cutter=boundary_6)  # disabled
item_24 = ListItem(List=split_2, Index=0, Wrap=True)  # disabled
brep_7 = Brep(item_24)  # disabled
debrep_11 = DeconstructBrep(Brep=brep_7)  # -> Faces, Edges, Vertices; disabled
item_25 = ListItem(List=debrep_11.Edges, Index=0, Wrap=True)  # disabled
panel_32 = Panel("4")  # disabled
divide_9 = DivideCurve(Curve=item_25, Count=panel_32, Kinks=False)  # -> Points, Tangents, Parameters; disabled
number_slider_94 = Slider(0.4, range=0..1)  # disabled
shatter_3 = Shatter(Curve=item_25, Parameters=divide_9.Parameters)  # disabled
eval_3 = EvaluateCurve(Curve=reparameterize(shatter_3), Parameter=number_slider_94)  # -> Point, Tangent, Angle; disabled
dist_2 = Distance(PointA=divide_9.Points, PointB=eval_3.Point)  # disabled
ln_12 = Line(StartPoint=divide_9.Points, EndPoint=eval_3.Point)  # disabled
panel_33 = Panel("0.5")  # disabled
round_3 = Round(Number=dist_2)  # -> Nearest, Floor, Ceiling; disabled
multiplication_16 = Multiplication(A=round_3.Nearest, B=panel_33)  # disabled
midpt_5 = CurveMiddle(Curve=ln_12)  # disabled
panel_34 = Panel(round_3.Nearest)  # disabled
Z_12 = UnitZ(Factor=multiplication_16)  # disabled
move_13 = Move(Geometry=midpt_5, Motion=Z_12)  # -> Geometry, Transform; disabled
arc_3 = Arc3Pt(PointA=divide_9.Points, PointB=move_13.Geometry, PointC=eval_3.Point)  # -> Arc, Plane, Radius; disabled
number_slider_95 = Slider(-3, range=-10..10)  # disabled
pln_4 = Plane(arc_3.Plane)  # disabled
vec_2 = Vector(pln_4)  # disabled
amp_9 = Amplitude(Vector=vec_2, Amplitude=number_slider_95)  # disabled
move_14 = Move(Geometry=arc_3.Arc, Motion=vec_2)  # -> Geometry, Transform; disabled
# not sure this is really parametric
extr_6 = Extrude(Base=move_14.Geometry, Direction=amp_9)  # disabled
brep_8 = Brep(brep_7)  # disabled
sdiff_3 = SolidDifference(BrepsA=extr_6, BrepsB=brep_8)  # disabled
splitmul_10 = SplitBrepMultiple(Brep=brep_8, Cutters=extr_6)  # disabled
splitmul_11 = SplitBrepMultiple(Brep=extr_6, Cutters=brep_8)  # disabled
item_26 = ListItem(List=splitmul_11, Index=0, Wrap=True)  # -> flatten(Item); disabled
item_27 = ListItem(List=splitmul_10, Index=0, Wrap=True)  # disabled
panel_35 = Panel(item_26)  # disabled
mesh_31 = Mesh(item_27)  # disabled
mesh_32 = Mesh(item_26)  # disabled
merge_11 = Merge(Data1=mesh_31, Data2=mesh_32)  # -> flatten(Result); disabled
mjoin_8 = MeshJoin(Meshes=merge_11)  # disabled
panel_36 = Panel(mjoin_8)  # disabled
weldvertices_8 = MeshWeldVertices(Mesh=mjoin_8, Tolerance=0.01)  # -> RuntimeMessage, Mesh; disabled
unifynormals_8 = MeshUnifyNormals(Mesh=weldvertices_8.Mesh)  # disabled
project_2 = Project(Geometry=unifynormals_8, Plane=PlaneXY(0, 0, 0))  # -> Geometry, Transform; disabled
nv_7 = NakedVertices(Mesh=unifynormals_8)  # -> ClothedIndex, NakedIndex, ClothedPts, NakedPts; disabled
pt_23 = Point(nv_7.NakedPts)  # disabled
refine_5 = Refine(Mesh=unifynormals_8, Level=1)  # disabled
mesh_33 = Mesh(refine_5)  # disabled
medges_6 = MeshEdges(Mesh=mesh_33)  # -> NakedEdges, InteriorEdges, NonManifoldEdges; disabled
line_6 = Line(medges_6.NakedEdges)  # disabled
panel_37 = Panel("""0
11
14
19""")  # disabled
join_11 = JoinCurves(Curves=line_6, Preserve=False)  # disabled
item_28 = ListItem(Index=0, Wrap=True)  # disabled
item_29 = ListItem(List=join_11, Index=panel_37, Wrap=True)  # disabled
number_slider_96 = Slider(4, range=0..10)  # disabled
panel_38 = Panel("4")  # disabled
multiplication_17 = Multiplication(A=number_slider_96, B=panel_38)  # disabled
explode_6 = Explode(Curve=item_29, Recursive=True)  # -> Segments, Vertices; disabled
crv_11 = Curve(join_11)  # disabled
mesh_34 = Mesh(project_2.Geometry)  # disabled
divide_10 = DivideCurve(Curve=item_29, Count=multiplication_17, Kinks=False)  # -> Points, Tangents, Parameters; disabled
nv_8 = NakedVertices(Mesh=mesh_34)  # -> ClothedIndex, NakedIndex, ClothedPts, NakedPts; disabled
number_slider_97 = Slider(0.007, range=0..0.01)  # disabled
duppt_5 = RemoveDuplicatePts(Points=divide_10.Points, Tolerance=0.01)  # disabled
number_slider_98 = Slider(1.249, range=0..1.5)  # disabled
plfit_5 = PlaneFit(Points=duppt_5)  # -> Plane, Deviation; disabled
avr_8 = Average(Input=duppt_5)  # disabled
neg_5 = Negative()  # disabled
pt_24 = Point(nv_8.NakedPts)  # disabled
number_slider_99 = Slider(10, range=0..10)  # disabled
pl_origin_5 = PlaneOrigin(Base=plfit_5.Plane, Origin=avr_8)  # disabled

# ---- group: Curve Closest Point
# this is failing
crv_cp_7 = CurveClosestPoint(Point=nv_8.NakedPts, Curve=crv_11)  # -> Point, Parameter, Distance; disabled

# ----
edgelengths_7 = EdgeLengths(Mesh=mesh_34, LengthFactor=number_slider_98, Strength=1)  # disabled
vertexloads = VertexLoads(Mesh=mesh_34, Strength=number_slider_97)  # disabled
show_7 = Show(G=mesh_34)  # disabled
cir_6 = Circle(Plane=pl_origin_5, Radius=number_slider_99)  # disabled
anchor_8 = Anchor(Point=nv_8.NakedPts, Target=crv_cp_7.Point, Strength=10000)  # disabled
merge_12 = Merge(Data1=flatten(vertexloads), Data2=flatten(show_7), Data3=flatten(edgelengths_7), Data4=flatten(anchor_8))  # disabled
crv_cp_8 = CurveClosestPoint(Point=duppt_5, Curve=cir_6)  # -> Point, Parameter, Distance; disabled
number_slider_100 = Slider(0.265, range=0..0.5)  # disabled
number_slider_101 = Slider(0.5, range=0..1)  # disabled
button_6 = Button()  # disabled
toggle_7 = BooleanToggle(True)  # disabled
pt_25 = Point(simplify(crv_cp_8.Point))  # disabled
pt_26 = Point(simplify(duppt_5))  # disabled
Z_13 = UnitZ(Factor=1)  # disabled
edgelengths_8 = EdgeLengths(Mesh=mesh_33, LengthFactor=number_slider_101, Strength=1)  # disabled
solver_3 = Solver(GoalObjects=merge_12, Reset=button_6, Threshold=1e-15, Tolerance=0.0001, On=toggle_7)  # -> I, V, O; disabled
anchor_9 = Anchor(Point=pt_26, Target=pt_25, Strength=10000)  # disabled
load_3 = Load(ForceVector=Z_13, Weighting=1)  # disabled
show_8 = Show(G=mesh_33)  # disabled
ln_13 = Line(StartPoint=pt_26, EndPoint=pt_25)  # disabled
previewmat_9 = CustomPreviewMaterials(Geometry=solver_3.O, DiffuseColor=RGB(255, 255, 255))  # disabled
merge_13 = Merge(Data1=flatten(show_8), Data2=flatten(edgelengths_8), Data3=flatten(anchor_9))  # disabled
toggle_8 = BooleanToggle(False)  # disabled
button_7 = Button()  # disabled
number_slider_102 = Slider(0.45, range=0..1)  # disabled
bouncysolver_5 = BouncySolver(
    GoalObjects=merge_13,
    Reset=button_7,
    Threshold=1e-15,
    Tolerance=0.0001,
    Damping=number_slider_102,
    Iterations=10,
    On=toggle_8)  # -> I, V, O; disabled
previewmat_10 = CustomPreviewMaterials(Geometry=bouncysolver_5.O, DiffuseColor=RGB(255, 255, 255))  # disabled

# ----
# sphere
# not sure this is really parametric
# got this data from rhino
#  geom see how to make
#  itr parametrical
pt_27 = Point(Point(5285.7853, 10525.48167, 6208.9387))  # disabled
number_slider_103 = Slider(20, range=0..100)  # disabled
number_slider_104 = Slider(10, range=0..10)  # disabled
multiplication_18 = Multiplication(A=number_slider_35, B=number_slider_34)  # disabled
number_slider_105 = Slider(34, range=0..1000)  # disabled
number_slider_106 = Slider(45, range=0..100)  # disabled
xy_6 = XYPlane(Origin=pt_27)  # disabled
box_5 = CenterBox(Base=pt_27, X=multiplication_18, Y=multiplication_18, Z=multiplication_18)  # disabled
rectangle_11 = Rectangle(Plane=xy_6, XSize=number_slider_105, YSize=number_slider_105, Radius=0)  # -> Rectangle, Length; disabled
rotate_2 = Rotate(Geometry=box_5, Angle=degrees(number_slider_106), Plane=pt_27)  # -> Geometry, Transform; disabled
debrep_12 = DeconstructBrep(Brep=box_5)  # -> Faces, Edges, Vertices; disabled
area_19 = Area(Geometry=rectangle_11.Rectangle)  # -> Area, Centroid; disabled
area_20 = Area(Geometry=debrep_12.Faces)  # -> Area, Centroid; disabled
number_slider_107 = Slider(0.1, range=0..0.1)  # disabled
pln_5 = Plane(area_20.Centroid)  # disabled
number_slider_108 = Slider(6205, range=0..10000)  # disabled
number_slider_109 = Slider(6210, range=0..10000)  # disabled
orient_11 = Orient(Geometry=rectangle_11.Rectangle, Source=area_19.Centroid, Target=pt_27)  # -> Geometry, Transform; disabled
sph_6 = Sphere(Base=pt_27, Radius=multiplication_18)  # disabled
boundary_7 = BoundarySurfaces(Edges=orient_11.Geometry)  # disabled
pdecon_3 = Deconstruct(Point=area_20.Centroid)  # -> XComponent, YComponent, ZComponent; disabled
panel_40 = Panel(pdecon_3.ZComponent)  # disabled
sdiff_4 = SolidDifference()  # disabled
sint_2 = SolidIntersection(BrepsA=sph_6, BrepsB=boundary_7)  # disabled
abs_3 = Absolute(Value=pdecon_3.ZComponent)  # disabled
debrep_13 = DeconstructBrep(Brep=sint_2)  # -> Faces, Edges, Vertices; disabled
smaller_2 = SmallerThan(FirstNumber=pdecon_3.ZComponent, SecondNumber=number_slider_109)  # -> SmallerThan, OrEqualTo; disabled
larger_3 = LargerThan(FirstNumber=pdecon_3.ZComponent, SecondNumber=number_slider_108)  # -> LargerThan, OrEqualTo; disabled
item_30 = ListItem(List=debrep_13.Edges, Index=0, Wrap=True)  # -> Item, Item1; disabled
and = GateAnd(A=smaller_2.SmallerThan, B=larger_3.LargerThan)  # disabled
panel_41 = Panel(and)  # disabled
number_slider_110 = Slider(8, range=0..10)  # disabled
cull_5 = CullPattern(List=debrep_12.Faces, CullPattern=panel_41)  # disabled
crv_12 = Curve(item_30.Item1)  # disabled
item_31 = ListItem(List=cull_5, Index=0, Wrap=True)  # -> Item, Item1, Item2, Item3; disabled
divide_11 = DivideCurve(Curve=crv_12, Count=number_slider_110, Kinks=False)  # -> Points, Tangents, Parameters; disabled
panel_42 = Panel("{0.5, 0.5, 0}")  # disabled
number_slider_111 = Slider(10, range=0..10)  # disabled
brep_9 = Brep(sph_6)  # disabled
evalsrf_4 = EvaluateSurface(Surface=reparameterize(cull_5), Point=panel_42)  # -> Point, Normal, UDirection, VDirection, Frame; disabled
number_slider_112 = Slider(4, range=0..10)  # disabled
amp_10 = Amplitude(Vector=evalsrf_4.Normal, Amplitude=number_slider_111)  # disabled
number_slider_113 = Slider(20, range=0..100)  # disabled
pt_28 = Point(evalsrf_4.Point)  # disabled
srf_cp_2 = SurfaceClosestPoint(Point=pt_28, Surface=sph_6)  # -> Point, UVPoint, Distance; disabled
pln_6 = Plane(evalsrf_4.Frame)  # disabled
move_15 = Move(Geometry=pt_28, Motion=amp_10)  # -> Geometry, Transform; disabled
rectangle_12 = Rectangle(Plane=pln_6, XSize=number_slider_112, YSize=number_slider_112, Radius=0)  # -> Rectangle, Length; disabled
area_21 = Area(Geometry=rectangle_12.Rectangle)  # -> Area, Centroid; disabled
orient_12 = Orient(Geometry=rectangle_12.Rectangle, Source=area_21.Centroid, Target=pt_28)  # -> Geometry, Transform; disabled
ln_14 = Line(StartPoint=pt_28, EndPoint=move_15.Geometry)  # disabled
extrcrv_3 = ExtrudeAlong(Base=orient_12.Geometry, Curve=ln_14)  # disabled
area_22 = Area(Geometry=extrcrv_3)  # -> Area, Centroid; disabled
sdiff_5 = SolidDifference(BrepsA=extrcrv_3, BrepsB=brep_9)  # disabled
splitmul_12 = SplitBrepMultiple(Brep=extrcrv_3, Cutters=brep_9)  # disabled
splitmul_13 = SplitBrepMultiple(Brep=brep_9, Cutters=extrcrv_3)  # disabled
item_32 = ListItem(List=splitmul_12, Index=0, Wrap=True)  # -> flatten(Item); disabled
item_33 = ListItem(List=splitmul_13, Index=0, Wrap=True)  # disabled
panel_43 = Panel(item_32)  # disabled
mesh_35 = Mesh(item_33)  # disabled
mesh_36 = Mesh(item_32)  # disabled
merge_14 = Merge(Data1=mesh_35, Data2=mesh_36)  # -> flatten(Result); disabled
mjoin_9 = MeshJoin(Meshes=merge_14)  # disabled
panel_44 = Panel(mjoin_9)  # disabled
weldvertices_9 = MeshWeldVertices(Mesh=mjoin_9, Tolerance=0.01)  # -> RuntimeMessage, Mesh; disabled
unifynormals_9 = MeshUnifyNormals(Mesh=weldvertices_9.Mesh)  # disabled
mesh_37 = Mesh(unifynormals_9)  # disabled
nv_9 = NakedVertices(Mesh=mesh_37)  # -> ClothedIndex, NakedIndex, ClothedPts, NakedPts; disabled
refine_6 = Refine(Mesh=mesh_37, Level=1)  # disabled
pt_29 = Point(nv_9.NakedPts)  # disabled
number_slider_114 = Slider(0.81, range=0..1)  # disabled
mesh_38 = Mesh(refine_6)  # disabled
medges_7 = MeshEdges(Mesh=mesh_38)  # -> NakedEdges, InteriorEdges, NonManifoldEdges; disabled
line_7 = Line(medges_7.NakedEdges)  # disabled
join_12 = JoinCurves(Curves=line_7, Preserve=False)  # disabled
number_slider_115 = Slider(4, range=0..10)  # disabled
panel_45 = Panel("4")  # disabled
multiplication_19 = Multiplication(A=number_slider_115, B=panel_45)  # disabled
explode_7 = Explode(Curve=join_12, Recursive=True)  # -> Segments, Vertices; disabled
divide_12 = DivideCurve(Curve=join_12, Count=multiplication_19, Kinks=False)  # -> Points, Tangents, Parameters; disabled
duppt_6 = RemoveDuplicatePts(Points=divide_12.Points, Tolerance=0.01)  # disabled
plfit_6 = PlaneFit(Points=duppt_6)  # -> Plane, Deviation; disabled
avr_9 = Average(Input=duppt_6)  # disabled
number_slider_116 = Slider(10, range=0..10)  # disabled
pl_origin_6 = PlaneOrigin(Base=plfit_6.Plane, Origin=avr_9)  # disabled
cir_7 = Circle(Plane=pl_origin_6, Radius=number_slider_116)  # disabled
crv_cp_9 = CurveClosestPoint(Point=duppt_6, Curve=cir_7)  # -> Point, Parameter, Distance; disabled
number_slider_117 = Slider(0.501, range=0..1)  # disabled
pt_30 = Point(simplify(crv_cp_9.Point))  # disabled
pt_31 = Point(simplify(duppt_6))  # disabled
edgelengths_9 = EdgeLengths(Mesh=mesh_38, LengthFactor=number_slider_117, Strength=1)  # disabled
anchor_10 = Anchor(Point=pt_31, Target=pt_30, Strength=10000)  # disabled
ln_15 = Line(StartPoint=pt_31, EndPoint=pt_30)  # disabled
show_9 = Show(G=mesh_38)  # disabled
toggle_9 = BooleanToggle(False)  # disabled
number_slider_118 = Slider(0.97, range=0..1)  # disabled
button_8 = Button()  # disabled
toggle_10 = GroupToggle(ToggleActive=True, ToggleVisible=False)  # disabled
number_slider_119 = Slider(0.5, range=0..1)  # disabled

number_slider_120 = Slider(1, range=0..1)  # disabled
larger_4 = LargerThan(FirstNumber=pdecon_3.ZComponent, SecondNumber=number_slider_120)  # -> LargerThan, OrEqualTo; disabled
cull_6 = CullPattern(List=area_20.Centroid, CullPattern=larger_4.LargerThan)  # disabled

pt_32 = Point(cull_6)  # disabled
anchor_11 = Anchor(Target=pt_32, Strength=10000)  # disabled
merge_15 = Merge(Data1=flatten(show_9), Data2=flatten(edgelengths_9), Data3=flatten(anchor_10), Data4=flatten(anchor_11))  # disabled
bouncysolver_6 = BouncySolver(
    GoalObjects=merge_15,
    Reset=button_8,
    Threshold=1e-15,
    Tolerance=0.0001,
    Damping=number_slider_118,
    Iterations=10,
    On=toggle_9)  # -> I, V, O; disabled
previewmat_11 = CustomPreviewMaterials(Geometry=bouncysolver_6.O, DiffuseColor=RGB(255, 255, 255), Transparency=number_slider_119)  # disabled

# ----
# collision with floor, failed
crv_13 = Curve(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)  # disabled
crv_14 = Curve(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)  # disabled
loft_2 = Loft(Curves=[crv_14, crv_13], Options={Adjust=True, Closed=False, LoftEnds=0, LoftSimp=1, LoftType=0, Rebuild=60, Refit=0.01})  # disabled
mesh_39 = MeshBrep(
    Brep=loft_2,
    Settings={GridMaxCount=0, GridMinCount=16, JaggedSeams=False, MaxEdgeLength=0, MinEdgeLength=0.0001, MinTolerance=0, Refine=True, RefineAngle=0, RelativeTolerance=0.65, SimplePlanes=True, Tolerance=0})  # disabled
number_slider_121 = Slider(1, range=0..100)  # disabled
triremesh_6 = TriRemesh(Geometry=mesh_14, Length=number_slider_121, Iterations=25)  # -> Triangulation, Dual, Creases; disabled
number_slider_122 = Slider(100, range=0..10000)  # disabled
flipm = FlipMesh(Mesh=triremesh_6.Triangulation, VertexNormals=True, FaceNormals=True, FaceOrientation=True)  # disabled
srf_3 = Surface(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)  # disabled
clean_2 = CombineClean(Meshes=flipm)  # disabled
Z_14 = UnitZ(Factor=panel_23)  # disabled
nv_10 = NakedVertices(Mesh=clean_2)  # -> ClothedIndex, NakedIndex, ClothedPts, NakedPts; disabled
swatch = ColourSwatch(SwatchColor=RGBA(196, 79, 79, 133))  # disabled
number_slider_123 = Slider(50, range=0..100)  # disabled
number_slider_124 = Slider(0.1, range=0..1)  # disabled
toggle_11 = BooleanToggle(False)  # disabled
edgelengths_10 = EdgeLengths(Mesh=clean_2, LengthFactor=number_slider_65, Strength=number_slider_123)  # disabled
pressure = Pressure(M=clean_2, Strength=number_slider_124)  # disabled
anchor_12 = Anchor(Point=nv_10.NakedPts, Strength=10000)  # disabled
show_10 = Show(G=clean_2)  # disabled
toggle_12 = BooleanToggle(False)  # disabled
button_9 = Button()  # disabled
panel_46 = Panel("0;0")  # disabled
swatch_2 = ColourSwatch(SwatchColor=RGBA(156, 58, 222, 133))  # disabled

move_16 = Move(Geometry=srf_3, Motion=Z_8)  # -> Geometry, Transform; disabled

extr_7 = Extrude(Base=move_16.Geometry, Direction=Z_14)  # disabled
preview_3 = CustomPreview(Geometry=extr_7, Material=swatch)  # disabled
spc = SolidPointCollide(Points=nv_10.ClothedPts, Solid=extr_7, Interior=False, Unidirectional=toggle_11, Strength=100000)  # disabled
entwine_2 = Entwine(Branch00=show_10, Branch01=anchor_12, Branch02=pressure, Branch03=edgelengths_10, Branch04=spc, FlattenInputs=True)  # disabled
solver_4 = Solver(GoalObjects=entwine_2, Reset=button_9, Threshold=1e-15, Tolerance=0.0001, On=toggle_12)  # -> I, V, O; disabled
branch = TreeBranch(Tree=solver_4.O, Path=panel_46, MaintainPaths=True)  # disabled
arrpolar = PolarArray(
    Geometry=branch,
    Plane=Plane(origin=(-99007.07709, -45233.28614, 39100), x=(-1, 0, 0), y=(0, -1, 0)),
    Count=10,
    Angle=6.283185307)  # -> Geometry, Transform; disabled
preview_4 = CustomPreview(Geometry=solver_4.O, Material=swatch_2)  # disabled

pt_33 = Point(nv_10.ClothedPts)  # disabled

# ----
# BOTTOM FLOOR
number_slider_125 = Slider(1.25, range=0..2.5)  # disabled
mshnakededgs_2 = MeshNakedEdges(Mesh=mjoin_7)  # -> Naked, R; disabled
crv_15 = Curve(mshnakededgs_2.Naked)  # disabled
neg_6 = Negative(Value=number_slider_125)  # disabled
Z_15 = UnitZ(Factor=neg_6)
move_17 = Move(Geometry=crv_15, Motion=Z_15)  # -> Geometry, Transform
area_23 = Area(Geometry=move_17.Geometry)  # -> Area, Centroid
scale_5 = Scale(Geometry=move_17.Geometry, Center=area_23.Centroid, Factor=0.5)  # -> Geometry, Transform
merge_16 = Merge(Data1=crv_15, Data2=scale_5.Geometry)
Z_16 = UnitZ(Factor=1)

# ----
# this loft looks terrible HELP
loft_3 = Loft(Curves=merge_16, Options={Adjust=False, Closed=False, LoftEnds=0, LoftSimp=0, LoftType=0, Rebuild=10, Refit=0.01})

cap_5 = CapHoles(Brep=loft_3)
join_13 = BrepJoin(Breps=[loft_3, cap_5])  # -> Breps, Closed
mesh_40 = MeshBrep(
    Brep=join_13.Breps,
    Settings={GridMaxCount=0, GridMinCount=16, JaggedSeams=False, MaxEdgeLength=0, MinEdgeLength=0.0001, MinTolerance=0, Refine=True, RefineAngle=0, RelativeTolerance=0.65, SimplePlanes=True, Tolerance=0})
offsetbrep = OffsetBrep(Brep=join_13.Breps, OffsetDistance=Z_16, Solid=True, SharpEdges=True, Tolerance=0.01)
wbcatmullclark_5 = WeaverbirdsCatmullClarkSubdivision(MeshCurves=mesh_40, Level=1, SmoothNakedEdges=1)

demesh_2 = DeconstructMesh(Mesh=triremesh_5.Triangulation)  # -> Vertices, Faces, Colours, Normals; disabled
prox = Proximity3D(Points=demesh_2.Vertices, Group=Slider(2, range=0..10))  # -> flatten(Links), Topology
dupln = RemoveDuplicateLines(Lines=prox.Links, Tolerance=0.01)
len_3 = Length(Curve=dupln)
larger_5 = LargerThan(FirstNumber=len_3, SecondNumber=Slider(0.5, range=0..1))  # -> LargerThan, OrEqualTo
cull_7 = CullPattern(List=dupln, CullPattern=larger_5.LargerThan)
explode_8 = Explode(Curve=cull_7, Recursive=True)  # -> flatten(Segments), Vertices
dupln_2 = RemoveDuplicateLines(Lines=explode_8.Segments, Tolerance=0.01)
end_3 = EndPoints(Curve=dupln_2)  # -> Start, End
merge_17 = Merge(Data1=end_3.Start, Data2=end_3.End)
pdecon_4 = Deconstruct(Point=merge_17)  # -> XComponent, YComponent, ZComponent
dom_4 = ConstructDomain(DomainStart=Slider(0.3, range=0..25), DomainEnd=Slider(0.1, range=0..25))
bnd_2 = Bounds(Numbers=pdecon_4.ZComponent)
remap_2 = RemapNumbers(Value=pdecon_4.ZComponent, Source=bnd_2, Target=Domain(0, 1))  # -> Mapped, Clipped
graph = GraphMapper(
    remap_2.Mapped,
    x0=0,
    x1=1,
    y0=0,
    y1=1,
    container_name="Bezier",
    cpx=[0, 0.6996052861, 0.2302564532, 1],
    cpy=[0, 0.1501221657, 0.7780513763, 1])
remap_3 = RemapNumbers(Value=graph, Source=Domain(0, 1), Target=dom_4)  # -> Mapped, Clipped
toggle_13 = GroupToggle(ToggleActive=True, ToggleVisible=False)  # disabled

mp_4 = MultiPipe(
    Curves=dupln_2,
    NodeSize=remap_3.Mapped,
    SizePoints=merge_17,
    EndOffset=1,
    StrutSize=1,
    Segment=0,
    KinkAngle=0.6,
    CubeFit=0)

preview_5 = CustomPreview(Geometry=mp_4, Material=ColourSwatch(SwatchColor=RGB(118, 163, 91)))

popgeo = PopulateGeometry(Geometry=brep_6, Count=Slider(440, range=0..1200), Seed=1000)
bbox = BoundingBox(Content=brep_6, Plane=PlaneXY(0, 0, 0))  # -> Box, Box_2
voronoi³ = Voronoi3D(Points=popgeo, Box=bbox.Box)  # -> Cells, Boundary
bbx = BrepBrep(BrepA=brep_6, BrepB=voronoi³.Cells)  # -> flatten(Curves), Points
leave_true = BooleanToggle(True)
disc_3 = Discontinuity(Curve=bbx.Curves, Level=1)  # -> Points, Parameters
number_slider_126 = Slider(0.58, range=0.01..0.98)
pline = PolyLine(Vertices=disc_3.Points, Closed=leave_true)  # -> flatten(Polyline)
pcen_2 = PolygonCenter(Polyline=pline)  # -> CenterV, CenterE, CenterA
number_slider_127 = Slider(1, range=0..10)
Y = UnitY(Factor=Slider(120, range=0..1000))
swatch_3 = ColourSwatch(SwatchColor=RGB(205, 69, 255))

pdecon_5 = Deconstruct(Point=popgeo)  # -> XComponent, YComponent, ZComponent
bnd_3 = Bounds(Numbers=flatten(pdecon_5.ZComponent))  # -> flatten(Domain)
remap_4 = RemapNumbers(Value=pdecon_5.ZComponent, Source=bnd_3, Target=dom_3)  # -> reverse(Mapped), Clipped
panel_47 = Panel(bnd_3)
graph_2 = GraphMapper(
    reverse(remap_4.Mapped),
    x0=0,
    x1=1,
    y0=0,
    y1=1,
    container_name="Bezier",
    cpx=[0, 0.25, 0.8424620628, 1],
    cpy=[0, 0.25, 0.4494681954, 1])

scale_6 = Scale(Geometry=pline, Center=pcen_2.CenterE, Factor=graph_2)  # -> flatten(Geometry), Transform

merge_18 = Merge(Data1=graft(pline), Data2=graft(scale_6.Geometry))
clean_tree = CleanTree(RemoveNulls=True, RemoveInvalid=True, RemoveEmpty=False, Tree=merge_18)

loft_4 = Loft(Curves=clean_tree, Options={Adjust=False, Closed=False, LoftEnds=0, LoftSimp=0, LoftType=3, Rebuild=10, Refit=0.01})
debrep_14 = DeconstructBrep(Brep=loft_4)  # -> Faces, Edges, Vertices
mesh_uv = MeshSurface(Surface=debrep_14.Faces, UCount=number_slider_127, VCount=number_slider_127, Overhang=True, Equalize=False)
wbjoin = WeaverbirdsJoinMeshesAndWeld(Mesh=flatten(mesh_uv), Weld=invert(False))
wbthicken_2 = WeaverbirdsMeshThicken(MeshCurves=wbjoin, Distance=Slider(0.22, range=0..10), OffsetType=0)
wbloop_2 = WeaverbirdsLoopSubdivision(MeshCurves=wbthicken_2, Level=1, SmoothNakedEdges=1)
move_18 = Move(Geometry=wbloop_2, Motion=Y)  # -> Geometry, Transform
preview_6 = CustomPreview(Geometry=wbthicken_2, Material=swatch_3)
medges_8 = MeshEdges(Mesh=wbloop_2)  # -> NakedEdges, InteriorEdges, NonManifoldEdges
preview_7 = CustomPreview(Geometry=move_18.Geometry, Material=swatch_3)
weaverbird_s_catmull_clark_subdivision = WeaverbirdsCatmullClarkSubdivision(MeshCurves=wbthicken_2, Level=Slider(2, range=0..10), SmoothNakedEdges=1)

# ==== cluster Cluster
L = ClusterInput()
L_2 = ClusterInput()
item = ListItem(List=L, Index=0, Wrap=True)  # -> Item, Item1, Item2, Item3, Item4, Item5, Item6, Item7, Item8, Item9
item_2 = ListItem(List=L_2, Index=0, Wrap=True)  # -> Item, Item1, Item2, Item3, Item4, Item5, Item6, Item7, Item8, Item9
loft = Loft(
    Curves=[item_2.Item7, item.Item7],
    Options={Adjust=False, Closed=False, LoftEnds=0, LoftSimp=0, LoftType=0, Rebuild=10, Refit=0.01})
loft_2 = Loft(
    Curves=[item_2.Item9, item.Item9],
    Options={Adjust=False, Closed=False, LoftEnds=0, LoftSimp=0, LoftType=0, Rebuild=10, Refit=0.01})
loft_3 = Loft(
    Curves=[item_2.Item6, item.Item6],
    Options={Adjust=False, Closed=False, LoftEnds=0, LoftSimp=0, LoftType=0, Rebuild=10, Refit=0.01})
loft_4 = Loft(
    Curves=[item.Item3, item_2.Item3],
    Options={Adjust=False, Closed=False, LoftEnds=0, LoftSimp=0, LoftType=0, Rebuild=10, Refit=0.01})
loft_5 = Loft(
    Curves=[item.Item4, item_2.Item4],
    Options={Adjust=False, Closed=False, LoftEnds=0, LoftSimp=0, LoftType=0, Rebuild=10, Refit=0.01})
loft_6 = Loft(
    Curves=[item_2.Item5, item.Item5],
    Options={Adjust=False, Closed=False, LoftEnds=0, LoftSimp=0, LoftType=0, Rebuild=10, Refit=0.01})
loft_7 = Loft(
    Curves=[item_2.Item8, item.Item8],
    Options={Adjust=False, Closed=False, LoftEnds=0, LoftSimp=0, LoftType=0, Rebuild=10, Refit=0.01})
loft_8 = Loft(
    Curves=[item.Item2, item_2.Item2],
    Options={Adjust=False, Closed=False, LoftEnds=0, LoftSimp=0, LoftType=0, Rebuild=10, Refit=0.01})
loft_9 = Loft(
    Curves=[item_2.Item1, item.Item1],
    Options={Adjust=False, Closed=False, LoftEnds=0, LoftSimp=0, LoftType=0, Rebuild=10, Refit=0.01})
loft_10 = Loft(
    Curves=[item.Item, item_2.Item],
    Options={Adjust=False, Closed=False, LoftEnds=0, LoftSimp=0, LoftType=0, Rebuild=10, Refit=0.01})
L_3 = ClusterOutput(loft)
L_4 = ClusterOutput(loft_2)
L_5 = ClusterOutput(loft_3)
L_6 = ClusterOutput(loft_4)
L_7 = ClusterOutput(loft_5)
L_8 = ClusterOutput(loft_6)
L_9 = ClusterOutput(loft_7)
L_10 = ClusterOutput(loft_8)
L_11 = ClusterOutput(loft_9)
L_12 = ClusterOutput(loft_10)

# ==== cluster Cluster_2
L = ClusterInput()
L_2 = ClusterInput()
item = ListItem(List=L, Index=0, Wrap=True)  # -> Item, Item1, Item2, Item3, Item4, Item5
item_2 = ListItem(List=L_2, Index=0, Wrap=True)  # -> Item, Item1, Item2, Item3, Item4, Item5
loft = Loft(
    Curves=[item.Item3, item_2.Item3],
    Options={Adjust=False, Closed=False, LoftEnds=0, LoftSimp=0, LoftType=0, Rebuild=10, Refit=0.01})
loft_2 = Loft(
    Curves=[item.Item4, item_2.Item4],
    Options={Adjust=False, Closed=False, LoftEnds=0, LoftSimp=0, LoftType=0, Rebuild=10, Refit=0.01})
loft_3 = Loft(
    Curves=[item_2.Item5, item.Item5],
    Options={Adjust=False, Closed=False, LoftEnds=0, LoftSimp=0, LoftType=0, Rebuild=10, Refit=0.01})
loft_4 = Loft(
    Curves=[item.Item2, item_2.Item2],
    Options={Adjust=False, Closed=False, LoftEnds=0, LoftSimp=0, LoftType=0, Rebuild=10, Refit=0.01})
loft_5 = Loft(
    Curves=[item_2.Item1, item.Item1],
    Options={Adjust=False, Closed=False, LoftEnds=0, LoftSimp=0, LoftType=0, Rebuild=10, Refit=0.01})
loft_6 = Loft(
    Curves=[item.Item, item_2.Item],
    Options={Adjust=False, Closed=False, LoftEnds=0, LoftSimp=0, LoftType=0, Rebuild=10, Refit=0.01})
L_3 = ClusterOutput(loft)
L_4 = ClusterOutput(loft_2)
L_5 = ClusterOutput(loft_3)
L_6 = ClusterOutput(loft_4)
L_7 = ClusterOutput(loft_5)
L_8 = ClusterOutput(loft_6)
