# Grasshopper definition G6-BIMSC24Studio-SITE_v2.gh (Grasshopper 1.0.7)
# plug-ins: Speckle 2, MetaHopper, Human, Pufferfish, MeshEdit Components

# ----
# GetSiteGeometry
panel = Panel("https://macad.speckle.xyz/streams/4975f9f0a8/branches/site%2F00-federated-model")
receive = Receive(
    Stream=panel,
    AutoReceive=False,
    CurrentComponentState="up_to_date",
    ExpandOutput=True,
    LastInfoMessage="James McBennett @ 01/19/2024 01:06:29: Pushed 38 elements from Grasshopper. (id:b5d4e56588)",
    ReceiveOnOpen=False,
    ReceivedCommitId="b5d4e56588",
    StreamWrapper="https://macad.speckle.xyz/streams/4975f9f0a8/branches/site/00-federated-model",
    selectedKitName="Objects")  # -> Info, CollectionType, Elements, Info_2, Levels, Name, Types
dso = DeconstructSpeckleObject(SpeckleObject=receive.Elements, selectedKitName="Objects")  # -> CollectionType, Elements, Name
dso_2 = DeconstructSpeckleObject(SpeckleObject=dso.Elements, selectedKitName="Objects")  # -> BaseGeometry, BaseLine, BuiltInCategory, Category, DisplayValue, ElementId, IsRevitLinkedModel, Label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

panel_2 = Panel("https://macad.speckle.xyz/streams/4975f9f0a8/commits/6c185bed15")
receive_2 = Receive(
    Stream=panel_2,
    AutoReceive=False,
    CurrentComponentState="up_to_date",
    ExpandOutput=True,
    LastInfoMessage="James McBennett @ 01/20/2024 17:54:06: Pushed 5 elements from Grasshopper. (id:6c185bed15)",
    ReceiveOnOpen=False,
    ReceivedCommitId="6c185bed15",
    StreamWrapper="https://macad.speckle.xyz/streams/4975f9f0a8/commits/6c185bed15",
    selectedKitName="Objects")  # -> Info, Data
dso_3 = DeconstructSpeckleObject(SpeckleObject=receive_2.Data, selectedKitName="Objects")  # -> GROUPNAME, SPHERELOCATION
mesh = Mesh(dso_3.SPHERELOCATION)
number_slider = Slider(250, range=0..500)
clean = CleanTree(RemoveNulls=True, RemoveInvalid=True, RemoveEmpty=True, Tree=dso_2.BaseLine)
swatch = ColourSwatch(SwatchColor=RGB(138, 138, 138))
clean_2 = CleanTree(RemoveNulls=True, RemoveInvalid=True, RemoveEmpty=True, Tree=dso_2.DisplayValue)  # -> flatten(Tree)
volume = MeshVolume(Mesh=dso_3.SPHERELOCATION)  # -> Volume, Centroid
dom = ConstructDomain(DomainStart=expr("-x", number_slider), DomainEnd=number_slider)
previewlw = CustomPreviewLineweights(Geometry=clean, Shader=swatch, Absolute=False)  # disabled
project = Project(Geometry=volume.Centroid, Plane=PlaneXY(0, 0, 0))  # -> Geometry, Transform
pt = Point(volume.Centroid)
crv = Curve(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)
item = ListItem(List=clean_2, Index=Slider(0, range=0..2), Wrap=True)
mmx = MeshMesh(MeshA=item, MeshB=mesh)
msplit = MeshSplit(Mesh=item, Splitters=mesh)
item_2 = ListItem(List=msplit, Index=Slider(1, range=0..1), Wrap=True)
rectangle = Rectangle(Plane=project.Geometry, XSize=dom, YSize=dom, Radius=0)  # -> Rectangle, Length
number_slider_2 = Slider(30, range=0..100)
contour = Contour(Shape=item, Point=Point(0, 0, 0), Direction=Vector(0, 0, 1), Distance="50")
sdivide = DivideSurface(Surface=rectangle.Rectangle, UCount=number_slider_2, VCount=number_slider_2)  # -> Points, Normals, Parameters
line = LineSDL(Start=sdivide.Points, Direction=Vector(0, 0, 1), Length="10000")
swatch_2 = ColourSwatch(SwatchColor=RGB(166, 0, 0))
previewlw_2 = CustomPreviewLineweights(Geometry=contour, Shader=ColourSwatch(SwatchColor=RGB(64, 64, 64)), Absolute=False)
mcx = MeshCurve(Mesh=item_2, Curve=line)  # -> flatten(Points), Faces
srfgrid = SurfaceFromPoints(Points=mcx.Points, UCount=expr("x+1", number_slider_2), Interpolate=False)
previewlw_3 = CustomPreviewLineweights(Geometry=mmx, Shader=swatch_2, Thickness=Slider(2, range=0..10), Absolute=False)
dots = DotDisplay(Point=volume.Centroid, Colour=swatch_2, Size=Slider(5, range=0..100))
dots_2 = DotDisplay(Point=mcx.Points, Colour=ColourSwatch(SwatchColor=RGB(28, 28, 28)), Size=Slider(2, range=0..100))
previewmat = CustomPreviewMaterials(Geometry=srfgrid, DiffuseColor=swatch, Transparency=Slider(0.634, range=0..1))
swatch_3 = ColourSwatch(SwatchColor=RGB(64, 64, 64))

panel_3 = Panel(" ")  # disabled
panel_4 = Panel("M")  # disabled
number_slider_3 = Slider(353, range=0..10000)  # disabled
panel_5 = Panel("{0,0,-1000}")
panel_6 = Panel("10000")  # disabled
Z = UnitZ(Factor=expr("-x", number_slider_3))  # disabled
Z_2 = UnitZ(Factor=panel_6)  # disabled
project_2 = Project(Geometry=item, Plane=Z)  # -> Geometry, Transform
bbox = BoundingBox(Content=project_2.Geometry, Plane=PlaneXY(0, 0, 0))  # -> Box, Box_2; disabled
debrep = DeconstructBrep(Brep=bbox.Box)  # -> Faces, Edges, Vertices; disabled
move = Move(Geometry=debrep.Vertices, Motion=Z_2)  # -> Geometry, Transform; disabled
medges = MeshEdges(Mesh=project_2.Geometry)  # -> NakedEdges, InteriorEdges, NonManifoldEdges
ln = Line(StartPoint=debrep.Vertices, EndPoint=move.Geometry)  # disabled
number_slider_4 = Slider(51, range=0..100)  # disabled
mcx_2 = MeshCurve(Mesh=item, Curve=ln)  # -> flatten(Points), Faces; disabled
number_slider_5 = Slider(72, range=0..100)  # disabled
ln_2 = Line(StartPoint=debrep.Vertices, EndPoint=mcx_2.Points)  # disabled
midpt = CurveMiddle(Curve=ln_2)  # disabled
len = Length(Curve=ln_2)  # disabled
round = Round(Number=len)  # -> Nearest, Floor, Ceiling; disabled
concat = Concatenate(FragmentA=round.Nearest, FragmentB=panel_3, FragmentC=panel_4)  # disabled
tag = TextTag(Location=midpt, Text=concat, Colour=swatch_3)  # disabled
panel_7 = Panel(len)  # disabled
swatch_4 = ColourSwatch(SwatchColor=RGB(224, 0, 0))  # disabled
popgeo = PopulateGeometry(Geometry=item, Count=number_slider_4, Seed=1)  # disabled
sph = Sphere(Base=popgeo, Radius=500)  # disabled
cso = CreateSpeckleObject(selectedKitName="Objects")  # disabled
cso_2 = CreateSpeckleObject(selectedKitName="Objects")  # disabled
mesh_2 = Mesh(sph)  # disabled
number_slider_6 = Slider(3, range=0..10)  # disabled
mmx_2 = MeshMesh(MeshA=item, MeshB=mesh_2)  # disabled
panel_8 = Panel("https://macad.speckle.xyz/streams/5963382190/branches/all-available-data")  # disabled
cso_3 = CreateSpeckleObject(Level1=cso, Level2=cso_2, selectedKitName="Objects")  # disabled
swatch_5 = ColourSwatch(SwatchColor=RGB(143, 26, 26))  # disabled
divide = DivideCurve(Curve=mmx_2, Count=10, Kinks=False)  # -> Points, Tangents, Parameters; disabled
panel_9 = Panel("360")  # disabled
panel_10 = Panel("Add All geometry to branch 1 all sorted data")  # disabled
pdecon = Deconstruct(Point=divide.Points)  # -> XComponent, YComponent, ZComponent; disabled
previewlw_4 = CustomPreviewLineweights(Geometry=mmx_2, Shader=swatch_5, Thickness=number_slider_6, Absolute=False)  # disabled
bnd = Bounds(Numbers=pdecon.ZComponent)  # disabled
panel_11 = Panel(bnd)  # disabled
panel_12 = Panel(cso_3)  # disabled
dedomain = DeconstructDomain(Domain=bnd)  # -> Start, End; disabled
equals = Equality(FirstNumber=pdecon.ZComponent, SecondNumber=dedomain.Start)  # -> Equality, Inequality; disabled
send = Send(
    Stream=panel_8,
    Message=panel_10,
    Data=cso_3,
    AutoSend=False,
    BaseId="a36274ef0466ee3dbb588743f432b874",
    CurrentComponentState="expired",
    KitName="Objects",
    OutputWrappers="https://macad.speckle.xyz\t5963382190\t2e59024224",
    UseDefaultCache=True,
    selectedKitName="Objects")  # disabled
cull = CullPattern(List=divide.Points, CullPattern=equals.Equality)  # -> flatten(List); disabled
vec2pt = Vector2Pt(PointA=popgeo, PointB=cull, Unitize=False)  # -> Vector, Length; disabled
project_3 = Project(Geometry=cull, Plane=popgeo)  # -> Geometry, Transform; disabled
vec2pt_2 = Vector2Pt(PointA=popgeo, PointB=project_3.Geometry, Unitize=False)  # -> Vector, Length; disabled
angle = Angle(VectorA=vec2pt_2.Vector, VectorB=vec2pt.Vector)  # -> Angle, Reflex; disabled
vec2pt_3 = Vector2Pt(PointA=popgeo, PointB=cull, Unitize=False)  # -> Vector, Length; disabled
deg = Degrees(Radians=angle.Reflex)  # disabled
abs = Absolute(Value=deg)  # disabled
subtraction = Subtraction(A=panel_9, B=abs)  # disabled
ln_3 = Line(StartPoint=popgeo, EndPoint=cull)  # disabled
midpt_2 = CurveMiddle(Curve=ln_3)  # disabled
panel_13 = Panel("1")  # disabled
roundd = RoundToDecimalPlace(NumberX=subtraction, DecimalPlace=panel_13, RoundType=0)  # -> Rounded, Difference; disabled
tag_2 = TextTag(Location=midpt_2, Text=roundd.Rounded, Colour=swatch_3)  # disabled

# ----
# Enable To Upload Geomtry to Speckle Server
toggle = GroupToggle(ToggleActive=True, ToggleVisible=False)  # disabled
link_to_upload_to_our_speckle_server = Panel("https://macad.speckle.xyz/streams/4975f9f0a8/branches/students%2Fg06-site_locations")  # disabled
panel_14 = Panel("SiteLocationSelection")  # disabled
send_2 = Send(
    Stream=link_to_upload_to_our_speckle_server,
    Message=panel_14,
    AutoSend=False,
    CurrentComponentState="needs_input",
    KitName="Objects",
    UseDefaultCache=True,
    selectedKitName="Objects")  # disabled
