# Grasshopper definition G6-BIMSC24Studio-SITE_v4.gh (Grasshopper 1.0.7)
# plug-ins: Speckle 2, MetaHopper, Human, Pufferfish, MeshEdit Components, ShapeDiverForGrasshopper

sddp = ShapeDiverDocumentPayload({AbsoluteTolerance=0, AngleTolerance=0, DistanceDisplayPrecision=0, GltfVersion="Gltf2", GrasshopperVersion="1.0.0007", InputGroups="{}", OutputGroups="{}", RelativeTolerance=0, RhinoVersion="7.29.23107.3001", UnitSystem=0, VersionCreated="1.14.0.0", VersionSaved="1.14.0.0"})

# ----
# GetSiteGeometry
panel = Panel("https://macad.speckle.xyz/streams/4975f9f0a8/branches/site%2F00-federated-model")
receive = Receive(
    Stream=panel,
    AutoReceive=False,
    CurrentComponentState="expired",
    ExpandOutput=True,
    LastInfoMessage="James McBennett @ 01/19/2024 01:06:29: Pushed 38 elements from Grasshopper. (id:b5d4e56588)",
    ReceiveOnOpen=False,
    ReceivedCommitId="b5d4e56588",
    StreamWrapper="https://macad.speckle.xyz/streams/4975f9f0a8/branches/site/00-federated-model",
    selectedKitName="Objects")  # -> Info, CollectionType, Elements, Info_2, Levels, Name, Types
dso = DeconstructSpeckleObject(SpeckleObject=receive.Elements, selectedKitName="Objects")  # -> CollectionType, Elements, Name
dso_2 = DeconstructSpeckleObject(SpeckleObject=dso.Elements, selectedKitName="Objects")  # -> BaseGeometry, BaseLine, BuiltInCategory, Category, DisplayValue, ElementId, IsRevitLinkedModel, Label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

panel_2 = Panel("https://macad.speckle.xyz/streams/4975f9f0a8/commits/6c185bed15")
receive_2 = Receive(
    Stream=panel_2,
    AutoReceive=False,
    CurrentComponentState="expired",
    ExpandOutput=True,
    ReceiveOnOpen=False,
    ReceivedCommitId="6c185bed15",
    StreamWrapper="https://macad.speckle.xyz/streams/4975f9f0a8/commits/6c185bed15",
    selectedKitName="Objects")  # -> Info, Data
geo = Geometry(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)
dso_3 = DeconstructSpeckleObject(SpeckleObject=receive_2.Data, selectedKitName="Objects")  # -> GROUPNAME, SPHERELOCATION

crv = Curve([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])
pt = Point(Point(5159.268773, 9205.265575, 0))
crv_2 = Curve(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)
pt_2 = Point([Point(5157.927383, 9205.265575, 1.930970702), Point(5160.369894, 9203.352493, 1.930970702), Point(5161.611836, 9204.518417, 1.930970702)])
crv_3 = Curve(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)
pt_3 = Point(Point(5159.76961, 9205.265575, 3.861941404))
conndir = Wasp_ConnectionFromDirection(GEO=geo, CEN=pt_3, UP=crv_2, T="TOP")  # -> CONN, PLN_OUT; inputs CEN: list of Point3d, UP: list of Curve, T: list; plug-in component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
conndir_2 = Wasp_ConnectionFromDirection(GEO=geo, CEN=pt, UP=crv_3, T="BOTTOM")  # -> CONN, PLN_OUT; inputs CEN: list of Point3d, UP: list of Curve, T: list; plug-in component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
conndir_3 = Wasp_ConnectionFromDirection(GEO=geo, CEN=pt_2, UP=crv, T="SIDES")  # -> CONN, PLN_OUT; inputs CEN: list of Point3d, UP: list of Curve, T: list; plug-in component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
merge = Merge(Data1=conndir_3.CONN, Data2=conndir_2.CONN, Data3=conndir.CONN)

# ---- group: ROAD CURVES
crv_4 = Curve(<curve referenced from the Rhino model>)

# ----
mesh = Mesh(dso_3.SPHERELOCATION)

geo_2 = Geometry(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)
attribute = Wasp_Attribute(ID="house", VAL=geo_2, TR=Toggle(True))  # -> ATTR; inputs VAL: list, TR: Boolean; plug-in component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

number_slider = Slider(60, range=0..500)
part = Wasp_BasicPart(NAME="BLOCK01", GEO=geo, CONN=flatten(merge), ATTR=attribute)  # -> PART; inputs GEO: Mesh, CONN: list, ATTR: list; plug-in component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
clean = CleanTree(RemoveNulls=True, RemoveInvalid=True, RemoveEmpty=True, Tree=dso_2.BaseLine)
swatch = ColourSwatch(SwatchColor=RGB(138, 138, 138))
clean_2 = CleanTree(RemoveNulls=True, RemoveInvalid=True, RemoveEmpty=True, Tree=dso_2.DisplayValue)  # -> flatten(Tree)
volume = MeshVolume(Mesh=dso_3.SPHERELOCATION)  # -> Volume, Centroid
dom = ConstructDomain(DomainStart=expr("-x", number_slider), DomainEnd=number_slider)
previewlw = CustomPreviewLineweights(Geometry=clean, Shader=swatch, Absolute=False)  # disabled
project = Project(Geometry=volume.Centroid, Plane=PlaneXY(0, 0, 0))  # -> Geometry, Transform
pt_4 = Point(volume.Centroid)
crv_5 = Curve(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)
item = ListItem(List=clean_2, Index=Slider(0, range=0..2), Wrap=True)
mmx = MeshMesh(MeshA=item, MeshB=mesh)
msplit = MeshSplit(Mesh=item, Splitters=mesh)
item_2 = ListItem(List=msplit, Index=Slider(1, range=0..1), Wrap=True)
rectangle = Rectangle(Plane=project.Geometry, XSize=dom, YSize=dom, Radius=0)  # -> Rectangle, Length
number_slider_2 = Slider(30, range=0..100)
contour = Contour(Shape=item, Point=Point(0, 0, 0), Direction=Vector(0, 0, 1), Distance="50")
sdivide = DivideSurface(Surface=rectangle.Rectangle, UCount=number_slider_2, VCount=number_slider_2)  # -> Points, Normals, Parameters
number_slider_3 = Slider(5, range=0..100)
line = LineSDL(Start=sdivide.Points, Direction=Vector(0, 0, 1), Length="10000")
number_slider_4 = Slider(2, range=0..100)
number_slider_5 = Slider(0.25, range=0..1)
swatch_2 = ColourSwatch(SwatchColor=RGB(28, 28, 28))
number_slider_6 = Slider(0.25, range=0..1)
previewlw_2 = CustomPreviewLineweights(Geometry=contour, Shader=ColourSwatch(SwatchColor=RGB(64, 64, 64)), Absolute=False)
mcx = MeshCurve(Mesh=item_2, Curve=line)  # -> flatten(Points), Faces
srfgrid = SurfaceFromPoints(Points=mcx.Points, UCount=expr("x+1", number_slider_2), Interpolate=False)
previewlw_3 = CustomPreviewLineweights(Geometry=mmx, Shader=ColourSwatch(SwatchColor=RGB(166, 0, 0)), Thickness=Slider(2, range=0..10), Absolute=False)
previewmat = CustomPreviewMaterials(Geometry=srfgrid, DiffuseColor=swatch, Transparency=Slider(0.634, range=0..1))
swatch_3 = ColourSwatch(SwatchColor=RGB(64, 64, 64))  # disabled

panel_3 = Panel(" ")  # disabled
panel_4 = Panel("M")  # disabled
number_slider_7 = Slider(353, range=0..10000)  # disabled
panel_5 = Panel("{0,0,-1000}")  # disabled
panel_6 = Panel("10000")  # disabled
Z = UnitZ(Factor=expr("-x", number_slider_7))  # disabled
Z_2 = UnitZ(Factor=panel_6)  # disabled
project_2 = Project(Geometry=item, Plane=Z)  # -> Geometry, Transform; disabled
bbox = BoundingBox(Content=project_2.Geometry, Plane=PlaneXY(0, 0, 0))  # -> Box, Box_2; disabled
debrep = DeconstructBrep(Brep=bbox.Box)  # -> Faces, Edges, Vertices; disabled
move = Move(Geometry=debrep.Vertices, Motion=Z_2)  # -> Geometry, Transform; disabled
medges = MeshEdges(Mesh=project_2.Geometry)  # -> NakedEdges, InteriorEdges, NonManifoldEdges; disabled
ln = Line(StartPoint=debrep.Vertices, EndPoint=move.Geometry)  # disabled
number_slider_8 = Slider(51, range=0..100)  # disabled
mcx_2 = MeshCurve(Mesh=item, Curve=ln)  # -> flatten(Points), Faces; disabled
number_slider_9 = Slider(72, range=0..100)  # disabled
ln_2 = Line(StartPoint=debrep.Vertices, EndPoint=mcx_2.Points)  # disabled
midpt = CurveMiddle(Curve=ln_2)  # disabled
len = Length(Curve=ln_2)  # disabled
round = Round(Number=len)  # -> Nearest, Floor, Ceiling; disabled
concat = Concatenate(FragmentA=round.Nearest, FragmentB=panel_3, FragmentC=panel_4)  # disabled
tag = TextTag(Location=midpt, Text=concat, Colour=swatch_3)  # disabled
panel_7 = Panel(len)  # disabled
swatch_4 = ColourSwatch(SwatchColor=RGB(224, 0, 0))  # disabled
popgeo = PopulateGeometry(Geometry=item, Count=number_slider_8, Seed=1)  # disabled
sph = Sphere(Base=popgeo, Radius=500)  # disabled
cso = CreateSpeckleObject(selectedKitName="Objects")  # disabled
cso_2 = CreateSpeckleObject(selectedKitName="Objects")  # disabled
mesh_2 = Mesh(sph)  # disabled
number_slider_10 = Slider(3, range=0..10)  # disabled
mmx_2 = MeshMesh(MeshA=item, MeshB=mesh_2)  # disabled
panel_8 = Panel("https://macad.speckle.xyz/streams/5963382190/branches/all-available-data")  # disabled
cso_3 = CreateSpeckleObject(Level1=cso, Level2=cso_2, selectedKitName="Objects")  # disabled
swatch_5 = ColourSwatch(SwatchColor=RGB(143, 26, 26))  # disabled
divide = DivideCurve(Curve=mmx_2, Count=10, Kinks=False)  # -> Points, Tangents, Parameters; disabled
panel_9 = Panel("360")  # disabled
panel_10 = Panel("Add All geometry to branch 1 all sorted data")  # disabled
pdecon = Deconstruct(Point=divide.Points)  # -> XComponent, YComponent, ZComponent; disabled
previewlw_4 = CustomPreviewLineweights(Geometry=mmx_2, Shader=swatch_5, Thickness=number_slider_10, Absolute=False)  # disabled
bnd = Bounds(Numbers=pdecon.ZComponent)  # disabled
panel_11 = Panel(bnd)  # disabled
panel_12 = Panel(cso_3)  # disabled
dedomain = DeconstructDomain(Domain=bnd)  # -> Start, End; disabled
equals = Equality(FirstNumber=pdecon.ZComponent, SecondNumber=dedomain.Start)  # -> Equality, Inequality; disabled
send = Send(
    Stream=panel_8,
    Message=panel_10,
    Data=cso_3,
    AutoSend=False,
    BaseId="a36274ef0466ee3dbb588743f432b874",
    CurrentComponentState="expired",
    KitName="Objects",
    OutputWrappers="https://macad.speckle.xyz\t5963382190\t2e59024224",
    UseDefaultCache=True,
    selectedKitName="Objects")  # disabled
cull = CullPattern(List=divide.Points, CullPattern=equals.Equality)  # -> flatten(List); disabled
vec2pt = Vector2Pt(PointA=popgeo, PointB=cull, Unitize=False)  # -> Vector, Length; disabled
project_3 = Project(Geometry=cull, Plane=popgeo)  # -> Geometry, Transform; disabled
vec2pt_2 = Vector2Pt(PointA=popgeo, PointB=project_3.Geometry, Unitize=False)  # -> Vector, Length; disabled
angle = Angle(VectorA=vec2pt_2.Vector, VectorB=vec2pt.Vector)  # -> Angle, Reflex; disabled
vec2pt_3 = Vector2Pt(PointA=popgeo, PointB=cull, Unitize=False)  # -> Vector, Length; disabled
deg = Degrees(Radians=angle.Reflex)  # disabled
abs = Absolute(Value=deg)  # disabled
subtraction = Subtraction(A=panel_9, B=abs)  # disabled
ln_3 = Line(StartPoint=popgeo, EndPoint=cull)  # disabled
midpt_2 = CurveMiddle(Curve=ln_3)  # disabled
panel_13 = Panel("1")  # disabled
roundd = RoundToDecimalPlace(NumberX=subtraction, DecimalPlace=panel_13, RoundType=0)  # -> Rounded, Difference; disabled
tag_2 = TextTag(Location=midpt_2, Text=roundd.Rounded, Colour=swatch_3)  # disabled

# ----
# Enable To Upload Geomtry to Speckle Server
toggle = GroupToggle(ToggleActive=True, ToggleVisible=False)  # disabled
link_to_upload_to_our_speckle_server = Panel("https://macad.speckle.xyz/streams/4975f9f0a8/branches/students%2Fg06-site_locations")  # disabled
panel_14 = Panel("SiteLocationSelection")  # disabled
send_2 = Send(
    Stream=link_to_upload_to_our_speckle_server,
    Message=panel_14,
    AutoSend=False,
    CurrentComponentState="needs_input",
    KitName="Objects",
    UseDefaultCache=True,
    selectedKitName="Objects")  # disabled

geo_3 = Geometry(srfgrid)
bbox_2 = BoundingBox(Content=geo_3, Plane=PlaneXY(0, 0, 0))  # -> Box, Box_2
volume_2 = Volume(Geometry=bbox_2.Box)  # -> Volume, Centroid
scale_nu = ScaleNU(
    Geometry=bbox_2.Box,
    Plane=volume_2.Centroid,
    ScaleX=Slider(1, range=0..10),
    ScaleY=Slider(1, range=0..10),
    ScaleZ=Slider(2.17, range=0..10))  # -> Geometry, Transform
fieldpts = Wasp_FieldPoints(BOU=scale_nu.Geometry, RES=Slider(2.5, range=0..10))  # -> E_FIELD, PTS; inputs BOU: list of Mesh, PLN: Plane; plug-in component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

contour_2 = Contour(Shape=geo_3, Point=Point(0, 0, 0), Direction=Vector(0, 0, 1), Distance=Slider(0.5, range=0..1))
preview = CustomPreview(Geometry=geo_3, Material=ColourSwatch(SwatchColor=RGB(194, 194, 194)))
preview_2 = CustomPreview(Geometry=contour_2, Material=ColourSwatch(SwatchColor=RGB(0, 0, 0)))

geo_4 = Geometry(geo_3)
pull = PullPoint(Point=fieldpts.PTS, Geometry=geo_4, ClosestOnly=True)  # -> ClosestPoint, Distance
pdecon_2 = Deconstruct(Point=fieldpts.PTS)  # -> XComponent, YComponent, ZComponent
pdecon_3 = Deconstruct(Point=pull.ClosestPoint)  # -> XComponent, YComponent, ZComponent
smaller = SmallerThan(FirstNumber=pdecon_2.ZComponent, SecondNumber=pdecon_3.ZComponent)  # -> SmallerThan, OrEqualTo
dispatch = Dispatch(List=pull.Distance, DispatchPattern=smaller.SmallerThan)  # -> ListA, ListB
dom_2 = ConstructDomain(DomainStart=Slider(1, range=0..1), DomainEnd=Slider(0, range=0..100))
bnd_2 = Bounds(Numbers=dispatch.ListB)
remap = RemapNumbers(Value=dispatch.ListB, Source=bnd_2, Target=dom_2)  # -> Mapped, Clipped
lng = ListLength(List=dispatch.ListA)
repeat = RepeatData(Data=Slider(0, range=0..100), Length=lng)
graph = GraphMapper(
    remap.Mapped,
    x0=0,
    x1=1,
    y0=0,
    y1=1,
    container_name="Bezier",
    cpx=[0, 0.6471909881, 0.9011235833, 1],
    cpy=[0, 0.07142859697, 0.428571403, 1])
weave = Weave(Pattern=smaller.SmallerThan, Stream0=graph, Stream1=repeat, NullGaps=False)

geo_5 = Geometry(geo_3)
project_4 = Project(Curve=crv_4, Brep=geo_5, Direction=Vector(0, 0, 1))
pt_5 = Point(fieldpts.PTS)
pull_2 = PullPoint(Point=pt_5, Geometry=flatten(project_4), ClosestOnly=True)  # -> ClosestPoint, Distance
dom_3 = ConstructDomain(DomainStart=Slider(1, range=0..1), DomainEnd=Slider(0, range=0..100))
bnd_3 = Bounds(Numbers=dispatch.ListB)
remap_2 = RemapNumbers(Value=pull_2.Distance, Source=bnd_3, Target=dom_3)  # -> Mapped, Clipped
graph_2 = GraphMapper(
    remap_2.Mapped,
    x0=0,
    x1=1,
    y0=0,
    y1=1,
    container_name="Bezier",
    cpx=[0, 0.6471909881, 0.9011235833, 1],
    cpy=[0, 0.07142859697, 0.428571403, 1])

pt_6 = Point(fieldpts.PTS)
geo_6 = Geometry(geo_3)
srf_cp = SurfaceClosestPoint(Point=pt_6, Surface=geo_6)  # -> Point, UVPoint, Distance
evalsrf = EvaluateSurface(Surface=geo_6, Point=srf_cp.UVPoint)  # -> Point, Normal, UDirection, VDirection, Frame
Z_3 = UnitZ(Factor=1)
angle_2 = Angle(VectorA=Z_3, VectorB=evalsrf.Normal)  # -> Angle, Reflex
bnd_4 = Bounds(Numbers=angle_2.Angle)
remap_3 = RemapNumbers(Value=angle_2.Angle, Source=bnd_4, Target="1 To 0")  # -> Mapped, Clipped
graph_3 = GraphMapper(remap_3.Mapped, x0=0, x1=1, y0=0, y1=1, container_name="Bezier", cpx=[0, 0.25, 0.75, 1], cpy=[0, 0.25, 0.75, 1])

gradient = Gradient(LowerLimit=0, UpperLimit=1, Parameter=weave, stops=[0: RGB(0, 128, 0), 0.5: RGB(255, 255, 0), 1: RGB(255, 0, 0)])
preview_3 = CustomPreview(Material=gradient)  # disabled

gradient_2 = Gradient(LowerLimit=0, UpperLimit=1, Parameter=graph_3, stops=[0: RGB(0, 128, 0), 0.5: RGB(255, 255, 0), 1: RGB(255, 0, 0)])  # disabled
preview_4 = CustomPreview(Geometry=evalsrf.Point, Material=gradient_2)  # disabled

gradient_3 = Gradient(LowerLimit=0, UpperLimit=1, Parameter=graph_2, stops=[0: RGB(0, 128, 0), 0.5: RGB(255, 255, 0), 1: RGB(255, 0, 0)])  # disabled
preview_5 = CustomPreview(Material=gradient_3)  # disabled

multiplication = Multiplication(A=weave, B=graph_2, C=graph_3)

field = Wasp_Field(NAME="srfField", E_FIELD=fieldpts.E_FIELD, VAL=multiplication)  # -> FIELD; inputs VAL: list; plug-in component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

number_slider_11 = Slider(35, range=0..50)
panel_15 = Panel("""SIDES>SIDES
TOP>BOTTOM
BOTTOM>TOP""")
rulegen = Wasp_RulesGenerator(PART=part, GR=panel_15)  # -> R; inputs PART: list, SELF_P: Boolean, SELF_C: Boolean, TYP: Boolean, GR: list; plug-in component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
fieldaggregation = Wasp_FieldDrivenAggregation(PART=flatten(part), N=Slider(33, range=0..500), RULES=rulegen, FIELD=field, RESET=Button())  # -> AGGR, PART_OUT; inputs PART: list, PREV: list, N: Int32, RULES: list, FIELD: list, MODE: Int32, GC: list, RESET: Boolean; plug-in component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

series = Series(Start=0, Step=1, Count="3")
bnd_5 = Bounds(Numbers=series)
dedomain_2 = DeconstructDomain(Domain=bnd_5)  # -> Start, End
gradient_4 = Gradient(
    LowerLimit=dedomain_2.Start,
    UpperLimit=dedomain_2.End,
    Parameter=series,
    stops=[0.15: RGB(255, 130, 160), 0.85: RGB(220, 0, 40)])
lng_2 = ListLength(List=fieldaggregation.PART_OUT)
getattr = Wasp_GetAttributeByName(PART=fieldaggregation.PART_OUT, ID="house")  # -> VAL; plug-in component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
random = Random(Range=Slider(2, range=0..10), Number=lng_2, Seed=2, Integers=True)
item_3 = ListItem(List=gradient_4, Index=random, Wrap=True)
preview_6 = CustomPreview(Geometry=flatten(getattr), Material=item_3)

gradient_5 = Gradient(
    LowerLimit=0,
    UpperLimit=1,
    Parameter=multiplication,
    stops=[0: RGB(0, 128, 0), 0.5: RGB(255, 255, 0), 1: RGB(255, 0, 0)])  # disabled
preview_7 = CustomPreview(Material=gradient_5)  # disabled
