# Grasshopper definition site crop.gh (Grasshopper 1.0.7)
# plug-ins: Speckle 2, ShapeDiverForGrasshopper

sddp = ShapeDiverDocumentPayload({AbsoluteTolerance=0, AngleTolerance=0, DistanceDisplayPrecision=0, GltfVersion="Gltf2", GrasshopperVersion="1.0.0007", InputGroups="{}", OutputGroups="{}", RelativeTolerance=0, RhinoVersion="7.35.23346.11001", UnitSystem=0, VersionCreated="1.16.0.0", VersionSaved="1.16.0.0"})
panel = Panel("https://macad.speckle.xyz/streams/4975f9f0a8/commits/677c881419")
so = SpeckleObject()
land_mesh = Mesh(<mesh referenced from the Rhino model>)
geo = Geometry(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)
receive = Receive(
    Stream=panel,
    AutoReceive=False,
    CurrentComponentState="expired",
    ExpandOutput=True,
    ReceiveOnOpen=False,
    ReceivedCommitId="677c881419",
    StreamWrapper="https://macad.speckle.xyz/streams/4975f9f0a8/commits/677c881419",
    selectedKitName="Objects")  # -> Info, Data

# ----
# our part
cluster = Cluster(B=geo, A=land_mesh, G=geo, A_2=land_mesh)

swatch = ColourSwatch(SwatchColor=RGB(255, 0, 0))
mesh = Mesh(cluster)
geo_2 = Geometry(receive.Data)
weld = WeldMesh(Mesh=mesh, Angle=3.141592654)
mjoin = MeshJoin(Meshes=weld)

mesh_2 = Mesh(mesh)
face_boundaries = FaceBoundaries(Mesh=mesh_2)
boundary_surfaces = BoundarySurfaces(Edges=face_boundaries)
brep_join = BrepJoin(Breps=boundary_surfaces)  # -> Breps, Closed
brep = Brep(flatten(brep_join.Breps))

Z = UnitZ(Factor=-10)
extr = Extrude(Base=brep, Direction=Z)
preview = CustomPreview(Geometry=brep, Material=ColourSwatch(SwatchColor=RGB(176, 141, 109)))
extrude = ExtrudeLinear(OrientationP=PlaneXY(0, 0, 0))

# ==== cluster Cluster
G = ClusterInput()
B = ClusterInput()
volume = Volume(Geometry=G)  # -> Volume, Centroid
mesh = MeshBrep(
    Brep=B,
    Settings={GridMaxCount=0, GridMinCount=16, JaggedSeams=False, MaxEdgeLength=0, MinEdgeLength=0.0001, MinTolerance=0, Refine=True, RefineAngle=0, RelativeTolerance=0.65, SimplePlanes=True, Tolerance=0})
Z = UnitZ(Factor="-2000")
A = ClusterInput()
cyl = Cylinder(Base=volume.Centroid, Radius=Slider(500, range=0..1000), Length=Slider(5000, range=0..10000))
move = Move(Geometry=volume.Centroid, Motion=Z)  # -> Geometry, Transform
mdif = MeshDifference(MeshesA=A, MeshesB=mesh)
orient = Orient(Geometry=cyl, Source=volume.Centroid, Target=move.Geometry)  # -> Geometry, Transform
mesh_2 = MeshBrep(
    Brep=orient.Geometry,
    Settings={GridMaxCount=0, GridMinCount=16, JaggedSeams=False, MaxEdgeLength=0, MinEdgeLength=0.0001, MinTolerance=0, Refine=True, RefineAngle=0, RelativeTolerance=0.65, SimplePlanes=True, Tolerance=0})
A_2 = ClusterInput()
mint = MeshIntersection(MeshesA=A_2, MeshesB=mesh_2)
facen = FaceNormals(Mesh=mint)  # -> Centers, Normals
explode = MeshExplode(Mesh=mint, Interpolate=False)
pdecon = Deconstruct(Point=facen.Centers)  # -> XComponent, YComponent, ZComponent
larger = LargerThan(FirstNumber=pdecon.ZComponent, SecondNumber=Slider(5946, range=5500..6300))  # -> LargerThan, OrEqualTo
cull = CullPattern(List=explode, CullPattern=larger.LargerThan)
triremesh = TriRemesh(Geometry=cull, Iterations=Slider(0, range=0..10))  # -> Triangulation, Dual, Creases
facen_2 = FaceNormals(Mesh=triremesh.Triangulation)  # -> Centers, Normals
explode_2 = MeshExplode(Mesh=triremesh.Triangulation, Interpolate=False)
devec = DeconstructVector(Vector=facen_2.Normals)  # -> XComponent, YComponent, ZComponent
larger_2 = LargerThan(FirstNumber=devec.ZComponent, SecondNumber=Slider(0.01, range=0..0.01))  # -> LargerThan, OrEqualTo
cull_2 = CullPattern(List=explode_2, CullPattern=larger_2.LargerThan)  # -> flatten(List)
triremesh_2 = TriRemesh(Geometry=cull_2, Iterations=Slider(50, range=0..100))  # -> Triangulation, Dual, Creases
T = ClusterOutput(triremesh_2.Triangulation)
