# Grasshopper definition UnitsAggregationStudies_v1.gh (Grasshopper 1.0.7)
# plug-ins: Human, Pufferfish, Speckle 2, MeshEdit Components, MetaHopper, treesloth01, ShapeDiverForGrasshopper

get_from = Panel("https://macad.speckle.xyz/streams/6ba03db5f8/commits/4bfdabba08")  # disabled
receive = Receive(
    Stream=get_from,
    AutoReceive=False,
    CurrentComponentState="expired",
    ExpandOutput=True,
    ReceiveOnOpen=False,
    ReceivedCommitId="4bfdabba08",
    StreamWrapper="https://macad.speckle.xyz/streams/6ba03db5f8/commits/4bfdabba08",
    selectedKitName="Objects")  # -> Info, CollectionType, Elements, Name; disabled
dso = DeconstructSpeckleObject(SpeckleObject=receive.Elements, selectedKitName="Objects")  # disabled
clean = CleanTree(RemoveNulls=True, RemoveInvalid=True, RemoveEmpty=True, Tree=dso)  # -> simplify(Tree); disabled
bang = ExplodeTree(Data=clean)  # -> Branch0, Branch1, Branch2, Branch3, Branch4, Branch5, Branch6, Branch7, Branch8; disabled
geo = Geometry(bang.Branch4)  # disabled
geo_2 = Geometry(bang.Branch1)  # disabled
sddp = ShapeDiverDocumentPayload()

# ----
# Enable To Upload Geomtry to Speckle Server
toggle = GroupToggle(ToggleActive=True, ToggleVisible=False)  # disabled
link_to_upload_to_our_speckle_server = Panel("https://macad.speckle.xyz/streams/4975f9f0a8/branches/students%2Fg06-site_locations")  # disabled
panel = Panel("SiteLocationSelection")  # disabled
send = Send(
    Stream=link_to_upload_to_our_speckle_server,
    Message=panel,
    AutoSend=False,
    CurrentComponentState="needs_input",
    KitName="Objects",
    UseDefaultCache=True,
    selectedKitName="Objects")  # disabled

# ----
# Get Topo from Speckle
panel_2 = Panel("https://macad.speckle.xyz/streams/4975f9f0a8/branches/site%2F00-federated-model")
receive_2 = Receive(
    Stream=panel_2,
    AutoReceive=False,
    CurrentComponentState="expired",
    ExpandOutput=True,
    LastInfoMessage="James McBennett @ 01/19/2024 01:06:29: Pushed 38 elements from Grasshopper. (id:b5d4e56588)",
    ReceiveOnOpen=False,
    ReceivedCommitId="b5d4e56588",
    StreamWrapper="https://macad.speckle.xyz/streams/4975f9f0a8/branches/site/00-federated-model",
    selectedKitName="Objects")  # -> Info, CollectionType, Elements, Info_2, Levels, Name, Types
dso_2 = DeconstructSpeckleObject(SpeckleObject=receive_2.Elements, selectedKitName="Objects")  # -> CollectionType, Elements, Name
dso_3 = DeconstructSpeckleObject(SpeckleObject=dso_2.Elements, selectedKitName="Objects")  # -> BaseGeometry, BaseLine, BuiltInCategory, Category, DisplayValue, ElementId, IsRevitLinkedModel, Label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
clean_2 = CleanTree(RemoveNulls=True, RemoveInvalid=True, RemoveEmpty=True, Tree=dso_3.BaseLine)
swatch = ColourSwatch(SwatchColor=RGB(138, 138, 138))
clean_3 = CleanTree(RemoveNulls=True, RemoveInvalid=True, RemoveEmpty=True, Tree=dso_3.DisplayValue)  # -> flatten(Tree)
previewlw = CustomPreviewLineweights(Geometry=clean_2, Shader=swatch, Absolute=False)
item = ListItem(List=clean_3, Index=Slider(0, range=0..2), Wrap=True)

# ----
# Get SiteLocation from Speckle
panel_3 = Panel("https://macad.speckle.xyz/streams/4975f9f0a8/commits/6c185bed15")
receive_3 = Receive(
    Stream=panel_3,
    AutoReceive=False,
    CurrentComponentState="expired",
    ExpandOutput=True,
    LastInfoMessage="James McBennett @ 01/20/2024 17:54:06: Pushed 5 elements from Grasshopper. (id:6c185bed15)",
    ReceiveOnOpen=False,
    ReceivedCommitId="6c185bed15",
    StreamWrapper="https://macad.speckle.xyz/streams/4975f9f0a8/commits/6c185bed15",
    selectedKitName="Objects")  # -> Info, Data
dso_4 = DeconstructSpeckleObject(SpeckleObject=receive_3.Data, selectedKitName="Objects")  # -> GROUPNAME, SPHERELOCATION

mesh = Mesh(dso_4.SPHERELOCATION)
clean_4 = CleanTree(RemoveNulls=True, RemoveInvalid=True, RemoveEmpty=True, Tree=dso_3.DisplayValue)  # -> flatten(Tree)
volume = MeshVolume(Mesh=dso_4.SPHERELOCATION)  # -> Volume, Centroid

# ---- group: Site Contours
Z = UnitZ(Factor=expr("-x", Slider(353, range=0..10000)))
project = Project(Geometry=item, Plane=Z)  # -> Geometry, Transform
medges = MeshEdges(Mesh=project.Geometry)  # -> NakedEdges, InteriorEdges, NonManifoldEdges
contour = Contour(Shape=item, Point=Point(0, 0, 0), Direction=Vector(0, 0, 1), Distance="50")
previewlw_2 = CustomPreviewLineweights(Geometry=[contour, medges.NakedEdges], Shader=ColourSwatch(SwatchColor=RGB(64, 64, 64)), Absolute=False)

# ---- group: Populate surface
number_slider = Slider(51, range=0..100)  # disabled
popgeo = PopulateGeometry(Geometry=item, Count=number_slider, Seed=1)  # disabled
sph = Sphere(Base=popgeo, Radius=500)  # disabled
mesh_2 = Mesh(sph)  # disabled

# ---- group: Surface topo
number_slider_2 = Slider(0.623, range=0..1)  # disabled
previewmat = CustomPreviewMaterials(Geometry=item, DiffuseColor=swatch, Transparency=number_slider_2)  # disabled

# ----
mmx = MeshMesh(MeshA=item, MeshB=mesh)
divide = DivideCurve(Curve=mmx, Count=10, Kinks=False)  # -> Points, Tangents, Parameters
item_2 = ListItem(List=clean_4, Index=Slider(0, range=0..2), Wrap=True)

# ---- group: Site Perimeter Sphere
swatch_2 = ColourSwatch(SwatchColor=RGB(143, 26, 26))
previewmat_2 = CustomPreviewMaterials(Geometry=mesh, DiffuseColor=swatch_2, Transparency=Slider(0.747, range=0..1))
previewlw_3 = CustomPreviewLineweights(Geometry=mmx, Shader=swatch_2, Thickness=Slider(3, range=0..10), Absolute=False)

# ---- group: Height of side of full site
panel_4 = Panel("{0,0,-1000}")
Z_2 = UnitZ(Factor=expr("-x", Slider(353, range=0..10000)))
project_2 = Project(Geometry=item_2, Plane=Z_2)  # -> Geometry, Transform
bbox = BoundingBox(Content=project_2.Geometry, Plane=PlaneXY(0, 0, 0))  # -> Box, Box_2
debrep = DeconstructBrep(Brep=bbox.Box)  # -> Faces, Edges, Vertices
Z_3 = UnitZ(Factor="10000")
move = Move(Geometry=debrep.Vertices, Motion=Z_3)  # -> Geometry, Transform
ln = Line(StartPoint=debrep.Vertices, EndPoint=move.Geometry)
mcx = MeshCurve(Mesh=item_2, Curve=ln)  # -> flatten(Points), Faces
ln_2 = Line(StartPoint=debrep.Vertices, EndPoint=mcx.Points)
len = Length(Curve=ln_2)
round = Round(Number=len)  # -> Nearest, Floor, Ceiling
midpt = CurveMiddle(Curve=ln_2)
concat = Concatenate(FragmentA=round.Nearest, FragmentB=" ", FragmentC="M")
tag = TextTag(Location=midpt, Text=concat, Colour=ColourSwatch(SwatchColor=RGB(64, 64, 64)))

# ---- group: Generate clean surface for aggregation
number_slider_3 = Slider(60, range=0..500)
dom = ConstructDomain(DomainStart=expr("-x", number_slider_3), DomainEnd=number_slider_3)
project_3 = Project(Geometry=volume.Centroid, Plane=PlaneXY(0, 0, 0))  # -> Geometry, Transform
rectangle = Rectangle(Plane=project_3.Geometry, XSize=dom, YSize=dom, Radius=0)  # -> Rectangle, Length
number_slider_4 = Slider(30, range=0..100)
msplit = MeshSplit(Mesh=item_2, Splitters=mesh)
sdivide = DivideSurface(Surface=rectangle.Rectangle, UCount=number_slider_4, VCount=number_slider_4)  # -> Points, Normals, Parameters
item_3 = ListItem(List=msplit, Index=Slider(1, range=0..1), Wrap=True)
line = LineSDL(Start=sdivide.Points, Direction=Vector(0, 0, 1), Length="10000")
mcx_2 = MeshCurve(Mesh=item_3, Curve=line)  # -> flatten(Points), Faces
srfgrid = SurfaceFromPoints(Points=mcx_2.Points, UCount=expr("x+1", number_slider_4), Interpolate=False)
previewmat_3 = CustomPreviewMaterials(Geometry=srfgrid, DiffuseColor=RGB(255, 255, 255), Transparency=Slider(0.634, range=0..1))

# ----
pdecon = Deconstruct(Point=divide.Points)  # -> XComponent, YComponent, ZComponent
bnd = Bounds(Numbers=pdecon.ZComponent)
panel_5 = Panel(bnd)
dedomain = DeconstructDomain(Domain=bnd)  # -> Start, End
equals = Equality(FirstNumber=pdecon.ZComponent, SecondNumber=dedomain.Start)  # -> Equality, Inequality
cull = CullPattern(List=divide.Points, CullPattern=equals.Equality)  # -> flatten(List)
vec2pt = Vector2Pt(PointA=volume.Centroid, PointB=cull, Unitize=False)  # -> Vector, Length
vec2pt_2 = Vector2Pt(PointA=volume.Centroid, PointB=cull, Unitize=False)  # -> Vector, Length
angle = Angle(VectorA=vec2pt.Vector, VectorB=vec2pt_2.Vector)  # -> Angle, Reflex
deg = Degrees(Radians=angle.Reflex)
abs = Absolute(Value=deg)
subtraction = Subtraction(A="360", B=abs)

# ----
# Press the button to make sure the file is
# updated to latest Wasp version on your pc.
button = Button()
updatefile = Wasp_UpdateFile(UPDATE=button)  # -> LOG; inputs UPDATE: Boolean; plug-in component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

number_slider_5 = Slider(0.4, range=0..1)

# ---- group: ROAD CURVES
crv = Curve(<curve referenced from the Rhino model>)

# ----
project_4 = Project(Curve=crv, Brep=srfgrid, Direction=Vector(0, 0, 1))

# ---- group: M1
crv_2 = Curve([<curve referenced from the Rhino model> x3])
geo_3 = Geometry(<brep referenced from the Rhino model>)
pt = Point([<point referenced from the Rhino model> x3])
stack = StackTrees(Data0=geo_3, Data1=pt, Data2=crv_2, Reduce=True)
points = PointList(Points=pt, Size=number_slider_5)

# ---- group: M2
geo_4 = Geometry(<brep referenced from the Rhino model>)
pt_2 = Point([<point referenced from the Rhino model> x2])
crv_3 = Curve([<curve referenced from the Rhino model> x2])
stack_2 = StackTrees(Data0=geo_4, Data1=pt_2, Data2=crv_3, Reduce=True)
points_2 = PointList(Points=pt_2, Size=number_slider_5)

# ---- group: M3
geo_5 = Geometry(<brep referenced from the Rhino model>)
pt_3 = Point([<point referenced from the Rhino model> x2])
crv_4 = Curve([<curve referenced from the Rhino model> x2])
stack_3 = StackTrees(Data0=geo_5, Data1=pt_3, Data2=crv_4, Reduce=True)
points_3 = PointList(Points=pt_3, Size=number_slider_5)

# ---- group: M4
geo_6 = Geometry(<brep referenced from the Rhino model>)
pt_4 = Point([<point referenced from the Rhino model> x2])
crv_5 = Curve([<curve referenced from the Rhino model> x2])
stack_4 = StackTrees(Data0=geo_6, Data1=pt_4, Data2=crv_5, Reduce=True)
points_4 = PointList(Points=pt_4, Size=number_slider_5)

# ----
geo_7 = Geometry(<brep referenced from the Rhino model>)

pt_5 = Point([<point referenced from the Rhino model> x6])
crv_6 = Curve([<curve referenced from the Rhino model> x6])
pt_6 = Point([<point referenced from the Rhino model> x2])
crv_7 = Curve([<curve referenced from the Rhino model> x2])
pt_7 = Point([<point referenced from the Rhino model> x3])
crv_8 = Curve([<curve referenced from the Rhino model> x3])
conndir = Wasp_ConnectionFromDirection(GEO=geo_7, CEN=pt_7, UP=crv_8, T="TOP")  # -> CONN, PLN_OUT; inputs CEN: list of Point3d, UP: list of Curve, T: list; plug-in component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
conndir_2 = Wasp_ConnectionFromDirection(GEO=geo_7, CEN=pt_6, UP=crv_7, T="BOTTOM")  # -> CONN, PLN_OUT; inputs CEN: list of Point3d, UP: list of Curve, T: list; plug-in component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
conndir_3 = Wasp_ConnectionFromDirection(GEO=geo_7, CEN=pt_5, UP=crv_6, T="SIDES")  # -> CONN, PLN_OUT; inputs CEN: list of Point3d, UP: list of Curve, T: list; plug-in component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
merge = Merge(Data1=conndir_3.CONN, Data2=conndir_2.CONN, Data3=conndir.CONN)

bang_2 = ExplodeTree(Data=stack_2)  # -> Branch0, Branch1, Branch2
conndir_4 = Wasp_ConnectionFromDirection(GEO=bang_2.Branch0, CEN=bang_2.Branch1, UP=bang_2.Branch2)  # -> CONN, PLN_OUT; inputs CEN: list of Point3d, UP: list of Curve, T: list; plug-in component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
geo_8 = Geometry()
attribute = Wasp_Attribute(ID="KIT", VAL=geo_8, TR=Toggle(True))  # -> ATTR; inputs VAL: list, TR: Boolean; plug-in component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
part = Wasp_BasicPart(NAME="KIT", GEO=bang_2.Branch0, CONN=flatten(conndir_4.CONN))  # -> PART; inputs GEO: Mesh, CONN: list, ATTR: list; plug-in component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

bang_3 = ExplodeTree(Data=stack_3)  # -> Branch0, Branch1, Branch2
conndir_5 = Wasp_ConnectionFromDirection(GEO=bang_3.Branch0, CEN=bang_3.Branch1, UP=bang_3.Branch2)  # -> CONN, PLN_OUT; inputs CEN: list of Point3d, UP: list of Curve, T: list; plug-in component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
geo_9 = Geometry()
attribute_2 = Wasp_Attribute(ID="CIR1", VAL=geo_9, TR=Toggle(True))  # -> ATTR; inputs VAL: list, TR: Boolean; plug-in component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
part_2 = Wasp_BasicPart(NAME="CIR1", GEO=bang_3.Branch0, CONN=flatten(conndir_5.CONN))  # -> PART; inputs GEO: Mesh, CONN: list, ATTR: list; plug-in component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

bang_4 = ExplodeTree(Data=stack_4)  # -> Branch0, Branch1, Branch2
conndir_6 = Wasp_ConnectionFromDirection(GEO=bang_4.Branch0, CEN=bang_4.Branch1, UP=bang_4.Branch2)  # -> CONN, PLN_OUT; inputs CEN: list of Point3d, UP: list of Curve, T: list; plug-in component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
geo_10 = Geometry()
attribute_3 = Wasp_Attribute(ID="CIR2", VAL=geo_10, TR=Toggle(True))  # -> ATTR; inputs VAL: list, TR: Boolean; plug-in component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
part_3 = Wasp_BasicPart(NAME="CIR2", GEO=bang_4.Branch0, CONN=flatten(conndir_6.CONN))  # -> PART; inputs GEO: Mesh, CONN: list, ATTR: list; plug-in component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

bang_5 = ExplodeTree(Data=stack)  # -> Branch0, Branch1, Branch2
conndir_7 = Wasp_ConnectionFromDirection(GEO=bang_5.Branch0, CEN=bang_5.Branch1, UP=bang_5.Branch2)  # -> CONN, PLN_OUT; inputs CEN: list of Point3d, UP: list of Curve, T: list; plug-in component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
geo_11 = Geometry(<brep referenced from the Rhino model>)
attribute_4 = Wasp_Attribute(ID="MECHd", VAL=geo_11, TR=Toggle(True))  # -> ATTR; inputs VAL: list, TR: Boolean; plug-in component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
part_4 = Wasp_BasicPart(NAME="MECH", GEO=bang_5.Branch0, CONN=flatten(conndir_7.CONN), ATTR=attribute_4)  # -> PART; inputs GEO: Mesh, CONN: list, ATTR: list; plug-in component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

geo_12 = Geometry(<brep referenced from the Rhino model>)
attribute_5 = Wasp_Attribute(ID="house", VAL=geo_12, TR=Toggle(True))  # -> ATTR; inputs VAL: list, TR: Boolean; plug-in component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

part_5 = Wasp_BasicPart(NAME="BLOCK01", GEO=geo_7, CONN=flatten(merge))  # -> PART; inputs GEO: Mesh, CONN: list, ATTR: list; plug-in component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
item_4 = ListItem(Index=0, Wrap=True)
merge_2 = Merge(Data1=part_4, Data2=part, Data3=part_2, Data4=part_3)
number_slider_6 = Slider(27, range=1..50)  # disabled
rulegen = Wasp_RulesGenerator(PART=merge_2, SELF_P=Toggle(False))  # -> R; inputs PART: list, SELF_P: Boolean, SELF_C: Boolean, TYP: Boolean, GR: list; plug-in component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
lng = ListLength(List=rulegen)
division = Division(A=lng, B="2")
split = SplitList(List=rulegen, Index=division)  # -> ListA, ListB
panel_6 = Panel(rulegen)  # disabled
button_2 = Button()  # disabled
stochasticaggregation = Wasp_StochasticAggregation(PART=flatten(merge_2), N=number_slider_6, RULES=rulegen, RESET=button_2)  # -> AGGR, PART_OUT; inputs PART: list, PREV: list, N: Int32, RULES: list, SEED: Int32, MODE: Int32, GC: list, RESET: Boolean; disabled; plug-in component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

panel_7 = Panel("3")  # disabled
series = Series(Start=0, Step=1, Count=panel_7)  # disabled
bnd_2 = Bounds(Numbers=series)  # disabled
dedomain_2 = DeconstructDomain(Domain=bnd_2)  # -> Start, End; disabled
number_slider_7 = Slider(2, range=0..10)  # disabled
gradient = Gradient(
    LowerLimit=dedomain_2.Start,
    UpperLimit=dedomain_2.End,
    Parameter=series,
    stops=[0.15: RGB(255, 130, 160), 0.85: RGB(220, 0, 40)])  # disabled
lng_2 = ListLength(List=stochasticaggregation.PART_OUT)  # disabled
getattr = Wasp_GetAttributeByName(PART=stochasticaggregation.PART_OUT, ID="MECHd")  # -> VAL; disabled; plug-in component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
random = Random(Range=number_slider_7, Number=lng_2, Seed=2, Integers=True)  # disabled
item_5 = ListItem(List=gradient, Index=random, Wrap=True)  # disabled
preview = CustomPreview(Geometry=flatten(getattr), Material=item_5)  # disabled

number_slider_8 = Slider(0.25, range=0..1)  # disabled

geo_13 = Geometry(srfgrid)
bbox_2 = BoundingBox(Content=geo_13, Plane=PlaneXY(0, 0, 0))  # -> Box, Box_2
volume_2 = Volume(Geometry=bbox_2.Box)  # -> Volume, Centroid
scale_nu = ScaleNU(
    Geometry=bbox_2.Box,
    Plane=volume_2.Centroid,
    ScaleX=Slider(1, range=0..10),
    ScaleY=Slider(1, range=0..10),
    ScaleZ=Slider(2.17, range=0..10))  # -> Geometry, Transform
fieldpts = Wasp_FieldPoints(BOU=scale_nu.Geometry, RES=Slider(2.5, range=0..10))  # -> E_FIELD, PTS; inputs BOU: list of Mesh, PLN: Plane; plug-in component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

contour_2 = Contour(Shape=geo_13, Point=Point(0, 0, 0), Direction=Vector(0, 0, 1), Distance=Slider(0.5, range=0..1))
preview_2 = CustomPreview(Geometry=geo_13, Material=ColourSwatch(SwatchColor=RGB(194, 194, 194)))
preview_3 = CustomPreview(Geometry=contour_2, Material=ColourSwatch(SwatchColor=RGB(0, 0, 0)))

geo_14 = Geometry(geo_13)
pull = PullPoint(Point=fieldpts.PTS, Geometry=geo_14, ClosestOnly=True)  # -> ClosestPoint, Distance
pdecon_2 = Deconstruct(Point=fieldpts.PTS)  # -> XComponent, YComponent, ZComponent
pdecon_3 = Deconstruct(Point=pull.ClosestPoint)  # -> XComponent, YComponent, ZComponent
smaller = SmallerThan(FirstNumber=pdecon_2.ZComponent, SecondNumber=pdecon_3.ZComponent)  # -> SmallerThan, OrEqualTo
dispatch = Dispatch(List=pull.Distance, DispatchPattern=smaller.SmallerThan)  # -> ListA, ListB
dom_2 = ConstructDomain(DomainStart=Slider(1, range=0..1), DomainEnd=Slider(0, range=0..100))
bnd_3 = Bounds(Numbers=dispatch.ListB)
remap = RemapNumbers(Value=dispatch.ListB, Source=bnd_3, Target=dom_2)  # -> Mapped, Clipped
lng_3 = ListLength(List=dispatch.ListA)
repeat = RepeatData(Data=Slider(0, range=0..100), Length=lng_3)
graph = GraphMapper(
    remap.Mapped,
    x0=0,
    x1=1,
    y0=0,
    y1=1,
    container_name="Bezier",
    cpx=[0, 0.6471909881, 0.9011235833, 1],
    cpy=[0, 0.07142859697, 0.428571403, 1])
weave = Weave(Pattern=smaller.SmallerThan, Stream0=graph, Stream1=repeat, NullGaps=False)

geo_15 = Geometry(geo_13)
project_5 = Project(Curve=project_4, Brep=geo_15, Direction=Vector(0, 0, 1))
pt_8 = Point(fieldpts.PTS)
pull_2 = PullPoint(Point=pt_8, Geometry=flatten(project_5), ClosestOnly=True)  # -> ClosestPoint, Distance
dom_3 = ConstructDomain(DomainStart=Slider(1, range=0..1), DomainEnd=Slider(0, range=0..100))
bnd_4 = Bounds(Numbers=dispatch.ListB)
remap_2 = RemapNumbers(Value=pull_2.Distance, Source=bnd_4, Target=dom_3)  # -> Mapped, Clipped
graph_2 = GraphMapper(
    remap_2.Mapped,
    x0=0,
    x1=1,
    y0=0,
    y1=1,
    container_name="Bezier",
    cpx=[0, 0.6471909881, 0.9011235833, 1],
    cpy=[0, 0.07142859697, 0.428571403, 1])

pt_9 = Point(fieldpts.PTS)
geo_16 = Geometry(geo_13)
srf_cp = SurfaceClosestPoint(Point=pt_9, Surface=geo_16)  # -> Point, UVPoint, Distance
evalsrf = EvaluateSurface(Surface=geo_16, Point=srf_cp.UVPoint)  # -> Point, Normal, UDirection, VDirection, Frame
Z_4 = UnitZ(Factor=1)
angle_2 = Angle(VectorA=Z_4, VectorB=evalsrf.Normal)  # -> Angle, Reflex
bnd_5 = Bounds(Numbers=angle_2.Angle)
remap_3 = RemapNumbers(Value=angle_2.Angle, Source=bnd_5, Target="1 To 0")  # -> Mapped, Clipped
graph_3 = GraphMapper(remap_3.Mapped, x0=0, x1=1, y0=0, y1=1, container_name="Bezier", cpx=[0, 0.25, 0.75, 1], cpy=[0, 0.25, 0.75, 1])

gradient_2 = Gradient(LowerLimit=0, UpperLimit=1, Parameter=graph_2, stops=[0: RGB(0, 128, 0), 0.5: RGB(255, 255, 0), 1: RGB(255, 0, 0)])
preview_4 = CustomPreview(Geometry=pt_8, Material=gradient_2)

gradient_3 = Gradient(LowerLimit=0, UpperLimit=1, Parameter=graph_3, stops=[0: RGB(0, 128, 0), 0.5: RGB(255, 255, 0), 1: RGB(255, 0, 0)])
preview_5 = CustomPreview(Geometry=evalsrf.Point, Material=gradient_3)

gradient_4 = Gradient(LowerLimit=0, UpperLimit=1, Parameter=weave, stops=[0: RGB(0, 128, 0), 0.5: RGB(255, 255, 0), 1: RGB(255, 0, 0)])
preview_6 = CustomPreview(Geometry=fieldpts.PTS, Material=gradient_4)

multiplication = Multiplication(A=weave, B=graph_2, C=graph_3)

field = Wasp_Field(NAME="srfField", E_FIELD=fieldpts.E_FIELD, VAL=multiplication)  # -> FIELD; inputs VAL: list; plug-in component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

panel_8 = Panel("""SIDES>SIDES
TOP>BOTTOM
BOTTOM>TOP""")
rulegen_2 = Wasp_RulesGenerator(PART=part_5, GR=panel_8)  # -> R; inputs PART: list, SELF_P: Boolean, SELF_C: Boolean, TYP: Boolean, GR: list; plug-in component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
fieldaggregation = Wasp_FieldDrivenAggregation(PART=flatten(merge_2), N=Slider(265, range=0..1000), RULES=rulegen, FIELD=field, RESET=Button())  # -> AGGR, PART_OUT; inputs PART: list, PREV: list, N: Int32, RULES: list, FIELD: list, MODE: Int32, GC: list, RESET: Boolean; plug-in component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

partgeo = Wasp_GetPartGeometry(PART=fieldaggregation.PART_OUT)  # -> GEO; plug-in component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
angsplitmsh = AngleSplitMesh(Mesh=partgeo, Angle=0, Opposite=False)  # -> Split, R
medges_2 = MeshEdges(Mesh=angsplitmsh.Split)  # -> NakedEdges, InteriorEdges, NonManifoldEdges

gradient_5 = Gradient(
    LowerLimit=0,
    UpperLimit=1,
    Parameter=multiplication,
    stops=[0: RGB(0, 128, 0), 0.5: RGB(255, 255, 0), 1: RGB(255, 0, 0)])
preview_7 = CustomPreview(Geometry=fieldpts.PTS, Material=gradient_5)  # disabled

previewmat_4 = CustomPreviewMaterials(
    Geometry=partgeo,
    DiffuseColor=ColourSwatch(SwatchColor=RGBA(255, 255, 255, 204)),
    Transparency=Slider(0.589, range=0..1))
previewlw_4 = CustomPreviewLineweights(Geometry=medges_2.NakedEdges, Shader=ColourSwatch(SwatchColor=RGB(0, 0, 0)), Absolute=False)

lng_4 = ListLength(List=fieldaggregation.PART_OUT)
getattr_2 = Wasp_GetAttributeByName(PART=fieldaggregation.PART_OUT, ID="house")  # -> VAL; plug-in component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
random_2 = Random(Range=Slider(2, range=0..10), Number=lng_4, Seed=2, Integers=True)
merge_3 = Merge(
    Data1=ColourSwatch(SwatchColor=RGB(42, 181, 14)),
    Data2=ColourSwatch(SwatchColor=RGB(110, 255, 0)),
    Data3=ColourSwatch(SwatchColor=RGB(207, 255, 77)))
item_6 = ListItem(List=merge_3, Index=random_2, Wrap=True)
preview_8 = CustomPreview(Geometry=flatten(getattr_2), Material=item_6)
