# Grasshopper definition UnitsAggregationStudies_v2-AR.gh (Grasshopper 1.0.7)
# plug-ins: Human, Pufferfish, Speckle 2, MeshEdit Components, MetaHopper, treesloth01, ShapeDiverForGrasshopper, Rhino.Inside for Autodesk Revit

get_from = Panel("https://macad.speckle.xyz/streams/6ba03db5f8/commits/4bfdabba08")  # disabled
receive = Receive(
    Stream=get_from,
    AutoReceive=False,
    CurrentComponentState="expired",
    ExpandOutput=True,
    ReceiveOnOpen=False,
    ReceivedCommitId="4bfdabba08",
    StreamWrapper="https://macad.speckle.xyz/streams/6ba03db5f8/commits/4bfdabba08",
    selectedKitName="Objects")  # -> Info, CollectionType, Elements, Name; disabled
dso = DeconstructSpeckleObject(SpeckleObject=receive.Elements, selectedKitName="Objects")  # disabled
clean = CleanTree(RemoveNulls=True, RemoveInvalid=True, RemoveEmpty=True, Tree=dso)  # -> simplify(Tree); disabled
bang = ExplodeTree(Data=clean)  # -> Branch0, Branch1, Branch2, Branch3, Branch4, Branch5, Branch6, Branch7, Branch8; disabled
geo = Geometry(bang.Branch4)  # disabled
geo_2 = Geometry(bang.Branch1)  # disabled
sddp = ShapeDiverDocumentPayload()

# ----
# Enable To Upload Geomtry to Speckle Server
toggle = GroupToggle(ToggleActive=True, ToggleVisible=False)  # disabled
link_to_upload_to_our_speckle_server = Panel("https://macad.speckle.xyz/streams/4975f9f0a8/branches/students%2Fg06-site_locations")  # disabled
panel = Panel("SiteLocationSelection")  # disabled
send = Send(
    Stream=link_to_upload_to_our_speckle_server,
    Message=panel,
    AutoSend=False,
    CurrentComponentState="needs_input",
    KitName="Objects",
    UseDefaultCache=True,
    selectedKitName="Objects")  # disabled

# ----
# Get Topo from Speckle
panel_2 = Panel("https://macad.speckle.xyz/streams/4975f9f0a8/branches/site%2F00-federated-model")
receive_2 = Receive(
    Stream=panel_2,
    AutoReceive=False,
    CurrentComponentState="expired",
    ExpandOutput=True,
    LastInfoMessage="James McBennett @ 01/19/2024 01:06:29: Pushed 38 elements from Grasshopper. (id:b5d4e56588)",
    ReceiveOnOpen=False,
    ReceivedCommitId="b5d4e56588",
    StreamWrapper="https://macad.speckle.xyz/streams/4975f9f0a8/branches/site/00-federated-model",
    selectedKitName="Objects")  # -> Info, CollectionType, Elements, Info_2, Levels, Name, Types
dso_2 = DeconstructSpeckleObject(SpeckleObject=receive_2.Elements, selectedKitName="Objects")  # -> CollectionType, Elements, Name
dso_3 = DeconstructSpeckleObject(SpeckleObject=dso_2.Elements, selectedKitName="Objects")  # -> BaseGeometry, BaseLine, BuiltInCategory, Category, DisplayValue, ElementId, IsRevitLinkedModel, Label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
clean_2 = CleanTree(RemoveNulls=True, RemoveInvalid=True, RemoveEmpty=True, Tree=dso_3.BaseLine)
clean_3 = CleanTree(RemoveNulls=True, RemoveInvalid=True, RemoveEmpty=True, Tree=dso_3.DisplayValue)  # -> flatten(Tree)
previewlw = CustomPreviewLineweights(Geometry=clean_2, Shader=ColourSwatch(SwatchColor=RGB(138, 138, 138)), Absolute=False)
item = ListItem(List=clean_3, Index=Slider(0, range=0..2), Wrap=True)

# ----
# Get SiteLocation from Speckle
panel_3 = Panel("https://macad.speckle.xyz/streams/4975f9f0a8/commits/6c185bed15")
receive_3 = Receive(
    Stream=panel_3,
    AutoReceive=False,
    CurrentComponentState="expired",
    ExpandOutput=True,
    LastInfoMessage="James McBennett @ 01/20/2024 17:54:06: Pushed 5 elements from Grasshopper. (id:6c185bed15)",
    ReceiveOnOpen=False,
    ReceivedCommitId="6c185bed15",
    StreamWrapper="https://macad.speckle.xyz/streams/4975f9f0a8/commits/6c185bed15",
    selectedKitName="Objects")  # -> Info, Data
dso_4 = DeconstructSpeckleObject(SpeckleObject=receive_3.Data, selectedKitName="Objects")  # -> GROUPNAME, SPHERELOCATION

mesh = Mesh(dso_4.SPHERELOCATION)
clean_4 = CleanTree(RemoveNulls=True, RemoveInvalid=True, RemoveEmpty=True, Tree=dso_3.DisplayValue)  # -> flatten(Tree)
volume = MeshVolume(Mesh=dso_4.SPHERELOCATION)  # -> Volume, Centroid

# ---- group: Site Contours
Z = UnitZ(Factor=expr("-x", Slider(353, range=0..10000)))
project = Project(Geometry=item, Plane=Z)  # -> Geometry, Transform
swatch = ColourSwatch(SwatchColor=RGB(64, 64, 64))
medges = MeshEdges(Mesh=project.Geometry)  # -> NakedEdges, InteriorEdges, NonManifoldEdges
contour = Contour(Shape=item, Point=Point(0, 0, 0), Direction=Vector(0, 0, 1), Distance="50")
previewlw_2 = CustomPreviewLineweights(Geometry=[contour, medges.NakedEdges], Shader=swatch, Absolute=False)

# ---- group: Populate surface
number_slider = Slider(51, range=0..100)  # disabled
popgeo = PopulateGeometry(Geometry=item, Count=number_slider, Seed=1)  # disabled
sph = Sphere(Base=popgeo, Radius=500)  # disabled
mesh_2 = Mesh(sph)  # disabled

# ----
mmx = MeshMesh(MeshA=item, MeshB=mesh)
divide = DivideCurve(Curve=mmx, Count=10, Kinks=False)  # -> Points, Tangents, Parameters
item_2 = ListItem(List=clean_4, Index=Slider(0, range=0..2), Wrap=True)

# ---- group: Site Perimeter Sphere
number_slider_2 = Slider(0.747, range=0..1)  # disabled
number_slider_3 = Slider(3, range=0..10)  # disabled
swatch_2 = ColourSwatch(SwatchColor=RGB(143, 26, 26))  # disabled
previewmat = CustomPreviewMaterials(Geometry=mesh, DiffuseColor=swatch_2, Transparency=number_slider_2)  # disabled
previewlw_3 = CustomPreviewLineweights(Geometry=mmx, Shader=swatch_2, Thickness=number_slider_3, Absolute=False)  # disabled

# ---- group: Height of side of full site
Z_2 = UnitZ(Factor=expr("-x", Slider(353, range=0..10000)))
project_2 = Project(Geometry=item_2, Plane=Z_2)  # -> Geometry, Transform
bbox = BoundingBox(Content=project_2.Geometry, Plane=PlaneXY(0, 0, 0))  # -> Box, Box_2
debrep = DeconstructBrep(Brep=bbox.Box)  # -> Faces, Edges, Vertices
Z_3 = UnitZ(Factor="10000")
move = Move(Geometry=debrep.Vertices, Motion=Z_3)  # -> Geometry, Transform
ln = Line(StartPoint=debrep.Vertices, EndPoint=move.Geometry)
mcx = MeshCurve(Mesh=item_2, Curve=ln)  # -> flatten(Points), Faces
ln_2 = Line(StartPoint=debrep.Vertices, EndPoint=mcx.Points)
len = Length(Curve=ln_2)
round = Round(Number=len)  # -> Nearest, Floor, Ceiling
midpt = CurveMiddle(Curve=ln_2)
concat = Concatenate(FragmentA=round.Nearest, FragmentB=" ", FragmentC="M")
tag = TextTag(Location=midpt, Text=concat, Colour=ColourSwatch(SwatchColor=RGB(64, 64, 64)))

# ---- group: Generate clean surface for aggregation
number_slider_4 = Slider(60, range=0..500)
dom = ConstructDomain(DomainStart=expr("-x", number_slider_4), DomainEnd=number_slider_4)
project_3 = Project(Geometry=volume.Centroid, Plane=PlaneXY(0, 0, 0))  # -> Geometry, Transform
rectangle = Rectangle(Plane=project_3.Geometry, XSize=dom, YSize=dom, Radius=0)  # -> Rectangle, Length
number_slider_5 = Slider(30, range=0..100)
msplit = MeshSplit(Mesh=item_2, Splitters=mesh)
sdivide = DivideSurface(Surface=rectangle.Rectangle, UCount=number_slider_5, VCount=number_slider_5)  # -> Points, Normals, Parameters
item_3 = ListItem(List=msplit, Index=Slider(1, range=0..1), Wrap=True)
line = LineSDL(Start=sdivide.Points, Direction=Vector(0, 0, 1), Length="10000")
mcx_2 = MeshCurve(Mesh=item_3, Curve=line)  # -> flatten(Points), Faces
srfgrid = SurfaceFromPoints(Points=mcx_2.Points, UCount=expr("x+1", number_slider_5), Interpolate=False)
previewmat_2 = CustomPreviewMaterials(Geometry=srfgrid, DiffuseColor=RGB(255, 255, 255), Transparency=Slider(0.772, range=0..1))

# ----
pdecon = Deconstruct(Point=divide.Points)  # -> XComponent, YComponent, ZComponent
bnd = Bounds(Numbers=pdecon.ZComponent)
panel_4 = Panel(bnd)
dedomain = DeconstructDomain(Domain=bnd)  # -> Start, End
equals = Equality(FirstNumber=pdecon.ZComponent, SecondNumber=dedomain.Start)  # -> Equality, Inequality
cull = CullPattern(List=divide.Points, CullPattern=equals.Equality)  # -> flatten(List)
vec2pt = Vector2Pt(PointA=volume.Centroid, PointB=cull, Unitize=False)  # -> Vector, Length
vec2pt_2 = Vector2Pt(PointA=volume.Centroid, PointB=cull, Unitize=False)  # -> Vector, Length
angle = Angle(VectorA=vec2pt.Vector, VectorB=vec2pt_2.Vector)  # -> Angle, Reflex
deg = Degrees(Radians=angle.Reflex)
abs = Absolute(Value=deg)
subtraction = Subtraction(A="360", B=abs)

number_slider_6 = Slider(0.25, range=0..1)
wires = BrepWireframe(Brep=srfgrid, Density=-1)
previewlw_4 = CustomPreviewLineweights(Geometry=wires, Shader=swatch, Absolute=False)

# ---- group: populate site with 50 possible locations
popgeo_2 = PopulateGeometry(Geometry=item, Count=Slider(50, range=0..100), Seed=1)
sph_2 = Sphere(Base=popgeo_2, Radius=500)
mesh_3 = Mesh(sph_2)
mmx_2 = MeshMesh(MeshA=item, MeshB=mesh_3)  # -> flatten(Intersections)
volume_2 = MeshVolume(Mesh=mesh_3)  # -> Volume, Centroid
project_4 = Project(Geometry=mmx_2, Plane=PlaneXY(0, 0, 0))  # -> Geometry, Transform
Z_4 = UnitZ(Factor=expr("-x", "10000"))
move_2 = Move(Geometry=project_4.Geometry, Motion=Z_4)  # -> Geometry, Transform
divide_2 = DivideCurve(Curve=move_2.Geometry, Count=4, Kinks=False)  # -> Points, Tangents, Parameters
item_4 = ListItem(List=divide_2.Points, Index=0, Wrap=True)
ln_3 = Line(StartPoint=flatten(item_4), EndPoint=volume_2.Centroid)

# ----
# SITE SELECTION BASED ON SLOPE CONSTRAINTS
select_slope_for_main_site_limit = Panel("30")

divide_3 = DivideCurve(Curve=flatten(mmx_2), Count=10, Kinks=False)  # -> Points, Tangents, Parameters
pdecon_2 = Deconstruct(Point=divide_3.Points)  # -> XComponent, YComponent, ZComponent
bnd_2 = Bounds(Numbers=pdecon_2.ZComponent)
dedomain_2 = DeconstructDomain(Domain=bnd_2)  # -> Start, End
equals_2 = Equality(FirstNumber=pdecon_2.ZComponent, SecondNumber=dedomain_2.Start)  # -> Equality, Inequality
cull_2 = CullPattern(List=divide_3.Points, CullPattern=equals_2.Equality)  # -> flatten(List)

# ---- group: get slope angle of all main sites
pt = Point(volume_2.Centroid)
pt_2 = Point(cull_2)

Z_5 = UnitZ(Factor="10000")
move_3 = Move(Geometry=pt_2, Motion=Z_5)  # -> Geometry, Transform
ln_4 = Line(StartPoint=pt_2, EndPoint=move_3.Geometry)
crv_cp = CurveClosestPoint(Point=pt, Curve=ln_4)  # -> Point, Parameter, Distance
vec2pt_3 = Vector2Pt(PointA=pt, PointB=crv_cp.Point, Unitize=False)  # -> Vector, Length
vec2pt_4 = Vector2Pt(PointA=pt, PointB=pt_2, Unitize=False)  # -> Vector, Length
angle_2 = Angle(VectorA=vec2pt_4.Vector, VectorB=vec2pt_3.Vector)  # -> Angle, Reflex
deg_2 = Degrees(Radians=angle_2.Angle)
int = Integer(deg_2)

# ---- group: Dispatch locations based on set degree limit of slope and picks the best 3 options
smaller = SmallerThan(FirstNumber=int, SecondNumber=expr("x+0.2", select_slope_for_main_site_limit))  # -> SmallerThan, OrEqualTo
dispatch = Dispatch(List=mmx_2, DispatchPattern=smaller.SmallerThan)  # -> ListA, ListB
project_5 = Project(Geometry=dispatch.ListA, Plane=PlaneXY(0, 0, 0))  # -> Geometry, Transform
len_2 = Length(Curve=project_5.Geometry)
sort = SortList(Keys=len_2, ValuesA=dispatch.ListA)  # -> Keys, reverse(ValuesA)
panel_5 = Panel("""0
1
2""")
item_5 = ListItem(List=sort.ValuesA, Index=panel_5, Wrap=True)

# ---- group: ROAD CURVES
crv = Curve(<curve referenced from the Rhino model>)

# ----
# Press the button to make sure the file is
# updated to latest Wasp version on your pc.
button = Button()
updatefile = Wasp_UpdateFile(UPDATE=button)  # -> LOG; inputs UPDATE: Boolean; plug-in component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

project_6 = Project(Curve=crv, Brep=srfgrid, Direction=Vector(0, 0, 1))
number_slider_7 = Slider(0.4, range=0..1)
len_3 = Length(Curve=ln_3)
swatch_3 = ColourSwatch(SwatchColor=RGB(64, 64, 64))
number_slider_8 = Slider(0.4, range=0..1)
shatter = Shatter()
midpt_2 = CurveMiddle(Curve=ln_3)
roundd = RoundToDecimalPlace(NumberX=len_3, DecimalPlace="1", RoundType=0)  # -> Rounded, Difference
previewlw_5 = CustomPreviewLineweights(Geometry=flatten(ln_3), Shader=swatch_3, Absolute=False)
tag_2 = TextTag(Location=midpt_2, Text=roundd.Rounded, Colour=swatch_3)

# ---- group: M4
crv_2 = Curve([<curve referenced from the Rhino model> x2])
geo_3 = Geometry(<brep referenced from the Rhino model>)
pt_3 = Point([<point referenced from the Rhino model> x2])
points = PointList(Points=pt_3, Size=number_slider_7)
stack = StackTrees(Data0=geo_3, Data1=pt_3, Data2=crv_2, Reduce=True)

# ---- group: M3
geo_4 = Geometry(<brep referenced from the Rhino model>)
crv_3 = Curve([<curve referenced from the Rhino model> x3])
pt_4 = Point([<point referenced from the Rhino model> x3])
points_2 = PointList(Points=pt_4, Size=number_slider_7)
stack_2 = StackTrees(Data0=geo_4, Data1=pt_4, Data2=crv_3, Reduce=True)

# ---- group: M1
geo_5 = Geometry(<brep referenced from the Rhino model>)
pt_5 = Point(<point referenced from the Rhino model>)
crv_4 = Curve(<curve referenced from the Rhino model>)
points_3 = PointList(Points=pt_5, Size=number_slider_7)
stack_3 = StackTrees(Data0=geo_5, Data1=pt_5, Data2=crv_4, Reduce=True)

# ---- group: M2
geo_6 = Geometry(<brep referenced from the Rhino model>)
pt_6 = Point([<point referenced from the Rhino model> x2])
crv_5 = Curve([<curve referenced from the Rhino model> x2])
points_4 = PointList(Points=pt_6, Size=number_slider_7)
stack_4 = StackTrees(Data0=geo_6, Data1=pt_6, Data2=crv_5, Reduce=True)

# ---- group: M3
geo_7 = Geometry(<brep referenced from the Rhino model>)
crv_6 = Curve([<curve referenced from the Rhino model> x3])
pt_7 = Point([<point referenced from the Rhino model> x3])
points_5 = PointList(Points=pt_7, Size=number_slider_7)
stack_5 = StackTrees(Data0=geo_7, Data1=pt_7, Data2=crv_6, Reduce=True)

# ---- group: M4
geo_8 = Geometry(<brep referenced from the Rhino model>)
pt_8 = Point([<point referenced from the Rhino model> x2])
crv_7 = Curve([<curve referenced from the Rhino model> x2])
points_6 = PointList(Points=pt_8, Size=number_slider_7)
stack_6 = StackTrees(Data0=geo_8, Data1=pt_8, Data2=crv_7, Reduce=True)

# ---- group: M1
geo_9 = Geometry(<brep referenced from the Rhino model>)
pt_9 = Point([<point referenced from the Rhino model> x3])
crv_8 = Curve([<curve referenced from the Rhino model> x3])
points_7 = PointList(Points=pt_9, Size=number_slider_8)
stack_7 = StackTrees(Data0=geo_9, Data1=pt_9, Data2=crv_8, Reduce=True)

# ---- group: M2
geo_10 = Geometry(<brep referenced from the Rhino model>)
pt_10 = Point([<point referenced from the Rhino model> x2])
crv_9 = Curve([<curve referenced from the Rhino model> x2])
points_8 = PointList(Points=pt_10, Size=number_slider_8)
stack_8 = StackTrees(Data0=geo_10, Data1=pt_10, Data2=crv_9, Reduce=True)

# ---- group: M3
geo_11 = Geometry(<brep referenced from the Rhino model>)
crv_10 = Curve([<curve referenced from the Rhino model> x2])
pt_11 = Point([<point referenced from the Rhino model> x2])
points_9 = PointList(Points=pt_11, Size=number_slider_8)
stack_9 = StackTrees(Data0=geo_11, Data1=pt_11, Data2=crv_10, Reduce=True)

# ---- group: M4
geo_12 = Geometry(<brep referenced from the Rhino model>)
pt_12 = Point([<point referenced from the Rhino model> x2])
crv_11 = Curve([<curve referenced from the Rhino model> x2])
points_10 = PointList(Points=pt_12, Size=number_slider_8)
stack_10 = StackTrees(Data0=geo_12, Data1=pt_12, Data2=crv_11, Reduce=True)

# ----
volume_3 = Volume(Geometry=geo_6)  # -> Volume, Centroid
bang_2 = ExplodeTree(Data=stack_4)  # -> Branch0, Branch1, Branch2
conndir = Wasp_ConnectionFromDirection(GEO=bang_2.Branch0, CEN=bang_2.Branch1, UP=bang_2.Branch2)  # -> CONN, PLN_OUT; inputs CEN: list of Point3d, UP: list of Curve, T: list; plug-in component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
tag_3 = TextTag(Location=volume_3.Centroid, Text="KIT")
geo_13 = Geometry()
attribute = Wasp_Attribute(ID="KIT", VAL=geo_13, TR=Toggle(True))  # -> ATTR; inputs VAL: list, TR: Boolean; plug-in component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
part = Wasp_BasicPart(NAME="KIT", GEO=bang_2.Branch0, CONN=flatten(conndir.CONN))  # -> PART; inputs GEO: Mesh, CONN: list, ATTR: list; plug-in component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

volume_4 = Volume(Geometry=geo_7)  # -> Volume, Centroid
bang_3 = ExplodeTree(Data=stack_5)  # -> Branch0, Branch1, Branch2
conndir_2 = Wasp_ConnectionFromDirection(GEO=bang_3.Branch0, CEN=bang_3.Branch1, UP=bang_3.Branch2)  # -> CONN, PLN_OUT; inputs CEN: list of Point3d, UP: list of Curve, T: list; plug-in component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
geo_14 = Geometry()
tag_4 = TextTag(Location=volume_4.Centroid, Text="VOID1")
attribute_2 = Wasp_Attribute(ID="VOID1", VAL=geo_14, TR=Toggle(True))  # -> ATTR; inputs VAL: list, TR: Boolean; plug-in component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
part_2 = Wasp_BasicPart(NAME="VOID1", GEO=bang_3.Branch0, CONN=flatten(conndir_2.CONN))  # -> PART; inputs GEO: Mesh, CONN: list, ATTR: list; plug-in component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

volume_5 = Volume(Geometry=geo_4)  # -> Volume, Centroid
bang_4 = ExplodeTree(Data=stack_2)  # -> Branch0, Branch1, Branch2
conndir_3 = Wasp_ConnectionFromDirection(GEO=bang_4.Branch0, CEN=bang_4.Branch1, UP=bang_4.Branch2)  # -> CONN, PLN_OUT; inputs CEN: list of Point3d, UP: list of Curve, T: list; plug-in component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
geo_15 = Geometry()
tag_5 = TextTag(Location=volume_5.Centroid, Text="CIR1")
attribute_3 = Wasp_Attribute(ID="CIR1", VAL=geo_15, TR=Toggle(True))  # -> ATTR; inputs VAL: list, TR: Boolean; plug-in component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
part_3 = Wasp_BasicPart(NAME="CIR1", GEO=bang_4.Branch0, CONN=flatten(conndir_3.CONN))  # -> PART; inputs GEO: Mesh, CONN: list, ATTR: list; plug-in component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

volume_6 = Volume(Geometry=geo_8)  # -> Volume, Centroid
bang_5 = ExplodeTree(Data=stack_6)  # -> Branch0, Branch1, Branch2
conndir_4 = Wasp_ConnectionFromDirection(GEO=bang_5.Branch0, CEN=bang_5.Branch1, UP=bang_5.Branch2)  # -> CONN, PLN_OUT; inputs CEN: list of Point3d, UP: list of Curve, T: list; plug-in component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
geo_16 = Geometry()
tag_6 = TextTag(Location=volume_6.Centroid, Text="CIR2")
attribute_4 = Wasp_Attribute(ID="CIR2", VAL=geo_16, TR=Toggle(True))  # -> ATTR; inputs VAL: list, TR: Boolean; plug-in component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
part_4 = Wasp_BasicPart(NAME="CIR2", GEO=bang_5.Branch0, CONN=flatten(conndir_4.CONN))  # -> PART; inputs GEO: Mesh, CONN: list, ATTR: list; plug-in component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

volume_7 = Volume(Geometry=geo_3)  # -> Volume, Centroid
bang_6 = ExplodeTree(Data=stack)  # -> Branch0, Branch1, Branch2
conndir_5 = Wasp_ConnectionFromDirection(GEO=bang_6.Branch0, CEN=bang_6.Branch1, UP=bang_6.Branch2)  # -> CONN, PLN_OUT; inputs CEN: list of Point3d, UP: list of Curve, T: list; plug-in component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
geo_17 = Geometry()
tag_7 = TextTag(Location=volume_7.Centroid, Text="VOID2")
attribute_5 = Wasp_Attribute(ID="VOID2", VAL=geo_17, TR=Toggle(True))  # -> ATTR; inputs VAL: list, TR: Boolean; plug-in component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
part_5 = Wasp_BasicPart(NAME="VOID2", GEO=bang_6.Branch0, CONN=flatten(conndir_5.CONN))  # -> PART; inputs GEO: Mesh, CONN: list, ATTR: list; plug-in component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

bang_7 = ExplodeTree(Data=stack_8)  # -> Branch0, Branch1, Branch2
conndir_6 = Wasp_ConnectionFromDirection(GEO=bang_7.Branch0, CEN=bang_7.Branch1, UP=bang_7.Branch2)  # -> CONN, PLN_OUT; inputs CEN: list of Point3d, UP: list of Curve, T: list; plug-in component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
geo_18 = Geometry()
attribute_6 = Wasp_Attribute(ID="KIT", VAL=geo_18, TR=Toggle(True))  # -> ATTR; inputs VAL: list, TR: Boolean; plug-in component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
part_6 = Wasp_BasicPart(NAME="KIT", GEO=bang_7.Branch0, CONN=flatten(conndir_6.CONN))  # -> PART; inputs GEO: Mesh, CONN: list, ATTR: list; plug-in component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

bang_8 = ExplodeTree(Data=stack_9)  # -> Branch0, Branch1, Branch2
conndir_7 = Wasp_ConnectionFromDirection(GEO=bang_8.Branch0, CEN=bang_8.Branch1, UP=bang_8.Branch2)  # -> CONN, PLN_OUT; inputs CEN: list of Point3d, UP: list of Curve, T: list; plug-in component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
geo_19 = Geometry()
attribute_7 = Wasp_Attribute(ID="CIR1", VAL=geo_19, TR=Toggle(True))  # -> ATTR; inputs VAL: list, TR: Boolean; plug-in component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
part_7 = Wasp_BasicPart(NAME="CIR1", GEO=bang_8.Branch0, CONN=flatten(conndir_7.CONN))  # -> PART; inputs GEO: Mesh, CONN: list, ATTR: list; plug-in component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

bang_9 = ExplodeTree(Data=stack_10)  # -> Branch0, Branch1, Branch2
conndir_8 = Wasp_ConnectionFromDirection(GEO=bang_9.Branch0, CEN=bang_9.Branch1, UP=bang_9.Branch2)  # -> CONN, PLN_OUT; inputs CEN: list of Point3d, UP: list of Curve, T: list; plug-in component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
geo_20 = Geometry()
attribute_8 = Wasp_Attribute(ID="CIR2", VAL=geo_20, TR=Toggle(True))  # -> ATTR; inputs VAL: list, TR: Boolean; plug-in component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
part_8 = Wasp_BasicPart(NAME="CIR2", GEO=bang_9.Branch0, CONN=flatten(conndir_8.CONN))  # -> PART; inputs GEO: Mesh, CONN: list, ATTR: list; plug-in component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

volume_8 = Volume(Geometry=geo_5)  # -> Volume, Centroid
bang_10 = ExplodeTree(Data=stack_3)  # -> Branch0, Branch1, Branch2
conndir_9 = Wasp_ConnectionFromDirection(GEO=bang_10.Branch0, CEN=bang_10.Branch1, UP=bang_10.Branch2)  # -> CONN, PLN_OUT; inputs CEN: list of Point3d, UP: list of Curve, T: list; plug-in component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
tag_8 = TextTag(Location=volume_8.Centroid, Text="MECH")
geo_21 = Geometry(<brep referenced from the Rhino model>)
attribute_9 = Wasp_Attribute(ID="MECHd", VAL=geo_21, TR=Toggle(True))  # -> ATTR; inputs VAL: list, TR: Boolean; plug-in component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
part_9 = Wasp_BasicPart(NAME="MECH", GEO=bang_10.Branch0, CONN=flatten(conndir_9.CONN))  # -> PART; inputs GEO: Mesh, CONN: list, ATTR: list; plug-in component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

bang_11 = ExplodeTree(Data=stack_7)  # -> Branch0, Branch1, Branch2
conndir_10 = Wasp_ConnectionFromDirection(GEO=bang_11.Branch0, CEN=bang_11.Branch1, UP=bang_11.Branch2)  # -> CONN, PLN_OUT; inputs CEN: list of Point3d, UP: list of Curve, T: list; plug-in component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
geo_22 = Geometry(<brep referenced from the Rhino model>)
attribute_10 = Wasp_Attribute(ID="MECHd", VAL=geo_22, TR=Toggle(True))  # -> ATTR; inputs VAL: list, TR: Boolean; plug-in component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
part_10 = Wasp_BasicPart(NAME="MECH", GEO=bang_11.Branch0, CONN=flatten(conndir_10.CONN), ATTR=attribute_10)  # -> PART; inputs GEO: Mesh, CONN: list, ATTR: list; plug-in component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

previewlw_6 = CustomPreviewLineweights(Geometry=mmx_2, Shader=ColourSwatch(SwatchColor=RGB(143, 26, 26)), Thickness=Slider(3, range=0..10), Absolute=False)
merge = Merge(Data1=part_9, Data2=part, Data3=part_2, Data4=part_4, Data5=part_3, Data6=part_5)
merge_2 = Merge(Data1=part_10, Data2=part_6, Data3=part_7, Data4=part_8)
panel_6 = Panel("""MECH|0_CIR2|1
CRIT2|0_VOID1|0
VOID1|1_VOID2|1
VOID1|2_KIT|1
VOID2|0_CIR1|2
KIT|0_CIR1|1""")
toggle_2 = BooleanToggle(False)
rulegen = Wasp_RulesGenerator(PART=merge, SELF_P=toggle_2)  # -> R; inputs PART: list, SELF_P: Boolean, SELF_C: Boolean, TYP: Boolean, GR: list; plug-in component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
ruletxt = Wasp_RuleFromText(TXT=panel_6)  # -> R; plug-in component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
stochasticaggregation = Wasp_StochasticAggregation(PART=flatten(merge), N=Slider(6, range=1..50), RULES=rulegen, RESET=Button())  # -> AGGR, PART_OUT; inputs PART: list, PREV: list, N: Int32, RULES: list, SEED: Int32, MODE: Int32, GC: list, RESET: Boolean; disabled; plug-in component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
number_slider_9 = Slider(0.25, range=0..1)  # disabled

series = Series(Start=0, Step=1, Count="3")
bnd_3 = Bounds(Numbers=series)
dedomain_3 = DeconstructDomain(Domain=bnd_3)  # -> Start, End
gradient = Gradient(
    LowerLimit=dedomain_3.Start,
    UpperLimit=dedomain_3.End,
    Parameter=series,
    stops=[0.15: RGB(255, 130, 160), 0.85: RGB(220, 0, 40)])
lng = ListLength(List=stochasticaggregation.PART_OUT)
getattr = Wasp_GetAttributeByName(PART=part_9, ID="MECH")  # -> VAL; plug-in component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
random = Random(Range=Slider(2, range=0..10), Number=lng, Seed=2, Integers=True)
item_6 = ListItem(List=gradient, Index=random, Wrap=True)
preview = CustomPreview(Geometry=flatten(getattr), Material=item_6)

number_slider_10 = Slider(0.589, range=0..1)
swatch_4 = ColourSwatch(SwatchColor=RGBA(255, 255, 255, 204))
swatch_5 = ColourSwatch(SwatchColor=RGB(0, 0, 0))

angsplitmsh = AngleSplitMesh(Mesh=[geo_5, geo_6, geo_7, geo_8, geo_4, geo_3], Angle=0, Opposite=False)  # -> Split, R
medges_2 = MeshEdges(Mesh=angsplitmsh.Split)  # -> NakedEdges, InteriorEdges, NonManifoldEdges
previewmat_3 = CustomPreviewMaterials(Geometry=[geo_5, geo_6, geo_7, geo_8, geo_4, geo_3], DiffuseColor=swatch_4, Transparency=number_slider_10)  # disabled
previewlw_7 = CustomPreviewLineweights(Geometry=medges_2.NakedEdges, Shader=swatch_5, Absolute=False)  # disabled

# ---- group: Create new sheets based on list
drawings = Panel("""Site Plan
Floor Plan
Section
Elevation""")  # disabled
toggle_3 = BooleanToggle(False)  # disabled
lng_2 = ListLength(List=drawings)  # disabled
series_2 = Series(Start=101, Step=1, Count=lng_2)  # disabled
panel_7 = Panel("-")  # disabled
panel_8 = Panel("A")  # disabled
filter = StreamFilter(Gate=toggle_3, Stream1=drawings)  # disabled
concat_2 = Concatenate(FragmentA=panel_8, FragmentC=panel_7, FragmentB=series_2)  # disabled
sheet = AddSheet(SheetNumber=concat_2, SheetName=filter, TrackingMode=2)  # disabled

# ---- group: Aggregation 1
geo_23 = Geometry([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])  # disabled

# ---- group: Aggregation 2
geo_24 = Geometry()  # disabled

# ----
panel_9 = Panel(rulegen)

# ---- group: Aggregation
m_shape = AddDirectShapeMesh(Mesh=geo_23, TrackingMode=2)  # disabled

# ----
m_shape_2 = AddDirectShapeMesh(Mesh=geo_24, TrackingMode=2)  # disabled
sheets = QuerySheets(Placeholder=False, AppearsInSheetList=True, Assembly=null)  # disabled
views = QueryViews(IsDependent=False, IsTemplate=False)  # disabled
number_slider_11 = Slider(101, range=0..1000)  # disabled
value_picker = ValuePicker(sheets)  # disabled
value_picker_2 = ValuePicker(views, SearchPattern="SECTIONS")  # disabled
revisions = QueryRevisions()  # disabled
revision = Revision(revisions)  # disabled
panel_10 = Panel(views)  # disabled
crv_12 = Curve(<curve referenced from the Rhino model>)  # disabled
item_7 = ListItem(List=drawings, Index=0, Wrap=True)  # -> Item, Item1, Item2, Item3; disabled
line_2 = Line(crv_12)  # disabled
param = ElementParameter()  # -> Element, Value; disabled
sectionview = AddSectionView(Frame=line_2, Name=item_7.Item2, TrackingMode=2)  # disabled
passport = ElementPassport(Element=sectionview)  # -> DocumentGUID, Document, UniqueID, Id; disabled
e_name = ElementName(Element=sectionview)  # -> Element, Name; disabled
e_category = ElementCategory(Element=sectionview)  # -> Element, Category; disabled
e_type = ElementType(Element=sectionview)  # -> Element, Type; disabled
inspect = InspectElement(Element=sectionview)  # -> OtherFolder, OtherSRViewCalculationSettings, OtherSubfolder, OtherNone, DataBIG_Views_Exchange, GraphicsColorSchemeLocation, GraphicsHideAtScalesCoarserThan, GraphicsDefaultAnalysisDisplayStyle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; disabled
panel_11 = Panel(inspect.IdentityDataTitleOnSheet)  # disabled
panel_12 = Panel(inspect.IdentityDataViewName)  # disabled
panel_13 = Panel(inspect.GraphicsViewScale)  # disabled
panel_14 = Panel(inspect.PhasingPhase)  # disabled

geo_25 = Geometry(srfgrid)
bbox_2 = BoundingBox(Content=geo_25, Plane=PlaneXY(0, 0, 0))  # -> Box, Box_2
volume_9 = Volume(Geometry=bbox_2.Box)  # -> Volume, Centroid
scale_nu = ScaleNU(
    Geometry=bbox_2.Box,
    Plane=volume_9.Centroid,
    ScaleX=Slider(1, range=0..10),
    ScaleY=Slider(1, range=0..10),
    ScaleZ=Slider(1, range=0..10))  # -> Geometry, Transform
fieldpts = Wasp_FieldPoints(BOU=scale_nu.Geometry, RES=Slider(2.5, range=0..10))  # -> E_FIELD, PTS; inputs BOU: list of Mesh, PLN: Plane; plug-in component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

contour_2 = Contour(Shape=geo_25, Point=Point(0, 0, 0), Direction=Vector(0, 0, 1), Distance=Slider(0.5, range=0..1))
preview_2 = CustomPreview(Geometry=contour_2, Material=ColourSwatch(SwatchColor=RGB(0, 0, 0)))

geo_26 = Geometry(geo_25)
pull = PullPoint(Point=fieldpts.PTS, Geometry=geo_26, ClosestOnly=True)  # -> ClosestPoint, Distance
pdecon_3 = Deconstruct(Point=fieldpts.PTS)  # -> XComponent, YComponent, ZComponent
pdecon_4 = Deconstruct(Point=pull.ClosestPoint)  # -> XComponent, YComponent, ZComponent
smaller_2 = SmallerThan(FirstNumber=pdecon_3.ZComponent, SecondNumber=pdecon_4.ZComponent)  # -> SmallerThan, OrEqualTo
dispatch_2 = Dispatch(List=pull.Distance, DispatchPattern=smaller_2.SmallerThan)  # -> ListA, ListB
dom_2 = ConstructDomain(DomainStart=Slider(1, range=0..1), DomainEnd=Slider(0, range=0..100))
bnd_4 = Bounds(Numbers=dispatch_2.ListB)
remap = RemapNumbers(Value=dispatch_2.ListB, Source=bnd_4, Target=dom_2)  # -> Mapped, Clipped
lng_3 = ListLength(List=dispatch_2.ListA)
repeat = RepeatData(Data=Slider(0, range=0..100), Length=lng_3)
graph = GraphMapper(
    remap.Mapped,
    x0=0,
    x1=1,
    y0=0,
    y1=1,
    container_name="Bezier",
    cpx=[0, 0.6471909881, 0.9011235833, 1],
    cpy=[0, 0.07142859697, 0.428571403, 1])
weave = Weave(Pattern=smaller_2.SmallerThan, Stream0=graph, Stream1=repeat, NullGaps=False)

geo_27 = Geometry(geo_25)
project_7 = Project(Curve=project_6, Brep=geo_27, Direction=Vector(0, 0, 1))
pt_13 = Point(fieldpts.PTS)
pull_2 = PullPoint(Point=pt_13, Geometry=flatten(project_7), ClosestOnly=True)  # -> ClosestPoint, Distance
dom_3 = ConstructDomain(DomainStart=Slider(1, range=0..1), DomainEnd=Slider(0, range=0..100))
bnd_5 = Bounds(Numbers=dispatch_2.ListB)
remap_2 = RemapNumbers(Value=pull_2.Distance, Source=bnd_5, Target=dom_3)  # -> Mapped, Clipped
graph_2 = GraphMapper(
    remap_2.Mapped,
    x0=0,
    x1=1,
    y0=0,
    y1=1,
    container_name="Bezier",
    cpx=[0, 0.6471909881, 0.9011235833, 1],
    cpy=[0, 0.07142859697, 0.428571403, 1])

pt_14 = Point(fieldpts.PTS)
geo_28 = Geometry(geo_25)
srf_cp = SurfaceClosestPoint(Point=pt_14, Surface=geo_28)  # -> Point, UVPoint, Distance
evalsrf = EvaluateSurface(Surface=geo_28, Point=srf_cp.UVPoint)  # -> Point, Normal, UDirection, VDirection, Frame
Z_6 = UnitZ(Factor=1)
angle_3 = Angle(VectorA=Z_6, VectorB=evalsrf.Normal)  # -> Angle, Reflex
bnd_6 = Bounds(Numbers=angle_3.Angle)
remap_3 = RemapNumbers(Value=angle_3.Angle, Source=bnd_6, Target="1 To 0")  # -> Mapped, Clipped
graph_3 = GraphMapper(remap_3.Mapped, x0=0, x1=1, y0=0, y1=1, container_name="Bezier", cpx=[0, 0.25, 0.75, 1], cpy=[0, 0.25, 0.75, 1])

gradient_2 = Gradient(LowerLimit=0, UpperLimit=1, Parameter=graph_2, stops=[0: RGB(0, 128, 0), 0.5: RGB(255, 255, 0), 1: RGB(255, 0, 0)])
preview_3 = CustomPreview(Geometry=pt_13, Material=gradient_2)

gradient_3 = Gradient(LowerLimit=0, UpperLimit=1, Parameter=graph_3, stops=[0: RGB(0, 128, 0), 0.5: RGB(255, 255, 0), 1: RGB(255, 0, 0)])
preview_4 = CustomPreview(Geometry=evalsrf.Point, Material=gradient_3)

gradient_4 = Gradient(LowerLimit=0, UpperLimit=1, Parameter=weave, stops=[0: RGB(0, 128, 0), 0.5: RGB(255, 255, 0), 1: RGB(255, 0, 0)])
preview_5 = CustomPreview(Geometry=fieldpts.PTS, Material=gradient_4)  # disabled

multiplication = Multiplication(A=weave, B=graph_2, C=graph_3)

field = Wasp_Field(NAME="srfField", E_FIELD=fieldpts.E_FIELD, VAL=multiplication)  # -> FIELD; inputs VAL: list; plug-in component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

number_slider_12 = Slider(338, range=0..1000)
panel_16 = Panel("""SIDES>SIDES
TOP>BOTTOM
BOTTOM>TOP""")
rulegen_2 = Wasp_RulesGenerator(PART=merge, SELF_P=toggle_2)  # -> R; inputs PART: list, SELF_P: Boolean, SELF_C: Boolean, TYP: Boolean, GR: list; plug-in component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
fieldaggregation = Wasp_FieldDrivenAggregation(PART=flatten(merge), N=Slider(87, range=0..100), RULES=rulegen_2, FIELD=field, RESET=Button())  # -> AGGR, PART_OUT; inputs PART: list, PREV: list, N: Int32, RULES: list, FIELD: list, MODE: Int32, GC: list, RESET: Boolean; plug-in component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

gradient_5 = Gradient(
    LowerLimit=0,
    UpperLimit=1,
    Parameter=multiplication,
    stops=[0: RGB(0, 128, 0), 0.5: RGB(255, 255, 0), 1: RGB(255, 0, 0)])
preview_6 = CustomPreview(Geometry=fieldpts.PTS, Material=gradient_5)  # disabled

panel_17 = Panel(rulegen_2)
partgeo = Wasp_GetPartGeometry(PART=fieldaggregation.PART_OUT)  # -> GEO; plug-in component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
geo_29 = Geometry(partgeo)  # disabled
angsplitmsh_2 = AngleSplitMesh(Mesh=partgeo, Angle=0, Opposite=False)  # -> Split, R

number_slider_13 = Slider(2, range=0..10)  # disabled
panel_18 = Panel("house")  # disabled
swatch_6 = ColourSwatch(SwatchColor=RGB(42, 181, 14))  # disabled
swatch_7 = ColourSwatch(SwatchColor=RGB(207, 255, 77))  # disabled
swatch_8 = ColourSwatch(SwatchColor=RGB(110, 255, 0))  # disabled
lng_4 = ListLength(List=fieldaggregation.PART_OUT)  # disabled
getattr_2 = Wasp_GetAttributeByName(PART=fieldaggregation.PART_OUT, ID=panel_18)  # -> VAL; disabled; plug-in component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
random_2 = Random(Range=number_slider_13, Number=lng_4, Seed=2, Integers=True)  # disabled
merge_3 = Merge(Data1=swatch_6, Data2=swatch_8, Data3=swatch_7)  # disabled
item_8 = ListItem(List=merge_3, Index=random_2, Wrap=True)  # disabled
preview_7 = CustomPreview(Geometry=flatten(getattr_2), Material=item_8)  # disabled

medges_3 = MeshEdges(Mesh=angsplitmsh_2.Split)  # -> NakedEdges, InteriorEdges, NonManifoldEdges
getattr_3 = Wasp_GetAttributeByName(PART=fieldaggregation.PART_OUT, ID="MECH")  # -> VAL; plug-in component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
previewmat_4 = CustomPreviewMaterials(Geometry=partgeo, DiffuseColor=swatch_4, Transparency=number_slider_10)
previewlw_8 = CustomPreviewLineweights(Geometry=medges_3.NakedEdges, Shader=swatch_5, Absolute=False)
