# Grasshopper definition Units_interior_exterior_design_v2_Paula.gh (Grasshopper 1.0.7)
# plug-ins: Kangaroo2 Components, Bifocals, Weaverbird, MeshEdit Components, DendroGH, Human, MetaHopper, Nautilus, Pufferfish, Sasquatch

crv = Curve(<curve referenced from the Rhino model>)
crv_2 = Curve(<curve referenced from the Rhino model>)

# ---- group: boundary curve
crv_3 = Curve(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)

# ----
number_slider = Slider(11, range=0..100)  # disabled
# Inflated pillow - Predefined creases
number_slider_2 = Slider(0.88, range=0..1)  # disabled
number_slider_3 = Slider(2.91, range=0..10)  # disabled
rectangle = Rectangle(Plane=PlaneXY(0, 0, 0), XSize=number_slider, YSize=number_slider, Radius=0)  # -> Rectangle, Length; disabled
number_slider_4 = Slider(7, range=0..10)  # disabled
dom = ConstructDomain(DomainStart=number_slider_2, DomainEnd=number_slider_3)  # disabled
pop2d = Populate2D(Region=rectangle.Rectangle, Count=number_slider_4, Seed=1)  # disabled
lng = ListLength(List=pop2d)  # disabled
random = Random(Range=lng, Number=dom, Seed=2)  # disabled
number_slider_5 = Slider(3, range=0..10)  # disabled
cir = Circle(Plane=pop2d, Radius=random)  # disabled
Z = UnitZ(Factor=number_slider_5)  # disabled
number_slider_6 = Slider(0.18, range=0..1)  # disabled
runion = RegionUnion(Curves=cir)  # disabled
number_slider_7 = Slider(0.06, range=0..0.1)  # disabled
Z_2 = UnitZ(Factor=number_slider_6)  # disabled
boundary = BoundarySurfaces(Edges=runion)  # disabled
move = Move(Geometry=runion, Motion=Z)  # -> Geometry, Transform; disabled
number_slider_8 = Slider(30, range=0..100)  # disabled
boundary_2 = BoundarySurfaces(Edges=move.Geometry)  # disabled
extr = Extrude(Base=boundary, Direction=Z_2)  # disabled
number_slider_9 = Slider(2, range=0..10)  # disabled
mesh = Mesh(boundary_2)  # disabled
divide = DivideCurve(Curve=move.Geometry, Count=number_slider_8, Kinks=False)  # -> Points, Tangents, Parameters; disabled
pipe = Pipe(Curve=move.Geometry, Radius=number_slider_7, Caps=0)  # disabled
number_slider_10 = Slider(0.08, range=0..0.1)  # disabled
number_slider_11 = Slider(0.18, range=0..1)  # disabled
nv = NakedVertices(Mesh=mesh)  # -> ClothedIndex, NakedIndex, ClothedPts, NakedPts; disabled
Z_3 = UnitZ(Factor=number_slider_9)  # disabled
show = Show(G=mesh)  # disabled
edgelengths = EdgeLengths(Mesh=mesh, LengthFactor=number_slider_10, Strength=1)  # disabled
dispatch = Dispatch(List=divide.Points, DispatchPattern=[True, False])  # -> ListA, ListB; disabled
anchor = Anchor(Point=nv.NakedPts, Strength=10000)  # disabled
pt = ConstructPoint(XCoordinate=0, YCoordinate=0, ZCoordinate=number_slider_11)  # disabled
load = Load(Point=nv.ClothedPts, ForceVector=Z_3, Weighting=1)  # disabled
number_slider_12 = Slider(14, range=0..100)  # disabled
button = Button()  # disabled
geo = Geometry(dispatch.ListA)  # disabled
geo_2 = Geometry(dispatch.ListB)  # disabled
toggle = BooleanToggle(True)  # disabled
shift = ShiftList(List=geo_2, Shift=number_slider_12, Wrap=True)  # disabled
project = Project(Geometry=geo, Plane=pt)  # -> Geometry, Transform; disabled
solver = Solver(GoalObjects=[show, edgelengths, load, anchor], Reset=button, Threshold=1e-15, Tolerance=0.01, On=toggle)  # -> I, V, O; disabled
bang = ExplodeTree(Data=solver.O)  # -> Branch0, Branch1; disabled
ln = Line(StartPoint=geo_2, EndPoint=project.Geometry)  # disabled
ln_2 = Line(StartPoint=project.Geometry, EndPoint=shift)  # disabled
number_slider_13 = Slider(1000, range=0..1000)  # disabled
mesh_2 = Mesh(bang.Branch0)  # disabled
join = JoinCurves(Curves=flatten([ln_2, ln]), Preserve=False)  # disabled
wbloop = WeaverbirdsLoopSubdivision(MeshCurves=mesh_2, Level=1, SmoothNakedEdges=1)  # disabled
divide_2 = DivideCurve(Curve=join, Count=number_slider_13, Kinks=False)  # -> Points, Tangents, Parameters; disabled
number_slider_14 = Slider(0.045, range=0..0.1)  # disabled
intcrv = Interpolate(Vertices=divide_2.Points, Degree=3, Periodic=invert(False), KnotStyle=1)  # -> Curve, Length, Domain; disabled
wbframe = WeaverbirdsPictureFrame(MeshPolylines=wbloop, Distance=5, InsetType=0)  # disabled
number_slider_15 = Slider(0.06, range=0..0.1)  # disabled
pipe_2 = Pipe(Curve=intcrv.Curve, Radius=number_slider_14, Caps=0)  # disabled
wbthicken = WeaverbirdsMeshThicken(MeshCurves=wbframe, Distance=number_slider_15, OffsetType=0)  # disabled
number_slider_16 = Slider(3, range=0..10)  # disabled
wbcatmullclark = WeaverbirdsCatmullClarkSubdivision(MeshCurves=wbthicken, Level=number_slider_16, SmoothNakedEdges=1)  # disabled

loft = Loft(Curves=[crv_2, crv], Options={Adjust=False, Closed=False, LoftEnds=0, LoftSimp=0, LoftType=0, Rebuild=10, Refit=0.01})
mesh_3 = Mesh(crv_3)
mesh_4 = Mesh(crv_2)
triremesh = TriRemesh(Geometry=mesh_4, Length=1, Iterations=25)  # -> Triangulation, Dual, Creases
neg = Negative(Value=Slider(1252.659, range=0..20101))
nv_2 = NakedVertices(Mesh=triremesh.Triangulation)  # -> ClothedIndex, NakedIndex, ClothedPts, NakedPts
# LAST INFLATABLE, WORKING FINE
number_slider_17 = Slider(0.5, range=0..1)  # disabled
number_slider_18 = Slider(14.57, range=0..100)  # disabled
# got this data from rhino
#  geom see how to make
#  itr parametrical
pt_2 = Point(Point(5285.7853, 10525.48167, 6208.9387))  # disabled
edgelengths_2 = EdgeLengths(Mesh=triremesh.Triangulation, LengthFactor=Slider(0.67, range=0..1), Strength=1)
volume = Volume(Mesh=triremesh.Triangulation, Volume=neg, Strength=1)
anchor_2 = Anchor(Point=nv_2.NakedPts, Strength=10000)
show_2 = Show(G=triremesh.Triangulation)
# half sphere script (NEED FIXING)
number_slider_19 = Slider(10, range=0..10)  # disabled
multiplication = Multiplication(A=number_slider_18, B=number_slider_17)  # disabled
number_slider_20 = Slider(0.88, range=0..1)  # disabled
number_slider_21 = Slider(855, range=0..1000)  # disabled
number_slider_22 = Slider(34, range=0..1000)  # disabled

# ----
# not sure this is really parametric
number_slider_23 = Slider(20, range=0..100)  # disabled
# CUBE
number_slider_24 = Slider(10, range=0..10)  # disabled
box = CenterBox(Base=PlaneXY(0, 0, 0), X=number_slider_23, Y=number_slider_23, Z=number_slider_23)  # disabled
debrep = DeconstructBrep(Brep=box)  # -> Faces, Edges, Vertices; disabled
area = Area(Geometry=debrep.Faces)  # -> Area, Centroid; disabled
number_slider_25 = Slider(0.1, range=0..0.1)  # disabled
pln = Plane(area.Centroid)  # disabled
number_slider_26 = Slider(25, range=0..100)  # disabled
pdecon = Deconstruct(Point=area.Centroid)  # -> XComponent, YComponent, ZComponent; disabled
abs = Absolute(Value=pdecon.ZComponent)  # disabled
smaller = SmallerThan(FirstNumber=abs, SecondNumber=number_slider_25)  # -> SmallerThan, OrEqualTo; disabled
sph = Sphere(Base=PlaneXY(0, 0, 0), Radius=number_slider_26)  # disabled
cull = CullPattern(List=debrep.Faces, CullPattern=smaller.SmallerThan)  # disabled
panel = Panel(smaller.SmallerThan)  # disabled
cull_2 = CullPattern(List=area.Centroid, CullPattern=smaller.SmallerThan)  # disabled
item = ListItem(List=cull, Index=0, Wrap=True)  # -> Item, Item1, Item2, Item3; disabled
panel_2 = Panel("{0.5, 0.5, 0}")  # disabled
number_slider_27 = Slider(10, range=0..10)  # disabled
brep = Brep(box)  # disabled
evalsrf = EvaluateSurface(Surface=reparameterize(cull), Point=panel_2)  # -> Point, Normal, UDirection, VDirection, Frame; disabled
amp = Amplitude(Vector=evalsrf.Normal, Amplitude=number_slider_27)  # disabled
number_slider_28 = Slider(9, range=0..10)  # disabled
pt_3 = Point(evalsrf.Point)  # disabled
srf_cp = SurfaceClosestPoint(Point=pt_3, Surface=sph)  # -> Point, UVPoint, Distance; disabled
pln_2 = Plane(evalsrf.Frame)  # disabled
rectangle_2 = Rectangle(Plane=pln_2, XSize=number_slider_28, YSize=number_slider_28, Radius=0)  # -> Rectangle, Length; disabled
move_2 = Move(Geometry=pt_3, Motion=amp)  # -> Geometry, Transform; disabled
area_2 = Area(Geometry=rectangle_2.Rectangle)  # -> Area, Centroid; disabled
orient = Orient(Geometry=rectangle_2.Rectangle, Source=area_2.Centroid, Target=pt_3)  # -> Geometry, Transform; disabled
ln_3 = Line(StartPoint=pt_3, EndPoint=move_2.Geometry)  # disabled
extrcrv = ExtrudeAlong(Base=orient.Geometry, Curve=ln_3)  # disabled
area_3 = Area(Geometry=extrcrv)  # -> Area, Centroid; disabled
orient_2 = Orient(Geometry=extrcrv, Source=area_3.Centroid, Target=pt_3)  # -> Geometry, Transform; disabled
sdiff = SolidDifference(BrepsA=orient_2.Geometry, BrepsB=brep)  # disabled
splitmul = SplitBrepMultiple(Brep=orient_2.Geometry, Cutters=brep)  # disabled
splitmul_2 = SplitBrepMultiple(Brep=brep, Cutters=orient_2.Geometry)  # disabled
item_2 = ListItem(List=splitmul, Index=0, Wrap=True)  # -> flatten(Item); disabled
item_3 = ListItem(List=splitmul_2, Index=0, Wrap=True)  # disabled
panel_3 = Panel(item_2)  # disabled
mesh_5 = Mesh(item_3)  # disabled
mesh_6 = Mesh(item_2)  # disabled
merge = Merge(Data1=mesh_5, Data2=mesh_6)  # -> flatten(Result); disabled
mjoin = MeshJoin(Meshes=merge)  # disabled
panel_4 = Panel(mjoin)  # disabled
weldvertices = MeshWeldVertices(Mesh=mjoin, Tolerance=0.01)  # -> RuntimeMessage, Mesh; disabled
unifynormals = MeshUnifyNormals(Mesh=weldvertices.Mesh)  # disabled
mesh_7 = Mesh(unifynormals)  # disabled
nv_3 = NakedVertices(Mesh=mesh_7)  # -> ClothedIndex, NakedIndex, ClothedPts, NakedPts; disabled
pt_4 = Point(nv_3.NakedPts)  # disabled
refine = Refine(Mesh=mesh_7, Level=1)  # disabled
mesh_8 = Mesh(refine)  # disabled
medges = MeshEdges(Mesh=mesh_8)  # -> NakedEdges, InteriorEdges, NonManifoldEdges; disabled
line = Line(medges.NakedEdges)  # disabled
panel_5 = Panel("""0
11
14
19""")  # disabled
join_2 = JoinCurves(Curves=line, Preserve=False)  # disabled
number_slider_29 = Slider(4, range=0..10)  # disabled
item_4 = ListItem(List=join_2, Index=panel_5, Wrap=True)  # disabled
panel_6 = Panel("4")  # disabled
multiplication_2 = Multiplication(A=number_slider_29, B=panel_6)  # disabled
explode = Explode(Curve=item_4, Recursive=True)  # -> Segments, Vertices; disabled
divide_3 = DivideCurve(Curve=item_4, Count=multiplication_2, Kinks=False)  # -> Points, Tangents, Parameters; disabled
duppt = RemoveDuplicatePts(Points=divide_3.Points, Tolerance=0.01)  # disabled
plfit = PlaneFit(Points=duppt)  # -> Plane, Deviation; disabled
avr = Average(Input=duppt)  # disabled
number_slider_30 = Slider(10, range=0..10)  # disabled
pl_origin = PlaneOrigin(Base=plfit.Plane, Origin=avr)  # disabled
cir_2 = Circle(Plane=pl_origin, Radius=number_slider_30)  # disabled
crv_cp = CurveClosestPoint(Point=duppt, Curve=cir_2)  # -> Point, Parameter, Distance; disabled
number_slider_31 = Slider(0.501, range=0..1)  # disabled
pt_5 = Point(simplify(crv_cp.Point))  # disabled
pt_6 = Point(simplify(duppt))  # disabled
edgelengths_3 = EdgeLengths(Mesh=mesh_8, LengthFactor=number_slider_31, Strength=1)  # disabled
anchor_3 = Anchor(Point=pt_6, Target=pt_5, Strength=10000)  # disabled
ln_4 = Line(StartPoint=pt_6, EndPoint=pt_5)  # disabled
show_3 = Show(G=mesh_8)  # disabled
merge_2 = Merge(Data1=flatten(show_3), Data2=flatten(edgelengths_3), Data3=flatten(anchor_3))  # disabled
toggle_2 = BooleanToggle(False)  # disabled
button_2 = Button()  # disabled
number_slider_32 = Slider(0.72, range=0..1)  # disabled
toggle_3 = GroupToggle(ToggleActive=True, ToggleVisible=False)  # disabled
bouncysolver = BouncySolver(
    GoalObjects=merge_2,
    Reset=button_2,
    Threshold=1e-15,
    Tolerance=0.0001,
    Damping=number_slider_32,
    Iterations=10,
    On=toggle_2)  # -> I, V, O; disabled
previewmat = CustomPreviewMaterials(Geometry=bouncysolver.O, DiffuseColor=RGB(255, 255, 255))  # disabled

number_slider_33 = Slider(45, range=0..100)  # disabled
xy = XYPlane(Origin=Point(0, 0, 0))  # disabled
entwine = Entwine(Branch00=show_2, Branch01=[anchor_2, volume, edgelengths_2], FlattenInputs=True)

number_slider_34 = Slider(0.5, range=0..1)  # disabled
number_slider_35 = Slider(14.57, range=0..100)  # disabled

num = Number(multiplication)  # disabled
xy_2 = XYPlane(Origin=pt_2)  # disabled
box_2 = CenterBox(Base=pt_2, X=multiplication, Y=multiplication, Z=multiplication)  # disabled
sph_2 = Sphere(Base=PlaneXY(0, 0, 0), Radius=number_slider_19)  # disabled
rectangle_3 = Rectangle(Plane=xy, XSize=number_slider_21, YSize=number_slider_21, Radius=0)  # -> Rectangle, Length; disabled
multiplication_3 = Multiplication(A=num, B=number_slider_20)  # disabled
rectangle_4 = Rectangle(Plane=xy_2, XSize=number_slider_22, YSize=number_slider_22, Radius=0)  # -> Rectangle, Length; disabled
rotate = Rotate(Geometry=box_2, Angle=degrees(number_slider_33), Plane=pt_2)  # -> Geometry, Transform; disabled
debrep_2 = DeconstructBrep(Brep=box_2)  # -> Faces, Edges, Vertices; disabled
solver_2 = Solver(GoalObjects=entwine, Reset=Button(), Threshold=1e-15, Tolerance=0.01, On=Toggle(True))  # -> I, V, O
area_4 = Area(Geometry=rectangle_3.Rectangle)  # -> Area, Centroid; disabled
area_5 = Area(Geometry=rectangle_4.Rectangle)  # -> Area, Centroid; disabled
area_6 = Area(Geometry=debrep_2.Faces)  # -> Area, Centroid; disabled
number_slider_36 = Slider(1, range=0..1)  # disabled
bang_2 = ExplodeTree(Data=solver_2.O)  # -> Branch0, Branch1
number_slider_37 = Slider(192, range=0..200)  # disabled
orient_3 = Orient(Geometry=rectangle_4.Rectangle, Source=area_5.Centroid, Target=pt_2)  # -> Geometry, Transform; disabled
orient_4 = Orient(Geometry=rectangle_3.Rectangle, Source=area_4.Centroid, Target=xy)  # -> Geometry, Transform; disabled
sph_3 = Sphere(Base=pt_2, Radius=multiplication_3)  # disabled
xy_3 = XYPlane(Origin=Point(0, 0, 0))  # disabled
pdecon_2 = Deconstruct(Point=area_6.Centroid)  # -> XComponent, YComponent, ZComponent; disabled
boundary_3 = BoundarySurfaces(Edges=orient_3.Geometry)  # disabled
boundary_4 = BoundarySurfaces(Edges=orient_4.Geometry)  # disabled
mesh_9 = Mesh(bang_2.Branch0)
brep_2 = Brep(sph_3)  # disabled
sint = SolidIntersection(BrepsA=sph_3, BrepsB=boundary_3)  # disabled
larger = LargerThan(FirstNumber=pdecon_2.ZComponent, SecondNumber=number_slider_36)  # -> LargerThan, OrEqualTo; disabled
preview = CustomPreview(
    Geometry=mesh_9,
    Material={diffuse=RGB(0, 128, 0), emission=RGB(0, 0, 0), shine=0.5, specular=RGB(255, 255, 255), transparency=0.1})
rectangle_5 = Rectangle(Plane=xy_3, XSize=number_slider_37, YSize=number_slider_37, Radius=0)  # -> Rectangle, Length; disabled
split = SplitBrep(Brep=sph_2, Cutter=boundary_4)  # disabled
debrep_3 = DeconstructBrep(Brep=sint)  # -> Faces, Edges, Vertices; disabled
number_slider_38 = Slider(4, range=0..10)  # disabled
number_slider_39 = Slider(76, range=0..100)  # disabled
number_slider_40 = Slider(8, range=0..10)  # disabled
cull_3 = CullPattern(List=area_6.Centroid, CullPattern=larger.LargerThan)  # disabled
item_5 = ListItem(List=debrep_3.Edges, Index=0, Wrap=True)  # -> Item, Item1; disabled
item_6 = ListItem(List=split, Index=0, Wrap=True)  # disabled
# LAST INFLATABLE,
# SUSCRIBED IN COURTYARD GEOMETRY
number_slider_41 = Slider(3, range=0..3)
xy_4 = XYPlane(Origin=Point(0, 0, 0))  # disabled
crv_4 = Curve(item_5.Item1)  # disabled
pop2d_2 = Populate2D(Region=rectangle_5.Rectangle, Count=number_slider_39, Seed=number_slider_38)  # disabled
brep_3 = Brep(item_6)  # disabled
pt_7 = Point(cull_3)  # disabled
divide_4 = DivideCurve(Curve=crv_4, Count=number_slider_40, Kinks=False)  # -> Points, Tangents, Parameters; disabled
del = DelaunayMesh(Points=pop2d_2, Plane=xy_4)  # disabled
hull = ConvexHull(Points=pop2d_2, Plane=xy_4)  # -> Hull, HullZ, Indices; disabled
# BOUNDARY CYARD
crv_5 = Curve(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)
series = Series(Start=0, Step="-2.5", Count=number_slider_41)
debrep_4 = DeconstructBrep(Brep=brep_3)  # -> Faces, Edges, Vertices; disabled
number_slider_42 = Slider(1, range=0..1)  # disabled
number_slider_43 = Slider(50, range=0..100)  # disabled
number_slider_44 = Slider(53.6, range=0..100)  # disabled
ln_5 = Line(StartPoint=pt_2, EndPoint=divide_4.Points)  # disabled
demesh = DeconstructMesh(Mesh=del)  # -> Vertices, Faces, Colours, Normals; disabled
item_7 = ListItem(List=debrep_4.Edges, Index=0, Wrap=True)  # disabled
panel_7 = Panel(series)
end = EndPoints(Curve=ln_5)  # -> Start, End; disabled
Z_4 = UnitZ(Factor=series)
neg_2 = Negative(Value=number_slider_44)  # disabled
panel_8 = Panel("4")  # disabled
divide_5 = DivideCurve(Curve=item_7, Count=panel_8, Kinks=False)  # -> Points, Tangents, Parameters; disabled
move_3 = Move(Geometry=crv_5, Motion=Z_4)  # -> Geometry, Transform
avr_2 = Average(Input=demesh.Vertices)  # disabled
pframe = PerpFrame(Curve=ln_5, Parameter=number_slider_42)  # disabled
pt_8 = Point(end.End)  # disabled

number_slider_45 = Slider(2.5, range=0..10)  # disabled
rectangle_6 = Rectangle(Plane=pframe, XSize=number_slider_45, YSize=number_slider_45, Radius=0)  # -> Rectangle, Length; disabled
area_7 = Area(Geometry=rectangle_6.Rectangle)  # -> Area, Centroid; disabled
orient_5 = Orient(Geometry=rectangle_6.Rectangle, Source=area_7.Centroid, Target=pt_8)  # -> Geometry, Transform; disabled
number_slider_46 = Slider(4, range=-10..10)  # disabled
vec2pt = Vector2Pt(PointA=end.End, PointB=end.Start, Unitize=False)  # -> Vector, Length; disabled
extrcrv_2 = ExtrudeAlong(Base=orient_5.Geometry, Curve=ln_5)  # disabled
amp_2 = Amplitude(Vector=vec2pt.Vector, Amplitude=number_slider_46)  # disabled
move_4 = Move(Geometry=extrcrv_2, Motion=amp_2)  # -> Geometry, Transform; disabled
# not sure this is really parametric
area_8 = Area(Geometry=move_4.Geometry)  # -> Area, Centroid; disabled

Z_5 = UnitZ(Factor=neg_2)  # disabled
number_slider_47 = Slider(0.4, range=0..1)  # disabled
crv_cp_2 = CurveClosestPoint(Point=demesh.Vertices, Curve=hull.Hull)  # -> Point, Parameter, Distance; disabled
item_8 = ListItem(List=move_3.Geometry, Index=0, Wrap=True)  # -> Item, Item1, Item2
move_5 = Move(Geometry=avr_2, Motion=Z_5)  # -> Geometry, Transform; disabled
shatter = Shatter(Curve=item_7, Parameters=divide_5.Parameters)  # disabled
bool = Boolean(crv_cp_2.Distance)  # disabled
number_slider_48 = Slider(100, range=0..100)  # disabled
crv_6 = Curve(item_8.Item1)
# TOP CURVES (0.00 , -2.50)
crv_7 = Curve(item_8.Item2)
# TOP CURVES (0.00 , -2.50)
crv_8 = Curve(item_8.Item)
crv_9 = Curve(item_8.Item1)
vec2pt_2 = Vector2Pt(PointA=move_5.Geometry, PointB=demesh.Vertices, Unitize=False)  # -> Vector, Length; disabled
eval = EvaluateCurve(Curve=reparameterize(shatter), Parameter=number_slider_47)  # -> Point, Tangent, Angle; disabled
panel_9 = Panel("0")  # disabled
explode_2 = Explode(Curve=crv_8, Recursive=True)  # -> Segments, Vertices
explode_3 = Explode(Curve=crv_9, Recursive=True)  # -> Segments, Vertices
int = Integer(bool)  # disabled
dist = Distance(PointA=divide_5.Points, PointB=eval.Point)  # disabled
bnd = Bounds(Numbers=vec2pt_2.Length)  # disabled
midpt = CurveMiddle(Curve=explode_2.Segments)  # -> graft(Midpoint)
midpt_2 = CurveMiddle(Curve=explode_3.Segments)  # -> graft(Midpoint)
round = Round(Number=dist)  # -> Nearest, Floor, Ceiling; disabled

# ---- group: define height
ln_6 = Line(StartPoint=divide_5.Points, EndPoint=eval.Point)  # disabled
panel_10 = Panel("0.5")  # disabled
multiplication_4 = Multiplication(A=round.Nearest, B=panel_10)  # disabled
midpt_3 = CurveMiddle(Curve=ln_6)  # disabled
Z_6 = UnitZ(Factor=multiplication_4)  # disabled
move_6 = Move(Geometry=midpt_3, Motion=Z_6)  # -> Geometry, Transform; disabled

# ----
dom_2 = ConstructDomain(DomainStart=number_slider_48, DomainEnd=panel_9)  # disabled
merge_3 = Merge(Data1=midpt, Data2=midpt_2)
remap = RemapNumbers(Value=vec2pt_2.Vector, Source=bnd, Target=dom_2)  # -> Mapped, Clipped; disabled
panel_11 = Panel(round.Nearest)  # disabled
# FIND CENTER OF
# ATTACHING SQUARES
avr_3 = Average(Input=merge_3)  # -> flatten(ArithmeticMean)
lng_2 = ListLength(List=avr_3)

# ----
# NOT SURE HOW TO
# MAKE A RULE TO GRAB
# HE SIDES I WANT
number_slider_49 = Slider(0, range=0..24)

multiplication_5 = Multiplication(A=int, B=remap.Mapped)  # disabled
arc = Arc3Pt(PointA=divide_5.Points, PointB=move_6.Geometry, PointC=eval.Point)  # -> Arc, Plane, Radius; disabled
division = Division(A=lng_2, B="3")
amp_3 = Amplitude(Vector=vec2pt_2.Vector, Amplitude=multiplication_5)  # disabled
series_2 = Series(Start=0, Step="3", Count=division)
move_7 = Move(Geometry=demesh.Vertices, Motion=amp_3)  # -> Geometry, Transform; disabled
item_9 = ListItem(List=avr_3, Index=series_2, Wrap=True)

random_2 = Random(Range=" 0 to 1", Number=Slider(1, range=0..10), Seed=2)
# this is a random rule
# to make it pick whichever
abs_2 = Absolute(Value=random_2)
round_2 = Round(Number=random_2)  # -> Nearest, Floor, Ceiling
panel_12 = Panel(round_2.Nearest)
cull_4 = CullPattern(List=item_9, CullPattern=panel_12)

number_slider_50 = Slider(-3, range=-10..10)  # disabled
pln_3 = Plane(arc.Plane)  # disabled
vec = Vector(pln_3)  # disabled
conmesh = ConstructMesh(Vertices=move_7.Geometry, Faces=demesh.Faces)  # disabled
move_8 = Move(Geometry=arc.Arc, Motion=vec)  # -> Geometry, Transform; disabled
amp_4 = Amplitude(Vector=vec, Amplitude=number_slider_50)  # disabled
faceb = FaceBoundaries(Mesh=conmesh)  # disabled
number_slider_51 = Slider(0.1, range=0..0.3)  # disabled
# Maybe make a rule to
# select the faces i wanna
# connect and not all 8
avr_4 = Average(Input=item_9)
planar = IsPlanar(Surface=faceb, Interior=True)  # -> Planar, Plane; disabled

# ---- group: unifying meshed
# not sure this is really parametric
extr_2 = Extrude(Base=move_8.Geometry, Direction=amp_4)  # disabled
brep_4 = Brep(brep_3)  # disabled
sdiff_2 = SolidDifference(BrepsA=extr_2, BrepsB=brep_4)  # disabled
splitmul_3 = SplitBrepMultiple(Brep=extr_2, Cutters=brep_4)  # disabled
splitmul_4 = SplitBrepMultiple(Brep=brep_4, Cutters=extr_2)  # disabled
item_10 = ListItem(List=splitmul_3, Index=0, Wrap=True)  # -> flatten(Item); disabled
item_11 = ListItem(List=splitmul_4, Index=0, Wrap=True)  # disabled

# ----
number_slider_52 = Slider(14.57, range=0..100)
number_slider_53 = Slider(1, range=0..1)
# FIND curves and planes for extrusion
ln_7 = Line(StartPoint=avr_4, EndPoint=cull_4)
number_slider_54 = Slider(2.5, range=0..10)
multiplication_6 = Multiplication(A=number_slider_52, B=Slider(0.5, range=0..1))
pframe_2 = PerpFrame(Curve=reparameterize(ln_7), Parameter=number_slider_53)
eval_2 = EvaluateCurve(Curve=reparameterize(ln_7), Parameter=number_slider_53)  # -> Point, Tangent, Angle
num_2 = Number(multiplication_6)
rectangle_7 = Rectangle(Plane=pframe_2, XSize=number_slider_54, YSize=number_slider_54, Radius=0)  # -> Rectangle, Length

splitmul_5 = SplitBrepMultiple(Brep=move_4.Geometry, Cutters=brep_2)  # disabled
splitmul_6 = SplitBrepMultiple(Brep=brep_2, Cutters=move_4.Geometry)  # disabled
item_12 = ListItem(List=splitmul_5, Index=0, Wrap=True)  # -> flatten(Item); disabled
item_13 = ListItem(List=splitmul_6, Index=0, Wrap=True)  # disabled
panel_13 = Panel(item_12)  # disabled

multiplication_7 = Multiplication(A=num_2, B=Slider(0.88, range=0..1))
area_9 = Area(Geometry=rectangle_7.Rectangle)  # -> Area, Centroid
offset = OffsetCurve(Curve=faceb, Distance=expr("-x", number_slider_51), Plane=planar.Plane, Corners=1)  # disabled
# point for central shape
# sphere for trying
pt_9 = Point(avr_4)
vec2pt_3 = Vector2Pt(PointA=avr_4, PointB=eval_2.Point, Unitize=False)  # -> Vector, Length
orient_6 = Orient(Geometry=rectangle_7.Rectangle, Source=area_9.Centroid, Target=eval_2.Point)  # -> Geometry, Transform
explode_4 = Explode(Curve=offset, Recursive=True)  # -> graft(Segments), Vertices; disabled
amp_5 = Amplitude(Vector=vec2pt_3.Vector, Amplitude=Slider(-4, range=-10..10))
midpt_4 = CurveMiddle(Curve=explode_4.Segments)  # disabled
end_2 = EndPoints(Curve=explode_4.Segments)  # -> Start, End; disabled
box_3 = Box()
number_slider_55 = Slider(0.12, range=0..0.3)  # disabled
meshcp = MeshClosestPoint(Point=midpt_4, Mesh=conmesh)  # -> Point, Index, Parameter; disabled
panel_14 = Panel(item_10)  # disabled
meval = MeshEval(Mesh=conmesh, Parameter=meshcp.Parameter)  # -> Point, Normal, Colour; disabled
len = Length(Curve=explode_4.Segments)  # disabled
mesh_10 = Mesh(item_13)  # disabled
mesh_11 = Mesh(item_12)  # disabled
multiplication_8 = Multiplication(A=len, B=number_slider_55)  # disabled

sph_4 = Sphere(Base=pt_9, Radius=multiplication_7)
extr_3 = Extrude(Base=orient_6.Geometry, Direction=amp_5)

# ----
# trim sphere bottom
panel_15 = Panel("0.5")
number_slider_56 = Slider(22, range=0..1000)
multiplication_9 = Multiplication(A=number_slider_54, B=panel_15)
area_10 = Area(Geometry=sph_4)  # -> Area, Centroid
neg_3 = Negative(Value=multiplication_9)
rectangle_8 = Rectangle(Plane=area_10.Centroid, XSize=number_slider_56, YSize=number_slider_56, Radius=0)  # -> Rectangle, Length
Z_7 = UnitZ(Factor=neg_3)
area_11 = Area(Geometry=rectangle_8.Rectangle)  # -> Area, Centroid
orient_7 = Orient(Geometry=rectangle_8.Rectangle, Source=area_11.Centroid, Target=area_10.Centroid)  # -> Geometry, Transform
move_9 = Move(Geometry=orient_7.Geometry, Motion=Z_7)  # -> Geometry, Transform
boundary_5 = BoundarySurfaces(Edges=move_9.Geometry)
splitmul_7 = SplitBrepMultiple(Brep=sph_4, Cutters=boundary_5)
item_14 = ListItem(List=splitmul_7, Index=0, Wrap=True)

amp_6 = Amplitude(Vector=meval.Normal, Amplitude=multiplication_8)  # disabled
mesh_12 = Mesh(item_11)  # disabled
mesh_13 = Mesh(item_10)  # disabled
multiplication_10 = Multiplication(A=number_slider_52, B=Slider(0.35, range=0..1))
merge_4 = Merge(Data1=mesh_10, Data2=mesh_11)  # -> flatten(Result); disabled
move_10 = Move(Geometry=midpt_4, Motion=amp_6)  # -> Geometry, Transform; disabled
box_4 = CenterBox(Base=pt_9, X=multiplication_10, Y=multiplication_10, Z=multiplication_10)
arc_2 = Arc3Pt(PointA=end_2.Start, PointB=move_10.Geometry, PointC=end_2.End)  # -> simplify(Arc), Plane, Radius; disabled
merge_5 = Merge(Data1=mesh_12, Data2=mesh_13)  # -> flatten(Result); disabled
mjoin_2 = MeshJoin(Meshes=merge_4)  # disabled
facet = FacetDome()  # -> Pattern, Dome
pshift = ShiftPaths(Data=arc_2.Arc, Offset=-1)  # disabled
panel_16 = Panel(mjoin_2)  # disabled
mjoin_3 = MeshJoin(Meshes=merge_5)  # disabled
weldvertices_2 = MeshWeldVertices(Mesh=mjoin_2, Tolerance=0.01)  # -> RuntimeMessage, Mesh; disabled
srf = Surface(box_4)
srf_2 = Surface(item_14)
item_15 = ListItem(List=pshift, Index=0, Wrap=True)  # -> Item, Item1, Item2; disabled
panel_17 = Panel(mjoin_3)  # disabled
unifynormals_2 = MeshUnifyNormals(Mesh=weldvertices_2.Mesh)  # disabled
weldvertices_3 = MeshWeldVertices(Mesh=mjoin_3, Tolerance=0.01)  # -> RuntimeMessage, Mesh; disabled
edgesrf = EdgeSurface(CurveA=item_15.Item, CurveB=item_15.Item1, CurveC=item_15.Item2)  # disabled
mesh_14 = Mesh(unifynormals_2)  # disabled

# ----
# not sure this is really parametric
splitmul_8 = SplitBrepMultiple(Brep=extr_3, Cutters=box_4)
splitmul_9 = SplitBrepMultiple(Brep=box_4, Cutters=extr_3)
item_16 = ListItem(List=splitmul_8, Index=0, Wrap=True)  # -> flatten(Item)
item_17 = ListItem(List=splitmul_9, Index=0, Wrap=True)

unifynormals_3 = MeshUnifyNormals(Mesh=weldvertices_3.Mesh)  # disabled
preview_2 = CustomPreview(
    Geometry=edgesrf,
    Material={diffuse=RGB(221, 160, 221), emission=RGB(66, 48, 66), shine=0.5, specular=RGB(255, 255, 255), transparency=0})  # disabled
nv_4 = NakedVertices(Mesh=unifynormals_3)  # -> ClothedIndex, NakedIndex, ClothedPts, NakedPts; disabled
nv_5 = NakedVertices(Mesh=mesh_14)  # -> ClothedIndex, NakedIndex, ClothedPts, NakedPts; disabled
panel_18 = Panel(item_16)
pt_10 = Point(nv_4.NakedPts)  # disabled

# ----
# meshing for kangaroo
mesh_15 = Mesh(item_17)
mesh_16 = Mesh(item_16)
merge_6 = Merge(Data1=mesh_15, Data2=mesh_16)  # -> flatten(Result)
mjoin_4 = MeshJoin(Meshes=merge_6)
weldvertices_4 = MeshWeldVertices(Mesh=mjoin_4, Tolerance=0.01)  # -> RuntimeMessage, Mesh
unifynormals_4 = MeshUnifyNormals(Mesh=weldvertices_4.Mesh)
mesh_17 = Mesh(unifynormals_4)

refine_2 = Refine(Mesh=mesh_14, Level=1)  # disabled
pt_11 = Point(nv_5.NakedPts)  # disabled
refine_3 = Refine(Mesh=unifynormals_3, Level=1)  # disabled
panel_19 = Panel("-1")  # disabled

# ---- group: dendro settings / voxel size
number_slider_57 = Slider(0.747, range=0..10)  # disabled
number_slider_58 = Slider(0.81, range=0..1)  # disabled
vsettings = CreateSettings(VoxelSize=number_slider_57, Bandwidth=1, Isovalue=0, Adaptivity=number_slider_58)  # disabled

# ----
mesh_18 = Mesh(refine_2)  # disabled
Z_8 = UnitZ(Factor=panel_19)  # disabled
panel_20 = Panel("-1")  # disabled
medges_2 = MeshEdges(Mesh=mesh_18)  # -> NakedEdges, InteriorEdges, NonManifoldEdges; disabled
mesh_19 = Mesh(refine_3)  # disabled
medges_3 = MeshEdges(Mesh=mesh_19)  # -> NakedEdges, InteriorEdges, NonManifoldEdges; disabled
line_2 = Line(medges_2.NakedEdges)  # disabled

vmesh = MeshToVolume(Settings=vsettings)  # disabled
vunion = VolumeUnion(Volumes=vmesh)  # disabled
mvolume = VolumeToMesh(Volume=vunion, VolumeSettings=vsettings)  # disabled
number_slider_59 = Slider(2, range=0..10)  # disabled
wbcatmullclark_2 = WeaverbirdsCatmullClarkSubdivision(MeshCurves=mvolume, Level=1, SmoothNakedEdges=1)  # disabled
triremesh_2 = TriRemesh(Geometry=wbcatmullclark_2, Length=number_slider_59, Iterations=25)  # -> Triangulation, Dual, Creases; disabled
mesh_20 = Mesh(triremesh_2.Triangulation)  # disabled

panel_21 = Panel(mjoin_4)
join_3 = JoinCurves(Curves=line_2, Preserve=False)  # disabled
line_3 = Line(medges_3.NakedEdges)  # disabled

# ----
# input side length!
# exterior face
number_slider_60 = Slider(8, range=0..10)
pi = Pi(Factor=1)
number_slider_61 = Slider(3, range=0..10)
division_2 = Division(A=pi, B=number_slider_60)
tan = Tangent(Value=division_2)
multiplication_11 = Multiplication(A="2", B=tan)
division_3 = Division(A=number_slider_61, B=multiplication_11)
polygon = Polygon(Plane=PlaneXY(0, 0, 0), Radius=division_3, Segments=number_slider_60, FilletRadius=0)  # -> Polygon, Length
pt_12 = Point(Point(4185.194014, 9214.115731, 0))
area_12 = Area(Geometry=polygon.Polygon)  # -> Area, Centroid
orient_8 = Orient(Geometry=polygon.Polygon, Source=area_12.Centroid, Target=pt_12)  # -> Geometry, Transform
Z_9 = UnitZ(Factor=number_slider_61)
extr_4 = Extrude(Base=orient_8.Geometry, Direction=Z_9)

number_slider_62 = Slider(0.313, range=0..1)  # disabled
panel_22 = Panel("""0
11
14
19""")  # disabled
join_4 = JoinCurves(Curves=line_3, Preserve=False)  # disabled
item_18 = ListItem(Index=0, Wrap=True)  # disabled
# chack if welding is ok
nv_6 = NakedVertices(Mesh=mesh_17)  # -> ClothedIndex, NakedIndex, ClothedPts, NakedPts
number_slider_63 = Slider(4, range=0..10)  # disabled

# ----
# input side length!
number_slider_64 = Slider(2.5, range=0..10)

# ----
# input side length!
number_slider_65 = Slider(2.5, range=0..10)
panel_23 = Panel("4")  # disabled
item_19 = ListItem(List=join_4, Index=panel_22, Wrap=True)  # disabled
pt_13 = Point(nv_6.NakedPts)
number_slider_66 = Slider(2, range=0..10)  # disabled
multiplication_12 = Multiplication(A=number_slider_63, B=panel_23)  # disabled
number_slider_67 = Slider(4, range=0..10)  # disabled
refine_4 = Refine(Mesh=mesh_17, Level=1)
panel_24 = Panel("4")  # disabled
divide_6 = DivideCurve(Curve=join_3, Count=multiplication_12, Kinks=False)  # -> Points, Tangents, Parameters; disabled
multiplication_13 = Multiplication(A=number_slider_67, B=panel_24)  # disabled
explode_5 = Explode(Curve=item_19, Recursive=True)  # -> Segments, Vertices; disabled
duppt_2 = RemoveDuplicatePts(Points=divide_6.Points, Tolerance=0.01)  # disabled
divide_7 = DivideCurve(Curve=item_19, Count=multiplication_13, Kinks=False)  # -> Points, Tangents, Parameters; disabled
multiplication_14 = Multiplication(A=number_slider_65)
mesh_21 = Mesh(refine_4)
mesh_22 = Mesh(mesh_21)
medges_4 = MeshEdges(Mesh=mesh_22)  # -> NakedEdges, InteriorEdges, NonManifoldEdges
line_4 = Line(medges_4.NakedEdges)
plfit_2 = PlaneFit(Points=duppt_2)  # -> Plane, Deviation; disabled
avr_5 = Average(Input=duppt_2)  # disabled
join_5 = JoinCurves(Curves=line_4, Preserve=False)

# ----
# interior face
division_4 = Division(A=number_slider_64, B=multiplication_11)
polygon_2 = Polygon(Plane=PlaneXY(0, 0, 0), Radius=division_4, Segments=number_slider_60, FilletRadius=0)  # -> Polygon, Length
pt_14 = Point(Point(4185.194014, 9214.115731, 0))
area_13 = Area(Geometry=polygon_2.Polygon)  # -> Area, Centroid
orient_9 = Orient(Geometry=polygon_2.Polygon, Source=area_13.Centroid, Target=pt_14)  # -> Geometry, Transform
Z_10 = UnitZ(Factor=number_slider_64)
extr_5 = Extrude(Base=orient_9.Geometry, Direction=Z_10)

duppt_3 = RemoveDuplicatePts(Points=divide_7.Points, Tolerance=0.01)  # disabled
number_slider_68 = Slider(1.6, range=0..10)  # disabled
pl_origin_2 = PlaneOrigin(Base=plfit_2.Plane, Origin=avr_5)  # disabled
plfit_3 = PlaneFit(Points=duppt_3)  # -> Plane, Deviation; disabled
avr_6 = Average(Input=duppt_3)  # disabled
medges_5 = MeshEdges(Mesh=mesh_21)  # -> NakedEdges, InteriorEdges, NonManifoldEdges
number_slider_69 = Slider(10, range=0..10)  # disabled
rectangle_9 = Rectangle(Plane=PlaneXY(0, 0, 0), XSize=number_slider_65, YSize=number_slider_65, Radius=0)  # -> Rectangle, Length
cir_3 = Circle(Plane=pl_origin_2, Radius=number_slider_68)  # disabled
pl_origin_3 = PlaneOrigin(Base=plfit_3.Plane, Origin=avr_6)  # disabled
line_5 = Line(medges_5.NakedEdges)
cir_4 = Circle(Plane=pl_origin_3, Radius=number_slider_69)  # disabled
join_6 = JoinCurves(Curves=line_5, Preserve=False)
pt_15 = Point(Point(4185.194014, 9214.115731, 0))
area_14 = Area(Geometry=rectangle_9.Rectangle)  # -> Area, Centroid
crv_cp_3 = CurveClosestPoint(Point=duppt_2, Curve=cir_3)  # -> Point, Parameter, Distance; disabled
multiplication_15 = Multiplication(A=Slider(4, range=0..10), B="4")
orient_10 = Orient(Geometry=rectangle_9.Rectangle, Source=area_14.Centroid, Target=pt_15)  # -> Geometry, Transform
Z_11 = UnitZ(Factor=number_slider_65)
divide_8 = DivideCurve(Curve=join_5, Count=multiplication_15, Kinks=False)  # -> Points, Tangents, Parameters
number_slider_70 = Slider(0.501, range=0..1)  # disabled
panel_25 = Panel("-1")  # disabled
crv_cp_4 = CurveClosestPoint(Point=duppt_3, Curve=cir_4)  # -> Point, Parameter, Distance; disabled
duppt_4 = RemoveDuplicatePts(Points=divide_8.Points, Tolerance=0.01)
pt_16 = Point(simplify(crv_cp_3.Point))  # disabled
pt_17 = Point(simplify(duppt_2))  # disabled
# WALLS
extr_6 = Extrude(Base=orient_10.Geometry, Direction=Z_11)
area_15 = Area(Geometry=extr_4)  # -> Area, Centroid
plfit_4 = PlaneFit(Points=duppt_4)  # -> Plane, Deviation
avr_7 = Average(Input=duppt_4)
number_slider_71 = Slider(0.5, range=0..1)  # disabled
area_16 = Area(Geometry=extr_5)  # -> Area, Centroid
orient_11 = Orient(Geometry=extr_4, Source=area_15.Centroid, Target=area_16.Centroid)  # -> Geometry, Transform
pt_18 = Point(simplify(crv_cp_4.Point))  # disabled
pt_19 = Point(simplify(duppt_3))  # disabled
edgelengths_4 = EdgeLengths(Mesh=mesh_18, LengthFactor=number_slider_70, Strength=1)  # disabled
floor = Floor(Strength=1)  # disabled
anchor_4 = Anchor(Point=pt_17, Target=pt_16, Strength=10000)  # disabled
pl_origin_4 = PlaneOrigin(Base=plfit_4.Plane, Origin=avr_7)
multiplication_16 = Multiplication(A=number_slider_54, B="0.5")
anchor_5 = Anchor(Target=pt_7, Strength=10000)  # disabled
ln_8 = Line(StartPoint=pt_17, EndPoint=pt_16)  # disabled
show_4 = Show(G=mesh_18)  # disabled
Z_12 = UnitZ(Factor=1)  # disabled
# scaffolding
cap = CapHoles(Brep=extr_6)
# scaffolding
cap_2 = CapHoles(Brep=extr_5)
number_slider_72 = Slider(0.2, range=0..1)
number_slider_73 = Slider(0.2, range=0..1)
edgelengths_5 = EdgeLengths(Mesh=mesh_19, LengthFactor=number_slider_71, Strength=1)  # disabled
cir_5 = Circle(Plane=pl_origin_4, Radius=multiplication_16)
anchor_6 = Anchor(Point=pt_19, Target=pt_18, Strength=10000)  # disabled
load_2 = Load(ForceVector=Z_12, Weighting=1)  # disabled
# comprueba: es la casa da musica?
show_5 = Show(G=mesh_19)  # disabled
ln_9 = Line(StartPoint=pt_19, EndPoint=pt_18)  # disabled
merge_7 = Merge(
    Data1=flatten(show_4),
    Data2=flatten(edgelengths_4),
    Data3=flatten(anchor_4),
    Data4=flatten(anchor_5),
    Data5=flatten(floor))  # disabled
debrep_5 = DeconstructBrep(Brep=cap)  # -> Faces, Edges, Vertices
debrep_6 = DeconstructBrep(Brep=cap_2)  # -> Faces, Edges, Vertices
solidplanecollide = SolidPlaneCollide(CollisionPlane=PlaneXY(0, 0, 0), Strength=1)  # disabled
filedge = FilletEdge(Shape=cap, Blend=0, Metric=0)
filedge_2 = FilletEdge(Shape=cap_2, Blend=0, Metric=0)
toggle_4 = BooleanToggle(False)  # disabled
crv_cp_5 = CurveClosestPoint(Point=duppt_4, Curve=cir_5)  # -> Point, Parameter, Distance
number_slider_74 = Slider(0.36, range=0..1)  # disabled
button_3 = Button()  # disabled
merge_8 = Merge(Data1=flatten(show_5), Data2=flatten(edgelengths_5), Data3=flatten(anchor_6))  # disabled
debrep_7 = DeconstructBrep(Brep=debrep_5.Faces)  # -> Faces, flatten(Edges), Vertices
area_17 = Area(Geometry=debrep_5.Faces)  # -> Area, Centroid
debrep_8 = DeconstructBrep(Brep=debrep_6.Faces)  # -> Faces, flatten(Edges), Vertices
area_18 = Area(Geometry=debrep_6.Faces)  # -> Area, Centroid
rigidbodycollide = RigidBodyCollide(Strength=1)  # disabled
toggle_5 = BooleanToggle(False)  # disabled
button_4 = Button()  # disabled
number_slider_75 = Slider(0.45, range=0..1)  # disabled
join_7 = JoinCurves(Curves=debrep_8.Edges, Preserve=False)
bouncysolver_2 = BouncySolver(
    GoalObjects=merge_7,
    Reset=button_3,
    Threshold=1e-15,
    Tolerance=0.0001,
    Damping=number_slider_74,
    Iterations=10,
    On=toggle_4)  # -> I, V, O; disabled

# ----
# horizontal faces
# vertical faces
pcen = PolygonCenter(Polyline=join_7)  # -> CenterV, CenterE, CenterA
pdecon_3 = Deconstruct(Point=pcen.CenterV)  # -> XComponent, YComponent, ZComponent
ma = MassAddition(Input=pdecon_3.ZComponent)  # -> Result, PartialResults
lng_3 = ListLength(List=pdecon_3.ZComponent)
division_5 = Division(A=ma.Result, B=lng_3)
similar = Similarity(FirstNumber=pdecon_3.ZComponent, SecondNumber=division_5, Threshold="0.1")  # -> Similarity, AbsoluteDifference
dispatch_2 = Dispatch(List=join_7, DispatchPattern=similar.Similarity)  # -> ListA, ListB

pt_20 = Point(simplify(crv_cp_5.Point))
pt_21 = Point(simplify(duppt_4))
evalsrf_2 = EvaluateSurface(Surface=reparameterize(debrep_5.Faces), Point=area_17.Centroid)  # -> Point, Normal, UDirection, VDirection, Frame
number_slider_76 = Slider(0.5, range=0..1)  # disabled
bouncysolver_3 = BouncySolver(
    GoalObjects=merge_8,
    Reset=button_4,
    Threshold=1e-15,
    Tolerance=0.0001,
    Damping=number_slider_75,
    Iterations=10,
    On=toggle_5)  # -> I, V, O; disabled
edgelengths_6 = EdgeLengths(Mesh=mesh_22, LengthFactor=Slider(0.796, range=0..1), Strength=1)
amp_7 = Amplitude(Vector=evalsrf_2.Normal, Amplitude=Slider(0.6, range=0..1))
anchor_7 = Anchor(Point=pt_21, Target=pt_20, Strength=Slider(500, range=0..1000))
geo_3 = Geometry(bouncysolver_2.O)  # disabled
ln_10 = Line(StartPoint=pt_21, EndPoint=pt_20)
show_6 = Show(G=mesh_22)
join_8 = JoinCurves(Curves=debrep_7.Edges, Preserve=False)
scale = Scale(Geometry=join_8, Center=area_17.Centroid, Factor=Slider(0.6, range=0..1))  # -> Geometry, Transform
move_11 = Move(Geometry=scale.Geometry, Motion=amp_7)  # -> Geometry, Transform
previewmat_2 = CustomPreviewMaterials(Geometry=bouncysolver_2.O, DiffuseColor=RGB(255, 255, 255))  # disabled
previewmat_3 = CustomPreviewMaterials(Geometry=bouncysolver_3.O, DiffuseColor=RGB(255, 255, 255))  # disabled
merge_9 = Merge(Data1=flatten(show_6), Data2=flatten(edgelengths_6), Data3=flatten(anchor_7))
solidplanecollide_2 = SolidPlaneCollide(CollisionPlane=PlaneXY(0, 0, 0), Strength=1)
# dont enable before
# disabling the following
# part
button_5 = Button()
cluster = Cluster(L=move_11.Geometry, L_2=join_8)  # -> L_8, L_7, L_6, L_3, L_4, L_5
rigidbodycollide_2 = RigidBodyCollide(Strength=1)
# type 1 circulation and inside
crv_10 = Curve(dispatch_2.ListA)
item_20 = ListItem(List=crv_10, Index=0, Wrap=True)  # -> Item, Item1, Item2, Item3, Item4, Item5, Item6, Item7
merge_10 = Merge(Data1=item_20.Item, Data2=item_20.Item1, Data3=item_20.Item2, Data4=item_20.Item3)
# type 2 cool ones
merge_11 = Merge(Data1=item_20.Item4, Data2=item_20.Item5, Data3=item_20.Item6, Data4=item_20.Item7)
join_9 = BrepJoin(Breps=[cluster.L_8, cluster.L_7, cluster.L_6, cluster.L_3, cluster.L_4, cluster.L_5])  # -> Breps, Closed
# type 3 upper and lower
crv_11 = Curve(dispatch_2.ListB)
cap_3 = CapHoles(Brep=join_9.Breps)
volume_2 = Volume(Geometry=join_9.Breps)  # -> Volume, Centroid
item_21 = ListItem(List=merge_10, Index=0, Wrap=True)  # -> Item, Item1, Item2, Item3
number_slider_77 = Slider(0, range=0..0.3)
scale_2 = Scale(Geometry=join_9.Breps, Center=volume_2.Centroid, Factor=Slider(1.1, range=1..1.2))  # -> Geometry, Transform
number_slider_78 = Slider(0.001, range=0..0.001)
crv_12 = Curve([item_21.Item, item_21.Item3])
triremesh_3 = TriRemesh(Geometry=join_9.Breps, Iterations=25)  # -> Triangulation, Dual, Creases
debrep_9 = DeconstructBrep(Brep=scale_2.Geometry)  # -> Faces, Edges, Vertices
mesh_23 = MeshBrep(
    Brep=join_9.Breps,
    Settings={GridMaxCount=0, GridMinCount=16, JaggedSeams=False, MaxEdgeLength=0, MinEdgeLength=0.0001, MinTolerance=0, Refine=True, RefineAngle=0, RelativeTolerance=0.65, SimplePlanes=True, Tolerance=0})

# ----
# limits!
length = Slider(0.47, range=0..1)
offset_2 = Slider(0.31, range=0..1)

length_2 = Slider(0.43, range=0..1)
# limits!
offset_3 = Slider(0.37, range=0..1)

# ----
# limits!
offset_4 = Slider(0.55, range=0..0.55)

length_3 = Slider(0.84, range=0..1)
bouncysolver_4 = BouncySolver(
    GoalObjects=merge_9,
    Reset=button_5,
    Threshold=1e-15,
    Tolerance=0.0001,
    Damping=Slider(0.87, range=0..1),
    Iterations=10,
    On=Toggle(True))  # -> I, V, O

# ----
# limits!
offset_5 = Slider(0, range=0..0.55)
length_4 = Slider(0.84, range=0..1)

crv_13 = Curve([item_21.Item1, item_21.Item2])
mp = MultiPipe(
    Curves=debrep_9.Edges,
    NodeSize=Slider(0.07, range=0..0.3),
    EndOffset=1,
    StrutSize=Slider(0.36, range=0..1),
    Segment=0,
    KinkAngle=0.6,
    CubeFit=0,
    Caps=0)
number_slider_79 = Slider(0.5, range=0..1)
wbcatmullclark_3 = WeaverbirdsCatmullClarkSubdivision(MeshCurves=triremesh_3.Triangulation, Level=Slider(2, range=0..10), SmoothNakedEdges=1)
cluster_2 = Cluster_3(F=length_2, A=offset_3, relay=crv_11)
# circulation
boundary_6 = BoundarySurfaces(Edges=crv_12)
area_19 = Area(Geometry=boundary_6)  # -> Area, Centroid
# inside
boundary_7 = BoundarySurfaces(Edges=crv_13)
area_20 = Area(Geometry=boundary_7)  # -> Area, Centroid
evalsrf_3 = EvaluateSurface(Surface=reparameterize(boundary_6), Point=area_19.Centroid)  # -> Point, Normal, UDirection, VDirection, Frame
scale_3 = Scale(Geometry=crv_12, Center=area_19.Centroid, Factor=length_3)  # -> Geometry, Transform
evalsrf_4 = EvaluateSurface(Surface=reparameterize(boundary_7), Point=area_20.Centroid)  # -> Point, Normal, UDirection, VDirection, Frame
scale_4 = Scale(Geometry=crv_13, Center=area_20.Centroid, Factor=length_4)  # -> Geometry, Transform
amp_8 = Amplitude(Vector=evalsrf_3.Normal, Amplitude=offset_4)
pt_22 = Point(evalsrf_3.Point)
move_12 = Move(Geometry=scale_3.Geometry, Motion=amp_8)  # -> Geometry, Transform
amp_9 = Amplitude(Vector=evalsrf_4.Normal, Amplitude=offset_5)
md_slider = MDSlider(SliderMode=0, slider_value=Point(1, 1, 0.5), x_domain=Domain(0, 1), y_domain=Domain(0, 1), z_domain=Domain(0, 1))
debrep_10 = DeconstructBrep(Brep=move_12.Geometry)  # -> Faces, Edges, Vertices
move_13 = Move(Geometry=scale_4.Geometry, Motion=amp_9)  # -> Geometry, Transform
item_22 = ListItem(List=debrep_10.Vertices, Index=0, Wrap=True)  # -> Item, Item1, Item2, Item3
ln_11 = Line(StartPoint=item_22.Item3, EndPoint=item_22.Item)
cluster_3 = Cluster_4(G=merge_11, F=length, A_2=Slider(0, range=0..100), A=offset_2, E=merge_11)
len_2 = Length(Curve=ln_11)
vec2pt_4 = Vector2Pt(PointA=item_22.Item3, PointB=item_22.Item, Unitize=False)  # -> Vector, Length
multiplication_17 = Multiplication(A=len_2, B=Slider(0.5, range=0..1))
amp_10 = Amplitude(Vector=vec2pt_4.Vector, Amplitude=multiplication_17)
move_14 = Move(Geometry=[item_22.Item2, item_22.Item3], Motion=amp_10)  # -> Geometry, Transform
item_23 = ListItem(List=move_14.Geometry, Index=0, Wrap=True)  # -> Item, Item1
merge_12 = Merge(Data1=item_22.Item, Data2=item_22.Item1, Data3=item_23.Item, Data4=item_23.Item1)
pline = PolyLine(Vertices=merge_12, Closed=True)  # -> flatten(Polyline)
boundary_8 = BoundarySurfaces(Edges=pline)
debrep_11 = DeconstructBrep(Brep=boundary_8)  # -> Faces, Edges, Vertices
join_10 = JoinCurves(Curves=pline, Preserve=False)
crv_14 = Curve(graft(join_10))
crv_15 = Curve(graft(crv_12))
crv_16 = Curve(graft(crv_13))
merge_13 = Merge(Data1=geo_3)  # -> flatten(Result); disabled
crv_17 = Curve(graft(move_13.Geometry))
crv_18 = Curve(graft(cluster_3))
crv_19 = Curve(graft(merge_11))
previewmat_4 = CustomPreviewMaterials(Geometry=mp, DiffuseColor=ColourSwatch(SwatchColor=RGB(184, 184, 184)))
previewmat_5 = CustomPreviewMaterials(Geometry=wbcatmullclark_3, DiffuseColor=ColourSwatch(SwatchColor=RGB(224, 213, 171)))

crv_20 = Curve(graft(crv_11))
# points dont match,
# looks cool tho
crv_21 = Curve(graft(cluster_2))
loft_2 = Loft(
    Curves=[crv_20, crv_21],
    Options={Adjust=False, Closed=False, LoftEnds=0, LoftSimp=0, LoftType=0, Rebuild=10, Refit=0.01})  # -> flatten(Loft)

geo_4 = Geometry(bouncysolver_4.O)  # disabled
previewmat_6 = CustomPreviewMaterials(Geometry=bouncysolver_4.O, DiffuseColor=RGB(255, 255, 255))  # disabled
mesh_24 = MeshBrep(
    Brep=boundary_5,
    Settings={GridMaxCount=0, GridMinCount=16, JaggedSeams=False, MaxEdgeLength=0, MinEdgeLength=0.0001, MinTolerance=0, Refine=True, RefineAngle=0, RelativeTolerance=0.65, SimplePlanes=True, Tolerance=0})  # disabled
mjoin_5 = MeshJoin(Meshes=merge_13)  # disabled
loft_3 = Loft(
    Curves=[crv_19, crv_18],
    Options={Adjust=False, Closed=False, LoftEnds=0, LoftSimp=0, LoftType=0, Rebuild=10, Refit=0.01})  # -> flatten(Loft)
boundary_9 = BoundarySurfaces(Edges=crv_18)  # -> flatten(Surfaces)
boundary_10 = BoundarySurfaces(Edges=crv_21)  # disabled
clean = CleanTree(RemoveNulls=True, RemoveInvalid=True, RemoveEmpty=False, Tree=geo_4)  # disabled
loft_4 = Loft(
    Curves=[crv_14, crv_15],
    Options={Adjust=False, Closed=False, LoftEnds=0, LoftSimp=0, LoftType=0, Rebuild=10, Refit=0.01})  # -> flatten(Loft)
loft_5 = Loft(
    Curves=[crv_17, crv_16],
    Options={Adjust=False, Closed=False, LoftEnds=0, LoftSimp=0, LoftType=0, Rebuild=10, Refit=0.01})  # -> flatten(Loft)
item_24 = ListItem(List=clean, Index=0, Wrap=True)  # disabled
weldvertices_5 = MeshWeldVertices(Mesh=mjoin_5, Tolerance=0.01)  # -> RuntimeMessage, Mesh; disabled
msplit = MeshSplit(Mesh=item_24, Splitters=mesh_24)  # disabled
brep_5 = Brep(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)  # disabled
mesh_25 = Mesh(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)  # disabled
mesh_26 = MeshBrep(
    Brep=brep_5,
    Settings={GridMaxCount=0, GridMinCount=16, JaggedSeams=False, MaxEdgeLength=0, MinEdgeLength=0.0001, MinTolerance=0, Refine=True, RefineAngle=0, RelativeTolerance=0.65, SimplePlanes=True, Tolerance=0})  # disabled
item_25 = ListItem(List=msplit, Index=0, Wrap=True)  # -> Item, Item1
unifynormals_5 = MeshUnifyNormals(Mesh=weldvertices_5.Mesh)  # disabled
msplit_2 = MeshSplit(Mesh=mesh_25, Splitters=mesh_26)  # disabled
mesh_27 = Mesh(unifynormals_5)  # disabled
item_26 = ListItem(List=msplit_2, Index=0, Wrap=True)  # disabled
mjoin_6 = MeshJoin(Meshes=item_25.Item)
mjoin_7 = MeshJoin(Meshes=item_25.Item1)
mesh_28 = Mesh(item_26)  # disabled
mshnakededgs = MeshNakedEdges(Mesh=item_26)  # -> Naked, R; disabled
weldvertices_6 = MeshWeldVertices(Mesh=mjoin_6, Tolerance=0.01)  # -> RuntimeMessage, Mesh
pcen_2 = PolygonCenter(Polyline=mshnakededgs.Naked)  # -> CenterV, CenterE, CenterA; disabled
weldvertices_7 = MeshWeldVertices(Mesh=mjoin_7, Tolerance=0.01)  # -> RuntimeMessage, Mesh
unifynormals_6 = MeshUnifyNormals(Mesh=weldvertices_6.Mesh)
unifynormals_7 = MeshUnifyNormals(Mesh=weldvertices_7.Mesh)

# ---- group: Mesh Resolution
number_slider_80 = Slider(20, range=0..100)

# ----
merge_14 = Merge(Data1=loft_4, Data2=loft_5, Data3=loft_3, Data4=boundary_9, Data5=loft_2)
weld_mesh = WeldMesh(Mesh=item_24, Angle=3.141592654)  # disabled
join_11 = BrepJoin(Breps=merge_14)  # -> Breps, Closed
# mehsing (NOT IMPORTANT )
triremesh_4 = TriRemesh(Geometry=weld_mesh, Iterations=25)  # -> Triangulation, Dual, Creases
debrep_12 = DeconstructBrep(Brep=join_11.Breps)  # -> Faces, Edges, Vertices
srf_3 = Surface(debrep_12.Faces)
avr_8 = Average(Input=debrep_12.Vertices)
debrep_13 = DeconstructBrep(Brep=debrep_12.Faces)  # -> Faces, Edges, Vertices
crv_22 = Curve(debrep_13.Edges)
mesh_29 = Mesh(triremesh_4.Triangulation)
panel_26 = Panel(debrep_12.Faces)
panel_27 = Panel(debrep_13.Edges)
face_boundaries = FaceBoundaries(Mesh=mesh_29)
scale_5 = Scale(Geometry=debrep_12.Edges, Center=avr_8, Factor=Slider(1, range=0.75..1.5))  # -> Geometry, Transform
triremesh_5 = TriRemesh(Geometry=join_11.Breps, Iterations=25)  # -> Triangulation, Dual, Creases
boundary_surfaces = BoundarySurfaces(Edges=face_boundaries)
mp_2 = MultiPipe(
    Curves=face_boundaries,
    NodeSize=Slider(0.05, range=0..0.1),
    EndOffset=1,
    StrutSize=1,
    Segment=0,
    KinkAngle=0.6,
    CubeFit=0)
brep_join = BrepJoin(Breps=boundary_surfaces)  # -> Breps, Closed
mp_3 = MultiPipe(
    Curves=scale_5.Geometry,
    NodeSize=Slider(0.07, range=0..0.3),
    EndOffset=1,
    StrutSize=Slider(0.36, range=0..1),
    Segment=0,
    KinkAngle=0.6,
    CubeFit=0,
    Caps=0)
brep_6 = Brep(brep_join.Breps)
wbcatmullclark_4 = WeaverbirdsCatmullClarkSubdivision(MeshCurves=triremesh_5.Triangulation, Level=Slider(2, range=0..10), SmoothNakedEdges=1)
previewmat_7 = CustomPreviewMaterials(Geometry=mp_3, DiffuseColor=RGB(255, 255, 255))
previewmat_8 = CustomPreviewMaterials(Geometry=wbcatmullclark_4, DiffuseColor=RGB(255, 255, 255))
dom_3 = ConstructDomain(DomainStart=Slider(0.99, range=0..1), DomainEnd=Slider(0.32, range=0..1))
cleanoverlapcurves = CleanOverlappingCurves(Distance=1, LimitLength=2, OverSampling=5, Method=2)  # -> Curves, Polylines

# ----
# input side length!
# exterior face
# scaffolding
# input side length!
# interior face
number_slider_81 = Slider(8, range=0..10)  # disabled
pi_2 = Pi(Factor=1)  # disabled
number_slider_82 = Slider(3, range=0..10)  # disabled
number_slider_83 = Slider(2.5, range=0..10)  # disabled
division_6 = Division(A=pi_2, B=number_slider_81)  # disabled
tan_2 = Tangent(Value=division_6)  # disabled
panel_28 = Panel("2")  # disabled
multiplication_18 = Multiplication(A=panel_28, B=tan_2)  # disabled
division_7 = Division(A=number_slider_82, B=multiplication_18)  # disabled
division_8 = Division(A=number_slider_83, B=multiplication_18)  # disabled
polygon_3 = Polygon(Plane=PlaneXY(0, 0, 0), Radius=division_7, Segments=number_slider_81, FilletRadius=0)  # -> Polygon, Length; disabled
polygon_4 = Polygon(Plane=PlaneXY(0, 0, 0), Radius=division_8, Segments=number_slider_81, FilletRadius=0)  # -> Polygon, Length; disabled
pt_23 = Point(Point(4185.194014, 9214.115731, 0))  # disabled
pt_24 = Point(Point(4185.194014, 9214.115731, 0))  # disabled
area_21 = Area(Geometry=polygon_3.Polygon)  # -> Area, Centroid; disabled
area_22 = Area(Geometry=polygon_4.Polygon)  # -> Area, Centroid; disabled
orient_12 = Orient(Geometry=polygon_3.Polygon, Source=area_21.Centroid, Target=pt_23)  # -> Geometry, Transform; disabled
Z_13 = UnitZ(Factor=number_slider_82)  # disabled
orient_13 = Orient(Geometry=polygon_4.Polygon, Source=area_22.Centroid, Target=pt_24)  # -> Geometry, Transform; disabled
Z_14 = UnitZ(Factor=number_slider_83)  # disabled
extr_7 = Extrude(Base=orient_12.Geometry, Direction=Z_13)  # disabled
extr_8 = Extrude(Base=orient_13.Geometry, Direction=Z_14)  # disabled
area_23 = Area(Geometry=extr_7)  # -> Area, Centroid; disabled
area_24 = Area(Geometry=extr_8)  # -> Area, Centroid; disabled
orient_14 = Orient(Geometry=extr_7, Source=area_23.Centroid, Target=area_24.Centroid)  # -> Geometry, Transform; disabled
cap_4 = CapHoles(Brep=extr_8)  # disabled
number_slider_84 = Slider(0.2, range=0..1)  # disabled
debrep_14 = DeconstructBrep(Brep=cap_4)  # -> Faces, Edges, Vertices; disabled
filedge_3 = FilletEdge(Shape=cap_4, Blend=0, Metric=0)  # disabled
debrep_15 = DeconstructBrep(Brep=debrep_14.Faces)  # -> Faces, flatten(Edges), Vertices; disabled
area_25 = Area(Geometry=debrep_14.Faces)  # -> Area, Centroid; disabled
number_slider_85 = Slider(0.54, range=0..1)  # disabled
dispatch_3 = Dispatch(DispatchPattern=[True, False])  # -> ListA, ListB; disabled
number_slider_86 = Slider(0.82, range=0..1)  # disabled
evalsrf_5 = EvaluateSurface(Surface=reparameterize(debrep_14.Faces), Point=area_25.Centroid)  # -> Point, Normal, UDirection, VDirection, Frame; disabled
join_12 = JoinCurves(Curves=debrep_15.Edges, Preserve=False)  # disabled
midpt_5 = CurveMiddle(Curve=join_12)  # disabled
amp_11 = Amplitude(Vector=evalsrf_5.Normal, Amplitude=number_slider_85)  # disabled
scale_6 = Scale(Geometry=join_12, Center=area_25.Centroid, Factor=number_slider_86)  # -> Geometry, Transform; disabled
neg_4 = Negative(Value=amp_11)  # disabled
move_15 = Move(Geometry=scale_6.Geometry, Motion=amp_11)  # -> Geometry, Transform; disabled
cluster_4 = Cluster_2(L=move_15.Geometry, L_2=join_12)  # -> L_12, L_11, L_10, L_6, L_7, L_8, L_5, L_3, L_9, L_4; disabled
number_slider_87 = Slider(0.99, range=0.75..1.5)  # disabled
join_13 = BrepJoin(Breps=[cluster_4.L_12, cluster_4.L_11, cluster_4.L_10, cluster_4.L_6, cluster_4.L_7, cluster_4.L_8, cluster_4.L_5, cluster_4.L_3, cluster_4.L_9, cluster_4.L_4])  # -> Breps, Closed; disabled
volume_3 = Volume(Geometry=join_13.Breps)  # -> Volume, Centroid; disabled
cap_5 = CapHoles(Brep=join_13.Breps)  # disabled
number_slider_88 = Slider(0.07, range=0..0.3)  # disabled
number_slider_89 = Slider(0, range=0..0.3)  # disabled
number_slider_90 = Slider(0.001, range=0..0.001)  # disabled
triremesh_6 = TriRemesh(Geometry=join_13.Breps, Iterations=25)  # -> Triangulation, Dual, Creases; disabled
scale_7 = Scale(Geometry=join_13.Breps, Center=volume_3.Centroid, Factor=number_slider_87)  # -> Geometry, Transform; disabled
number_slider_91 = Slider(0.36, range=0..1)  # disabled
debrep_16 = DeconstructBrep(Brep=scale_7.Geometry)  # -> Faces, Edges, Vertices; disabled
mesh_30 = MeshBrep(
    Brep=join_13.Breps,
    Settings={GridMaxCount=0, GridMinCount=16, JaggedSeams=False, MaxEdgeLength=0, MinEdgeLength=0.0001, MinTolerance=0, Refine=True, RefineAngle=0, RelativeTolerance=0.65, SimplePlanes=True, Tolerance=0})  # disabled
number_slider_92 = Slider(2, range=0..10)  # disabled
mp_4 = MultiPipe(
    Curves=debrep_16.Edges,
    NodeSize=number_slider_88,
    EndOffset=1,
    StrutSize=number_slider_91,
    Segment=0,
    KinkAngle=0.6,
    CubeFit=0,
    Caps=0)  # disabled
wbcatmullclark_5 = WeaverbirdsCatmullClarkSubdivision(MeshCurves=triremesh_6.Triangulation, Level=number_slider_92, SmoothNakedEdges=1)  # disabled
previewmat_9 = CustomPreviewMaterials(Geometry=wbcatmullclark_5, DiffuseColor=RGB(255, 255, 255))  # disabled
previewmat_10 = CustomPreviewMaterials(Geometry=mp_4, DiffuseColor=RGB(255, 255, 255))  # disabled

number_slider_93 = Slider(10, range=0..10)  # disabled
number_slider_94 = Slider(855, range=0..1000)  # disabled
xy_5 = XYPlane(Origin=Point(0, 0, 0))  # disabled
sph_5 = Sphere(Base=PlaneXY(0, 0, 0), Radius=number_slider_93)  # disabled
rectangle_10 = Rectangle(Plane=xy_5, XSize=number_slider_94, YSize=number_slider_94, Radius=0)  # -> Rectangle, Length; disabled
area_26 = Area(Geometry=rectangle_10.Rectangle)  # -> Area, Centroid; disabled
orient_15 = Orient(Geometry=rectangle_10.Rectangle, Source=area_26.Centroid, Target=xy_5)  # -> Geometry, Transform; disabled
boundary_11 = BoundarySurfaces(Edges=orient_15.Geometry)  # disabled
split_2 = SplitBrep(Brep=sph_5, Cutter=boundary_11)  # disabled
item_27 = ListItem(List=split_2, Index=0, Wrap=True)  # disabled
brep_7 = Brep(item_27)  # disabled
debrep_17 = DeconstructBrep(Brep=brep_7)  # -> Faces, Edges, Vertices; disabled
item_28 = ListItem(List=debrep_17.Edges, Index=0, Wrap=True)  # disabled
panel_29 = Panel("4")  # disabled
divide_9 = DivideCurve(Curve=item_28, Count=panel_29, Kinks=False)  # -> Points, Tangents, Parameters; disabled
number_slider_95 = Slider(0.4, range=0..1)  # disabled
shatter_2 = Shatter(Curve=item_28, Parameters=divide_9.Parameters)  # disabled
eval_3 = EvaluateCurve(Curve=reparameterize(shatter_2), Parameter=number_slider_95)  # -> Point, Tangent, Angle; disabled
dist_2 = Distance(PointA=divide_9.Points, PointB=eval_3.Point)  # disabled
ln_12 = Line(StartPoint=divide_9.Points, EndPoint=eval_3.Point)  # disabled
panel_30 = Panel("0.5")  # disabled
round_3 = Round(Number=dist_2)  # -> Nearest, Floor, Ceiling; disabled
multiplication_19 = Multiplication(A=round_3.Nearest, B=panel_30)  # disabled
midpt_6 = CurveMiddle(Curve=ln_12)  # disabled
panel_31 = Panel(round_3.Nearest)  # disabled
Z_15 = UnitZ(Factor=multiplication_19)  # disabled
move_16 = Move(Geometry=midpt_6, Motion=Z_15)  # -> Geometry, Transform; disabled
arc_3 = Arc3Pt(PointA=divide_9.Points, PointB=move_16.Geometry, PointC=eval_3.Point)  # -> Arc, Plane, Radius; disabled
number_slider_96 = Slider(-3, range=-10..10)  # disabled
pln_4 = Plane(arc_3.Plane)  # disabled
vec_2 = Vector(pln_4)  # disabled
amp_12 = Amplitude(Vector=vec_2, Amplitude=number_slider_96)  # disabled
move_17 = Move(Geometry=arc_3.Arc, Motion=vec_2)  # -> Geometry, Transform; disabled
# not sure this is really parametric
extr_9 = Extrude(Base=move_17.Geometry, Direction=amp_12)  # disabled
brep_8 = Brep(brep_7)  # disabled
sdiff_3 = SolidDifference(BrepsA=extr_9, BrepsB=brep_8)  # disabled
splitmul_10 = SplitBrepMultiple(Brep=brep_8, Cutters=extr_9)  # disabled
splitmul_11 = SplitBrepMultiple(Brep=extr_9, Cutters=brep_8)  # disabled
item_29 = ListItem(List=splitmul_11, Index=0, Wrap=True)  # -> flatten(Item); disabled
item_30 = ListItem(List=splitmul_10, Index=0, Wrap=True)  # disabled
panel_32 = Panel(item_29)  # disabled
mesh_31 = Mesh(item_30)  # disabled
mesh_32 = Mesh(item_29)  # disabled
merge_15 = Merge(Data1=mesh_31, Data2=mesh_32)  # -> flatten(Result); disabled
mjoin_8 = MeshJoin(Meshes=merge_15)  # disabled
panel_33 = Panel(mjoin_8)  # disabled
weldvertices_8 = MeshWeldVertices(Mesh=mjoin_8, Tolerance=0.01)  # -> RuntimeMessage, Mesh; disabled
unifynormals_8 = MeshUnifyNormals(Mesh=weldvertices_8.Mesh)  # disabled
project_2 = Project(Geometry=unifynormals_8, Plane=PlaneXY(0, 0, 0))  # -> Geometry, Transform; disabled
nv_7 = NakedVertices(Mesh=unifynormals_8)  # -> ClothedIndex, NakedIndex, ClothedPts, NakedPts; disabled
pt_25 = Point(nv_7.NakedPts)  # disabled
refine_5 = Refine(Mesh=unifynormals_8, Level=1)  # disabled
mesh_33 = Mesh(refine_5)  # disabled
medges_6 = MeshEdges(Mesh=mesh_33)  # -> NakedEdges, InteriorEdges, NonManifoldEdges; disabled
line_6 = Line(medges_6.NakedEdges)  # disabled
panel_34 = Panel("""0
11
14
19""")  # disabled
join_14 = JoinCurves(Curves=line_6, Preserve=False)  # disabled
item_31 = ListItem(Index=0, Wrap=True)  # disabled
item_32 = ListItem(List=join_14, Index=panel_34, Wrap=True)  # disabled
number_slider_97 = Slider(4, range=0..10)  # disabled
panel_35 = Panel("4")  # disabled
multiplication_20 = Multiplication(A=number_slider_97, B=panel_35)  # disabled
explode_6 = Explode(Curve=item_32, Recursive=True)  # -> Segments, Vertices; disabled
crv_23 = Curve(join_14)  # disabled
mesh_34 = Mesh(project_2.Geometry)  # disabled
divide_10 = DivideCurve(Curve=item_32, Count=multiplication_20, Kinks=False)  # -> Points, Tangents, Parameters; disabled
nv_8 = NakedVertices(Mesh=mesh_34)  # -> ClothedIndex, NakedIndex, ClothedPts, NakedPts; disabled
number_slider_98 = Slider(0.007, range=0..0.01)  # disabled
duppt_5 = RemoveDuplicatePts(Points=divide_10.Points, Tolerance=0.01)  # disabled
number_slider_99 = Slider(1.249, range=0..1.5)  # disabled
plfit_5 = PlaneFit(Points=duppt_5)  # -> Plane, Deviation; disabled
avr_9 = Average(Input=duppt_5)  # disabled
neg_5 = Negative()  # disabled
pt_26 = Point(nv_8.NakedPts)  # disabled
number_slider_100 = Slider(10, range=0..10)  # disabled
pl_origin_5 = PlaneOrigin(Base=plfit_5.Plane, Origin=avr_9)  # disabled

# ---- group: Curve Closest Point
# this is failing
crv_cp_6 = CurveClosestPoint(Point=nv_8.NakedPts, Curve=crv_23)  # -> Point, Parameter, Distance; disabled

# ----
edgelengths_7 = EdgeLengths(Mesh=mesh_34, LengthFactor=number_slider_99, Strength=1)  # disabled
vertexloads = VertexLoads(Mesh=mesh_34, Strength=number_slider_98)  # disabled
show_7 = Show(G=mesh_34)  # disabled
cir_6 = Circle(Plane=pl_origin_5, Radius=number_slider_100)  # disabled
anchor_8 = Anchor(Point=nv_8.NakedPts, Target=crv_cp_6.Point, Strength=10000)  # disabled
merge_16 = Merge(Data1=flatten(vertexloads), Data2=flatten(show_7), Data3=flatten(edgelengths_7), Data4=flatten(anchor_8))  # disabled
crv_cp_7 = CurveClosestPoint(Point=duppt_5, Curve=cir_6)  # -> Point, Parameter, Distance; disabled
number_slider_101 = Slider(0.265, range=0..0.5)  # disabled
number_slider_102 = Slider(0.5, range=0..1)  # disabled
button_6 = Button()  # disabled
toggle_6 = BooleanToggle(True)  # disabled
pt_27 = Point(simplify(crv_cp_7.Point))  # disabled
pt_28 = Point(simplify(duppt_5))  # disabled
Z_16 = UnitZ(Factor=1)  # disabled
edgelengths_8 = EdgeLengths(Mesh=mesh_33, LengthFactor=number_slider_102, Strength=1)  # disabled
solver_3 = Solver(GoalObjects=merge_16, Reset=button_6, Threshold=1e-15, Tolerance=0.0001, On=toggle_6)  # -> I, V, O; disabled
anchor_9 = Anchor(Point=pt_28, Target=pt_27, Strength=10000)  # disabled
load_3 = Load(ForceVector=Z_16, Weighting=1)  # disabled
show_8 = Show(G=mesh_33)  # disabled
ln_13 = Line(StartPoint=pt_28, EndPoint=pt_27)  # disabled
previewmat_11 = CustomPreviewMaterials(Geometry=solver_3.O, DiffuseColor=RGB(255, 255, 255))  # disabled
merge_17 = Merge(Data1=flatten(show_8), Data2=flatten(edgelengths_8), Data3=flatten(anchor_9))  # disabled
toggle_7 = BooleanToggle(False)  # disabled
button_7 = Button()  # disabled
number_slider_103 = Slider(0.45, range=0..1)  # disabled
bouncysolver_5 = BouncySolver(
    GoalObjects=merge_17,
    Reset=button_7,
    Threshold=1e-15,
    Tolerance=0.0001,
    Damping=number_slider_103,
    Iterations=10,
    On=toggle_7)  # -> I, V, O; disabled
previewmat_12 = CustomPreviewMaterials(Geometry=bouncysolver_5.O, DiffuseColor=RGB(255, 255, 255))  # disabled

# ----
# sphere
# not sure this is really parametric
# got this data from rhino
#  geom see how to make
#  itr parametrical
pt_29 = Point(Point(5285.7853, 10525.48167, 6208.9387))  # disabled
number_slider_104 = Slider(20, range=0..100)  # disabled
number_slider_105 = Slider(10, range=0..10)  # disabled
multiplication_21 = Multiplication(A=number_slider_35, B=number_slider_34)  # disabled
number_slider_106 = Slider(34, range=0..1000)  # disabled
number_slider_107 = Slider(45, range=0..100)  # disabled
xy_6 = XYPlane(Origin=pt_29)  # disabled
box_5 = CenterBox(Base=pt_29, X=multiplication_21, Y=multiplication_21, Z=multiplication_21)  # disabled
rectangle_11 = Rectangle(Plane=xy_6, XSize=number_slider_106, YSize=number_slider_106, Radius=0)  # -> Rectangle, Length; disabled
rotate_2 = Rotate(Geometry=box_5, Angle=degrees(number_slider_107), Plane=pt_29)  # -> Geometry, Transform; disabled
debrep_18 = DeconstructBrep(Brep=box_5)  # -> Faces, Edges, Vertices; disabled
area_27 = Area(Geometry=rectangle_11.Rectangle)  # -> Area, Centroid; disabled
area_28 = Area(Geometry=debrep_18.Faces)  # -> Area, Centroid; disabled
number_slider_108 = Slider(0.1, range=0..0.1)  # disabled
pln_5 = Plane(area_28.Centroid)  # disabled
number_slider_109 = Slider(6205, range=0..10000)  # disabled
number_slider_110 = Slider(6210, range=0..10000)  # disabled
orient_16 = Orient(Geometry=rectangle_11.Rectangle, Source=area_27.Centroid, Target=pt_29)  # -> Geometry, Transform; disabled
sph_6 = Sphere(Base=pt_29, Radius=multiplication_21)  # disabled
boundary_12 = BoundarySurfaces(Edges=orient_16.Geometry)  # disabled
pdecon_4 = Deconstruct(Point=area_28.Centroid)  # -> XComponent, YComponent, ZComponent; disabled
panel_37 = Panel(pdecon_4.ZComponent)  # disabled
sdiff_4 = SolidDifference()  # disabled
sint_2 = SolidIntersection(BrepsA=sph_6, BrepsB=boundary_12)  # disabled
abs_3 = Absolute(Value=pdecon_4.ZComponent)  # disabled
debrep_19 = DeconstructBrep(Brep=sint_2)  # -> Faces, Edges, Vertices; disabled
smaller_2 = SmallerThan(FirstNumber=pdecon_4.ZComponent, SecondNumber=number_slider_110)  # -> SmallerThan, OrEqualTo; disabled
larger_2 = LargerThan(FirstNumber=pdecon_4.ZComponent, SecondNumber=number_slider_109)  # -> LargerThan, OrEqualTo; disabled
item_33 = ListItem(List=debrep_19.Edges, Index=0, Wrap=True)  # -> Item, Item1; disabled
and = GateAnd(A=smaller_2.SmallerThan, B=larger_2.LargerThan)  # disabled
panel_38 = Panel(and)  # disabled
number_slider_111 = Slider(8, range=0..10)  # disabled
cull_5 = CullPattern(List=debrep_18.Faces, CullPattern=panel_38)  # disabled
crv_24 = Curve(item_33.Item1)  # disabled
item_34 = ListItem(List=cull_5, Index=0, Wrap=True)  # -> Item, Item1, Item2, Item3; disabled
divide_11 = DivideCurve(Curve=crv_24, Count=number_slider_111, Kinks=False)  # -> Points, Tangents, Parameters; disabled
panel_39 = Panel("{0.5, 0.5, 0}")  # disabled
number_slider_112 = Slider(10, range=0..10)  # disabled
brep_9 = Brep(sph_6)  # disabled
evalsrf_6 = EvaluateSurface(Surface=reparameterize(cull_5), Point=panel_39)  # -> Point, Normal, UDirection, VDirection, Frame; disabled
amp_13 = Amplitude(Vector=evalsrf_6.Normal, Amplitude=number_slider_112)  # disabled
number_slider_113 = Slider(4, range=0..10)  # disabled
number_slider_114 = Slider(20, range=0..100)  # disabled
pt_30 = Point(evalsrf_6.Point)  # disabled
srf_cp_2 = SurfaceClosestPoint(Point=pt_30, Surface=sph_6)  # -> Point, UVPoint, Distance; disabled
pln_6 = Plane(evalsrf_6.Frame)  # disabled
move_18 = Move(Geometry=pt_30, Motion=amp_13)  # -> Geometry, Transform; disabled
rectangle_12 = Rectangle(Plane=pln_6, XSize=number_slider_113, YSize=number_slider_113, Radius=0)  # -> Rectangle, Length; disabled
area_29 = Area(Geometry=rectangle_12.Rectangle)  # -> Area, Centroid; disabled
orient_17 = Orient(Geometry=rectangle_12.Rectangle, Source=area_29.Centroid, Target=pt_30)  # -> Geometry, Transform; disabled
ln_14 = Line(StartPoint=pt_30, EndPoint=move_18.Geometry)  # disabled
extrcrv_3 = ExtrudeAlong(Base=orient_17.Geometry, Curve=ln_14)  # disabled
area_30 = Area(Geometry=extrcrv_3)  # -> Area, Centroid; disabled
sdiff_5 = SolidDifference(BrepsA=extrcrv_3, BrepsB=brep_9)  # disabled
splitmul_12 = SplitBrepMultiple(Brep=extrcrv_3, Cutters=brep_9)  # disabled
splitmul_13 = SplitBrepMultiple(Brep=brep_9, Cutters=extrcrv_3)  # disabled
item_35 = ListItem(List=splitmul_12, Index=0, Wrap=True)  # -> flatten(Item); disabled
item_36 = ListItem(List=splitmul_13, Index=0, Wrap=True)  # disabled
panel_40 = Panel(item_35)  # disabled
mesh_35 = Mesh(item_36)  # disabled
mesh_36 = Mesh(item_35)  # disabled
merge_18 = Merge(Data1=mesh_35, Data2=mesh_36)  # -> flatten(Result); disabled
mjoin_9 = MeshJoin(Meshes=merge_18)  # disabled
panel_41 = Panel(mjoin_9)  # disabled
weldvertices_9 = MeshWeldVertices(Mesh=mjoin_9, Tolerance=0.01)  # -> RuntimeMessage, Mesh; disabled
unifynormals_9 = MeshUnifyNormals(Mesh=weldvertices_9.Mesh)  # disabled
mesh_37 = Mesh(unifynormals_9)  # disabled
nv_9 = NakedVertices(Mesh=mesh_37)  # -> ClothedIndex, NakedIndex, ClothedPts, NakedPts; disabled
refine_6 = Refine(Mesh=mesh_37, Level=1)  # disabled
pt_31 = Point(nv_9.NakedPts)  # disabled
number_slider_115 = Slider(0.81, range=0..1)  # disabled
mesh_38 = Mesh(refine_6)  # disabled
medges_7 = MeshEdges(Mesh=mesh_38)  # -> NakedEdges, InteriorEdges, NonManifoldEdges; disabled
line_7 = Line(medges_7.NakedEdges)  # disabled
join_15 = JoinCurves(Curves=line_7, Preserve=False)  # disabled
number_slider_116 = Slider(4, range=0..10)  # disabled
panel_42 = Panel("4")  # disabled
multiplication_22 = Multiplication(A=number_slider_116, B=panel_42)  # disabled
explode_7 = Explode(Curve=join_15, Recursive=True)  # -> Segments, Vertices; disabled
divide_12 = DivideCurve(Curve=join_15, Count=multiplication_22, Kinks=False)  # -> Points, Tangents, Parameters; disabled
duppt_6 = RemoveDuplicatePts(Points=divide_12.Points, Tolerance=0.01)  # disabled
plfit_6 = PlaneFit(Points=duppt_6)  # -> Plane, Deviation; disabled
avr_10 = Average(Input=duppt_6)  # disabled
number_slider_117 = Slider(10, range=0..10)  # disabled
pl_origin_6 = PlaneOrigin(Base=plfit_6.Plane, Origin=avr_10)  # disabled
cir_7 = Circle(Plane=pl_origin_6, Radius=number_slider_117)  # disabled
crv_cp_8 = CurveClosestPoint(Point=duppt_6, Curve=cir_7)  # -> Point, Parameter, Distance; disabled
number_slider_118 = Slider(0.501, range=0..1)  # disabled
pt_32 = Point(simplify(crv_cp_8.Point))  # disabled
pt_33 = Point(simplify(duppt_6))  # disabled
edgelengths_9 = EdgeLengths(Mesh=mesh_38, LengthFactor=number_slider_118, Strength=1)  # disabled
anchor_10 = Anchor(Point=pt_33, Target=pt_32, Strength=10000)  # disabled
ln_15 = Line(StartPoint=pt_33, EndPoint=pt_32)  # disabled
show_9 = Show(G=mesh_38)  # disabled
toggle_8 = BooleanToggle(False)  # disabled
button_8 = Button()  # disabled
number_slider_119 = Slider(0.97, range=0..1)  # disabled
toggle_9 = GroupToggle(ToggleActive=True, ToggleVisible=False)  # disabled
number_slider_120 = Slider(0.5, range=0..1)  # disabled

number_slider_121 = Slider(1, range=0..1)  # disabled
larger_3 = LargerThan(FirstNumber=pdecon_4.ZComponent, SecondNumber=number_slider_121)  # -> LargerThan, OrEqualTo; disabled
cull_6 = CullPattern(List=area_28.Centroid, CullPattern=larger_3.LargerThan)  # disabled

pt_34 = Point(cull_6)  # disabled
anchor_11 = Anchor(Target=pt_34, Strength=10000)  # disabled
merge_19 = Merge(Data1=flatten(show_9), Data2=flatten(edgelengths_9), Data3=flatten(anchor_10), Data4=flatten(anchor_11))  # disabled
bouncysolver_6 = BouncySolver(
    GoalObjects=merge_19,
    Reset=button_8,
    Threshold=1e-15,
    Tolerance=0.0001,
    Damping=number_slider_119,
    Iterations=10,
    On=toggle_8)  # -> I, V, O; disabled
previewmat_13 = CustomPreviewMaterials(Geometry=bouncysolver_6.O, DiffuseColor=RGB(255, 255, 255), Transparency=number_slider_120)  # disabled

# ----
# collision with floor, failed
crv_25 = Curve(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)  # disabled
crv_26 = Curve(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)  # disabled
loft_6 = Loft(Curves=[crv_26, crv_25], Options={Adjust=True, Closed=False, LoftEnds=0, LoftSimp=1, LoftType=0, Rebuild=60, Refit=0.01})  # disabled
mesh_39 = MeshBrep(
    Brep=loft_6,
    Settings={GridMaxCount=0, GridMinCount=16, JaggedSeams=False, MaxEdgeLength=0, MinEdgeLength=0.0001, MinTolerance=0, Refine=True, RefineAngle=0, RelativeTolerance=0.65, SimplePlanes=True, Tolerance=0})  # disabled
number_slider_122 = Slider(1, range=0..100)  # disabled
triremesh_7 = TriRemesh(Geometry=mesh_14, Length=number_slider_122, Iterations=25)  # -> Triangulation, Dual, Creases; disabled
number_slider_123 = Slider(100, range=0..10000)  # disabled
flipm = FlipMesh(Mesh=triremesh_7.Triangulation, VertexNormals=True, FaceNormals=True, FaceOrientation=True)  # disabled
srf_4 = Surface(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)  # disabled
clean_2 = CombineClean(Meshes=flipm)  # disabled
Z_17 = UnitZ(Factor=panel_20)  # disabled
nv_10 = NakedVertices(Mesh=clean_2)  # -> ClothedIndex, NakedIndex, ClothedPts, NakedPts; disabled
swatch = ColourSwatch(SwatchColor=RGBA(196, 79, 79, 133))  # disabled
number_slider_124 = Slider(50, range=0..100)  # disabled
number_slider_125 = Slider(0.1, range=0..1)  # disabled
toggle_10 = BooleanToggle(False)  # disabled
edgelengths_10 = EdgeLengths(Mesh=clean_2, LengthFactor=number_slider_62, Strength=number_slider_124)  # disabled
pressure = Pressure(M=clean_2, Strength=number_slider_125)  # disabled
anchor_12 = Anchor(Point=nv_10.NakedPts, Strength=10000)  # disabled
show_10 = Show(G=clean_2)  # disabled
toggle_11 = BooleanToggle(False)  # disabled
button_9 = Button()  # disabled
panel_43 = Panel("0;0")  # disabled
swatch_2 = ColourSwatch(SwatchColor=RGBA(156, 58, 222, 133))  # disabled

move_19 = Move(Geometry=srf_4, Motion=Z_8)  # -> Geometry, Transform; disabled

extr_10 = Extrude(Base=move_19.Geometry, Direction=Z_17)  # disabled
preview_3 = CustomPreview(Geometry=extr_10, Material=swatch)  # disabled
spc = SolidPointCollide(Points=nv_10.ClothedPts, Solid=extr_10, Interior=False, Unidirectional=toggle_10, Strength=100000)  # disabled
entwine_2 = Entwine(Branch00=show_10, Branch01=anchor_12, Branch02=pressure, Branch03=edgelengths_10, Branch04=spc, FlattenInputs=True)  # disabled
solver_4 = Solver(GoalObjects=entwine_2, Reset=button_9, Threshold=1e-15, Tolerance=0.0001, On=toggle_11)  # -> I, V, O; disabled
branch = TreeBranch(Tree=solver_4.O, Path=panel_43, MaintainPaths=True)  # disabled
arrpolar = PolarArray(
    Geometry=branch,
    Plane=Plane(origin=(-99007.07709, -45233.28614, 39100), x=(-1, 0, 0), y=(0, -1, 0)),
    Count=10,
    Angle=6.283185307)  # -> Geometry, Transform; disabled
preview_4 = CustomPreview(Geometry=solver_4.O, Material=swatch_2)  # disabled

pt_35 = Point(nv_10.ClothedPts)  # disabled

number_slider_126 = Slider(50, range=0..100)  # disabled
rectangle_13 = Rectangle(Plane=PlaneXY(0, 0, 0), XSize=number_slider_126, YSize=number_slider_126, Radius=0)  # -> Rectangle, Length; disabled
boundary_13 = BoundarySurfaces(Edges=rectangle_13.Rectangle)  # disabled
number_slider_127 = Slider(1.5, range=0..10)  # disabled
xy_7 = XYPlane(Origin=Point(0, 0, 0))  # disabled
number_slider_128 = Slider(0.6, range=0..10)  # disabled
number_slider_129 = Slider(50, range=0..100)  # disabled
number_slider_130 = Slider(8, range=0..10)  # disabled
number_slider_131 = Slider(0.76, range=0..1)  # disabled
panel_44 = Panel("1000")  # disabled
number_slider_132 = Slider(0.913, range=0..1)  # disabled
button_10 = Button()  # disabled
toggle_12 = BooleanToggle(False)  # disabled

# ---- group: Defining Mesh subdivision to create pre-inflation creases
crv_27 = Curve([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])  # disabled
project_3 = Project(Geometry=crv_27, Plane=PlaneXY(0, 0, 0))  # -> Geometry, Transform; disabled
srfsplit = SurfaceSplit(Surface=boundary_13, Curves=project_3.Geometry)  # disabled
join_16 = BrepJoin(Breps=srfsplit)  # -> Breps, Closed; disabled

# ----
triremesh_8 = TriRemesh(Geometry=join_16.Breps, Sharp=False, Features=project_3.Geometry, Length=number_slider_127, Iterations=25)  # -> Triangulation, Dual, Creases; disabled

# ---- group: Adding depth to the mesh
nv_11 = NakedVertices(Mesh=triremesh_8.Triangulation)  # -> ClothedIndex, NakedIndex, ClothedPts, NakedPts; disabled
Z_18 = UnitZ(Factor=0.1)  # disabled
move_20 = Move(Geometry=nv_11.ClothedPts, Motion=Z_18)  # -> Geometry, Transform; disabled

# ---- group: Deconstruct/Construct Mesh
demesh_2 = DeconstructMesh(Mesh=triremesh_8.Triangulation)  # -> Vertices, Faces, Colours, Normals; disabled

# ---- group: Adding depth to the mesh (continued)
replace = ReplaceItems(List=demesh_2.Vertices, Item=move_20.Geometry, Indices=nv_11.ClothedIndex, Wrap=False)  # disabled

# ---- group: Deconstruct/Construct Mesh (continued)
conmesh_2 = ConstructMesh(Vertices=replace, Faces=demesh_2.Faces)  # disabled

# ----
data = Data(nv_11.NakedPts)  # disabled
mirror = Mirror(Geometry=conmesh_2, Plane=xy_7)  # -> Geometry, Transform; disabled
clean_3 = CombineClean(Meshes=[mirror.Geometry, conmesh_2])  # disabled
medges_8 = MeshEdges(Mesh=clean_3)  # -> NakedEdges, InteriorEdges, NonManifoldEdges; disabled
wbvertices = WeaverbirdsVerticesComponent(MeshClosedPolylinesGroup=clean_3, Weld=True)  # disabled
len_3 = Length(Curve=medges_8.InteriorEdges)  # disabled
avr_11 = Average(Input=len_3)  # disabled
nv_12 = NakedVertices(Mesh=mirror.Geometry)  # -> ClothedIndex, NakedIndex, ClothedPts, NakedPts; disabled
multiplication_23 = Multiplication(A=avr_11, B=number_slider_128)  # disabled
edgelengths_11 = EdgeLengths(Mesh=clean_3, LengthFactor=1, Strength=number_slider_130)  # disabled
show_11 = Show(G=clean_3)  # disabled
pressure_2 = Pressure(M=clean_3, Strength=number_slider_131)  # disabled
anchor_13 = Anchor(Point=nv_12.NakedPts, Strength=panel_44)  # disabled
sc = SphereCollide(Points=wbvertices, Radius=multiplication_23, Strength=number_slider_129)  # disabled
merge_20 = Merge(Data1=show_11, Data2=edgelengths_11, Data3=pressure_2, Data4=anchor_13, Data5=sc)  # disabled
bouncysolver_7 = BouncySolver(
    GoalObjects=merge_20,
    Reset=button_10,
    Threshold=1e-15,
    Tolerance=0.0001,
    Damping=number_slider_132,
    Iterations=10,
    On=toggle_12)  # -> I, V, O; disabled
item_37 = ListItem(List=bouncysolver_7.O, Index=0, Wrap=True)  # disabled
wbcatmullclark_6 = WeaverbirdsCatmullClarkSubdivision(MeshCurves=item_37, Level=1, SmoothNakedEdges=1)  # disabled
unweld = UnweldMesh(Mesh=wbcatmullclark_6, Angle=1)  # disabled

# ---- group: GEOMETRY PREVIEW
preview_5 = CustomPreview(
    Geometry=unweld,
    Material={diffuse=RGB(221, 160, 221), emission=RGB(66, 48, 66), shine=0.5, specular=RGB(255, 255, 255), transparency=0})  # disabled

# ----
# BOTTOM FLOOR
number_slider_133 = Slider(1.25, range=0..2.5)
mshnakededgs_2 = MeshNakedEdges(Mesh=mjoin_7)  # -> Naked, R
crv_28 = Curve(mshnakededgs_2.Naked)
neg_6 = Negative(Value=number_slider_133)
Z_19 = UnitZ(Factor=neg_6)
move_21 = Move(Geometry=crv_28, Motion=Z_19)  # -> Geometry, Transform
area_31 = Area(Geometry=move_21.Geometry)  # -> Area, Centroid
scale_8 = Scale(Geometry=move_21.Geometry, Center=area_31.Centroid, Factor=0.5)  # -> Geometry, Transform
merge_21 = Merge(Data1=crv_28, Data2=scale_8.Geometry)
Z_20 = UnitZ(Factor=1)

# ----
# this loft looks terrible HELP
loft_7 = Loft(Curves=merge_21, Options={Adjust=False, Closed=False, LoftEnds=0, LoftSimp=0, LoftType=0, Rebuild=10, Refit=0.01})

cap_6 = CapHoles(Brep=loft_7)
join_17 = BrepJoin(Breps=[loft_7, cap_6])  # -> Breps, Closed
mesh_40 = MeshBrep(
    Brep=join_17.Breps,
    Settings={GridMaxCount=0, GridMinCount=16, JaggedSeams=False, MaxEdgeLength=0, MinEdgeLength=0.0001, MinTolerance=0, Refine=True, RefineAngle=0, RelativeTolerance=0.65, SimplePlanes=True, Tolerance=0})
offsetbrep = OffsetBrep(Brep=join_17.Breps, OffsetDistance=Z_20, Solid=True, SharpEdges=True, Tolerance=0.01)
wbcatmullclark_7 = WeaverbirdsCatmullClarkSubdivision(MeshCurves=mesh_40, Level=1, SmoothNakedEdges=1)

# ----
# Inflated pillow - base setup
# You can use mesh edges or length component to restrain the mesh topology
# Pressure force to move mesh faces towards the normal direction
# Mesh creases or anchor points
rectangle_14 = Rectangle(Plane=PlaneXY(0, 0, 0), XSize=Domain(-1, 1), YSize=Domain(-2, 2), Radius=0)  # -> Rectangle, Length
volume_4 = Volume(Strength=1)
length_line = LengthLine(Strength=10)

# ---- group: Deconstruct/Construct Mesh
mesh_uv = MeshSurface(Surface=rectangle_14.Rectangle, UCount=number_slider_80, VCount=number_slider_80, Overhang=True, Equalize=False)
demesh_3 = DeconstructMesh(Mesh=mesh_uv)  # -> Vertices, Faces, Colours, Normals

# ---- group: Adding depth to the mesh
nv_13 = NakedVertices(Mesh=mesh_uv)  # -> ClothedIndex, NakedIndex, ClothedPts, NakedPts
Z_21 = UnitZ(Factor=0.1)
move_22 = Move(Geometry=nv_13.ClothedPts, Motion=Z_21)  # -> Geometry, Transform
replace_2 = ReplaceItems(List=demesh_3.Vertices, Item=move_22.Geometry, Indices=nv_13.ClothedIndex, Wrap=False)

# ---- group: Deconstruct/Construct Mesh (continued)
conmesh_3 = ConstructMesh(Vertices=replace_2, Faces=demesh_3.Faces)

# ---- group: Creating a double layered mesh
xy_8 = XYPlane(Origin=Point(0, 0, 0))
mirror_2 = Mirror(Geometry=conmesh_3, Plane=xy_8)  # -> Geometry, Transform
clean_4 = CombineClean(Meshes=[conmesh_3, mirror_2.Geometry])

# ----
nv_14 = NakedVertices(Mesh=mirror_2.Geometry)  # -> ClothedIndex, NakedIndex, ClothedPts, NakedPts
anchor_14 = Anchor(Point=nv_14.NakedPts, Strength="1000")

edgelengths_12 = EdgeLengths(Mesh=clean_4, LengthFactor=1, Strength=Slider(21, range=0..1000))

# ---- group: Mesh Pressure
pressure_3 = Pressure(M=clean_4, Strength=Slider(0.413, range=0..1))

# ----
show_12 = Show(G=clean_4)
merge_22 = Merge(Data1=show_12, Data2=edgelengths_12, Data3=pressure_3, Data4=anchor_14)
bouncysolver_8 = BouncySolver(
    GoalObjects=merge_22,
    Reset=Button(),
    Threshold=1e-15,
    Tolerance=0.0001,
    Damping=Slider(0.943, range=0..1),
    Iterations=10,
    On=Toggle(False))  # -> I, V, O
item_38 = ListItem(List=bouncysolver_8.O, Index=0, Wrap=True)

# ---- group: GEOMETRY PREVIEW
preview_6 = CustomPreview(Geometry=item_38, Material=ColourSwatch(SwatchColor=RGB(176, 176, 176)))

# ----
demesh_4 = DeconstructMesh(Mesh=triremesh_4.Triangulation)  # -> Vertices, Faces, Colours, Normals; disabled
prox = Proximity3D(Points=demesh_4.Vertices, Group=Slider(2, range=0..10))  # -> flatten(Links), Topology
dupln = RemoveDuplicateLines(Lines=prox.Links, Tolerance=0.01)
len_4 = Length(Curve=dupln)
larger_4 = LargerThan(FirstNumber=len_4, SecondNumber=Slider(0.5, range=0..1))  # -> LargerThan, OrEqualTo
cull_7 = CullPattern(List=dupln, CullPattern=larger_4.LargerThan)
explode_8 = Explode(Curve=cull_7, Recursive=True)  # -> flatten(Segments), Vertices
dupln_2 = RemoveDuplicateLines(Lines=explode_8.Segments, Tolerance=0.01)
end_3 = EndPoints(Curve=dupln_2)  # -> Start, End
merge_23 = Merge(Data1=end_3.Start, Data2=end_3.End)
pdecon_5 = Deconstruct(Point=merge_23)  # -> XComponent, YComponent, ZComponent
dom_4 = ConstructDomain(DomainStart=Slider(0.3, range=0..25), DomainEnd=Slider(0.1, range=0..25))
bnd_2 = Bounds(Numbers=pdecon_5.ZComponent)
remap_2 = RemapNumbers(Value=pdecon_5.ZComponent, Source=bnd_2, Target=Domain(0, 1))  # -> Mapped, Clipped
graph = GraphMapper(
    remap_2.Mapped,
    x0=0,
    x1=1,
    y0=0,
    y1=1,
    container_name="Bezier",
    cpx=[0, 0.6996052861, 0.2302564532, 1],
    cpy=[0, 0.1501221657, 0.7780513763, 1])
remap_3 = RemapNumbers(Value=graph, Source=Domain(0, 1), Target=dom_4)  # -> Mapped, Clipped
toggle_13 = GroupToggle(ToggleActive=True, ToggleVisible=False)  # disabled

mp_5 = MultiPipe(
    Curves=dupln_2,
    NodeSize=remap_3.Mapped,
    SizePoints=merge_23,
    EndOffset=1,
    StrutSize=1,
    Segment=0,
    KinkAngle=0.6,
    CubeFit=0)

preview_7 = CustomPreview(Geometry=mp_5, Material=ColourSwatch(SwatchColor=RGB(118, 163, 91)))

popgeo = PopulateGeometry(Geometry=brep_6, Count=Slider(440, range=0..1200), Seed=1000)
bbox = BoundingBox(Content=brep_6, Plane=PlaneXY(0, 0, 0))  # -> Box, Box_2
voronoi³ = Voronoi3D(Points=popgeo, Box=bbox.Box)  # -> Cells, Boundary
bbx = BrepBrep(BrepA=brep_6, BrepB=voronoi³.Cells)  # -> flatten(Curves), Points
leave_true = BooleanToggle(True)
disc = Discontinuity(Curve=bbx.Curves, Level=1)  # -> Points, Parameters
number_slider_134 = Slider(0.58, range=0.01..0.98)
pline_2 = PolyLine(Vertices=disc.Points, Closed=leave_true)  # -> flatten(Polyline)
pcen_3 = PolygonCenter(Polyline=pline_2)  # -> CenterV, CenterE, CenterA
number_slider_135 = Slider(1, range=0..10)
Y = UnitY(Factor=Slider(120, range=0..1000))
swatch_3 = ColourSwatch(SwatchColor=RGB(205, 69, 255))

pdecon_6 = Deconstruct(Point=popgeo)  # -> XComponent, YComponent, ZComponent
bnd_3 = Bounds(Numbers=flatten(pdecon_6.ZComponent))  # -> flatten(Domain)
remap_4 = RemapNumbers(Value=pdecon_6.ZComponent, Source=bnd_3, Target=dom_3)  # -> reverse(Mapped), Clipped
panel_45 = Panel(bnd_3)
graph_2 = GraphMapper(
    reverse(remap_4.Mapped),
    x0=0,
    x1=1,
    y0=0,
    y1=1,
    container_name="Bezier",
    cpx=[0, 0.25, 0.8424620628, 1],
    cpy=[0, 0.25, 0.4494681954, 1])

scale_9 = Scale(Geometry=pline_2, Center=pcen_3.CenterE, Factor=graph_2)  # -> flatten(Geometry), Transform

merge_24 = Merge(Data1=graft(pline_2), Data2=graft(scale_9.Geometry))
clean_tree = CleanTree(RemoveNulls=True, RemoveInvalid=True, RemoveEmpty=False, Tree=merge_24)

loft_8 = Loft(Curves=clean_tree, Options={Adjust=False, Closed=False, LoftEnds=0, LoftSimp=0, LoftType=3, Rebuild=10, Refit=0.01})
debrep_20 = DeconstructBrep(Brep=loft_8)  # -> Faces, Edges, Vertices
mesh_uv_2 = MeshSurface(Surface=debrep_20.Faces, UCount=number_slider_135, VCount=number_slider_135, Overhang=True, Equalize=False)
wbjoin = WeaverbirdsJoinMeshesAndWeld(Mesh=flatten(mesh_uv_2), Weld=invert(False))
wbthicken_2 = WeaverbirdsMeshThicken(MeshCurves=wbjoin, Distance=Slider(0.22, range=0..10), OffsetType=0)
wbloop_2 = WeaverbirdsLoopSubdivision(MeshCurves=wbthicken_2, Level=1, SmoothNakedEdges=1)
move_23 = Move(Geometry=wbloop_2, Motion=Y)  # -> Geometry, Transform
preview_8 = CustomPreview(Geometry=wbthicken_2, Material=swatch_3)
medges_9 = MeshEdges(Mesh=wbloop_2)  # -> NakedEdges, InteriorEdges, NonManifoldEdges
preview_9 = CustomPreview(Geometry=move_23.Geometry, Material=swatch_3)
weaverbird_s_catmull_clark_subdivision = WeaverbirdsCatmullClarkSubdivision(MeshCurves=wbthicken_2, Level=Slider(2, range=0..10), SmoothNakedEdges=1)

# ==== cluster Cluster
L = ClusterInput()
L_2 = ClusterInput()
item = ListItem(List=L, Index=0, Wrap=True)  # -> Item, Item1, Item2, Item3, Item4, Item5
item_2 = ListItem(List=L_2, Index=0, Wrap=True)  # -> Item, Item1, Item2, Item3, Item4, Item5
loft = Loft(
    Curves=[item.Item3, item_2.Item3],
    Options={Adjust=False, Closed=False, LoftEnds=0, LoftSimp=0, LoftType=0, Rebuild=10, Refit=0.01})
loft_2 = Loft(
    Curves=[item.Item4, item_2.Item4],
    Options={Adjust=False, Closed=False, LoftEnds=0, LoftSimp=0, LoftType=0, Rebuild=10, Refit=0.01})
loft_3 = Loft(
    Curves=[item_2.Item5, item.Item5],
    Options={Adjust=False, Closed=False, LoftEnds=0, LoftSimp=0, LoftType=0, Rebuild=10, Refit=0.01})
loft_4 = Loft(
    Curves=[item.Item2, item_2.Item2],
    Options={Adjust=False, Closed=False, LoftEnds=0, LoftSimp=0, LoftType=0, Rebuild=10, Refit=0.01})
loft_5 = Loft(
    Curves=[item_2.Item1, item.Item1],
    Options={Adjust=False, Closed=False, LoftEnds=0, LoftSimp=0, LoftType=0, Rebuild=10, Refit=0.01})
loft_6 = Loft(
    Curves=[item.Item, item_2.Item],
    Options={Adjust=False, Closed=False, LoftEnds=0, LoftSimp=0, LoftType=0, Rebuild=10, Refit=0.01})
L_3 = ClusterOutput(loft)
L_4 = ClusterOutput(loft_2)
L_5 = ClusterOutput(loft_3)
L_6 = ClusterOutput(loft_4)
L_7 = ClusterOutput(loft_5)
L_8 = ClusterOutput(loft_6)

# ==== cluster Cluster_2
L = ClusterInput()
L_2 = ClusterInput()
item = ListItem(List=L, Index=0, Wrap=True)  # -> Item, Item1, Item2, Item3, Item4, Item5, Item6, Item7, Item8, Item9
item_2 = ListItem(List=L_2, Index=0, Wrap=True)  # -> Item, Item1, Item2, Item3, Item4, Item5, Item6, Item7, Item8, Item9
loft = Loft(
    Curves=[item_2.Item7, item.Item7],
    Options={Adjust=False, Closed=False, LoftEnds=0, LoftSimp=0, LoftType=0, Rebuild=10, Refit=0.01})
loft_2 = Loft(
    Curves=[item_2.Item9, item.Item9],
    Options={Adjust=False, Closed=False, LoftEnds=0, LoftSimp=0, LoftType=0, Rebuild=10, Refit=0.01})
loft_3 = Loft(
    Curves=[item_2.Item6, item.Item6],
    Options={Adjust=False, Closed=False, LoftEnds=0, LoftSimp=0, LoftType=0, Rebuild=10, Refit=0.01})
loft_4 = Loft(
    Curves=[item.Item3, item_2.Item3],
    Options={Adjust=False, Closed=False, LoftEnds=0, LoftSimp=0, LoftType=0, Rebuild=10, Refit=0.01})
loft_5 = Loft(
    Curves=[item.Item4, item_2.Item4],
    Options={Adjust=False, Closed=False, LoftEnds=0, LoftSimp=0, LoftType=0, Rebuild=10, Refit=0.01})
loft_6 = Loft(
    Curves=[item_2.Item5, item.Item5],
    Options={Adjust=False, Closed=False, LoftEnds=0, LoftSimp=0, LoftType=0, Rebuild=10, Refit=0.01})
loft_7 = Loft(
    Curves=[item_2.Item8, item.Item8],
    Options={Adjust=False, Closed=False, LoftEnds=0, LoftSimp=0, LoftType=0, Rebuild=10, Refit=0.01})
loft_8 = Loft(
    Curves=[item.Item2, item_2.Item2],
    Options={Adjust=False, Closed=False, LoftEnds=0, LoftSimp=0, LoftType=0, Rebuild=10, Refit=0.01})
loft_9 = Loft(
    Curves=[item_2.Item1, item.Item1],
    Options={Adjust=False, Closed=False, LoftEnds=0, LoftSimp=0, LoftType=0, Rebuild=10, Refit=0.01})
loft_10 = Loft(
    Curves=[item.Item, item_2.Item],
    Options={Adjust=False, Closed=False, LoftEnds=0, LoftSimp=0, LoftType=0, Rebuild=10, Refit=0.01})
L_3 = ClusterOutput(loft)
L_4 = ClusterOutput(loft_2)
L_5 = ClusterOutput(loft_3)
L_6 = ClusterOutput(loft_4)
L_7 = ClusterOutput(loft_5)
L_8 = ClusterOutput(loft_6)
L_9 = ClusterOutput(loft_7)
L_10 = ClusterOutput(loft_8)
L_11 = ClusterOutput(loft_9)
L_12 = ClusterOutput(loft_10)

# ==== cluster Cluster_3
relay = ClusterInput()
boundary = BoundarySurfaces(Edges=relay)
area = Area(Geometry=boundary)  # -> Area, Centroid
F = ClusterInput()
evalsrf = EvaluateSurface(Surface=reparameterize(boundary), Point=area.Centroid)  # -> Point, Normal, UDirection, VDirection, Frame
scale = Scale(Geometry=relay, Center=area.Centroid, Factor=F)  # -> Geometry, Transform
A = ClusterInput()
amp = Amplitude(Vector=evalsrf.Normal, Amplitude=A)
move = Move(Geometry=scale.Geometry, Motion=amp)  # -> Geometry, Transform
G = ClusterOutput(move.Geometry)

# ==== cluster Cluster_4
E = ClusterInput()
boundary = BoundarySurfaces(Edges=E)
area = Area(Geometry=boundary)  # -> Area, Centroid
G = ClusterInput()
F = ClusterInput()
evalsrf = EvaluateSurface(Surface=reparameterize(boundary), Point=area.Centroid)  # -> Point, Normal, UDirection, VDirection, Frame
scale = Scale(Geometry=G, Center=area.Centroid, Factor=F)  # -> Geometry, Transform
A = ClusterInput()
amp = Amplitude(Vector=evalsrf.Normal, Amplitude=A)
pln = Plane(evalsrf.Normal)
move = Move(Geometry=scale.Geometry, Motion=amp)  # -> Geometry, Transform
debrep = DeconstructBrep(Brep=move.Geometry)  # -> Faces, Edges, Vertices
avr = Average(Input=debrep.Vertices)  # -> flatten(ArithmeticMean)
ln = Line(StartPoint=area.Centroid, EndPoint=avr)
A_2 = ClusterInput()
rotax = RotateAxis(Geometry=move.Geometry, Angle=degrees(A_2), Axis=ln)  # -> Geometry, Transform
relay = ClusterOutput(rotax.Geometry)
