# Grasshopper definition agreeTests3.gh (Grasshopper 1.0.7)
# plug-ins: Human, Pufferfish, Speckle 2, MeshEdit Components, treesloth01, MetaHopper, ShapeDiverForGrasshopper

geo = Geometry(<brep referenced from the Rhino model>)

panel = Panel("TOP")  # disabled
pt = Point([<point referenced from the Rhino model> x4])
crv = Curve([<curve referenced from the Rhino model> x4])
pt_2 = Point([<point referenced from the Rhino model> x2])
crv_2 = Curve([<curve referenced from the Rhino model> x2])
pt_3 = Point([<point referenced from the Rhino model> x3])  # disabled
crv_3 = Curve([<curve referenced from the Rhino model> x3])  # disabled
conndir = Wasp_ConnectionFromDirection(GEO=geo, CEN=pt_3, UP=crv_3, T=panel)  # -> CONN, PLN_OUT; inputs CEN: list of Point3d, UP: list of Curve, T: list; disabled; plug-in component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
conndir_2 = Wasp_ConnectionFromDirection(GEO=geo, CEN=pt_2, UP=crv_2, T="BOTTOM")  # -> CONN, PLN_OUT; inputs CEN: list of Point3d, UP: list of Curve, T: list; plug-in component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
conndir_3 = Wasp_ConnectionFromDirection(GEO=geo, CEN=pt, UP=crv, T="SIDES")  # -> CONN, PLN_OUT; inputs CEN: list of Point3d, UP: list of Curve, T: list; plug-in component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
merge = Merge(Data1=conndir_3.CONN, Data2=conndir_2.CONN, Data3=conndir.CONN)

number_slider = Slider(0.4, range=0..1)

# ----
# Press the button to make sure the file is
# updated to latest Wasp version on your pc.
button = Button()
updatefile = Wasp_UpdateFile(UPDATE=button)  # -> LOG; inputs UPDATE: Boolean; plug-in component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

number_slider_2 = Slider(0.4, range=0..1)
part = Wasp_BasicPart(NAME="BLOCK01", GEO=geo, CONN=flatten(merge))  # -> PART; inputs GEO: Mesh, CONN: list, ATTR: list; plug-in component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
# # Wasp: Discrete Design with Grasshopper plug-in (GPL) initiated by Andrea Rossi
# 
# 
# This file is part of Wasp.
# 
# Copyright (c) 2021, Andrea Rossi <a.rossi.andrea@gmail.com>
# 
# Wasp is free software; you can redistribute it and/or modify it under the terms of the GNU General Public License as published by the Free Software Foundation; either version 3 of the License, or (at your option) any later version.
# 
# Wasp is distributed in the hope that it will be useful, but WITHOUT ANY WARRANTY; without even the implied warranty of MERCHANTABILITY or FITNESS FOR A PARTICULAR PURPOSE. See the GNU General Public License for more details. You should have received a copy of the GNU General Public License
#  along with Wasp; If not, see <http://www.gnu.org/licenses/>.
# 
# license GPL-3.0 <https://www.gnu.org/licenses/gpl.html>
# 
# Significant parts of Wasp have been developed by Andrea Rossi as part of research on digital materials and discrete design at DDU Digital Design Unit - Prof. Oliver Tessmann - Technische Universität Darmstadt
# 0_07_Save_Load_Aggregation
sddp = ShapeDiverDocumentPayload({AbsoluteTolerance=0, AngleTolerance=0, DistanceDisplayPrecision=0, GltfVersion="Gltf2", GrasshopperVersion="1.0.0007", InputGroups="{}", OutputGroups="{}", RelativeTolerance=0, RhinoVersion="7.29.23107.3001", UnitSystem=0, VersionCreated="1.14.0.0", VersionSaved="1.14.0.0"})
number_slider_3 = Slider(1, range=0..10)

# ---- group: M1
geo_2 = Geometry(<brep referenced from the Rhino model>)
pt_4 = Point([<point referenced from the Rhino model> x3])
crv_4 = Curve([<curve referenced from the Rhino model> x3])
stack = StackTrees(Data0=geo_2, Data1=pt_4, Data2=crv_4, Reduce=True)
points = PointList(Points=pt_4, Size=number_slider)

# ---- group: M2
geo_3 = Geometry(<brep referenced from the Rhino model>)
pt_5 = Point([<point referenced from the Rhino model> x2])
crv_5 = Curve([<curve referenced from the Rhino model> x2])
stack_2 = StackTrees(Data0=geo_3, Data1=pt_5, Data2=crv_5, Reduce=True)
points_2 = PointList(Points=pt_5, Size=number_slider)

# ---- group: M3
geo_4 = Geometry(<brep referenced from the Rhino model>)
pt_6 = Point([<point referenced from the Rhino model> x2])
crv_6 = Curve([<curve referenced from the Rhino model> x2])
stack_3 = StackTrees(Data0=geo_4, Data1=pt_6, Data2=crv_6, Reduce=True)
points_3 = PointList(Points=pt_6, Size=number_slider)

# ---- group: M4
geo_5 = Geometry(<brep referenced from the Rhino model>)
pt_7 = Point([<point referenced from the Rhino model> x2])
crv_7 = Curve([<curve referenced from the Rhino model> x2])
stack_4 = StackTrees(Data0=geo_5, Data1=pt_7, Data2=crv_7, Reduce=True)
points_4 = PointList(Points=pt_7, Size=number_slider)

# ----
# GetSiteGeometry
panel_2 = Panel("https://macad.speckle.xyz/streams/4975f9f0a8/branches/site%2F00-federated-model")
receive = Receive(
    Stream=panel_2,
    AutoReceive=False,
    CurrentComponentState="expired",
    ExpandOutput=True,
    LastInfoMessage="James McBennett @ 01/19/2024 01:06:29: Pushed 38 elements from Grasshopper. (id:b5d4e56588)",
    ReceiveOnOpen=False,
    ReceivedCommitId="b5d4e56588",
    StreamWrapper="https://macad.speckle.xyz/streams/4975f9f0a8/branches/site/00-federated-model",
    selectedKitName="Objects")  # -> Info, CollectionType, Elements, Info_2, Levels, Name, Types
dso = DeconstructSpeckleObject(SpeckleObject=receive.Elements, selectedKitName="Objects")
dso_2 = DeconstructSpeckleObject(SpeckleObject=dso, selectedKitName="Objects")  # -> BaseLine, DisplayValue

panel_3 = Panel("https://macad.speckle.xyz/streams/4975f9f0a8/commits/6c185bed15")

bang = ExplodeTree(Data=stack_2)  # -> Branch0, Branch1, Branch2
conndir_4 = Wasp_ConnectionFromDirection(GEO=bang.Branch0, CEN=bang.Branch1, UP=bang.Branch2)  # -> CONN, PLN_OUT; inputs CEN: list of Point3d, UP: list of Curve, T: list; plug-in component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
geo_6 = Geometry()
attribute = Wasp_Attribute(ID="KIT", VAL=geo_6, TR=Toggle(True))  # -> ATTR; inputs VAL: list, TR: Boolean; plug-in component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
part_2 = Wasp_BasicPart(NAME="KIT", GEO=bang.Branch0, CONN=flatten(conndir_4.CONN), ATTR=attribute)  # -> PART; inputs GEO: Mesh, CONN: list, ATTR: list; plug-in component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

bang_2 = ExplodeTree(Data=stack)  # -> Branch0, Branch1, Branch2
conndir_5 = Wasp_ConnectionFromDirection(GEO=bang_2.Branch0, CEN=bang_2.Branch1, UP=bang_2.Branch2)  # -> CONN, PLN_OUT; inputs CEN: list of Point3d, UP: list of Curve, T: list; plug-in component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
geo_7 = Geometry(<brep referenced from the Rhino model>)
attribute_2 = Wasp_Attribute(ID="MECH", VAL=geo_7, TR=Toggle(True))  # -> ATTR; inputs VAL: list, TR: Boolean; plug-in component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
part_3 = Wasp_BasicPart(NAME="MECH", GEO=bang_2.Branch0, CONN=flatten(conndir_5.CONN), ATTR=attribute_2)  # -> PART; inputs GEO: Mesh, CONN: list, ATTR: list; plug-in component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

receive_2 = Receive(
    Stream=panel_3,
    AutoReceive=False,
    CurrentComponentState="expired",
    ExpandOutput=True,
    ReceiveOnOpen=False,
    ReceivedCommitId="6c185bed15",
    StreamWrapper="https://macad.speckle.xyz/streams/4975f9f0a8/commits/6c185bed15",
    selectedKitName="Objects")  # -> Info, Data
bang_3 = ExplodeTree(Data=stack_3)  # -> Branch0, Branch1, Branch2
bang_4 = ExplodeTree(Data=stack_4)  # -> Branch0, Branch1, Branch2
dso_3 = DeconstructSpeckleObject(SpeckleObject=receive_2.Data, selectedKitName="Objects")
panel_4 = Panel("""SIDES>SIDES
TOP>BOTTOM
BOTTOM>TOP""")
volume = MeshVolume(Mesh=dso_3)  # -> Volume, Centroid
conndir_6 = Wasp_ConnectionFromDirection(GEO=bang_3.Branch0, CEN=bang_3.Branch1, UP=bang_3.Branch2)  # -> CONN, PLN_OUT; inputs CEN: list of Point3d, UP: list of Curve, T: list; plug-in component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
conndir_7 = Wasp_ConnectionFromDirection(GEO=bang_4.Branch0, CEN=bang_4.Branch1, UP=bang_4.Branch2)  # -> CONN, PLN_OUT; inputs CEN: list of Point3d, UP: list of Curve, T: list; plug-in component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
mesh = Mesh(dso_3)
pt_8 = Point(Point(5162.282679, 9203.55205, 6173.502166))
crv_8 = Curve(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)
panel_5 = Panel("https://macad.speckle.xyz/streams/4975f9f0a8/branches/site%2F00-federated-model")
panel_6 = Panel("https://macad.speckle.xyz/streams/4975f9f0a8/commits/6c185bed15")
part_4 = Wasp_BasicPart(NAME="CIR1", GEO=bang_3.Branch0, CONN=flatten(conndir_6.CONN))  # -> PART; inputs GEO: Mesh, CONN: list, ATTR: list; plug-in component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
part_5 = Wasp_BasicPart(NAME="CIR2", GEO=bang_4.Branch0, CONN=flatten(conndir_7.CONN))  # -> PART; inputs GEO: Mesh, CONN: list, ATTR: list; plug-in component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
swatch = ColourSwatch(SwatchColor=RGB(255, 0, 0))  # disabled
receive_3 = Receive(
    Stream=panel_6,
    AutoReceive=False,
    CurrentComponentState="expired",
    ExpandOutput=True,
    ReceiveOnOpen=False,
    ReceivedCommitId="6c185bed15",
    StreamWrapper="https://macad.speckle.xyz/streams/4975f9f0a8/commits/6c185bed15",
    selectedKitName="Objects")  # -> Info, Data
receive_4 = Receive(
    Stream=panel_5,
    AutoReceive=False,
    CurrentComponentState="expired",
    ExpandOutput=True,
    LastInfoMessage="James McBennett @ 01/19/2024 01:06:29: Pushed 38 elements from Grasshopper. (id:b5d4e56588)",
    ReceiveOnOpen=False,
    ReceivedCommitId="b5d4e56588",
    StreamWrapper="https://macad.speckle.xyz/streams/4975f9f0a8/branches/site/00-federated-model",
    selectedKitName="Objects")  # -> Info, CollectionType, Elements, Info_2, Levels, Name, Types
dso_4 = DeconstructSpeckleObject(SpeckleObject=receive_3.Data, selectedKitName="Objects")
previewmat = CustomPreviewMaterials(Geometry=mesh, DiffuseColor=swatch, Transparency=Slider(0.747, range=0..1))  # disabled
volume_2 = MeshVolume(Mesh=dso_4)  # -> Volume, Centroid

geo_8 = Geometry(<brep referenced from the Rhino model>)
pt_9 = Point([<point referenced from the Rhino model> x3])
crv_9 = Curve([<curve referenced from the Rhino model> x3])
geo_9 = Geometry(<brep referenced from the Rhino model>)
pt_10 = Point([<point referenced from the Rhino model> x8])
crv_10 = Curve([<curve referenced from the Rhino model> x8])
stack_5 = StackTrees(Data0=geo_9, Data1=pt_10, Data2=crv_10, Reduce=True)
volume_3 = Volume(Geometry=geo_8)  # -> Volume, Centroid
stack_6 = StackTrees(Data0=geo_8, Data1=pt_9, Data2=crv_9, Reduce=True)
avr = Average(Input=volume_3.Centroid)
move2pt = MoveToPoint(Geometry=stack_6, PointA=avr, PointB=volume_2.Centroid)  # -> simplify(Moved), Vector, Transform
move2pt_2 = MoveToPoint(Geometry=stack_5, PointA=avr, PointB=volume_2.Centroid)  # -> simplify(Moved), Vector, Transform
bang_5 = ExplodeTree(Data=stack_6)  # -> Branch0, Branch1, Branch2
bang_6 = ExplodeTree(Data=stack_5)  # -> Branch0, Branch1, Branch2
conndir_8 = Wasp_ConnectionFromDirection(GEO=bang_5.Branch0, CEN=bang_5.Branch1, UP=bang_5.Branch2)  # -> CONN, PLN_OUT; inputs CEN: list of Point3d, UP: list of Curve, T: list; plug-in component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
conndir_9 = Wasp_ConnectionFromDirection(GEO=bang_6.Branch0, CEN=bang_6.Branch1, UP=bang_6.Branch2)  # -> CONN, PLN_OUT; inputs CEN: list of Point3d, UP: list of Curve, T: list; plug-in component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
part_6 = Wasp_BasicPart(NAME="HEX", GEO=bang_5.Branch0, CONN=flatten(conndir_8.CONN))  # -> PART; inputs GEO: Mesh, CONN: list, ATTR: list; plug-in component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
part_7 = Wasp_BasicPart(NAME="CUB", GEO=bang_6.Branch0, CONN=flatten(conndir_9.CONN))  # -> PART; inputs GEO: Mesh, CONN: list, ATTR: list; plug-in component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
merge_2 = Merge(Data1=part_6, Data2=part)

points_5 = PointList(Points=pt_9, Size=number_slider_2)
points_6 = PointList(Points=pt_10, Size=number_slider_2)
mesh_2 = Mesh(dso_4)
clean = CleanTree(RemoveNulls=True, RemoveInvalid=True, RemoveEmpty=True, Tree=dso_2.BaseLine)
swatch_2 = ColourSwatch(SwatchColor=RGB(138, 138, 138))
clean_2 = CleanTree(RemoveNulls=True, RemoveInvalid=True, RemoveEmpty=True, Tree=dso_2.DisplayValue)  # -> flatten(Tree)
dso_5 = DeconstructSpeckleObject(SpeckleObject=receive_4.Elements, selectedKitName="Objects")
panel_7 = Panel("{0,0,-1000}")
merge_3 = Merge(Data1=part_3, Data2=part_2, Data3=part_4, Data4=part_5)
panel_8 = Panel("""100
200""")
Z = UnitZ(Factor=expr("-x", Slider(353, range=0..10000)))
previewlw = CustomPreviewLineweights(Geometry=clean, Shader=swatch_2, Absolute=False)  # disabled
Z_2 = UnitZ(Factor="10000")
dso_6 = DeconstructSpeckleObject(SpeckleObject=dso_5, selectedKitName="Objects")  # -> BaseLine, DisplayValue
rulegen = Wasp_RulesGenerator(PART=merge_3, SELF_P=Toggle(False))  # -> R; inputs PART: list, SELF_P: Boolean, SELF_C: Boolean, TYP: Boolean, GR: list; plug-in component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

stochasticaggregation = Wasp_StochasticAggregation(PART=flatten(merge_3), N=Slider(27, range=1..50), RULES=rulegen, RESET=Button())  # -> AGGR, PART_OUT; inputs PART: list, PREV: list, N: Int32, RULES: list, SEED: Int32, MODE: Int32, GC: list, RESET: Boolean; plug-in component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
partgeo = Wasp_GetPartGeometry(PART=stochasticaggregation.PART_OUT)  # -> GEO; plug-in component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

number_slider_4 = Slider(0.747, range=0..1)  # disabled
item = ListItem(List=clean_2, Index=Slider(0, range=0..2), Wrap=True)
mmx = MeshMesh(MeshA=item, MeshB=mesh)
project = Project(Geometry=item, Plane=Z)  # -> Geometry, Transform
bbox = BoundingBox(Content=project.Geometry, Plane=PlaneXY(0, 0, 0))  # -> Box, Box_2
debrep = DeconstructBrep(Brep=bbox.Box)  # -> Faces, Edges, Vertices
move = Move(Geometry=debrep.Vertices, Motion=Z_2)  # -> Geometry, Transform
swatch_3 = ColourSwatch(SwatchColor=RGB(64, 64, 64))
swatch_4 = ColourSwatch(SwatchColor=RGB(191, 23, 23))
medges = MeshEdges(Mesh=project.Geometry)  # -> NakedEdges, InteriorEdges, NonManifoldEdges
ln = Line(StartPoint=debrep.Vertices, EndPoint=move.Geometry)
mcx = MeshCurve(Mesh=item, Curve=ln)  # -> flatten(Points), Faces
previewmat_2 = CustomPreviewMaterials(Geometry=mesh_2, DiffuseColor=swatch_4, Transparency=number_slider_4)  # disabled
number_slider_5 = Slider(72, range=0..100)  # disabled
ln_2 = Line(StartPoint=debrep.Vertices, EndPoint=mcx.Points)
# GetSiteGeometry
midpt = CurveMiddle(Curve=ln_2)
len = Length(Curve=ln_2)
round = Round(Number=len)  # -> Nearest, Floor, Ceiling
concat = Concatenate(FragmentA=round.Nearest, FragmentB=" ", FragmentC="M")
tag = TextTag(Location=midpt, Text=concat, Colour=swatch_3)
panel_9 = Panel(len)  # disabled
clean_3 = CleanTree(RemoveNulls=True, RemoveInvalid=True, RemoveEmpty=True, Tree=dso_6.BaseLine)
swatch_5 = ColourSwatch(SwatchColor=RGB(224, 0, 0))  # disabled
swatch_6 = ColourSwatch(SwatchColor=RGB(138, 138, 138))
clean_4 = CleanTree(RemoveNulls=True, RemoveInvalid=True, RemoveEmpty=True, Tree=dso_6.DisplayValue)  # -> flatten(Tree)
contour = Contour(Shape=item, Point=Point(0, 0, 0), Direction=Vector(0, 0, 1), Distance="50")
Z_3 = UnitZ(Factor=expr("-x", Slider(353, range=0..10000)))
previewmat_3 = CustomPreviewMaterials(Geometry=item, DiffuseColor=swatch_2, Transparency=Slider(0.872, range=0..1))
previewlw_2 = CustomPreviewLineweights(Geometry=clean_3, Shader=swatch_6, Absolute=False)
item_2 = ListItem(List=clean_4, Index=Slider(0, range=0..2), Wrap=True)
mmx_2 = MeshMesh(MeshA=item_2, MeshB=mesh_2)
project_2 = Project(Geometry=mmx_2, Plane=PlaneXY(0, 0, 0))  # -> Geometry, Transform
divide = DivideCurve(Curve=project_2.Geometry, Count=4, Kinks=False)  # -> Points, Tangents, Parameters
item_3 = ListItem(List=divide.Points, Index=0, Wrap=True)
popgeo = PopulateGeometry(Geometry=item_2, Count=Slider(51, range=0..100), Seed=1)
sph = Sphere(Base=popgeo, Radius=500)
project_3 = Project(Geometry=item_2, Plane=Z_3)  # -> Geometry, Transform
mesh_3 = Mesh(sph)
angsplitmsh = AngleSplitMesh(Mesh=partgeo, Angle=0, Opposite=False)  # -> Split, R
contour_2 = Contour(Shape=item_2, Point=Point(0, 0, 0), Direction=Vector(0, 0, 1), Distance="50")
medges_2 = MeshEdges(Mesh=project_3.Geometry)  # -> NakedEdges, InteriorEdges, NonManifoldEdges

series = Series(Start=0, Step=1, Count="3")
bnd = Bounds(Numbers=series)
dedomain = DeconstructDomain(Domain=bnd)  # -> Start, End
gradient = Gradient(
    LowerLimit=dedomain.Start,
    UpperLimit=dedomain.End,
    Parameter=series,
    stops=[0.15: RGB(255, 130, 160), 0.85: RGB(220, 0, 40)])
lng = ListLength()
getattr = Wasp_GetAttributeByName(ID="house")  # -> VAL; plug-in component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
random = Random(Range=Slider(2, range=0..10), Number=lng, Seed=2, Integers=True)
item_4 = ListItem(List=gradient, Index=random, Wrap=True)
preview = CustomPreview(Geometry=flatten(getattr), Material=item_4)

medges_3 = MeshEdges(Mesh=angsplitmsh.Split)  # -> NakedEdges, InteriorEdges, NonManifoldEdges
previewmat_4 = CustomPreviewMaterials(Geometry=item_2, DiffuseColor=swatch_6, Transparency=Slider(0.623, range=0..1))  # disabled
previewlw_3 = CustomPreviewLineweights(Geometry=[contour_2, medges_2.NakedEdges], Shader=ColourSwatch(SwatchColor=RGB(64, 64, 64)), Absolute=False)
previewlw_4 = CustomPreviewLineweights(Geometry=project_2.Geometry, Shader=swatch_4, Thickness=Slider(3, range=0..10), Absolute=False)
previewmat_5 = CustomPreviewMaterials(
    Geometry=partgeo,
    DiffuseColor=ColourSwatch(SwatchColor=RGBA(255, 255, 255, 204)),
    Transparency=Slider(0.402, range=0..1))
previewlw_5 = CustomPreviewLineweights(Geometry=medges_3.NakedEdges, Shader=ColourSwatch(SwatchColor=RGB(0, 0, 0)), Absolute=False)
mmx_3 = MeshMesh(MeshA=item_2, MeshB=mesh_3)
divide_2 = DivideCurve(Curve=mmx_2, Count=10, Kinks=False)  # -> Points, Tangents, Parameters
msplit = MeshSplit(Mesh=item_2, Splitters=mesh_2)
pdecon = Deconstruct(Point=divide_2.Points)  # -> XComponent, YComponent, ZComponent
item_5 = ListItem(List=msplit, Index=Slider(1, range=0..1), Wrap=True)
msh2psrf = MeshToPolysurface(Mesh=item_5, Triangles=False, FaceMerge=False)
bnd_2 = Bounds(Numbers=pdecon.ZComponent)

# ----
# Enable To Upload Geomtry to Speckle Server
toggle = GroupToggle(ToggleActive=True, ToggleVisible=False)  # disabled
link_to_upload_to_our_speckle_server = Panel("https://macad.speckle.xyz/streams/4975f9f0a8/branches/students%2Fg06-site_locations")  # disabled
panel_11 = Panel("SiteLocationSelection")  # disabled
send = Send(
    Stream=link_to_upload_to_our_speckle_server,
    Message=panel_11,
    AutoSend=False,
    CurrentComponentState="needs_input",
    KitName="Objects",
    UseDefaultCache=True,
    selectedKitName="Objects")  # disabled

dedomain_2 = DeconstructDomain(Domain=bnd_2)  # -> Start, End
contour_3 = Contour(Shape=msh2psrf, Point=Point(0, 0, 0), Direction=Vector(0, 0, 1), Distance="5")  # -> flatten(Contours)
previewlw_6 = CustomPreviewLineweights(Geometry=mmx_2, Shader=ColourSwatch(SwatchColor=RGB(143, 26, 26)), Thickness=Slider(3, range=0..10), Absolute=False)
equals = Equality(FirstNumber=pdecon.ZComponent, SecondNumber=dedomain_2.Start)  # -> Equality, Inequality
panel_12 = Panel(bnd_2)
cull = CullPattern(List=divide_2.Points, CullPattern=equals.Equality)  # -> flatten(List)
project_4 = Project(Geometry=cull, Plane=popgeo)  # -> Geometry, Transform
vec2pt = Vector2Pt(PointA=volume_2.Centroid, PointB=cull, Unitize=False)  # -> Vector, Length
ln_3 = Line(StartPoint=volume_2.Centroid, EndPoint=cull)
vec2pt_2 = Vector2Pt(PointA=popgeo, PointB=cull, Unitize=False)  # -> Vector, Length
midpt_2 = CurveMiddle(Curve=ln_3)
sort = SortList(Keys=contour_3, ValuesA=contour_3)  # -> Keys, ValuesA
midpt_3 = CurveMiddle(Curve=sort.ValuesA)
loft = Loft(Options={Adjust=False, Closed=False, LoftEnds=0, LoftSimp=0, LoftType=0, Rebuild=10, Refit=0.01})
vec2pt_3 = Vector2Pt(PointA=volume_2.Centroid, PointB=cull, Unitize=False)  # -> Vector, Length
angle = Angle(VectorA=vec2pt.Vector, VectorB=vec2pt_3.Vector)  # -> Angle, Reflex
deg = Degrees(Radians=angle.Reflex)
offset = OffsetCurve(Curve=project_2.Geometry, Distance=expr("-x", panel_8), Corners=1)  # -> flatten(Curve)
ln_4 = Line(StartPoint=item_3, EndPoint=volume_2.Centroid)
abs = Absolute(Value=deg)
len_2 = Length(Curve=ln_4)
crvprox = CurveProximity(CurveA=offset, CurveB=ln_4)  # -> PointA, PointB, Distance
subtraction = Subtraction(A="360", B=abs)
shatter = Shatter()
midpt_4 = CurveMiddle(Curve=ln_4)
roundd = RoundToDecimalPlace(NumberX=len_2, DecimalPlace="1", RoundType=0)  # -> Rounded, Difference
previewlw_7 = CustomPreviewLineweights(Geometry=flatten(ln_4), Shader=swatch_3, Absolute=False)
tag_2 = TextTag(Location=midpt_4, Text=roundd.Rounded, Colour=swatch_3)

# ---- group: ROAD CURVES
crv_11 = Curve([<curve referenced from the Rhino model> x3])

# ----
# 2_11_Combining_Fields
geo_10 = Geometry(<brep referenced from the Rhino model>)

pt_11 = Point([<point referenced from the Rhino model> x6])
crv_12 = Curve([<curve referenced from the Rhino model> x6])
pt_12 = Point([<point referenced from the Rhino model> x2])
pt_13 = Point([<point referenced from the Rhino model> x3])
crv_13 = Curve([<curve referenced from the Rhino model> x3])
crv_14 = Curve([<curve referenced from the Rhino model> x2])
conndir_10 = Wasp_ConnectionFromDirection(GEO=geo_10, CEN=pt_13, UP=crv_13, T="TOP")  # -> CONN, PLN_OUT; inputs CEN: list of Point3d, UP: list of Curve, T: list; plug-in component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
conndir_11 = Wasp_ConnectionFromDirection(GEO=geo_10, CEN=pt_12, UP=crv_14, T="BOTTOM")  # -> CONN, PLN_OUT; inputs CEN: list of Point3d, UP: list of Curve, T: list; plug-in component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
conndir_12 = Wasp_ConnectionFromDirection(GEO=geo_10, CEN=pt_11, UP=crv_12, T="SIDES")  # -> CONN, PLN_OUT; inputs CEN: list of Point3d, UP: list of Curve, T: list; plug-in component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
merge_4 = Merge(Data1=conndir_12.CONN, Data2=conndir_11.CONN, Data3=conndir_10.CONN)

geo_11 = Geometry(<brep referenced from the Rhino model>)
attribute_3 = Wasp_Attribute(ID="house", VAL=geo_11, TR=Toggle(True))  # -> ATTR; inputs VAL: list, TR: Boolean; plug-in component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

part_8 = Wasp_BasicPart(NAME="BLOCK01", GEO=geo_10, CONN=flatten(merge_4))  # -> PART; inputs GEO: Mesh, CONN: list, ATTR: list; plug-in component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

geo_12 = Geometry(<brep referenced from the Rhino model>)
bbox_2 = BoundingBox(Content=geo_12, Plane=PlaneXY(0, 0, 0))  # -> Box, Box_2
volume_4 = Volume(Geometry=bbox_2.Box)  # -> Volume, Centroid
scale_nu = ScaleNU(
    Geometry=bbox_2.Box,
    Plane=volume_4.Centroid,
    ScaleX=Slider(1, range=0..10),
    ScaleY=Slider(1, range=0..10),
    ScaleZ=Slider(2.17, range=0..10))  # -> Geometry, Transform
fieldpts = Wasp_FieldPoints(BOU=scale_nu.Geometry, RES=Slider(2.5, range=0..10))  # -> E_FIELD, PTS; inputs BOU: list of Mesh, PLN: Plane; plug-in component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

contour_4 = Contour(Shape=geo_12, Point=Point(0, 0, 0), Direction=Vector(0, 0, 1), Distance=Slider(0.5, range=0..1))
preview_2 = CustomPreview(Geometry=geo_12, Material=ColourSwatch(SwatchColor=RGB(194, 194, 194)))
preview_3 = CustomPreview(Geometry=contour_4, Material=ColourSwatch(SwatchColor=RGB(0, 0, 0)))

geo_13 = Geometry(geo_12)
pull = PullPoint(Point=fieldpts.PTS, Geometry=geo_13, ClosestOnly=True)  # -> ClosestPoint, Distance
pdecon_2 = Deconstruct(Point=fieldpts.PTS)  # -> XComponent, YComponent, ZComponent
pdecon_3 = Deconstruct(Point=pull.ClosestPoint)  # -> XComponent, YComponent, ZComponent
smaller = SmallerThan(FirstNumber=pdecon_2.ZComponent, SecondNumber=pdecon_3.ZComponent)  # -> SmallerThan, OrEqualTo
dispatch = Dispatch(List=pull.Distance, DispatchPattern=smaller.SmallerThan)  # -> ListA, ListB
dom = ConstructDomain(DomainStart=Slider(1, range=0..1), DomainEnd=Slider(0, range=0..100))
bnd_3 = Bounds(Numbers=dispatch.ListB)
remap = RemapNumbers(Value=dispatch.ListB, Source=bnd_3, Target=dom)  # -> Mapped, Clipped
lng_2 = ListLength(List=dispatch.ListA)
graph = GraphMapper(
    remap.Mapped,
    x0=0,
    x1=1,
    y0=0,
    y1=1,
    container_name="Bezier",
    cpx=[0, 0.6471909881, 0.9011235833, 1],
    cpy=[0, 0.07142859697, 0.428571403, 1])
repeat = RepeatData(Data=Slider(0, range=0..100), Length=lng_2)
weave = Weave(Pattern=smaller.SmallerThan, Stream0=graph, Stream1=repeat, NullGaps=False)

geo_14 = Geometry(geo_12)
project_5 = Project(Curve=crv_11, Brep=geo_14, Direction=Vector(0, 0, 1))
pt_14 = Point(fieldpts.PTS)
pull_2 = PullPoint(Point=pt_14, Geometry=flatten(project_5), ClosestOnly=True)  # -> ClosestPoint, Distance
dom_2 = ConstructDomain(DomainStart=Slider(1, range=0..1), DomainEnd=Slider(0, range=0..100))
bnd_4 = Bounds(Numbers=dispatch.ListB)
remap_2 = RemapNumbers(Value=pull_2.Distance, Source=bnd_4, Target=dom_2)  # -> Mapped, Clipped
graph_2 = GraphMapper(
    remap_2.Mapped,
    x0=0,
    x1=1,
    y0=0,
    y1=1,
    container_name="Bezier",
    cpx=[0, 0.6471909881, 0.9011235833, 1],
    cpy=[0, 0.07142859697, 0.428571403, 1])

pt_15 = Point(fieldpts.PTS)
geo_15 = Geometry(geo_12)
srf_cp = SurfaceClosestPoint(Point=pt_15, Surface=geo_15)  # -> Point, UVPoint, Distance
evalsrf = EvaluateSurface(Surface=geo_15, Point=srf_cp.UVPoint)  # -> Point, Normal, UDirection, VDirection, Frame
Z_4 = UnitZ(Factor=1)
angle_2 = Angle(VectorA=Z_4, VectorB=evalsrf.Normal)  # -> Angle, Reflex
bnd_5 = Bounds(Numbers=angle_2.Angle)
remap_3 = RemapNumbers(Value=angle_2.Angle, Source=bnd_5, Target="1 To 0")  # -> Mapped, Clipped
graph_3 = GraphMapper(remap_3.Mapped, x0=0, x1=1, y0=0, y1=1, container_name="Bezier", cpx=[0, 0.25, 0.75, 1], cpy=[0, 0.25, 0.75, 1])

gradient_2 = Gradient(LowerLimit=0, UpperLimit=1, Parameter=weave, stops=[0: RGB(0, 128, 0), 0.5: RGB(255, 255, 0), 1: RGB(255, 0, 0)])
preview_4 = CustomPreview(Geometry=fieldpts.PTS, Material=gradient_2)

gradient_3 = Gradient(LowerLimit=0, UpperLimit=1, Parameter=graph_3, stops=[0: RGB(0, 128, 0), 0.5: RGB(255, 255, 0), 1: RGB(255, 0, 0)])
preview_5 = CustomPreview(Geometry=evalsrf.Point, Material=gradient_3)

gradient_4 = Gradient(LowerLimit=0, UpperLimit=1, Parameter=graph_2, stops=[0: RGB(0, 128, 0), 0.5: RGB(255, 255, 0), 1: RGB(255, 0, 0)])
preview_6 = CustomPreview(Geometry=pt_14, Material=gradient_4)

multiplication = Multiplication(A=weave, B=graph_2, C=graph_3)

field = Wasp_Field(NAME="srfField", E_FIELD=fieldpts.E_FIELD, VAL=multiplication)  # -> FIELD; inputs VAL: list; plug-in component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

panel_13 = Panel("""SIDES>SIDES
TOP>BOTTOM
BOTTOM>TOP""")
rulegen_2 = Wasp_RulesGenerator(PART=part_8, GR=panel_13)  # -> R; inputs PART: list, SELF_P: Boolean, SELF_C: Boolean, TYP: Boolean, GR: list; plug-in component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
fieldaggregation = Wasp_FieldDrivenAggregation(PART=flatten(part_8), N=Slider(266, range=0..1000), RULES=rulegen_2, FIELD=field, RESET=Button())  # -> AGGR, PART_OUT; inputs PART: list, PREV: list, N: Int32, RULES: list, FIELD: list, MODE: Int32, GC: list, RESET: Boolean; plug-in component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

gradient_5 = Gradient(
    LowerLimit=0,
    UpperLimit=1,
    Parameter=multiplication,
    stops=[0: RGB(0, 128, 0), 0.5: RGB(255, 255, 0), 1: RGB(255, 0, 0)])
preview_7 = CustomPreview(Geometry=fieldpts.PTS, Material=gradient_5)

lng_3 = ListLength(List=fieldaggregation.PART_OUT)
getattr_2 = Wasp_GetAttributeByName(PART=fieldaggregation.PART_OUT, ID="house")  # -> VAL; plug-in component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
random_2 = Random(Range=Slider(2, range=0..10), Number=lng_3, Seed=2, Integers=True)
merge_5 = Merge(
    Data1=ColourSwatch(SwatchColor=RGB(42, 181, 14)),
    Data2=ColourSwatch(SwatchColor=RGB(110, 255, 0)),
    Data3=ColourSwatch(SwatchColor=RGB(207, 255, 77)))
item_6 = ListItem(List=merge_5, Index=random_2, Wrap=True)
preview_8 = CustomPreview(Geometry=flatten(getattr_2), Material=item_6)
