# Grasshopper definition kitchen-storage-mechanical_v1.gh (Grasshopper 1.0.7)
# plug-ins: Speckle 2

# Get Geometry from Speckle
# Push To: https://macad.speckle.xyz/streams/6ba03db5f8/branches/kitchen-storage-mechanical
get_from = Panel("https://macad.speckle.xyz/streams/6ba03db5f8/commits/4bfdabba08")
receive = Receive(
    Stream=get_from,
    AutoReceive=False,
    CurrentComponentState="up_to_date",
    ExpandOutput=True,
    LastInfoMessage="Fadi @ 01/24/2024 13:24:37: Tidied up (id:4bfdabba08)",
    ReceiveOnOpen=False,
    ReceivedCommitId="4bfdabba08",
    StreamWrapper="https://macad.speckle.xyz/streams/6ba03db5f8/commits/4bfdabba08",
    selectedKitName="Objects")  # -> Info, CollectionType, Elements, Name
dso = DeconstructSpeckleObject(SpeckleObject=receive.Elements, selectedKitName="Objects")  # -> BoundingBox, CollectionType, Cropped, DisplayStyle, Elements, ForwardDirection, Frustrum, IsOrthogonal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
clean = CleanTree(RemoveNulls=True, RemoveInvalid=True, RemoveEmpty=True, Tree=dso.Elements)  # -> simplify(Tree)
bang = ExplodeTree(Data=clean)  # -> Branch0, Branch1, Branch2, Branch3, Branch4, Branch5, Branch6, Branch7, Branch8
geo = Geometry(bang.Branch4)
geo_2 = Geometry(bang.Branch1)
